# Grasshopper definition CS1.gh (Grasshopper 1.0.8)
# plug-ins: Karamba3D, RhinoCodePluginGH, Speckle 2, CORE.Toolbox.Grasshopper

push_to_excel = BooleanToggle(False)

# ---- group: x
series = Series(Start="5", Step="0.5", Count="7")

# ---- group: y
series_2 = Series(Start="8", Step="0.5", Count="9")

# ---- group: Excel parameters
boolean_toggle = BooleanToggle(False)
file_path = FilePath("C:\Users\andre\OneDrive - NTNU\RhinoGrasshopper\CS1\0506_CS1.xlsx")

# ---- group: Excel parameters / Toggles
clear_excel = BooleanToggle(False)

# ---- group: HEADERS / Write to excel header building type 1
panel = Panel("BT1 Concrete")
panel_2 = Panel("BT1 PC1")
panel_3 = Panel("BT1 Timber")
panel_4 = Panel("F2")
panel_5 = Panel("D2")
panel_6 = Panel("BT1 PC2")
panel_7 = Panel("E2")
panel_8 = Panel("C2")

# ----
cross_reference = CrossReference(ListListA=series, ListListB=series_2, CrossMode=1)  # -> ListListA, ListListB

# ---- group: Write to excel header building type 3
panel_9 = Panel("BT3 Timber")
panel_10 = Panel("BT3 Concrete")
panel_11 = Panel("K2")
panel_12 = Panel("BT3 PC1")
panel_13 = Panel("BT3 PC2")
panel_14 = Panel("L2")
panel_15 = Panel("M2")
panel_16 = Panel("N2")

# ----
license_karamba3d = LicenseKaramba3D()
xy_plane = XYPlane(Origin=Point(0, 0, 0))
panel_17 = Panel(license_karamba3d)

# ---- group: HEADERS / Write to excel header building type 1
write_to_excel_classic = WriteToExcelClassic(
    WorkbookFilepath=file_path,
    WorksheetName="Beams",
    Data=panel,
    LocationAddress=panel_4,
    Clear=clear_excel,
    Stream=push_to_excel)

write_to_excel_classic_2 = WriteToExcelClassic(
    WorkbookFilepath=file_path,
    WorksheetName="Beams",
    Data=panel_3,
    LocationAddress=panel_8,
    Clear=clear_excel,
    Stream=push_to_excel)

write_to_excel_classic_3 = WriteToExcelClassic(
    WorkbookFilepath=file_path,
    WorksheetName="Beams",
    Data=panel_2,
    LocationAddress=panel_5,
    Clear=clear_excel,
    Stream=push_to_excel)

write_to_excel_classic_4 = WriteToExcelClassic(
    WorkbookFilepath=file_path,
    WorksheetName="Beams",
    Data=panel_6,
    LocationAddress=panel_7,
    Clear=clear_excel,
    Stream=push_to_excel)

# ---- group: Write to excel header building type 3
write_to_excel_classic_5 = WriteToExcelClassic(
    WorkbookFilepath=file_path,
    WorksheetName="Beams",
    Data=panel_12,
    LocationAddress=panel_14,
    Clear=clear_excel,
    Stream=push_to_excel)

write_to_excel_classic_6 = WriteToExcelClassic(
    WorkbookFilepath=file_path,
    WorksheetName="Beams",
    Data=panel_10,
    LocationAddress=panel_16,
    Clear=clear_excel,
    Stream=push_to_excel)

write_to_excel_classic_7 = WriteToExcelClassic(
    WorkbookFilepath=file_path,
    WorksheetName="Beams",
    Data=panel_9,
    LocationAddress=panel_11,
    Clear=clear_excel,
    Stream=push_to_excel)

write_to_excel_classic_8 = WriteToExcelClassic(
    WorkbookFilepath=file_path,
    WorksheetName="Beams",
    Data=panel_13,
    LocationAddress=panel_15,
    Clear=clear_excel,
    Stream=push_to_excel)

# ----
rectangle = Rectangle(Plane=xy_plane, XSize=cross_reference.ListListA, YSize=cross_reference.ListListB, Radius=0)  # -> Rectangle, Length

# ----
# Deg = 0 er implisitt med at xGrid og dermed primaryBeams i koden er i hovedretning
buildingtypes = ValueList({"1 Walls": 1, "2 Walls, beams, columns": 2, "3 Beams, columns": 3, "4 Columns (beams)": 4}, selected="4 Columns (beams)")
materials = ValueList({"1 Timber": 1, "2 PC1: All concrete": 2, "3 PC2: Concrete + Steel": 3, "4 Concrete": 4}, selected="4 Concrete")
buildingnumber = Slider(6, range=0..62)
numberoffloors = Slider(4, range=0..10)
rotatebuilding = Slider(0, range=0..360)
floorheight = Slider(3, range=0..10)
xspacing_yspacing = Panel("5")

refcurve = Curve(rectangle.Rectangle)

# ---- group: HEADERS / Write to excel headers
write_to_excel_classic_9 = WriteToExcelClassic(
    WorkbookFilepath=file_path,
    WorksheetName="Beams",
    Data="x",
    LocationAddress="A2",
    Clear=clear_excel,
    Stream=push_to_excel)

write_to_excel_classic_10 = WriteToExcelClassic(
    WorkbookFilepath=file_path,
    WorksheetName="Beams",
    Data="y",
    LocationAddress="B2",
    Clear=clear_excel,
    Stream=push_to_excel)

# ---- group: HEADERS / Write to excel header building type 1
write_to_excel_classic_11 = WriteToExcelClassic(
    WorkbookFilepath=file_path,
    WorksheetName="Columns",
    Data=panel_6,
    LocationAddress=panel_7,
    Clear=clear_excel,
    Stream=push_to_excel)

write_to_excel_classic_12 = WriteToExcelClassic(
    WorkbookFilepath=file_path,
    WorksheetName="Columns",
    Data=panel,
    LocationAddress=panel_4,
    Clear=clear_excel,
    Stream=push_to_excel)

write_to_excel_classic_13 = WriteToExcelClassic(
    WorkbookFilepath=file_path,
    WorksheetName="Columns",
    Data=panel_3,
    LocationAddress=panel_8,
    Clear=clear_excel,
    Stream=push_to_excel)

write_to_excel_classic_14 = WriteToExcelClassic(
    WorkbookFilepath=file_path,
    WorksheetName="Columns",
    Data=panel_2,
    LocationAddress=panel_5,
    Clear=clear_excel,
    Stream=push_to_excel)

# ----
boundary_surfaces = BoundarySurfaces(Edges=refcurve)

# ---- group: Write to excel header building type 3
write_to_excel_classic_15 = WriteToExcelClassic(
    WorkbookFilepath=file_path,
    WorksheetName="Columns",
    Data=panel_9,
    LocationAddress=panel_11,
    Clear=clear_excel,
    Stream=push_to_excel)

write_to_excel_classic_16 = WriteToExcelClassic(
    WorkbookFilepath=file_path,
    WorksheetName="Columns",
    Data=panel_12,
    LocationAddress=panel_14,
    Clear=clear_excel,
    Stream=push_to_excel)

write_to_excel_classic_17 = WriteToExcelClassic(
    WorkbookFilepath=file_path,
    WorksheetName="Columns",
    Data=panel_13,
    LocationAddress=panel_15,
    Clear=clear_excel,
    Stream=push_to_excel)

write_to_excel_classic_18 = WriteToExcelClassic(
    WorkbookFilepath=file_path,
    WorksheetName="Columns",
    Data=panel_10,
    LocationAddress=panel_16,
    Clear=clear_excel,
    Stream=push_to_excel)

# ----
c_script = CSharpScript(materials=materials)  # -> dimension; inputs materials: Int32
# ---------- c_script: C# ----------
// Grasshopper Script Instance
#region Usings
using System;
using System.Linq;
using System.Collections;
using System.Collections.Generic;
using System.Drawing;

using Rhino;
using Rhino.Geometry;

using Grasshopper;
using Grasshopper.Kernel;
using Grasshopper.Kernel.Data;
using Grasshopper.Kernel.Types;
#endregion

public class Script_Instance : GH_ScriptInstance
{
    #region Notes
    /* 
      Members:
        RhinoDoc RhinoDocument
        GH_Document GrasshopperDocument
        IGH_Component Component
        int Iteration

      Methods (Virtual & overridable):
        Print(string text)
        Print(string format, params object[] args)
        Reflect(object obj)
        Reflect(object obj, string method_name)
    */
    #endregion

    private void RunScript(int materials, ref object dimension)
    {
        if (materials == 1) //timber
        {
            dimension = "0.04";
        }
        if (materials == 2) //PC1
        {
            dimension = "0.0225";
        }
        if (materials == 3) //PC2
        {
            dimension = "0.0036";
        }
        if (materials == 4) //RC
        {
            dimension = "0.0225";
        }
    }  
}
# ---------- end c_script ----------
panel_18 = Panel(cross_reference.ListListA)
evaluate_surface = EvaluateSurface(Surface=reparameterize(boundary_surfaces), Point="0.5,0.5")  # -> Point, Normal, UDirection, VDirection, Frame
c_script_2 = CSharpScript(materials=materials)  # -> factor; inputs materials: Int32
# ---------- c_script_2: C# ----------
// Grasshopper Script Instance
#region Usings
using System;
using System.Linq;
using System.Collections;
using System.Collections.Generic;
using System.Drawing;

using Rhino;
using Rhino.Geometry;

using Grasshopper;
using Grasshopper.Kernel;
using Grasshopper.Kernel.Data;
using Grasshopper.Kernel.Types;
#endregion

public class Script_Instance : GH_ScriptInstance
{
    #region Notes
    /* 
      Members:
        RhinoDoc RhinoDocument
        GH_Document GrasshopperDocument
        IGH_Component Component
        int Iteration

      Methods (Virtual & overridable):
        Print(string text)
        Print(string format, params object[] args)
        Reflect(object obj)
        Reflect(object obj, string method_name)
    */
    #endregion

    private void RunScript(int materials, ref object factor)
    {
        if (materials == 1) //timber
        {
            factor = 1;
        }
        if (materials == 2) //PC1
        {
            factor = 0.55;
        }
        if (materials == 3) //PC2
        {
            factor = 0.55;
        }
        if (materials == 4) //RC
        {
            factor = 1;
        }
    }  
}
# ---------- end c_script_2 ----------

# ---- group: TOTAL / Alltid True
boolean_read_from_excel_for_total = BooleanToggle(False)  # disabled

# ---- group: HEADERS / Write to excel headers
write_to_excel_classic_19 = WriteToExcelClassic(
    WorkbookFilepath=file_path,
    WorksheetName="Columns",
    Data="x",
    LocationAddress="A2",
    Clear=clear_excel,
    Stream=push_to_excel)

write_to_excel_classic_20 = WriteToExcelClassic(
    WorkbookFilepath=file_path,
    WorksheetName="Columns",
    Data="y",
    LocationAddress="B2",
    Clear=clear_excel,
    Stream=push_to_excel)

# ---- group: HEADERS / Write to excel header building type 1
write_to_excel_classic_21 = WriteToExcelClassic(
    WorkbookFilepath=file_path,
    WorksheetName="Walls",
    Data=panel_6,
    LocationAddress=panel_7,
    Clear=clear_excel,
    Stream=push_to_excel)

write_to_excel_classic_22 = WriteToExcelClassic(
    WorkbookFilepath=file_path,
    WorksheetName="Walls",
    Data=panel_2,
    LocationAddress=panel_5,
    Clear=clear_excel,
    Stream=push_to_excel)

write_to_excel_classic_23 = WriteToExcelClassic(
    WorkbookFilepath=file_path,
    WorksheetName="Walls",
    Data=panel_3,
    LocationAddress=panel_8,
    Clear=clear_excel,
    Stream=push_to_excel)

write_to_excel_classic_24 = WriteToExcelClassic(
    WorkbookFilepath=file_path,
    WorksheetName="Walls",
    Data=panel,
    LocationAddress=panel_4,
    Clear=clear_excel,
    Stream=push_to_excel)

# ----
panel_19 = Panel(cross_reference.ListListB)

# ---- group: Write to excel header building type 3
write_to_excel_classic_25 = WriteToExcelClassic(
    WorkbookFilepath=file_path,
    WorksheetName="Walls",
    Data=panel_9,
    LocationAddress=panel_11,
    Clear=clear_excel,
    Stream=push_to_excel)

write_to_excel_classic_26 = WriteToExcelClassic(
    WorkbookFilepath=file_path,
    WorksheetName="Walls",
    Data=panel_10,
    LocationAddress=panel_16,
    Clear=clear_excel,
    Stream=push_to_excel)

write_to_excel_classic_27 = WriteToExcelClassic(
    WorkbookFilepath=file_path,
    WorksheetName="Walls",
    Data=panel_13,
    LocationAddress=panel_15,
    Clear=clear_excel,
    Stream=push_to_excel)

write_to_excel_classic_28 = WriteToExcelClassic(
    WorkbookFilepath=file_path,
    WorksheetName="Walls",
    Data=panel_12,
    LocationAddress=panel_14,
    Clear=clear_excel,
    Stream=push_to_excel)

# ----
vector_xyz = VectorXYZ(XComponent="1", YComponent="0", ZComponent="0")  # -> Vector, Length
orient = Orient(Geometry=boundary_surfaces, Source=evaluate_surface.Point, Target="0,0")  # -> Geometry, Transform
vector = Vector(evaluate_surface.UDirection)

# ---- group: HEADERS / Write to excel header building type 1
write_to_excel_classic_29 = WriteToExcelClassic(
    WorkbookFilepath=file_path,
    WorksheetName="Slabs",
    Data=panel_6,
    LocationAddress=panel_7,
    Clear=clear_excel,
    Stream=push_to_excel)

# ----
angle = Angle(VectorA=vector, VectorB=vector_xyz.Vector)  # -> Angle, Reflex

# ---- group: HEADERS / Write to excel header building type 1
write_to_excel_classic_30 = WriteToExcelClassic(
    WorkbookFilepath=file_path,
    WorksheetName="Slabs",
    Data=panel_2,
    LocationAddress=panel_5,
    Clear=clear_excel,
    Stream=push_to_excel)

write_to_excel_classic_31 = WriteToExcelClassic(
    WorkbookFilepath=file_path,
    WorksheetName="Slabs",
    Data=panel_3,
    LocationAddress=panel_8,
    Clear=clear_excel,
    Stream=push_to_excel)

write_to_excel_classic_32 = WriteToExcelClassic(
    WorkbookFilepath=file_path,
    WorksheetName="Slabs",
    Data=panel,
    LocationAddress=panel_4,
    Clear=clear_excel,
    Stream=push_to_excel)

# ---- group: HEADERS / Write to excel headers
write_to_excel_classic_33 = WriteToExcelClassic(
    WorkbookFilepath=file_path,
    WorksheetName="Walls",
    Data="x",
    LocationAddress="A2",
    Clear=clear_excel,
    Stream=push_to_excel)

write_to_excel_classic_34 = WriteToExcelClassic(
    WorkbookFilepath=file_path,
    WorksheetName="Walls",
    Data="y",
    LocationAddress="B2",
    Clear=clear_excel,
    Stream=push_to_excel)

# ---- group: TOTAL / Total of building type 3 / Total of timber
panel_20 = Panel("N3:N65")  # disabled
panel_21 = Panel("N3:N65")  # disabled
panel_22 = Panel("Slabs")  # disabled
panel_23 = Panel("Columns")  # disabled
panel_24 = Panel("N3:N65")  # disabled
panel_25 = Panel("Beams")  # disabled
read_from_excel = ReadFromExcel(
    WorkbookFilepath=file_path,
    WorksheetName=panel_22,
    Range=panel_20,
    Live=clear_excel,
    Stream=boolean_read_from_excel_for_total)  # disabled
read_from_excel_2 = ReadFromExcel(
    WorkbookFilepath=file_path,
    WorksheetName=panel_25,
    Range=panel_21,
    Live=clear_excel,
    Stream=boolean_read_from_excel_for_total)  # disabled
read_from_excel_3 = ReadFromExcel(
    WorkbookFilepath=file_path,
    WorksheetName=panel_23,
    Range=panel_24,
    Live=clear_excel,
    Stream=boolean_read_from_excel_for_total)  # disabled
merge = Merge(Data1=read_from_excel_2, Data2=read_from_excel_3, Data3=read_from_excel)  # disabled
mass_addition = MassAddition(Input=merge)  # -> Result, PartialResults; disabled
panel_26 = Panel("Total")  # disabled
panel_27 = Panel("P2")  # disabled
write_to_excel_classic_35 = WriteToExcelClassic(
    WorkbookFilepath=file_path,
    WorksheetName=panel_26,
    Data=mass_addition.Result,
    LocationAddress=panel_27,
    Clear=0,
    Stream=push_to_excel)  # disabled

# ---- group: TOTAL / Total of building type 4 / Total of timber
panel_28 = Panel("S3:S65")  # disabled
panel_29 = Panel("S3:S65")  # disabled
panel_30 = Panel("Slabs")  # disabled
panel_31 = Panel("Columns")  # disabled
panel_32 = Panel("S3:S65")  # disabled
panel_33 = Panel("Beams")  # disabled
read_from_excel_4 = ReadFromExcel(
    WorkbookFilepath=file_path,
    WorksheetName=panel_30,
    Range=panel_28,
    Live=clear_excel,
    Stream=boolean_read_from_excel_for_total)  # disabled
read_from_excel_5 = ReadFromExcel(
    WorkbookFilepath=file_path,
    WorksheetName=panel_33,
    Range=panel_29,
    Live=clear_excel,
    Stream=boolean_read_from_excel_for_total)  # disabled
read_from_excel_6 = ReadFromExcel(
    WorkbookFilepath=file_path,
    WorksheetName=panel_31,
    Range=panel_32,
    Live=clear_excel,
    Stream=boolean_read_from_excel_for_total)  # disabled
merge_2 = Merge(Data1=read_from_excel_5, Data2=read_from_excel_6, Data3=read_from_excel_4)  # disabled
mass_addition_2 = MassAddition(Input=merge_2)  # -> Result, PartialResults; disabled
panel_34 = Panel("Total")  # disabled
panel_35 = Panel("V2")  # disabled
write_to_excel_classic_36 = WriteToExcelClassic(
    WorkbookFilepath=file_path,
    WorksheetName=panel_34,
    Data=mass_addition_2.Result,
    LocationAddress=panel_35,
    Clear=0,
    Stream=push_to_excel)  # disabled

# ---- group: TOTAL / Total of building type 1 / Total of timber
panel_36 = Panel("D3:D65")  # disabled
panel_37 = Panel("D3:D65")  # disabled
panel_38 = Panel("Slabs")  # disabled
panel_39 = Panel("Walls")  # disabled
read_from_excel_7 = ReadFromExcel(
    WorkbookFilepath=file_path,
    WorksheetName=panel_39,
    Range=panel_36,
    Live=clear_excel,
    Stream=boolean_read_from_excel_for_total)  # disabled
read_from_excel_8 = ReadFromExcel(
    WorkbookFilepath=file_path,
    WorksheetName=panel_38,
    Range=panel_37,
    Live=clear_excel,
    Stream=boolean_read_from_excel_for_total)  # disabled
merge_3 = Merge(Data1=read_from_excel_7, Data2=read_from_excel_8)  # disabled
mass_addition_3 = MassAddition(Input=merge_3)  # -> Result, PartialResults; disabled
panel_40 = Panel("Total")  # disabled
panel_41 = Panel("D2")  # disabled
write_to_excel_classic_37 = WriteToExcelClassic(
    WorkbookFilepath=file_path,
    WorksheetName=panel_40,
    Data=mass_addition_3.Result,
    LocationAddress=panel_41,
    Clear=0,
    Stream=push_to_excel)  # disabled

# ---- group: TOTAL / Total of building type 2 / Total of timber
panel_42 = Panel("I3:I65")  # disabled
panel_43 = Panel("I3:I65")  # disabled
panel_44 = Panel("I3:I65")  # disabled
panel_45 = Panel("I3:I65")  # disabled
panel_46 = Panel("Columns")  # disabled
panel_47 = Panel("Beams")  # disabled
panel_48 = Panel("Slabs")  # disabled
panel_49 = Panel("Walls")  # disabled
read_from_excel_9 = ReadFromExcel(
    WorkbookFilepath=file_path,
    WorksheetName=panel_46,
    Range=panel_42,
    Live=clear_excel,
    Stream=boolean_read_from_excel_for_total)  # disabled
read_from_excel_10 = ReadFromExcel(
    WorkbookFilepath=file_path,
    WorksheetName=panel_47,
    Range=panel_43,
    Live=clear_excel,
    Stream=boolean_read_from_excel_for_total)  # disabled
read_from_excel_11 = ReadFromExcel(
    WorkbookFilepath=file_path,
    WorksheetName=panel_49,
    Range=panel_44,
    Live=clear_excel,
    Stream=boolean_read_from_excel_for_total)  # disabled
read_from_excel_12 = ReadFromExcel(
    WorkbookFilepath=file_path,
    WorksheetName=panel_48,
    Range=panel_45,
    Live=clear_excel,
    Stream=boolean_read_from_excel_for_total)  # disabled
merge_4 = Merge(Data1=read_from_excel_11, Data2=read_from_excel_12, Data3=read_from_excel_9, Data4=read_from_excel_10)  # disabled
mass_addition_4 = MassAddition(Input=merge_4)  # -> Result, PartialResults; disabled
panel_50 = Panel("Total")  # disabled
panel_51 = Panel("J2")  # disabled
write_to_excel_classic_38 = WriteToExcelClassic(
    WorkbookFilepath=file_path,
    WorksheetName=panel_50,
    Data=mass_addition_4.Result,
    LocationAddress=panel_51,
    Clear=0,
    Stream=push_to_excel)  # disabled

# ---- group: Write to excel header building type 3
write_to_excel_classic_39 = WriteToExcelClassic(
    WorkbookFilepath=file_path,
    WorksheetName="Slabs",
    Data=panel_9,
    LocationAddress=panel_11,
    Clear=clear_excel,
    Stream=push_to_excel)

write_to_excel_classic_40 = WriteToExcelClassic(
    WorkbookFilepath=file_path,
    WorksheetName="Slabs",
    Data=panel_12,
    LocationAddress=panel_14,
    Clear=clear_excel,
    Stream=push_to_excel)

write_to_excel_classic_41 = WriteToExcelClassic(
    WorkbookFilepath=file_path,
    WorksheetName="Slabs",
    Data=panel_13,
    LocationAddress=panel_15,
    Clear=clear_excel,
    Stream=push_to_excel)

write_to_excel_classic_42 = WriteToExcelClassic(
    WorkbookFilepath=file_path,
    WorksheetName="Slabs",
    Data=panel_10,
    LocationAddress=panel_16,
    Clear=clear_excel,
    Stream=push_to_excel)

# ----
degrees = Degrees(Radians=angle.Angle)
c_script_3 = CSharpScript(buildingType=buildingtypes, materials=materials)  # -> out, beam, column, floor, wall, location; inputs buildingType: Int32, materials: Int32
# ---------- c_script_3: C# ----------
// Grasshopper Script Instance
#region Usings
using System;
using System.Linq;
using System.Collections;
using System.Collections.Generic;
using System.Drawing;

using Rhino;
using Rhino.Geometry;

using Grasshopper;
using Grasshopper.Kernel;
using Grasshopper.Kernel.Data;
using Grasshopper.Kernel.Types;
#endregion

public class Script_Instance : GH_ScriptInstance
{
    #region Notes
    /* 
      Members:
        RhinoDoc RhinoDocument
        GH_Document GrasshopperDocument
        IGH_Component Component
        int Iteration

      Methods (Virtual & overridable):
        Print(string text)
        Print(string format, params object[] args)
        Reflect(object obj)
        Reflect(object obj, string method_name)
    */
    #endregion

    private void RunScript(
	int buildingType,
	int materials,
	ref object beam,
	ref object column,
	ref object floor,
	ref object wall,
	ref object location)
    {
        if (buildingType == 1) //walls og floors
        {
            wall = "Walls";
            floor = "Slabs";
            beam = "Sheet1";
            column = "Sheet1";

            if (materials == 1) //timber
            {
                location = "C3";
            }
            if (materials == 2) //PC1
            {
                location = "D3";
            }
            if (materials == 3) //PC2
            {
                location = "E3";
            }
            if (materials == 4) //RC
            {
                location = "F3";
            }
        }

        if (buildingType == 2) //beams, columns, walls og floors
        {
            wall = "Walls";
            floor = "Slabs";
            beam = "Beams";
            column = "Columns";

            if (materials == 1) //timber
            {
                location = "G3";
            }
            if (materials == 2) //PC1
            {
                location = "H3";
            }
            if (materials == 3) //PC2
            {
                location = "I3";
            }
            if (materials == 4) //RC
            {
                location = "J3";
            }
        }
        if (buildingType == 3) //beams, floors og columns
        {
            floor = "Slabs";
            beam = "Beams";
            column = "Columns";
            wall = "Sheet1";

            if (materials == 1) //timber
            {
                location = "K3";
            }
            if (materials == 2) //PC1
            {
                location = "L3";
            }
            if (materials == 3) //PC2
            {
                location = "M3";
            }
            if (materials == 4) //RC
            {
                location = "N3";
            }
        }
        if (buildingType == 4) //beams, floors og columns
        {
            floor = "Slabs";
            beam = "Beams";
            column = "Columns";
            wall = "Sheet1";

            if (materials == 1) //timber
            {
                location = "O3";
            }
            if (materials == 2) //PC1
            {
                location = "P3";
            }
            if (materials == 3) //PC2
            {
                location = "Q3";
            }
            if (materials == 4) //RC
            {
                location = "R3";
            }
        }

    }
}
# ---------- end c_script_3 ----------
multiplication = Multiplication(NumberOfFloors=numberoffloors, FloorHeight=floorheight)
addition = Addition(A=degrees, B=rotatebuilding)

# ---- group: HEADERS / Write to excel headers
write_to_excel_classic_43 = WriteToExcelClassic(
    WorkbookFilepath=file_path,
    WorksheetName="Slabs",
    Data="x",
    LocationAddress="A2",
    Clear=clear_excel,
    Stream=push_to_excel)

write_to_excel_classic_44 = WriteToExcelClassic(
    WorkbookFilepath=file_path,
    WorksheetName="Slabs",
    Data="y",
    LocationAddress="B2",
    Clear=clear_excel,
    Stream=push_to_excel)

# ----
panel_52 = Panel(read_from_excel_7)  # disabled
rotate = Rotate(Geometry=orient.Geometry, Angle=degrees(addition), Plane=PlaneXY(0, 0, 0))  # -> Geometry, Transform
unit_z = UnitZ(Factor=multiplication)

# ---- group: HEADERS / Write to excel headers
write_to_excel_classic_45 = WriteToExcelClassic(
    WorkbookFilepath=file_path,
    WorksheetName="Total",
    Data="x",
    LocationAddress="A1",
    Clear=clear_excel,
    Stream=push_to_excel)

write_to_excel_classic_46 = WriteToExcelClassic(
    WorkbookFilepath=file_path,
    WorksheetName="Total",
    Data="y",
    LocationAddress="B1",
    Clear=clear_excel,
    Stream=push_to_excel)

# ----
extrude = Extrude(Base=rotate.Geometry, Direction=unit_z)
panel_53 = Panel(c_script_3.column)
panel_54 = Panel(c_script_3.beam)
panel_55 = Panel(c_script_3.wall)
buildingbrep = Brep(extrude)
panel_56 = Panel(c_script_3.floor)

# ---- group: TOTAL / Total of building type 2 / Total of PC1
panel_57 = Panel("J3:J65")  # disabled
panel_58 = Panel("J3:J65")  # disabled
panel_59 = Panel("J3:J65")  # disabled
panel_60 = Panel("J3:J65")  # disabled
panel_61 = Panel("Columns")  # disabled
panel_62 = Panel("Beams")  # disabled
panel_63 = Panel("Slabs")  # disabled
panel_64 = Panel("Walls")  # disabled
read_from_excel_13 = ReadFromExcel(
    WorkbookFilepath=file_path,
    WorksheetName=panel_61,
    Range=panel_57,
    Live=clear_excel,
    Stream=boolean_read_from_excel_for_total)  # disabled
read_from_excel_14 = ReadFromExcel(
    WorkbookFilepath=file_path,
    WorksheetName=panel_62,
    Range=panel_58,
    Live=clear_excel,
    Stream=boolean_read_from_excel_for_total)  # disabled
read_from_excel_15 = ReadFromExcel(
    WorkbookFilepath=file_path,
    WorksheetName=panel_64,
    Range=panel_59,
    Live=clear_excel,
    Stream=boolean_read_from_excel_for_total)  # disabled
read_from_excel_16 = ReadFromExcel(
    WorkbookFilepath=file_path,
    WorksheetName=panel_63,
    Range=panel_60,
    Live=clear_excel,
    Stream=boolean_read_from_excel_for_total)  # disabled
merge_5 = Merge(Data1=read_from_excel_15, Data2=read_from_excel_16, Data3=read_from_excel_13, Data4=read_from_excel_14)  # disabled
mass_addition_5 = MassAddition(Input=merge_5)  # -> Result, PartialResults; disabled
panel_65 = Panel("Total")  # disabled
panel_66 = Panel("K2")  # disabled
write_to_excel_classic_47 = WriteToExcelClassic(
    WorkbookFilepath=file_path,
    WorksheetName=panel_65,
    Data=mass_addition_5.Result,
    LocationAddress=panel_66,
    Clear=0,
    Stream=push_to_excel)  # disabled

# ---- group: TOTAL / Total of building type 3 / Total of PC1
panel_67 = Panel("O3:O65")  # disabled
panel_68 = Panel("O3:O65")  # disabled
panel_69 = Panel("O3:O65")  # disabled
panel_70 = Panel("Columns")  # disabled
panel_71 = Panel("Beams")  # disabled
panel_72 = Panel("Slabs")  # disabled
read_from_excel_17 = ReadFromExcel(
    WorkbookFilepath=file_path,
    WorksheetName=panel_71,
    Range=panel_67,
    Live=clear_excel,
    Stream=boolean_read_from_excel_for_total)  # disabled
read_from_excel_18 = ReadFromExcel(
    WorkbookFilepath=file_path,
    WorksheetName=panel_70,
    Range=panel_68,
    Live=clear_excel,
    Stream=boolean_read_from_excel_for_total)  # disabled
read_from_excel_19 = ReadFromExcel(
    WorkbookFilepath=file_path,
    WorksheetName=panel_72,
    Range=panel_69,
    Live=clear_excel,
    Stream=boolean_read_from_excel_for_total)  # disabled
merge_6 = Merge(Data1=read_from_excel_17, Data2=read_from_excel_18, Data3=read_from_excel_19)  # disabled
mass_addition_6 = MassAddition(Input=merge_6)  # -> Result, PartialResults; disabled
panel_73 = Panel("Total")  # disabled
panel_74 = Panel("Q2")  # disabled
write_to_excel_classic_48 = WriteToExcelClassic(
    WorkbookFilepath=file_path,
    WorksheetName=panel_73,
    Data=mass_addition_6.Result,
    LocationAddress=panel_74,
    Clear=0,
    Stream=push_to_excel)  # disabled

# ---- group: Write to excel header building type 2
panel_75 = Panel("BT2 Timber")
panel_76 = Panel("BT2 Concrete")
panel_77 = Panel("BT2 PC1")
panel_78 = Panel("G2")
panel_79 = Panel("H2")
panel_80 = Panel("BT2 PC2")
panel_81 = Panel("I2")
panel_82 = Panel("J2")

# ---- group: TOTAL / Total of building type 1 / Total of PC1
panel_83 = Panel("E3:E65")  # disabled
panel_84 = Panel("E3:E65")  # disabled
panel_85 = Panel("Slabs")  # disabled
panel_86 = Panel("Walls")  # disabled
read_from_excel_20 = ReadFromExcel(
    WorkbookFilepath=file_path,
    WorksheetName=panel_86,
    Range=panel_83,
    Live=clear_excel,
    Stream=boolean_read_from_excel_for_total)  # disabled
read_from_excel_21 = ReadFromExcel(
    WorkbookFilepath=file_path,
    WorksheetName=panel_85,
    Range=panel_84,
    Live=clear_excel,
    Stream=boolean_read_from_excel_for_total)  # disabled
merge_7 = Merge(Data1=read_from_excel_20, Data2=read_from_excel_21)  # disabled
mass_addition_7 = MassAddition(Input=merge_7)  # -> Result, PartialResults; disabled
panel_87 = Panel("Total")  # disabled
panel_88 = Panel("E2")  # disabled
write_to_excel_classic_49 = WriteToExcelClassic(
    WorkbookFilepath=file_path,
    WorksheetName=panel_87,
    Data=mass_addition_7.Result,
    LocationAddress=panel_88,
    Clear=0,
    Stream=push_to_excel)  # disabled

# ---- group: TOTAL / Total of building type 4 / Total of PC1
panel_89 = Panel("T3:T65")  # disabled
panel_90 = Panel("T3:T65")  # disabled
panel_91 = Panel("T3:T65")  # disabled
panel_92 = Panel("Columns")  # disabled
panel_93 = Panel("Beams")  # disabled
panel_94 = Panel("Slabs")  # disabled
read_from_excel_22 = ReadFromExcel(
    WorkbookFilepath=file_path,
    WorksheetName=panel_93,
    Range=panel_89,
    Live=clear_excel,
    Stream=boolean_read_from_excel_for_total)  # disabled
read_from_excel_23 = ReadFromExcel(
    WorkbookFilepath=file_path,
    WorksheetName=panel_92,
    Range=panel_90,
    Live=clear_excel,
    Stream=boolean_read_from_excel_for_total)  # disabled
read_from_excel_24 = ReadFromExcel(
    WorkbookFilepath=file_path,
    WorksheetName=panel_94,
    Range=panel_91,
    Live=clear_excel,
    Stream=boolean_read_from_excel_for_total)  # disabled
merge_8 = Merge(Data1=read_from_excel_22, Data2=read_from_excel_23, Data3=read_from_excel_24)  # disabled
mass_addition_8 = MassAddition(Input=merge_8)  # -> Result, PartialResults; disabled
panel_95 = Panel("Total")  # disabled
panel_96 = Panel("W2")  # disabled
write_to_excel_classic_50 = WriteToExcelClassic(
    WorkbookFilepath=file_path,
    WorksheetName=panel_95,
    Data=mass_addition_8.Result,
    LocationAddress=panel_96,
    Clear=0,
    Stream=push_to_excel)  # disabled

# ---- group: Write to excel header building type 4
panel_97 = Panel("BT4 Concrete")
panel_98 = Panel("BT4 Timber")
panel_99 = Panel("Q2")
panel_100 = Panel("BT4 PC1")
panel_101 = Panel("BT4 PC2")
panel_102 = Panel("O2")
panel_103 = Panel("R2")
panel_104 = Panel("P2")

# ----
cladding = BooleanToggle(False)
edgecolumnspacing_m = Panel("2.0")
panel_105 = Panel(buildingbrep)

# ---- group: Write to excel header building type 2
write_to_excel_classic_51 = WriteToExcelClassic(
    WorkbookFilepath=file_path,
    WorksheetName="Beams",
    Data=panel_75,
    LocationAddress=panel_78,
    Clear=clear_excel,
    Stream=push_to_excel)

write_to_excel_classic_52 = WriteToExcelClassic(
    WorkbookFilepath=file_path,
    WorksheetName="Beams",
    Data=panel_77,
    LocationAddress=panel_79,
    Clear=clear_excel,
    Stream=push_to_excel)

write_to_excel_classic_53 = WriteToExcelClassic(
    WorkbookFilepath=file_path,
    WorksheetName="Beams",
    Data=panel_76,
    LocationAddress=panel_82,
    Clear=clear_excel,
    Stream=push_to_excel)

write_to_excel_classic_54 = WriteToExcelClassic(
    WorkbookFilepath=file_path,
    WorksheetName="Beams",
    Data=panel_80,
    LocationAddress=panel_81,
    Clear=clear_excel,
    Stream=push_to_excel)

# ---- group: Write to excel header building type 4
write_to_excel_classic_55 = WriteToExcelClassic(
    WorkbookFilepath=file_path,
    WorksheetName="Beams",
    Data=panel_97,
    LocationAddress=panel_103,
    Clear=clear_excel,
    Stream=push_to_excel)

write_to_excel_classic_56 = WriteToExcelClassic(
    WorkbookFilepath=file_path,
    WorksheetName="Beams",
    Data=panel_98,
    LocationAddress=panel_102,
    Clear=clear_excel,
    Stream=push_to_excel)

write_to_excel_classic_57 = WriteToExcelClassic(
    WorkbookFilepath=file_path,
    WorksheetName="Beams",
    Data=panel_100,
    LocationAddress=panel_104,
    Clear=clear_excel,
    Stream=push_to_excel)

write_to_excel_classic_58 = WriteToExcelClassic(
    WorkbookFilepath=file_path,
    WorksheetName="Beams",
    Data=panel_101,
    LocationAddress=panel_99,
    Clear=clear_excel,
    Stream=push_to_excel)

# ---- group: ISOTROPIC MATERIALS / material: GL32c
material_selection_karamba3d = MaterialSelectionKaramba3D(ElementIdentifier="GL32c", menu=[dropdown(5), dropdown(6)])

# ----
csharp_script = CSharpScript(
    buildingBrep=buildingbrep,
    floorHeight=floorheight,
    xSpacing=xspacing_yspacing,
    ySpacing=xspacing_yspacing,
    edgeSpacing=edgecolumnspacing_m,
    buildingType=buildingtypes,
    edgeSettings=cladding,
    materials=materials)  # -> out, floors, slabthickness, beamarea, primarycolumns, edgecolumns, primarybeams, transversebeams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; inputs buildingBrep: list of Brep, floorHeight: Double, xSpacing: Double, ySpacing: Double, edgeSpacing: Double, buildingType: Int32, edgeSettings: Boolean, materials: Int32
# ---------- csharp_script: C# ----------
// Grasshopper Script Instance
using System;
using System.Collections;
using System.Collections.Generic;
using System.Drawing;

using Rhino;
using Rhino.Geometry;

using Grasshopper;
using Grasshopper.Kernel;
using Grasshopper.Kernel.Data;
using Grasshopper.Kernel.Types;
using System.Linq;

public class Point3dEqualityComparer : IEqualityComparer<Point3d>
{
    private readonly double _tolerance;
    public Point3dEqualityComparer(double tolerance)
    {
        _tolerance = tolerance;
    }

    public bool Equals(Point3d x, Point3d y)
    {
        return x.DistanceTo(y) < _tolerance;
    }

    public int GetHashCode(Point3d obj)
    {
        int hashX = Convert.ToInt32(Math.Floor(obj.X * 1000));
        int hashY = Convert.ToInt32(Math.Floor(obj.Y * 1000));
        int hashZ = Convert.ToInt32(Math.Floor(obj.Z * 1000));
        return hashX ^ hashY ^ hashZ;
    }
}

public class Script_Instance : GH_ScriptInstance
{
 
  private void RunScript(
	List<Brep> buildingBrep,
	double floorHeight,
	double xSpacing,
	double ySpacing,
	double edgeSpacing,
	int buildingType,
	bool edgeSettings,
	int materials,
	ref object floors,
	ref object slabthickness,
	ref object beamarea,
	ref object primarycolumns,
	ref object edgecolumns,
	ref object primarybeams,
	ref object transversebeams,
	ref object edgebeams,
	ref object edgewalls,
	ref object primarywalls,
	ref object supportnodes,
	ref object inclusionnodes,
	ref object spacings)

{
    DataTree<Curve> floorTree = new DataTree<Curve>();
    DataTree<double> tSlabTree = new DataTree<double>();
    DataTree<double> aBeamTree = new DataTree<double>();
    DataTree<Line> primaryColumnsTree = new DataTree<Line>();
    DataTree<Line> edgeColumnsTree = new DataTree<Line>();
    DataTree<Curve> primaryBeamsTree = new DataTree<Curve>();
    DataTree<Curve> transverseBeamsTree = new DataTree<Curve>();
    DataTree<Line> edgeBeamsTree = new DataTree<Line>();
    DataTree<Polyline> edgeWallsTree = new DataTree<Polyline>();
    DataTree<Polyline> primaryWallsTree = new DataTree<Polyline>();
    DataTree<Point3d> supportNodesTree = new DataTree<Point3d>();
    DataTree<Point3d> inclusionNodesTree = new DataTree<Point3d>();
    DataTree<double> spacingsTree = new DataTree<double>();

    int buildingNumber = 0;
    foreach (Brep bb in buildingBrep)  
    {   
        List<Curve> floorSrf;
        List<double> tSlab;
        List<double> aBeam;
        List<List<Line>> iCols;
        List<List<Line>> eCols;
        List<List<Curve>> pBeams;
        List<List<Curve>> tBeams;
        List<List<Line>> eBeams;
        List<List<Polyline>> eWalls;
        List<List<Polyline>> iWalls;
        List<Point3d> supNodes;
        List<Point3d> inclNodes;
        List<double> xyVals;

            //Calling main method
            createB(bb, floorHeight, xSpacing, ySpacing, edgeSpacing, buildingType, edgeSettings, materials, out floorSrf, out tSlab, out aBeam, out iCols, out eCols, out pBeams, out tBeams, out eBeams, out eWalls, out iWalls, out supNodes, out inclNodes, out xyVals);

            //List<T> is added directly into new GH_Paths
            floorTree.AddRange(floorSrf, new GH_Path(buildingNumber));
            tSlabTree.AddRange(tSlab, new GH_Path(buildingNumber));
            aBeamTree.AddRange(aBeam, new GH_Path(buildingNumber));
            supportNodesTree.AddRange(supNodes, new GH_Path(buildingNumber));
            inclusionNodesTree.AddRange(inclNodes, new GH_Path(buildingNumber));
            spacingsTree.AddRange(xyVals, new GH_Path(buildingNumber));  

            //Method converting List<List<T>> to datatree<T>
            AddItemsToDataTree(iCols, primaryColumnsTree, buildingNumber);
            AddItemsToDataTree(eCols, edgeColumnsTree, buildingNumber);
            AddItemsToDataTree(pBeams, primaryBeamsTree, buildingNumber);
            AddItemsToDataTree(tBeams, transverseBeamsTree, buildingNumber);
            AddItemsToDataTree(eBeams, edgeBeamsTree, buildingNumber);
            AddItemsToDataTree(eWalls, edgeWallsTree, buildingNumber);
            AddItemsToDataTree(iWalls, primaryWallsTree, buildingNumber);
  
            //Repeat this for each brep in buildingBrep
            buildingNumber++;
    }


    //OUTPUT
    //output depending on edgeSettings
    if (edgeSettings == true)
    {
        edgecolumns = edgeColumnsTree;     
        edgebeams = edgeBeamsTree;
        edgewalls = edgeWallsTree;
    }

    //output depending on buildingType
    if (buildingType == 1)
    {
        floors = floorTree;
        slabthickness = tSlabTree;
        beamarea = aBeamTree;
        primarywalls = primaryWallsTree;
        supportnodes = supportNodesTree;
        inclusionnodes = inclusionNodesTree;
        spacings = spacingsTree;
    }
    else if (buildingType == 2)
    {
        floors = floorTree;
        slabthickness = tSlabTree;
        beamarea = aBeamTree;
        primarycolumns = primaryColumnsTree;
        primarybeams = primaryBeamsTree;
        primarywalls = primaryWallsTree;
        supportnodes = supportNodesTree;
        inclusionnodes = inclusionNodesTree;
        spacings = spacingsTree;       
    }
    else if (buildingType == 3)
    {
        floors = floorTree;
        slabthickness = tSlabTree;
        beamarea = aBeamTree;
        primarycolumns = primaryColumnsTree;
        primarybeams = primaryBeamsTree;
        transversebeams = transverseBeamsTree;
        supportnodes = supportNodesTree;
        inclusionnodes = inclusionNodesTree;
        spacings = spacingsTree;
    }
    else if (buildingType == 4)
    {
        floors = floorTree;
        slabthickness = tSlabTree;
        beamarea = aBeamTree;
        primarycolumns = primaryColumnsTree;
        primarybeams = primaryBeamsTree;
        supportnodes = supportNodesTree;
        inclusionnodes = inclusionNodesTree;
        spacings = spacingsTree;
    }
    else
    {
        floors = new List<Curve>();
        slabthickness = new List<double>();
        beamarea = new List<double>();
        primarycolumns = new List<List<Line>>();
        edgecolumns = new List<List<Line>>();
        primarybeams = new List<List<Curve>>();
        transversebeams = new List<List<Curve>>();
        edgebeams = new List<List<Line>>();
        edgewalls = new List<List<Polyline>>();
        primarywalls = new List<List<Polyline>>();
        supportnodes = new List<Point3d>();
        inclusionnodes = new List<Point3d>();
        spacings = new List<double>();
    }
}

//MAIN METHOD
void createB(Brep buildingBrep,	
double floorHeight, 
double xSpacing, 
double ySpacing, 
double edgeSpacing, 
int buildingType,
bool edgeSettings,
int materials,
out List<Curve> floors, 
out List<double> slabthickness,
out List<double> beamarea,
out List<List<Line>> primarycolumns,
out List<List<Line>> edgecolumns, 
out List<List<Curve>> primarybeams, 
out List<List<Curve>> transversebeams,
out List<List<Line>> edgebeams,
out List<List<Polyline>> edgewalls,
out List<List<Polyline>> primarywalls,
out List<Point3d> supportnodes,
out List<Point3d> inclusionnodes,
out List<double> spacings)

{
    //LIST XY SPACING
    List<double> xySpacings = new List<double>();

    xySpacings.Insert(0, xSpacing);
    xySpacings.Insert(1, ySpacing);

    //FLOORS
    Brep topBrep = topSrf(buildingBrep);
    Brep bottomBrep = bottomSrf(buildingBrep);

    List<Curve> floorBoundaries = createFloorCurves(buildingBrep, topBrep, bottomBrep, floorHeight);
    Curve refCurve = floorBoundaries[0];

    List<Curve> slabCurves = new List<Curve>();
    slabCurves.AddRange(floorBoundaries);
    slabCurves.RemoveAt(0);

    //verticeNodes: finner vertices til hver slabCurve
    List<List<Point3d>> verticeNodes = new List<List<Point3d>>();
    for (int i = 0; i < slabCurves.Count; i++)
    {
        List<Point3d> verticeNodesFloor = new List<Point3d>();
        if (slabCurves[i].IsPolyline())
        {
            Polyline polyline = new Polyline();
            slabCurves[i].TryGetPolyline(out polyline);
            Point3d[] vertices = polyline.ToArray();
            // Legg til hvert punkt fra vertices til verticeNodesFloor
            foreach (Point3d vertex in vertices)
            {
                verticeNodesFloor.Add(vertex);
            }
        }
        verticeNodes.Add(verticeNodesFloor);   
    }

    //SLABTHICKNESSES
    List<double> slabThickness = new List<double>();
    double span = Math.Min(xSpacing, ySpacing);
    //Timber (CLT): Slabthicknesses
    if (materials == 1)
    {
        if (span == 5)
        {
            slabThickness.Add(0.16);
        }
        else if (span > 5 && span <= 5.5 )
        {
            slabThickness.Add(0.175);
        }
        else if (span > 5.5 && span <= 6 )
        {
            slabThickness.Add(0.19);
        }
        else if (span > 6 && span <= 6.5 )
        {
            slabThickness.Add(0.205);
        }
        else if (span > 6.5 && span <= 7 )
        {
            slabThickness.Add(0.22);
        }
        else if (span > 7 && span <= 7.5 )
        {
            slabThickness.Add(0.245);
        }
        else if (span > 7.5 && span <= 8 )
        {
            slabThickness.Add(0.270);
        }
        else if (span > 8 && span <= 8.5 )
        {
            slabThickness.Add(0.3);
        }
        else if (span > 8.5 && span <= 9 )
        {
            slabThickness.Add(0.33);
        }
        else if (span > 9 && span <= 9.5 )
        {
            slabThickness.Add(0.36);
        }
        else if (span > 9.5 && span <= 10 )
        {
            slabThickness.Add(0.39);
        }
    }
    //Precast concrete (HD): Slabthicknesses
    if (materials == 2 || materials == 3)
    {
        slabThickness.Add(0.2);
    }
    //Reinforced concrete (RC): Slabthicknesses
    if (materials == 4)
    {
        if (span == 5)
        {
            slabThickness.Add(0.12);
        }
        else if (span > 5 && span <= 5.5 )
        {
            slabThickness.Add(0.13);
        }
        else if (span > 5.5 && span <= 6 )
        {
            slabThickness.Add(0.14);
        }
        else if (span > 6 && span <= 6.5 )
        {
            slabThickness.Add(0.15);
        }
        else if (span > 6.5 && span <= 7 )
        {
            slabThickness.Add(0.16);
        }
        else if (span > 7 && span <= 7.5 )
        {
            slabThickness.Add(0.17);
        }
        else if (span > 7.5 && span <= 8 )
        {
            slabThickness.Add(0.18);
        }
        else if (span > 8 && span <= 8.5 )
        {
            slabThickness.Add(0.19);
        }
        else if (span > 8.5 && span <= 9 )
        {
            slabThickness.Add(0.21);
        }
        else if (span > 9 && span <= 9.5 )
        {
            slabThickness.Add(0.22);
        }
        else if (span > 9.5 && span <= 10 )
        {
            slabThickness.Add(0.23);
        }
    }

    //BEAMHEIGHT
    List<double> beamArea = new List<double>();
    if (materials == 1) //timber
    {
        beamArea.Add(0.0364); //areal av 140 X 260 mm2 omgjort til meter.
    }
    else if (materials == 2 || materials == 4) //PC1
    {
        //List<Double> beamHeight = new List<Double>();

        if (span == 5)
        {
            //beamHeight.Add(0.22);
            beamArea.Add(0.044);
        }
        else if (span > 5 && span <= 5.5 )
        {
            //beamHeight.Add(0.23);
            beamArea.Add(0.046);
        }
        else if (span > 5.5 && span <= 6 )
        {
            //beamHeight.Add(0.24);
            beamArea.Add(0.048);
        }
        else if (span > 6 && span <= 6.5 )
        {
            //beamHeight.Add(0.25);
            beamArea.Add(0.05);
        }
        else if (span > 6.5 && span <= 7 )
        {
            //beamHeight.Add(0.26);
            beamArea.Add(0.052);
        }
        else if (span > 7 && span <= 7.5 )
        {
            //beamHeight.Add(0.27);
            beamArea.Add(0.054);
        }
        else if (span > 7.5 && span <= 8 )
        {
            //beamHeight.Add(0.28);
            beamArea.Add(0.056);
        }
        else if (span > 8 && span <= 8.5 )
        {
            //beamHeight.Add(0.29);
            beamArea.Add(0.058);
        }
        else if (span > 8.5 && span <= 9 )
        {
            //beamHeight.Add(0.31);
            beamArea.Add(0.06);
        }
        else if (span > 9 && span <= 9.5 )
        {
            //beamHeight.Add(0.32);
            beamArea.Add(0.062);
        }
        else if (span > 9.5 && span <= 10 )
        {
            //beamHeight.Add(0.33);
            beamArea.Add(0.064);
        }

        /*
        foreach (double height in beamHeight)
        {
            beamArea.Add(height*0.2);
        }
        */

    }

    else if (materials == 3) //PC2
    {
        beamArea.Add(0.004594);
    }

    //GRID
    //x, y intervals
    BoundingBox bb = refCurve.GetBoundingBox(true);
    Point3d cptmax = bb.Max;
    Point3d cptmin = bb.Min;
    double xmin = cptmin.X;
    double xmax = cptmax.X;
    double ymin = cptmin.Y;
    double ymax = cptmax.Y;
    double xdomain = xmax - xmin;
    double ydomain = ymax - ymin;
    int numberOfStepsX = Convert.ToInt32(xdomain/xSpacing);
    int numberOfStepsY = Convert.ToInt32(ydomain/ySpacing);

    //coordinates
    List<double> xValues = new List<double>();
    for (int i=1; i<numberOfStepsX+1; i++)
    {
        xValues.Add(xmin);
        xValues.Add(xmin + i*xSpacing);
        xValues.Add(xmax);
    } 
    List<double> yValues = new List<double>();
    for (int i=1; i<numberOfStepsY+1; i++)
    {
        yValues.Add(ymin);
        yValues.Add(ymin + i*ySpacing);
        yValues.Add(ymax);
    }

    //creating grid of lines
    List<List<Curve>> xzGrid = new List<List<Curve>>();
    List<List<Curve>> yzGrid = new List<List<Curve>>();

    foreach (Curve slabCurve in slabCurves)
    {
        double zVal = AreaMassProperties.Compute(slabCurve).Centroid.Z;

        List<Curve> xGrid = new List<Curve>();
        foreach (double x in xValues)
        {
            Point3d startPointx = new Point3d(x, ymin, zVal); 
            Point3d endPointx = new Point3d(x, ymax, zVal);
            Curve xLine = new LineCurve(startPointx, endPointx);
            xGrid.Add(xLine);
        }
        xzGrid.Add(xGrid);

        List<Curve> yGrid = new List<Curve>();
        foreach (double y in yValues)
        {
            Point3d startPointy = new Point3d(xmin, y, zVal); 
            Point3d endPointy = new Point3d(xmax, y, zVal);
            Curve yLine = new LineCurve(startPointy, endPointy);
            yGrid.Add(yLine);
        }
        yzGrid.Add(yGrid);
    }

    //trim xGrid at slabCurves
    List<List<Curve>> trimmedXGrid = new List<List<Curve>>();
    for (int i = 0; i < slabCurves.Count; i++)
    {
        List<Curve> floorGrid = new List<Curve>();
        foreach (Curve gridLine in xzGrid[i])
        {
            Rhino.Geometry.Intersect.CurveIntersections intersections = Rhino.Geometry.Intersect.Intersection.CurveCurve(gridLine, slabCurves[i], 0.01, 0.01);

            List<Curve> floorGrid1 = new List<Curve>();
            for (int j = 0; j < intersections.Count-1; j++)
            {
                Point3d stPt = intersections[j].PointA;
                Point3d enPt = intersections[j + 1].PointA;
                Line tLine = new Line(stPt, enPt);
                    
                if (slabCurves[i].Contains(tLine.PointAt(0.5))== PointContainment.Inside)
                {
                    if (tLine.Length > 0.5)
                    {
                        floorGrid1.Add(tLine.ToNurbsCurve());
                    }
                }
            }
            floorGrid.AddRange(floorGrid1);
        }
        trimmedXGrid.Add(floorGrid);
    }  

    //trim yGrid at slabCurves
    List<List<Curve>> trimmedYGrid = new List<List<Curve>>();
    for (int i = 0; i < slabCurves.Count; i++)
    {
        List<Curve> floorGrid = new List<Curve>();  
        foreach (Curve gridLine in yzGrid[i])
        {
            Rhino.Geometry.Intersect.CurveIntersections intersections = Rhino.Geometry.Intersect.Intersection.CurveCurve(gridLine, slabCurves[i], 0.01, 0.01);

            List<Curve> floorGrid1 = new List<Curve>();
            for (int j = 0; j < intersections.Count-1; j++)
            {
                Point3d stPt = intersections[j].PointA;
                Point3d enPt = intersections[j + 1].PointA;
                Line tLine = new Line(stPt, enPt);
                if (slabCurves[i].Contains(tLine.PointAt(0.5))== PointContainment.Inside)
                {
                    if (tLine.Length > 0.5)
                    {
                        floorGrid1.Add(tLine.ToNurbsCurve());
                    }
                }
            }
            floorGrid.AddRange(floorGrid1);
        }
        trimmedYGrid.Add(floorGrid);
    }


    //INNER BEAMS
    //inner xBeams and xNodes
    List<List<Curve>> innerXBeams = new List<List<Curve>>();
    List<Point3d> innerXBeamsInclPts = new List<Point3d>();
    List<List<Point3d>> innerNodesX = new List<List<Point3d>>();
    List<List<Point3d>> edgeNodesX = new List<List<Point3d>>();
    List<List<List<Point3d>>> intersectionNodesByRowX = new List<List<List<Point3d>>>();
    
    for (int i = 0; i < slabCurves.Count; i++)
    {
        List<Curve> innerBeamsFloor = new List<Curve>();
        List<Point3d> innerNodesFloor = new List<Point3d>();
        List<Point3d> edgeNodesFloor = new List<Point3d>();
        List<List<Point3d>> intNodesFloorByRow = new List<List<Point3d>>();
        
        foreach (Curve xCurve in trimmedXGrid[i])
        { 
            Point3d stPtCurve = xCurve.PointAtStart;
            Point3d enPtCurve = xCurve.PointAtEnd;

            //edgeNodes: startPtCurve + endPtCurve            
            List<Point3d> edgeNodes = new List<Point3d>();  
            edgeNodes.Add(stPtCurve);  
            edgeNodes.Add(enPtCurve);
            edgeNodesFloor.AddRange(edgeNodes);

            //intersectionNodesByRow: startPtCurve + gridIntersections + endPtCurve
            List<Point3d> intNodesRow = new List<Point3d>();     
            intNodesRow.Add(stPtCurve);           
            foreach (Curve yCurve in trimmedYGrid[i])  
            {
                Rhino.Geometry.Intersect.CurveIntersections intersections = Rhino.Geometry.Intersect.Intersection.CurveCurve(xCurve, yCurve, 0.01, 0.01);
                foreach( var intEvent in intersections)
                {
                    intNodesRow.Add(intEvent.PointA); 
                    innerNodesFloor.Add(intEvent.PointA); 
                }  
            }         
            intNodesRow.Add(enPtCurve); 
            intNodesFloorByRow.Add(intNodesRow);
            
            //segmentNodes: generate nodes by meter on xCurve.ToLine
            List<Line> curveToLine = new List<Line>();
            Line line = new Line (stPtCurve, enPtCurve);
            curveToLine.Add(line);
            List<Point3d> segmentNodes = nodesPrMeter(curveToLine);

            //inclusionNodes innerBeams
            List<Point3d> unsortedinclusionNodes = new List<Point3d>(); 
            unsortedinclusionNodes.AddRange(intNodesRow);
            unsortedinclusionNodes.AddRange(segmentNodes);
            List<Point3d> noDupesInclusionNodes = RemoveDuplicateNodes(unsortedinclusionNodes, 0.01);

            List<Point3d> inclusionNodesInnerBeam = new List<Point3d>(); 
            noDupesInclusionNodes.Sort((p1, p2) => p1.Y.CompareTo(p2.Y));
            inclusionNodesInnerBeam.AddRange(noDupesInclusionNodes);

            //innerBeamSegments
            List<Curve> beamSegments = new List<Curve>();
            Polyline polylineRow = new Polyline(inclusionNodesInnerBeam);
            for(int j = 0; j < polylineRow.SegmentCount; j++)
            {
                Line beamSegment = polylineRow.SegmentAt(j); 
                beamSegments.Add(beamSegment.ToNurbsCurve()); 
            }
            innerBeamsFloor.AddRange(beamSegments);   
            innerXBeamsInclPts.AddRange(inclusionNodesInnerBeam); //not local list
        }
        innerXBeams.Add(innerBeamsFloor);
        innerNodesX.Add(innerNodesFloor);
        edgeNodesX.Add(edgeNodesFloor);
        intersectionNodesByRowX.Add(intNodesFloorByRow);
    }

    //inner yBeams and yNodes
    List<List<Curve>> innerYBeams = new List<List<Curve>>();
    List<Point3d> innerYBeamsInclPts = new List<Point3d>();
    List<List<Point3d>> edgeNodesY = new List<List<Point3d>>();
    List<List<List<Point3d>>> intersectionNodesByRowY = new List<List<List<Point3d>>>();
    
    for (int i = 0; i < slabCurves.Count; i++)
    {
        List<Curve> innerBeamsFloor = new List<Curve>();
        List<Point3d> edgeNodesFloor = new List<Point3d>();
        List<List<Point3d>> intNodesFloorByRow = new List<List<Point3d>>();
        
        foreach (Curve yCurve in trimmedYGrid[i])
        { 
            Point3d stPtCurve = yCurve.PointAtStart;
            Point3d enPtCurve = yCurve.PointAtEnd;

            //edgeNodes: startPtCurve + endPtCurve            
            List<Point3d> edgeNodes = new List<Point3d>();  
            edgeNodes.Add(stPtCurve);  
            edgeNodes.Add(enPtCurve);
            edgeNodesFloor.AddRange(edgeNodes);

            //intersectionNodesByRow: startPtCurve + gridIntersections + endPtCurve
            List<Point3d> intNodesRow = new List<Point3d>();     
            intNodesRow.Add(stPtCurve);           
            foreach (Curve xCurve in trimmedXGrid[i])  
            {
                Rhino.Geometry.Intersect.CurveIntersections intersections = Rhino.Geometry.Intersect.Intersection.CurveCurve(xCurve, yCurve, 0.01, 0.01);
                foreach( var intEvent in intersections)
                {
                    intNodesRow.Add(intEvent.PointA); 
                }  
            }         
            intNodesRow.Add(enPtCurve); 
            intNodesFloorByRow.Add(intNodesRow);
            
            //segmentNodes: generate nodes by meter on xCurve.ToLine
            List<Line> curveToLine = new List<Line>();
            Line line = new Line (stPtCurve, enPtCurve);
            curveToLine.Add(line);
            List<Point3d> segmentNodes = nodesPrMeter(curveToLine);

            //inclusionNodes innerBeams
            List<Point3d> unsortedinclusionNodes = new List<Point3d>(); 
            unsortedinclusionNodes.AddRange(intNodesRow);
            unsortedinclusionNodes.AddRange(segmentNodes);
            List<Point3d> noDupesInclusionNodes = RemoveDuplicateNodes(unsortedinclusionNodes, 0.01);

            List<Point3d> inclusionNodesInnerBeam = new List<Point3d>(); 
            noDupesInclusionNodes.Sort((p1, p2) => p1.X.CompareTo(p2.X));
            inclusionNodesInnerBeam.AddRange(noDupesInclusionNodes);

            //innerBeamSegments
            List<Curve> beamSegments = new List<Curve>();
            Polyline polylineRow = new Polyline(inclusionNodesInnerBeam);
            for(int j = 0; j < polylineRow.SegmentCount; j++)
            {
                Line beamSegment = polylineRow.SegmentAt(j); 
                beamSegments.Add(beamSegment.ToNurbsCurve()); 
            }
            innerBeamsFloor.AddRange(beamSegments);   
            innerYBeamsInclPts.AddRange(inclusionNodesInnerBeam); //not local list
        }
        innerYBeams.Add(innerBeamsFloor);
        edgeNodesY.Add(edgeNodesFloor);
        intersectionNodesByRowY.Add(intNodesFloorByRow);
    }


    //EDGE BEAMS
    List<List<Point3d>> edgeBeamInclPts = new List<List<Point3d>>();
    List<Point3d> edgeBeamInclPtsX = new List<Point3d>();
    List<Point3d> edgeBeamInclPtsY = new List<Point3d>();
    for (int i = 0; i < slabCurves.Count; i++)
    {
        List<Line> edgeLinesFloor = new List<Line>();
        List<Line> edgeLinesXFloor = new List<Line>();
        List<Line> edgeLinesYFloor = new List<Line>();
        for (int j = 0; j < verticeNodes[i].Count - 1; j++)
        {
            Point3d currPt = verticeNodes[i][j];
            Point3d nextPt = verticeNodes[i][j + 1];
            Line edgeLine = new Line(currPt, nextPt);
            edgeLinesFloor.Add(edgeLine);

            if ((j % 2) == 0)
            {
                edgeLinesXFloor.Add(edgeLine);
            }
            else
            {
                edgeLinesYFloor.Add(edgeLine);
            }
        }

        Point3d lastPt = verticeNodes[i][verticeNodes[i].Count - 1];
        Point3d startPt = verticeNodes[i][0];
        Line lastEdgeLine = new Line(lastPt, startPt);
        edgeLinesFloor.Add(lastEdgeLine);

        if (verticeNodes[i].Count % 2 == 0)
        {
            edgeLinesXFloor.Add(lastEdgeLine);
        }
        else
        {
            edgeLinesYFloor.Add(lastEdgeLine);
        }

        List<Point3d> edgeNodesPerMeter = nodesPrMeter(edgeLinesFloor);
        List<Point3d> edgeNodesPerMeterX = nodesPrMeter(edgeLinesXFloor);
        List<Point3d> edgeNodesPerMeterY = nodesPrMeter(edgeLinesYFloor);

        edgeBeamInclPts.Add(edgeNodesPerMeter);
        edgeBeamInclPtsX.AddRange(edgeNodesPerMeterX);
        edgeBeamInclPtsY.AddRange(edgeNodesPerMeterY);
    }


    //allEdgeNodes: merge of engeNodesX, edgeNodesY and verticeNodes
    List<List<Point3d>> allEdgeNodes = new List<List<Point3d>>();
    for (int i = 0; i < edgeNodesX.Count; i++)
    {
        List<Point3d> mergedList = new List<Point3d>();
        mergedList.AddRange(edgeNodesX[i]);
        mergedList.AddRange(edgeNodesY[i]);
        mergedList.AddRange(edgeBeamInclPts[i]);
        List<Point3d> mergedListNoDupes = RemoveDuplicateNodes(mergedList, 0.1);
        allEdgeNodes.Add(mergedListNoDupes);
    }

    //allEdgeNodesSorted: sorting all nodes along slabCurves[i]
    List<List<Point3d>> allEdgeNodesSorted = new List<List<Point3d>>();
    for (int i = 0; i < slabCurves.Count; i++)
    {
        List<Point3d> edgeNodesSortedFloor = new List<Point3d>(); 
        foreach (Point3d edgeNode in allEdgeNodes[i])
        {
            List<Point3d> pointsAlongCurve = allEdgeNodes[i];            
            Curve curve = slabCurves[i]; 

            List<Tuple<double, int>> parameterAndIndex = new List<Tuple<double, int>>(); //creating list to save params and indexes for the nodes
            for (int j = 0; j < pointsAlongCurve.Count; j++) //calculating param value for each point along curve and add to list
            {
                Point3d point = pointsAlongCurve[j];
                double parameter;
                bool success = curve.ClosestPoint(point, out parameter, 0.01);
                if (success)
                {
                    parameterAndIndex.Add(new Tuple<double, int>(parameter, j));
                }
            }
            
            parameterAndIndex.Sort((a, b) => a.Item1.CompareTo(b.Item1)); //sorting list based on param values

            foreach (var tuple in parameterAndIndex) //add nodes in sorted order
            {
                int index = tuple.Item2;
                edgeNodesSortedFloor.Add(pointsAlongCurve[index]); 
            }
        }
        List<Point3d> edgeNodesFloor = RemoveDuplicateNodes(edgeNodesSortedFloor, 0.1);
        allEdgeNodesSorted.Add(edgeNodesFloor); 
    }

    // creating edgeBeams
    List<List<Line>> edgeBeams = new List<List<Line>>();  
    List<List<Curve>> edgeBeamsX = new List<List<Curve>>(); 
    List<List<Curve>> edgeBeamsY = new List<List<Curve>>(); 
    for (int i = 0; i < slabCurves.Count; i++)
    {
        List<Line> edgeBeamsFloor = new List<Line>(); 
        List<Curve> edgeBeamsFloorX = new List<Curve>();
        List<Curve> edgeBeamsFloorY = new List<Curve>();

        for (int j = 0; j < allEdgeNodesSorted[i].Count - 1; j++) 
        {
            Point3d currNode = allEdgeNodesSorted[i][j];
            Point3d nextNode = allEdgeNodesSorted[i][j + 1];
            Line edgeBeam = new Line(currNode, nextNode);
            Vector3d direction = edgeBeam.Direction;
            direction.Unitize();

            //adding the beams to correct list based on count parity
            if (Math.Abs(direction.Y)<0.0001)
            {
                Curve edgeBeamCurve = edgeBeam.ToNurbsCurve();
                edgeBeamsFloorY.Add(edgeBeamCurve);
            }
            else if (Math.Abs(direction.X)<0.0001)
            {
                Curve edgeBeamCurve = edgeBeam.ToNurbsCurve();
                edgeBeamsFloorX.Add(edgeBeamCurve); 
            }  
        }

        //adding line between last and first node
        Point3d lastNode = allEdgeNodesSorted[i][allEdgeNodesSorted[i].Count - 1];   
        Point3d firstNode = allEdgeNodesSorted[i][0];
        Line lastEdgeBeam = new Line(lastNode, firstNode);
        edgeBeamsFloor.Add(lastEdgeBeam);
        
        Vector3d lastDirection = lastEdgeBeam.Direction;
        lastDirection.Unitize();

        //adding the last beam to the correct list based on count parity
        if (Math.Abs(lastDirection.Y) < 0.0001)
        {
            Curve lastEdgeBeamCurve = lastEdgeBeam.ToNurbsCurve();
            edgeBeamsFloorY.Add(lastEdgeBeamCurve);
        }
        else if (Math.Abs(lastDirection.X)< 0.0001)
        {
            Curve lastEdgeBeamCurve = lastEdgeBeam.ToNurbsCurve();
            edgeBeamsFloorX.Add(lastEdgeBeamCurve);
        }

        edgeBeams.Add(edgeBeamsFloor);
        edgeBeamsX.Add(edgeBeamsFloorX); 
        edgeBeamsY.Add(edgeBeamsFloorY); 
    }

    
    //ALL BEAMS IN ONE DIRECTION
    //allXBeams
    List<List<Curve>> allXBeams = new List<List<Curve>>();
    for (int i = 0; i < edgeBeams.Count; i++)
    {
        List<Curve> mergedList = new List<Curve>();
        mergedList.AddRange(edgeBeamsX[i]);
        mergedList.AddRange(innerXBeams[i]);
        allXBeams.Add(mergedList);
    }

    //inclusionPts allXBeams
    List<Point3d> allInclPtsXBeams = new List<Point3d>();
    allInclPtsXBeams.AddRange(innerXBeamsInclPts);
    allInclPtsXBeams.AddRange(edgeBeamInclPtsX);


    //allYBeams
    List<List<Curve>> allYBeams = new List<List<Curve>>();
    for (int i = 0; i < edgeBeams.Count; i++)
    {
        List<Curve> mergedList = new List<Curve>();
        mergedList.AddRange(edgeBeamsY[i]);
        mergedList.AddRange(innerYBeams[i]);
        allYBeams.Add(mergedList);
    }

    //inclusionPts allYBeams
    List<Point3d> allInclPtsYBeams = new List<Point3d>();
    allInclPtsYBeams.AddRange(innerYBeamsInclPts);
    allInclPtsXBeams.AddRange(edgeBeamInclPtsY);
    

    //EDGE COLUMNS
    //edgeColumnNodes
    List<List<Point3d>> edgeColumnNodes = new List<List<Point3d>>();
    foreach (Curve slabCurve in slabCurves)
    {
        List<Point3d> edgeColumnNodesFloor = new List<Point3d>();
        Point3d[] edgeColumnNodesPt;
        slabCurve.DivideByLength(edgeSpacing, true, out edgeColumnNodesPt);
        edgeColumnNodesFloor.AddRange(edgeColumnNodesPt);
        edgeColumnNodes.Add(edgeColumnNodesFloor);
    }  

    //edgeColumns based on edgeColumnNodes
    List<List<Line>> edgeColumns = new List<List<Line>>();
    foreach (List<Point3d> edgeNodesFloor in edgeColumnNodes)
    {
        List<Line> edgeColumnsFloor = new List<Line>();
        foreach (Point3d node in edgeNodesFloor)
        {
            Vector3d vector = new Vector3d(0, 0, -1);
            Line columnLine = new Line(node, vector, floorHeight);
            edgeColumnsFloor.Add(columnLine);
        }
        edgeColumns.Add(edgeColumnsFloor);
    }


    //WALLS
    //allIntNodes: merge of engeNodesX, edgeNodesY and verticeNodes
    List<List<Point3d>> allIntersectionNodes = MergeMultipleLists(edgeNodesX, edgeNodesY, verticeNodes);

    //allEdgeNodesSorted: sorting all nodes along slabCurves[i]
    List<List<Point3d>> allIntersectionNodesSorted = new List<List<Point3d>>();
    for (int i = 0; i < slabCurves.Count; i++)
    {
        List<Point3d> intNodesSortedFloor = new List<Point3d>(); 
        foreach (Point3d intNode in allIntersectionNodes[i])
        {
            List<Point3d> pointsAlongCurve = allIntersectionNodes[i];            
            Curve curve = slabCurves[i]; 

            List<Tuple<double, int>> parameterAndIndex = new List<Tuple<double, int>>(); //creating list to save params and indexes for the nodes
            for (int j = 0; j < pointsAlongCurve.Count; j++) //calculating param value for each point along curve and add to list
            {
                Point3d point = pointsAlongCurve[j];
                double parameter;
                bool success = curve.ClosestPoint(point, out parameter, 0.01);
                if (success)
                {
                    parameterAndIndex.Add(new Tuple<double, int>(parameter, j));
                }
            }
            
            parameterAndIndex.Sort((a, b) => a.Item1.CompareTo(b.Item1)); //sorting list based on param values

            foreach (var tuple in parameterAndIndex) //add nodes in sorted order
            {
                int index = tuple.Item2;
                intNodesSortedFloor.Add(pointsAlongCurve[index]); 
            }
        }
        List<Point3d> edgeNodesFloor = RemoveDuplicateNodes(intNodesSortedFloor, 0.1);
        allIntersectionNodesSorted.Add(edgeNodesFloor); 
    }

    //edgeWalls
    List<List<Polyline>> allEdgeWalls = new List<List<Polyline>>();
    List<Line> supportLineEdgeWalls = new List<Line>();
    List<Line> inclusionLinesEdgeWalls = new List<Line>();

    List<List<Polyline>> edgeWallsX = new List<List<Polyline>>();
    List<Line> supportLineEdgeWallsX = new List<Line>();
    List<Line> inclusionLinesEdgeWallsX = new List<Line>();

    List<List<Polyline>> edgeWallsY = new List<List<Polyline>>();
    List<Line> supportLineEdgeWallsY = new List<Line>();
    List<Line> inclusionLinesEdgeWallsY = new List<Line>();

    for (int i = 0; i < allIntersectionNodesSorted.Count - 1; i++)
    {
        int numOfNodesToIndex = allIntersectionNodesSorted[i].Count - 1;

        List<Polyline> edgeWallFloor = new List<Polyline>();
        List<Polyline> edgeWallFloorX = new List<Polyline>();
        List<Polyline> edgeWallFloorY = new List<Polyline>();
        for (int j = 0; j < allIntersectionNodesSorted[i].Count - 1; j++)
        {
            //firstFloor and up
            Point3d currPt = allIntersectionNodesSorted[i][j];
            Point3d nextPt = allIntersectionNodesSorted[i][j+1];
            Point3d currPtUp = allIntersectionNodesSorted[i+1][j];
            Point3d nextPtUp = allIntersectionNodesSorted[i+1][j+1];

            Polyline polyWall = new Polyline(new Point3d[] {currPt, nextPt, nextPtUp, currPtUp, currPt}); 
            edgeWallFloor.Add(polyWall);   
            inclusionLinesEdgeWalls.AddRange(polyWall.GetSegments());

            Line line = new Line(currPt, nextPt);
            Vector3d direction = line.Direction;
            direction.Unitize();

            if (Math.Abs(direction.X)<0.01)
            {
                edgeWallFloorX.Add(polyWall);
                inclusionLinesEdgeWallsX.AddRange(polyWall.GetSegments());
            }
            else if (Math.Abs(direction.Y)<0.01)
            {
                edgeWallFloorY.Add(polyWall);
                inclusionLinesEdgeWallsY.AddRange(polyWall.GetSegments());
            }

            //groundFloor
            if (i == 0)
            {
                //similar to firstFloor and up
                Point3d currPtGround = new Point3d(currPt.X, currPt.Y, currPt.Z - floorHeight);
                Point3d nextPtGround = new Point3d(nextPt.X, nextPt.Y, nextPt.Z - floorHeight);
                Polyline polyWallGround = new Polyline(new Point3d[] {currPt, nextPt, nextPtGround, currPtGround, currPt});
                edgeWallFloor.Add(polyWallGround);
                inclusionLinesEdgeWalls.AddRange(polyWallGround.GetSegments());

                //also creating supportLineWalls
                Line supportLine = new Line(currPtGround, nextPtGround);
                supportLineEdgeWalls.Add(supportLine);

                //distinguishing between edgeWalls in x and y direction
                if (Math.Abs(direction.X)<0.01)
                {
                    edgeWallFloorX.Add(polyWallGround);
                    inclusionLinesEdgeWallsX.AddRange(polyWallGround.GetSegments());
                    supportLineEdgeWallsX.Add(supportLine);
                }
                else if (Math.Abs(direction.Y)<0.01)
                {
                    edgeWallFloorY.Add(polyWallGround);
                    inclusionLinesEdgeWallsY.AddRange(polyWallGround.GetSegments());
                    supportLineEdgeWallsY.Add(supportLine);
                }
            }
        }

        //last wall: firstFloor and up
        Point3d lastPt = allIntersectionNodesSorted[i][numOfNodesToIndex];
        Point3d firstPt = allIntersectionNodesSorted[i][0];
        Point3d lastPtUp = allIntersectionNodesSorted[i+1][numOfNodesToIndex];
        Point3d firstPtUp = allIntersectionNodesSorted[i+1][0];

        Polyline lastPolyWall = new Polyline(new Point3d[] {lastPt, firstPt, firstPtUp, lastPtUp, lastPt}); 
        edgeWallFloor.Add(lastPolyWall);   
        inclusionLinesEdgeWalls.AddRange(lastPolyWall.GetSegments());

        Line lastLine = new Line(lastPt, firstPt);
        Vector3d lastDirection = lastLine.Direction;
        lastDirection.Unitize();

        if (Math.Abs(lastDirection.X)<0.01)
        {
            edgeWallFloorX.Add(lastPolyWall);
            inclusionLinesEdgeWallsX.AddRange(lastPolyWall.GetSegments());
        }
        else if (Math.Abs(lastDirection.Y)<0.01)
        {
            edgeWallFloorY.Add(lastPolyWall);
            inclusionLinesEdgeWallsY.AddRange(lastPolyWall.GetSegments());
        }

        //last wall ground: firstFloor and down
        if (i == 0)
        {
            Point3d lastPtGround = new Point3d(lastPt.X, lastPt.Y, lastPt.Z - floorHeight);
            Point3d firstPtGround = new Point3d(firstPt.X, firstPt.Y, firstPt.Z - floorHeight);
            Polyline polyWallGround = new Polyline(new Point3d[] {lastPt, firstPt, firstPtGround, lastPtGround, lastPt});
            edgeWallFloor.Add(polyWallGround);
            inclusionLinesEdgeWalls.AddRange(polyWallGround.GetSegments());

            //also creating supportLineWalls
            Line lastSupportLine = new Line(lastPtGround, firstPtGround);
            supportLineEdgeWalls.Add(lastSupportLine);

            if (Math.Abs(lastDirection.X)<0.01)
            {
                edgeWallFloorX.Add(polyWallGround);
                edgeWallFloorX.Add(polyWallGround);
                inclusionLinesEdgeWallsX.AddRange(polyWallGround.GetSegments());
                supportLineEdgeWallsX.Add(lastSupportLine);
            }
            else if (Math.Abs(lastDirection.Y)<0.01)
            {
                edgeWallFloorY.Add(polyWallGround);
                inclusionLinesEdgeWallsY.AddRange(polyWallGround.GetSegments());
                supportLineEdgeWalls.Add(lastSupportLine);
            }
        }
        allEdgeWalls.Add(edgeWallFloor);
        edgeWallsX.Add(edgeWallFloorX);
        edgeWallsY.Add(edgeWallFloorY);       
    }

    //innerWallsX
    List<List<Polyline>> innerWallsX = new List<List<Polyline>>();
    List<Line> supportLineWallsX = new List<Line>();
    List<Line> inclusionLinesInnerWallsX = new List<Line>();
    for (int i = 0; i < slabCurves.Count - 1; i++)
    {
        List<Polyline> wallsOnFloor = new List<Polyline>();
        
        for (int j = 0; j < intersectionNodesByRowX[i].Count; j++)
        {
            for (int k = 0; k < intersectionNodesByRowX[i][j].Count - 1; k++)
            {
                //firstFloor and up
                Point3d currPt = intersectionNodesByRowX[i][j][k];
                Point3d nextPt = intersectionNodesByRowX[i][j][k+1];
                Point3d currPtUp = intersectionNodesByRowX[i+1][j][k];
                Point3d nextPtUp = intersectionNodesByRowX[i+1][j][k+1];

                Polyline polyWall = new Polyline(new Point3d[] {currPt, nextPt, nextPtUp, currPtUp, currPt});
                wallsOnFloor.Add(polyWall);           
                inclusionLinesInnerWallsX.AddRange(polyWall.GetSegments());

                //groundFloor
                if (i == 0)
                {
                    //similar to firstFloor and up
                    Point3d currPtGround = new Point3d(currPt.X, currPt.Y, currPt.Z - floorHeight);
                    Point3d nextPtGround = new Point3d(nextPt.X, nextPt.Y, nextPt.Z - floorHeight);

                    Polyline polyWallGround = new Polyline(new Point3d[] {currPt, nextPt, nextPtGround, currPtGround, currPt});
                    wallsOnFloor.Add(polyWallGround);
                    inclusionLinesInnerWallsX.AddRange(polyWallGround.GetSegments());
                        
                    //also creating supportLineWallsX
                    Line wallSupportLine = new Line(currPtGround, nextPtGround);
                    supportLineWallsX.Add(wallSupportLine);
                }   
            }
        }
        innerWallsX.Add(wallsOnFloor);
    }

    //innerWallsY
    List<List<Polyline>> innerWallsY = new List<List<Polyline>>();
    List<Line> supportLineWallsY = new List<Line>();
    List<Line> inclusionLinesInnerWallsY = new List<Line>();
    for (int i = 0; i < slabCurves.Count - 1; i++)
    {
        List<Polyline> wallsOnFloor = new List<Polyline>();
        for (int j = 0; j < intersectionNodesByRowY[i].Count; j++)
        {
            for (int k = 0; k < intersectionNodesByRowY[i][j].Count - 1; k++)
            {
                //firstFloor and up
                Point3d currPt = intersectionNodesByRowY[i][j][k];
                Point3d nextPt = intersectionNodesByRowY[i][j][k+1];
                Point3d currPtUp = intersectionNodesByRowY[i+1][j][k];
                Point3d nextPtUp = intersectionNodesByRowY[i+1][j][k+1];

                Polyline polyWall = new Polyline(new Point3d[] {currPt, nextPt, nextPtUp, currPtUp, currPt});
                wallsOnFloor.Add(polyWall);     
                inclusionLinesInnerWallsY.AddRange(polyWall.GetSegments());

                //groundFloor
                if (i == 0)
                {
                    //similar to firstFloor and up
                    Point3d currPtGround = new Point3d(currPt.X, currPt.Y, currPt.Z - floorHeight);
                    Point3d nextPtGround = new Point3d(nextPt.X, nextPt.Y, nextPt.Z - floorHeight);

                    Polyline polyWallGround = new Polyline(new Point3d[] {currPt, nextPt, nextPtGround, currPtGround, currPt});
                    wallsOnFloor.Add(polyWallGround);
                    inclusionLinesInnerWallsY.AddRange(polyWallGround.GetSegments());
                        
                   //also creating supportLineWallsY
                    Line wallSupportLine = new Line(currPtGround, nextPtGround);
                    supportLineWallsY.Add(wallSupportLine);
                }
            }
        }
        innerWallsY.Add(wallsOnFloor);
    }

    //DEFINING MAIN DIRECTION
    List<List<Point3d>> edgeNodesMainDirection = new List<List<Point3d>>();
    List<List<Curve>> allPrimaryBeams = new List<List<Curve>>();
    List<List<Curve>> outerPrimaryBeams = new List<List<Curve>>();
    List<List<Curve>> transverseBeams = new List<List<Curve>>();
    List<List<Polyline>> innerWalls = new List<List<Polyline>>();
    List<List<Polyline>> outerPrimaryWalls = new List<List<Polyline>>();
    List<List<Polyline>> claddingWalls = new List<List<Polyline>>();
    List<Line> supportLineInnerWalls = new List<Line>();
    List<Line> supportLineOuterPrimaryWalls = new List<Line>();
    List<Line> supportLineOuterSecondaryWalls = new List<Line>();
    List<Line> inclusionLinesOuterWalls = new List<Line>();
    List<Line> inclusionLinesInnerWalls = new List<Line>();
    List<Point3d> allPrimaryBeamInclPts = new List<Point3d>();
    List<Point3d> outerPrimaryBeamInclPts = new List<Point3d>();
    List<Point3d> transverseBeamInclPts = new List<Point3d>();
    List<Line> inclusionLinesOuterSecondaryWalls = new List<Line>();

    if (xdomain > ydomain) 
    {
        if (ySpacing < xSpacing)
        {
            edgeNodesMainDirection.AddRange(edgeNodesY);
            allPrimaryBeams.AddRange(allXBeams);
            outerPrimaryBeams.AddRange(edgeBeamsX);
            transverseBeams.AddRange(allYBeams);
            innerWalls.AddRange(innerWallsX);
            outerPrimaryWalls.AddRange(edgeWallsX);
            claddingWalls.AddRange(edgeWallsY);
            supportLineInnerWalls.AddRange(supportLineWallsX);
            supportLineOuterPrimaryWalls.AddRange(supportLineEdgeWallsX);
            supportLineOuterSecondaryWalls.AddRange(supportLineEdgeWallsY);
            allPrimaryBeamInclPts.AddRange(allInclPtsXBeams);
            outerPrimaryBeamInclPts.AddRange(edgeBeamInclPtsX);
            transverseBeamInclPts.AddRange(allInclPtsYBeams);
            inclusionLinesInnerWalls.AddRange(inclusionLinesInnerWallsX);
            inclusionLinesOuterWalls.AddRange(inclusionLinesEdgeWallsX);
            inclusionLinesOuterSecondaryWalls.AddRange(inclusionLinesEdgeWallsY);

        }
        else if (ySpacing >= xSpacing)
        {
            edgeNodesMainDirection.AddRange(edgeNodesX);
            allPrimaryBeams.AddRange(allYBeams);
            outerPrimaryBeams.AddRange(edgeBeamsY);
            transverseBeams.AddRange(allXBeams);    
            innerWalls.AddRange(innerWallsY);
            outerPrimaryWalls.AddRange(edgeWallsY);
            claddingWalls.AddRange(edgeWallsX);
            supportLineInnerWalls.AddRange(supportLineWallsY);
            supportLineOuterPrimaryWalls.AddRange(supportLineEdgeWallsY);
            supportLineOuterSecondaryWalls.AddRange(supportLineEdgeWallsX);
            allPrimaryBeamInclPts.AddRange(allInclPtsYBeams);
            outerPrimaryBeamInclPts.AddRange(edgeBeamInclPtsY);
            transverseBeamInclPts.AddRange(allInclPtsXBeams);
            inclusionLinesInnerWalls.AddRange(inclusionLinesInnerWallsY);
            inclusionLinesOuterWalls.AddRange(inclusionLinesEdgeWallsY);
            inclusionLinesOuterSecondaryWalls.AddRange(inclusionLinesEdgeWallsX);
        }
    }

    else if (xdomain <= ydomain)
    {
        if (ySpacing < xSpacing)
        {   
            edgeNodesMainDirection.AddRange(edgeNodesX);
            allPrimaryBeams.AddRange(allYBeams);
            outerPrimaryBeams.AddRange(edgeBeamsY);
            transverseBeams.AddRange(allXBeams);    
            innerWalls.AddRange(innerWallsY);
            outerPrimaryWalls.AddRange(edgeWallsY);
            claddingWalls.AddRange(edgeWallsX);
            supportLineInnerWalls.AddRange(supportLineWallsY);
            supportLineOuterPrimaryWalls.AddRange(supportLineEdgeWallsY);
            supportLineOuterSecondaryWalls.AddRange(supportLineEdgeWallsX);
            allPrimaryBeamInclPts.AddRange(allInclPtsYBeams);
            outerPrimaryBeamInclPts.AddRange(edgeBeamInclPtsY);
            transverseBeamInclPts.AddRange(allInclPtsXBeams);
            inclusionLinesInnerWalls.AddRange(inclusionLinesInnerWallsY);
            inclusionLinesOuterWalls.AddRange(inclusionLinesEdgeWallsY);
            inclusionLinesOuterSecondaryWalls.AddRange(inclusionLinesEdgeWallsX);
        }
        else if (ySpacing >= xSpacing)
        {
            edgeNodesMainDirection.AddRange(edgeNodesY);
            allPrimaryBeams.AddRange(allXBeams);
            outerPrimaryBeams.AddRange(edgeBeamsX);
            transverseBeams.AddRange(allYBeams);
            innerWalls.AddRange(innerWallsX);
            outerPrimaryWalls.AddRange(edgeWallsX);
            claddingWalls.AddRange(edgeWallsY);
            supportLineInnerWalls.AddRange(supportLineWallsX);
            supportLineOuterPrimaryWalls.AddRange(supportLineEdgeWallsX);
            supportLineOuterSecondaryWalls.AddRange(supportLineEdgeWallsY);
            allPrimaryBeamInclPts.AddRange(allInclPtsXBeams);
            outerPrimaryBeamInclPts.AddRange(edgeBeamInclPtsX);
            transverseBeamInclPts.AddRange(allInclPtsYBeams);
            inclusionLinesInnerWalls.AddRange(inclusionLinesInnerWallsX);
            inclusionLinesOuterWalls.AddRange(inclusionLinesEdgeWallsX);
            inclusionLinesOuterSecondaryWalls.AddRange(inclusionLinesEdgeWallsY);
        }
    }


    //PRIMARY BEAMS (depends on main direction, buildingType, material and slabThickness)
    //primaryBeams content
    List<List<Curve>> primaryBeams = new List<List<Curve>>();
    if (buildingType == 2)
    {
        primaryBeams.AddRange(outerPrimaryBeams);
    }
    else if (buildingType == 3)
    {
        primaryBeams.AddRange(allPrimaryBeams);
    }
    else if (buildingType == 4)
    {
        if (materials == 4)
        {
            foreach (double t in slabThickness)
            {
                if (t < 0.2)
                {
                    primaryBeams.AddRange(allPrimaryBeams);
                }  
            }
        }  
        else if (materials == 1 || materials == 2 || materials == 3)
        {
            primaryBeams.AddRange(allPrimaryBeams);
        }
    }
    //adapting primaryBeams if statements to output format
    List<List<Curve>> primaryBeamsOut = new List<List<Curve>> ();
    if (buildingType == 4)
    {
        if (materials == 4)
        {
            double t = slabThickness[0];
            if (t < 0.2)
            {
                primaryBeamsOut.AddRange(primaryBeams);
            }  
        }
        else if (materials == 1 || materials == 2 || materials == 3)
        {
            primaryBeamsOut.AddRange(primaryBeams);
        }
    }
    else
    {
        primaryBeamsOut.AddRange(primaryBeams);        
    }

    
    //PRIMARY COLUMNS (depends on buildingType, and BT2 also depends on main direction)
    //content if (buildingType == 2)
    List<List<Point3d>> columnNodesBT2 = new List<List<Point3d>>(); //columnNodesBT2
    for (int i = 0; i < edgeNodesX.Count; i++)
    {
        List<Point3d> mergedList = new List<Point3d>();
        mergedList.AddRange(edgeNodesMainDirection[i]); //content depending on main direction
        mergedList.AddRange(verticeNodes[i]);
        columnNodesBT2.Add(mergedList);
    }
    List<List<Line>> primaryColumnsBT2 = new List<List<Line>>(); //primaryColumnsBT2
    foreach (List<Point3d> primaryNodesFloor in columnNodesBT2)
    {
        List<Line> primaryColumnsFloor = new List<Line>();
        foreach (Point3d node in primaryNodesFloor)
        {
            Vector3d vector = new Vector3d(0, 0, -1);
            Line columnLine = new Line(node, vector, floorHeight);
            primaryColumnsFloor.Add(columnLine);
        }
        primaryColumnsBT2.Add(primaryColumnsFloor);
    }

    //content if (buildingType == 3 || buildingType == 4)
    List<List<Point3d>> columnNodesBT3BT4 = new List<List<Point3d>>(); //columnNodesBT3BT4
    for (int i = 0; i < edgeNodesX.Count; i++)
    {
        List<Point3d> mergedList = new List<Point3d>();
        mergedList.AddRange(innerNodesX[i]);
        mergedList.AddRange(edgeNodesX[i]);
        mergedList.AddRange(edgeNodesY[i]);
        mergedList.AddRange(verticeNodes[i]);
        List<Point3d> uniquecolumnNodesBT3BT4 = RemoveDuplicateNodes(mergedList, 0.01); 
        columnNodesBT3BT4.Add(uniquecolumnNodesBT3BT4);
    }   
    List<List<Line>> primaryColumnsBT3BT4 = new List<List<Line>>(); //primaryColumnsBT3BT4
    foreach (List<Point3d> primaryNodesFloor in columnNodesBT3BT4)
    {
        List<Line> primaryColumnsFloor = new List<Line>();
        foreach (Point3d node in primaryNodesFloor)
        {
            Vector3d vector = new Vector3d(0, 0, -1);
            Line columnLine = new Line(node, vector, floorHeight);
            primaryColumnsFloor.Add(columnLine);
        }
        primaryColumnsBT3BT4.Add(primaryColumnsFloor);
    }

    //primaryColumns content
    List<List<Line>> primaryColumns = new List<List<Line>> (); 
    if (buildingType == 2)
    {
        primaryColumns.AddRange(primaryColumnsBT2);
    }
    else if (buildingType == 3 || buildingType == 4)
    {
        primaryColumns.AddRange(primaryColumnsBT3BT4);
    }


    //PRIMARY WALLS (depends on buildingType and main direction)
    List<List<Polyline>> primaryWalls = new List<List<Polyline>>();
    List<List<Polyline>> edgeWalls = new List<List<Polyline>>();
    if (buildingType == 1)
    {
        primaryWalls.InsertRange(0, innerWalls); 
        primaryWalls.InsertRange(1, outerPrimaryWalls); 
        edgeWalls.AddRange(claddingWalls);
    }
    if (buildingType == 2)
    {
        primaryWalls.AddRange(innerWalls); 
        edgeWalls.AddRange(allEdgeWalls);
    }
    else
    {
        edgeWalls.AddRange(allEdgeWalls);
    }


    //PREPARING INCLUSION NODES 
    //columnInclusionNodes
    List<Point3d> primaryColumnInclusionPtsBT2 = columnNodesBT2.SelectMany(points => points).ToList();
    List<Point3d> primaryColumnInclusionPtsBT3BT4 = columnNodesBT3BT4.SelectMany(points => points).ToList();
    List<Point3d> edgeColumnInclusionPts = edgeColumnNodes.SelectMany(points => points).ToList();
    
    //wallInclusionNodes
    List<Point3d> innerWallInclusionPts = nodesPrMeter(inclusionLinesInnerWalls);
    List<Point3d> outerPrimaryWallInclusionPts = nodesPrMeter(inclusionLinesOuterWalls);
    List<Point3d> outerSecondaryWallInclusionPts = nodesPrMeter(inclusionLinesOuterSecondaryWalls);
    List<Point3d> allEdgeWallInclusionPts = nodesPrMeter(inclusionLinesEdgeWalls);

    //PREPARING SUPPORT NODES
    //columnSupportNodes
    List<Point3d> primaryColumnSupportsBT2 = columnSupportNodes(primaryColumnsBT2);
    List<Point3d> primaryColumnSupportsBT3BT4 = columnSupportNodes(primaryColumnsBT3BT4);
    List<Point3d> edgeColumnSupports = columnSupportNodes(edgeColumns);

    //wallSupportNodes 
    List<Point3d> innerWallSupports = nodesPrMeter(supportLineInnerWalls);
    List<Point3d> outerPrimaryWallSupports = nodesPrMeter(supportLineOuterPrimaryWalls);
    List<Point3d> outerSecondaryWallSupports = nodesPrMeter(supportLineOuterSecondaryWalls);
    List<Point3d> allEdgeWallSupports = nodesPrMeter(supportLineEdgeWalls);

    //adding extra nodes if edgeSettings == true 
    List<Point3d> columnSupports = new List<Point3d>();
    List<Point3d> columnInclusionPts = new List<Point3d>();

    List<Point3d> edgeWallSupports = new List<Point3d>();
    List<Point3d> edgeWallInclusionPts = new List<Point3d>();

    if (edgeSettings == true)
    {
        columnSupports.AddRange(edgeColumnSupports);
        columnInclusionPts.AddRange(edgeColumnInclusionPts);

        if (buildingType != 1)
        {
            edgeWallSupports.AddRange(allEdgeWallSupports); 
            edgeWallInclusionPts.AddRange(allEdgeWallInclusionPts);
        }
        else if (buildingType == 1)
        {
            edgeWallSupports.AddRange(outerSecondaryWallSupports); 
            edgeWallInclusionPts.AddRange(outerSecondaryWallInclusionPts);
        }
    }

    
    //SUPPORT NODES OG INCLUSION POINTS (depending on buildingType)
    List<Point3d> supportNodes = new List<Point3d>();
    List<Point3d> inclusionNodes = new List<Point3d>();

    //adding content to supportNodes and inclusionNodes if (buildingType == 1)
    if (buildingType == 1)
    {       
        //inclusionNodes
        List<Point3d> inclusionNodes1 = new List<Point3d>();
        inclusionNodes1.AddRange(innerWallInclusionPts);
        inclusionNodes1.AddRange(outerPrimaryWallInclusionPts);       
        List<Point3d> uniqueInclusionNodes = RemoveDuplicateNodes(inclusionNodes1, 0.01); 

        inclusionNodes.AddRange(uniqueInclusionNodes);

        //supportNodes
        List<Point3d> supportNodes1 = new List<Point3d>();
        supportNodes1.AddRange(outerPrimaryWallSupports);
        supportNodes1.AddRange(innerWallSupports);
        List<Point3d> uniqueSupportNodes = RemoveDuplicateNodes(supportNodes1, 0.01);

        supportNodes.AddRange(uniqueSupportNodes); 

    }

    //adding content to supportNodes and inclusionNodes if (buildingType == 2)
    if (buildingType == 2)
    { 
        //inclusionNodes
        columnInclusionPts.AddRange(primaryColumnInclusionPtsBT2); //done this way because of edgeSettings

        List<Point3d> inclusionNodes2  = new List<Point3d>();
        inclusionNodes2.AddRange(columnInclusionPts); 
        inclusionNodes2.AddRange(innerWallInclusionPts);
        inclusionNodes2.AddRange(outerPrimaryBeamInclPts);
        List<Point3d> uniqueInclusionNodes = RemoveDuplicateNodes(inclusionNodes2, 0.01); 

        inclusionNodes.AddRange(uniqueInclusionNodes);

        //supportNodes
        columnSupports.AddRange(primaryColumnSupportsBT2); //*done this way because of edgeSettings

        List<Point3d> supportNodes2 = new List<Point3d>();
        supportNodes2.AddRange(columnSupports); //*
        supportNodes2.AddRange(innerWallSupports);
        List<Point3d> uniqueSupportNodes = RemoveDuplicateNodes(supportNodes2, 0.01);

        supportNodes.AddRange(uniqueSupportNodes);

    }

    //adding content to supportNodes and inclusionNodes if (buildingType == 3)
    if (buildingType == 3)
    {  
        //inclusionNodes
        columnInclusionPts.AddRange(primaryColumnInclusionPtsBT3BT4); //*done this way because of edgeSettings

        List<Point3d> inclusionNodes3 = new List<Point3d>();
        inclusionNodes3.AddRange(columnInclusionPts); //*
        inclusionNodes3.AddRange(allPrimaryBeamInclPts);
        inclusionNodes3.AddRange(transverseBeamInclPts);
        List<Point3d> uniqueInclusionNodes = RemoveDuplicateNodes(inclusionNodes3, 0.01); 

        inclusionNodes.AddRange(uniqueInclusionNodes);

        //supportNodes
        columnSupports.AddRange(primaryColumnSupportsBT3BT4); //*done this way because of edgeSettings

        List<Point3d> supportNodes3 = new List<Point3d>();
        supportNodes3.AddRange(columnSupports); //*

        List<Point3d> uniqueSupportNodes = RemoveDuplicateNodes(supportNodes3, 0.01);

        supportNodes.AddRange(uniqueSupportNodes);
    }

    //adding content to supportNodes and inclusionNodes if (buildingType == 4)
    if (buildingType == 4)
    {
        //inclusionNodes
        columnInclusionPts.AddRange(primaryColumnInclusionPtsBT3BT4); //*done this way because of edgeSettings

        List<Point3d> inclusionNodes4 = new List<Point3d>();
        inclusionNodes4.AddRange(columnInclusionPts); //*    
        if (materials == 4)
        {
            foreach (double t in slabThickness)
            {
                if (t < 0.2)
                {
                    inclusionNodes4.AddRange(allPrimaryBeamInclPts);
                }
            } 
        }  
        else if (materials == 1 || materials == 2 || materials == 3)
        {
            inclusionNodes4.AddRange(allPrimaryBeamInclPts);
        }    
        List<Point3d> uniqueInclusionNodes = RemoveDuplicateNodes(inclusionNodes4, 0.01); 

        inclusionNodes.AddRange(uniqueInclusionNodes);

        //supportNodes
        columnSupports.AddRange(primaryColumnSupportsBT3BT4); //done this way because of edgeSettings
        
        List<Point3d> supportNodes4 = new List<Point3d>();     
        supportNodes4.AddRange(columnSupports);      

        List<Point3d> uniqueSupportNodes = RemoveDuplicateNodes(supportNodes4, 0.01);

        supportNodes.AddRange(uniqueSupportNodes);
    }

    //OUTPUTS MAIN METHOD
    floors = slabCurves;
    primarycolumns = primaryColumns;
    edgecolumns = edgeColumns;
    primarybeams = primaryBeamsOut;
    transversebeams = transverseBeams;
    edgebeams = edgeBeams;
    primarywalls = primaryWalls;
    edgewalls = edgeWalls;
    supportnodes = supportNodes;
    inclusionnodes = inclusionNodes;  
    slabthickness = slabThickness;
    beamarea = beamArea;
    spacings = xySpacings;

}

// ---- all other methods ------   
//method: extracts topSrf from buildingBrep 
Brep topSrf(Brep brep)
{
    Brep topBrp = brep.Surfaces[0].ToBrep();
    double rzmax = AreaMassProperties.Compute(brep.Surfaces[0]).Centroid.Z;

    foreach (Surface srf in brep.Surfaces)
    {
        Point3d cpt = AreaMassProperties.Compute(srf).Centroid;
        if (cpt.Z > rzmax)
        {
            rzmax = cpt.Z;
            topBrp = srf.ToBrep();
        }
    }
    return topBrp;
}

//method: extracts botSrf from buildingBrep
Brep bottomSrf(Brep brep)
{
    Brep botBrp = brep.Surfaces[0].ToBrep();
    double rzmin = AreaMassProperties.Compute(brep.Surfaces[0]).Centroid.Z;

    foreach (Surface srf in brep.Surfaces)
    {
        Point3d cpt = AreaMassProperties.Compute(srf).Centroid;
        if (cpt.Z < rzmin)
        {
            rzmin = cpt.Z;
            botBrp = srf.ToBrep();
        }   
    }
    return botBrp;
}

//method: defining planes
List<Plane> findPlanes(Brep topBrep, Brep bottomBrep, double floorHeight)
{
    List<Plane> planes = new List<Plane>();
    double topZ = topBrep.Vertices[0].Location.Z;
    double bottomZ = bottomBrep.Vertices[0].Location.Z;
    int i = 0;
    double levelZ = bottomZ; 
    
    while (levelZ < topZ)
    {
        levelZ = bottomZ + floorHeight * (i); //for å droppe grunnplanet adderes floorHeight*(i+1) istedenfor *i
        if (levelZ > topZ)
        {
            break;
        }
        Plane level = new Plane(new Point3d(0, 0, levelZ), new Vector3d(0, 0, 1));
        planes.Add(level);
        i++;
    }
    return planes;
}

//method: generates floorBoundaries with steps = floorHeight
List<Curve> createFloorCurves(Brep buildingBrep, Brep topBrep, Brep bottomBrep, double floorHeight)
{
    List<Curve> curves = new List<Curve>();
    List<Plane> floorPlanes = findPlanes(topBrep, bottomBrep, floorHeight);        

    foreach (Plane pl in floorPlanes)
    {
        Curve[] crvs;
        Point3d[] pts;
        Rhino.Geometry.Intersect.Intersection.BrepPlane(buildingBrep, pl, 0.001, out crvs, out pts);
        curves.AddRange(crvs);
    }
    return curves;
}

//method: removes node duplicates in a list of points
List<Point3d> RemoveDuplicateNodes(List<Point3d> nodeList, double tolerance)
{
    var comparer = new Point3dEqualityComparer(tolerance);
    var uniqueNodes = new HashSet<Point3d>(nodeList, comparer);
    return uniqueNodes.ToList();
}

//method: extracts columnSupportNodes in list
List<Point3d> columnSupportNodes(List<List<Line>> columns)
{
    List<Point3d> columnSupports = new List<Point3d>();
    foreach (Line bottomColumn in columns[0])
    {
        Point3d bottomPoint = bottomColumn.To;
        columnSupports.Add(bottomPoint);
    }
    return columnSupports;
}    

//method: creates nodes per meter per line + adding end node, populating line from end with smallest to biggest x, y, and lastly z value
List<Point3d> nodesPrMeter(List<Line> lines)
{
    List<Point3d> lineNodes = new List<Point3d>();
    foreach (Line line in lines)
    {
        Point3d start = line.From;
        Point3d end = line.To;

        if (start.X > end.X || (start.X == end.X && start.Y > end.Y) || (start.X == end.X && start.Y == end.Y && start.Z > end.Z))
        {
            // Bytt om start og slutt hvis nødvendig
            Point3d temp = start;
            start = end;
            end = temp;
        }

        Line sortedLine = new Line(start, end);
        double length = sortedLine.Length;
        int nodeCount = (int)Math.Ceiling(length); 

        lineNodes.Add(start);

        for (int i = 1; i < nodeCount; i++)
        {
            double t = i / length; 
            if (t < 1)
            {
                Point3d point = sortedLine.PointAt(t);
                lineNodes.Add(point);
            }
        }

        if (length > 1)
        {
            lineNodes.Add(end);
        }
    }
    return lineNodes;
}


//method: convert from List<List<T>> to Datatree<T>
private void AddItemsToDataTree<T>(List<List<T>> itemsList, DataTree<T> dataTree, int buildingNumber)
{
    for (int i = 0; i < itemsList.Count; i++)
    {
        dataTree.AddRange(itemsList[i], new GH_Path(buildingNumber, i));
    }
}


//method: merge multible lists
public static List<List<T>> MergeMultipleLists<T>(params List<List<T>>[] listOfLists)
{
    List<List<T>> allMergedLists = new List<List<T>>();

    // Sjekk om vi har noen lister å behandle
    if (listOfLists.Length == 0)
    {
        return allMergedLists;
    }

    // Finn ut hvor mange elementer vi har i den første listen av lister
    int numElements = listOfLists[0].Count;

    // Gå gjennom hvert sett av lister på samme indeks
    for (int i = 0; i < numElements; i++)
    {
        List<T> mergedList = new List<T>();

        // Slå sammen elementer fra hver liste på indeks 'i'
        foreach (var listOfList in listOfLists)
        {
            if (i < listOfList.Count)
            {
                mergedList.AddRange(listOfList[i]);
            }
        }
        
        // Legg til den sammenslåtte listen i resultatlisten
        allMergedLists.Add(mergedList);
    }

    return allMergedLists;
}

}
# ---------- end csharp_script ----------
primarybeamslines = Line(csharp_script.primarybeams)
edgewallsurfaces = Surface(csharp_script.edgewalls)
transversebeamslines = Line(csharp_script.transversebeams)
edgebeamslines = Line(csharp_script.edgebeams)
primarycolumnsline = Line(csharp_script.primarycolumns)
# path mapper gjør sånn at strukturen går fra {0;0} til {0}. forskjellen på dette og flatten er flatten legger alle elementene inn i samme liste, mens slik jeg har laget path mapperen nå, gjør at bygningsnummeret beholdes og alle elementene innenfor hvert bygg kommer i samme liste.
edgecolumnsline = Line(csharp_script.edgecolumns)
floorsurfaces = Surface(csharp_script.floors)
primarywallsurfaces = Surface(csharp_script.primarywalls)

# ---- group: Floors
area = Area(Geometry=floorsurfaces)  # -> Area, Centroid
mass_addition_9 = MassAddition(Input=area.Area)  # -> Result, PartialResults

# ---- group: Columns
length = Length(Curve=primarycolumnsline)

# ---- group: Beams
length_2 = Length(Curve=edgebeamslines)

length_3 = Length(Curve=primarybeamslines)

# ----
length_4 = Length(Curve=edgecolumnsline)

# ---- group: Beams
length_5 = Length(Curve=transversebeamslines)

# ---- group: Walls
area_2 = Area(Geometry=edgewallsurfaces)  # -> Area, Centroid

area_3 = Area(Geometry=primarywallsurfaces)  # -> Area, Centroid

# ---- group: All beams
merge_9 = Merge(Data1=length_3, Data2=length_5)

# ----
merge_10 = Merge(Data1=area_2.Area, Data2=area_3.Area)

# ---- group: All columns
merge_11 = Merge(Data1=length, Data2=length_4)

# ----
c_script_4 = CSharpScript(massAdditionResult=mass_addition_9.Result)  # -> totalWallsVolume
# ---------- c_script_4: C# ----------
using System;
using System.Linq;
using System.Collections;
using System.Collections.Generic;
using System.Drawing;

using Rhino;
using Rhino.Geometry;

using Grasshopper;
using Grasshopper.Kernel;
using Grasshopper.Kernel.Data;
using Grasshopper.Kernel.Types;

public class Script_Instance : GH_ScriptInstance
{
    #region Notes
    /* 
      Members:
        RhinoDoc RhinoDocument
        GH_Document GrasshopperDocument
        IGH_Component Component
        int Iteration

      Methods (Virtual & overridable):
        Print(string text)
        Print(string format, params object[] args)
        Reflect(object obj)
        Reflect(object obj, string method_name)
    */
    #endregion

    private void RunScript(object massAdditionResult, ref object totalWallsVolume)
    {
        if (massAdditionResult == null)
        {
            totalWallsVolume = 0;
        }
        else
        {
            totalWallsVolume = massAdditionResult;
        }

    }
}
# ---------- end c_script_4 ----------
trim_tree = TrimTree(Tree=merge_9, Depth="1")
path_mapper = PathMapper(merge_10, source="{A;B}", target="{A}")
multiplication_2 = Multiplication(A=flatten(csharp_script.beamarea), B=trim_tree)
panel_106 = Panel(csharp_script.slabthickness)
csharp_script_2 = CSharpScript(x=path_mapper)  # -> a; inputs x: list of String
# ---------- csharp_script_2: C# ----------
// Grasshopper Script Instance
using System;
using System.Collections;
using System.Collections.Generic;
using System.Drawing;
using System.Linq;

using Rhino;
using Rhino.Geometry;

using Grasshopper;
using Grasshopper.Kernel;
using Grasshopper.Kernel.Data;
using Grasshopper.Kernel.Types;

public class Script_Instance : GH_ScriptInstance
{
  /* 
    Members:
      RhinoDoc RhinoDocument
      GH_Document GrasshopperDocument
      IGH_Component Component
      int Iteration

    Methods (Virtual & overridable):
      Print(string text)
      Print(string format, params object[] args)
      Reflect(object obj)
      Reflect(object obj, string method_name)
  */
  
  private void RunScript(List<string> x, ref object a)
  {
    // Erstatter null-verdier med "0" i listen
    List<string> oppdatertListe = x.Select(element => element ?? "0").ToList();

    a = oppdatertListe;

  }
}
# ---------- end csharp_script_2 ----------
multiplication_3 = Multiplication(A=c_script_4, B=c_script_2)
multiplication_4 = Multiplication(A=c_script, B=merge_11)
mass_addition_10 = MassAddition(Input=multiplication_2)  # -> Result, PartialResults

# ---- group: Tykkelse innervegg
multiplication_5 = Multiplication(A="0.2", B=csharp_script_2)

# ----
path_mapper_2 = PathMapper(multiplication_4, source="{A;B}", target="{A}")
multiplication_6 = Multiplication(A=panel_106, B=multiplication_3)
mass_addition_11 = MassAddition(Input=path_mapper_2)  # -> Result, PartialResults
mass_addition_12 = MassAddition(Input=multiplication_5)  # -> Result, PartialResults
c_script_5 = CSharpScript(massAdditionResult=mass_addition_10.Result)  # -> totalWallsVolume; same code as c_script_4
c_script_6 = CSharpScript(massAdditionResult=mass_addition_12.Result)  # -> totalWallsVolume; same code as c_script_4
c_script_7 = CSharpScript(massAdditionResult=mass_addition_11.Result)  # -> totalWallsVolume; same code as c_script_4

# ---- group: Walls
write_to_excel_classic_59 = WriteToExcelClassic(
    WorkbookFilepath=file_path,
    WorksheetName=panel_55,
    Data=c_script_6,
    LocationAddress=c_script_3.location,
    Clear=0,
    Stream=boolean_toggle)

# ---- group: Columns
write_to_excel_classic_60 = WriteToExcelClassic(
    WorkbookFilepath=file_path,
    WorksheetName=panel_53,
    Data=c_script_7,
    LocationAddress=c_script_3.location,
    Clear=0,
    Stream=boolean_toggle)

# ---- group: Slabs
write_to_excel_classic_61 = WriteToExcelClassic(
    WorkbookFilepath=file_path,
    WorksheetName=panel_56,
    Data=multiplication_6,
    LocationAddress=c_script_3.location,
    Clear=0,
    Stream=boolean_toggle)

# ---- group: Beams
write_to_excel_classic_62 = WriteToExcelClassic(
    WorkbookFilepath=file_path,
    WorksheetName=panel_54,
    Data=c_script_5,
    LocationAddress=c_script_3.location,
    Clear=0,
    Stream=boolean_toggle)

# ----
# Poissons tall er lagt inn som gjennomsnittet langs fiberretningen (0.03) og på tvers av fiberretningen (0.35) vha. cGPT
# Har lagt inn slik at XY tilsvarer G12, XZ tilsvarer G31 og YZ tilsvarer G32
# Verdier fra tabell 3 i massivtre.pdf inne i Teams. Vi har brukt verdier for 180 (5s). Vi bør kontrollberegne analyse resultater for maks nedbøyning opp mot håndberegninger av w i tråd med PP som foreleser sendte på mail 05.04.24.
read_material_table_from_file_karamba3d = ReadMaterialTableFromFileKaramba3D()

# ---- group: Write to excel header building type 2
write_to_excel_classic_63 = WriteToExcelClassic(
    WorkbookFilepath=file_path,
    WorksheetName="Columns",
    Data=panel_75,
    LocationAddress=panel_78,
    Clear=clear_excel,
    Stream=push_to_excel)

write_to_excel_classic_64 = WriteToExcelClassic(
    WorkbookFilepath=file_path,
    WorksheetName="Columns",
    Data=panel_77,
    LocationAddress=panel_79,
    Clear=clear_excel,
    Stream=push_to_excel)

write_to_excel_classic_65 = WriteToExcelClassic(
    WorkbookFilepath=file_path,
    WorksheetName="Columns",
    Data=panel_80,
    LocationAddress=panel_81,
    Clear=clear_excel,
    Stream=push_to_excel)

write_to_excel_classic_66 = WriteToExcelClassic(
    WorkbookFilepath=file_path,
    WorksheetName="Columns",
    Data=panel_76,
    LocationAddress=panel_82,
    Clear=clear_excel,
    Stream=push_to_excel)

# ---- group: Write to excel header building type 4
write_to_excel_classic_67 = WriteToExcelClassic(
    WorkbookFilepath=file_path,
    WorksheetName="Columns",
    Data=panel_98,
    LocationAddress=panel_102,
    Clear=clear_excel,
    Stream=push_to_excel)

write_to_excel_classic_68 = WriteToExcelClassic(
    WorkbookFilepath=file_path,
    WorksheetName="Columns",
    Data=panel_100,
    LocationAddress=panel_104,
    Clear=clear_excel,
    Stream=push_to_excel)

write_to_excel_classic_69 = WriteToExcelClassic(
    WorkbookFilepath=file_path,
    WorksheetName="Columns",
    Data=panel_101,
    LocationAddress=panel_99,
    Clear=clear_excel,
    Stream=push_to_excel)

write_to_excel_classic_70 = WriteToExcelClassic(
    WorkbookFilepath=file_path,
    WorksheetName="Columns",
    Data=panel_97,
    LocationAddress=panel_103,
    Clear=clear_excel,
    Stream=push_to_excel)

# ----
panel_107 = Panel(csharp_script.slabthickness)

# ---- group: ISOTROPIC MATERIALS / material: C20/25
material_selection_karamba3d_2 = MaterialSelectionKaramba3D(ElementIdentifier="C20/25", menu=[dropdown(7), dropdown(4)])

# ---- group: ORTHOTROPIC MATERIALS / material: CLT wall
# husk å oppdatere verdier fra CLT og HD slab til CLT og PC wall
poissons_tall = Panel("0.19")
e_m_50_y = Panel("1092.7")
e_m_50_x = Panel("170.7")
g_50_xy = Panel("47.5")
g_50_xz = Panel("16.4")
g_50_yz = Panel("5.5")
f_t_x = Panel("1.39")
f_c_x = Panel("-1.76")
f_v_xz = Panel("0.07")
material_properties_karamba3d = MaterialPropertiesKaramba3D(
    FamilyOfMaterial="CLT wall",
    Name="S235",
    YoungsModulusKNCm2Dir1=e_m_50_y,
    YoungsModulusKNCm2Dir2=e_m_50_x,
    InPlaneShearModulus_kN_cm2=g_50_xy,
    InPlaneLateralContractionCoefficient=poissons_tall,
    TransverseShearModulusKNCm2Dir1=g_50_xz,
    TransverseShearModulusKNCm2Dir2=g_50_yz,
    SpecificWeight_kN_m3=78.5,
    CoefficientOfThermalExpansion1CDir1=1.2e-05,
    CoefficientOfThermalExpansion1CDir2=1.2e-05,
    TensileStrengthKNCm2Dir1=f_t_x,
    TensileStrengthKNCm2Dir2=23.5,
    CompressiveStrengthKNCm2Dir1=f_c_x,
    CompressiveStrengthKNCm2Dir2=-23.5,
    ShearStrengthKNCm2Dir12=f_v_xz,
    TsaiWuIntCoeff=0,
    StrengthHypothesis="MISES",
    mode="Orthotropic")

# ---- group: ORTHOTROPIC MATERIALS / material: CLT slab
poissons_tall_2 = Panel("0.19")
e_m_50_y_2 = Panel("977.5")
e_m_50_x_2 = Panel("284.4")
g_50_xy_2 = Panel("50.6")
g_50_yz_2 = Panel("5.5")
f_t_x_2 = Panel("1.09")
g_50_xz_2 = Panel("10.6")
f_c_x_2 = Panel("-1.35")
f_v_xz_2 = Panel("0.07")
material_properties_karamba3d_2 = MaterialPropertiesKaramba3D(
    FamilyOfMaterial="CLT slab",
    Name="S235",
    YoungsModulusKNCm2Dir1=e_m_50_y_2,
    YoungsModulusKNCm2Dir2=e_m_50_x_2,
    InPlaneShearModulus_kN_cm2=g_50_xy_2,
    InPlaneLateralContractionCoefficient=poissons_tall_2,
    TransverseShearModulusKNCm2Dir1=g_50_xz_2,
    TransverseShearModulusKNCm2Dir2=g_50_yz_2,
    SpecificWeight_kN_m3=78.5,
    CoefficientOfThermalExpansion1CDir1=1.2e-05,
    CoefficientOfThermalExpansion1CDir2=1.2e-05,
    TensileStrengthKNCm2Dir1=f_t_x_2,
    TensileStrengthKNCm2Dir2=23.5,
    CompressiveStrengthKNCm2Dir1=f_c_x_2,
    CompressiveStrengthKNCm2Dir2=-23.5,
    ShearStrengthKNCm2Dir12=f_v_xz_2,
    TsaiWuIntCoeff=0,
    StrengthHypothesis="MISES",
    mode="Orthotropic")

# ---- group: Write to excel header building type 2
write_to_excel_classic_71 = WriteToExcelClassic(
    WorkbookFilepath=file_path,
    WorksheetName="Walls",
    Data=panel_75,
    LocationAddress=panel_78,
    Clear=clear_excel,
    Stream=push_to_excel)

write_to_excel_classic_72 = WriteToExcelClassic(
    WorkbookFilepath=file_path,
    WorksheetName="Walls",
    Data=panel_77,
    LocationAddress=panel_79,
    Clear=clear_excel,
    Stream=push_to_excel)

write_to_excel_classic_73 = WriteToExcelClassic(
    WorkbookFilepath=file_path,
    WorksheetName="Walls",
    Data=panel_80,
    LocationAddress=panel_81,
    Clear=clear_excel,
    Stream=push_to_excel)

write_to_excel_classic_74 = WriteToExcelClassic(
    WorkbookFilepath=file_path,
    WorksheetName="Walls",
    Data=panel_76,
    LocationAddress=panel_82,
    Clear=clear_excel,
    Stream=push_to_excel)

# ---- group: Write to excel header building type 4
write_to_excel_classic_75 = WriteToExcelClassic(
    WorkbookFilepath=file_path,
    WorksheetName="Walls",
    Data=panel_98,
    LocationAddress=panel_102,
    Clear=clear_excel,
    Stream=push_to_excel)

write_to_excel_classic_76 = WriteToExcelClassic(
    WorkbookFilepath=file_path,
    WorksheetName="Walls",
    Data=panel_100,
    LocationAddress=panel_104,
    Clear=clear_excel,
    Stream=push_to_excel)

write_to_excel_classic_77 = WriteToExcelClassic(
    WorkbookFilepath=file_path,
    WorksheetName="Walls",
    Data=panel_101,
    LocationAddress=panel_99,
    Clear=clear_excel,
    Stream=push_to_excel)

write_to_excel_classic_78 = WriteToExcelClassic(
    WorkbookFilepath=file_path,
    WorksheetName="Walls",
    Data=panel_97,
    LocationAddress=panel_103,
    Clear=clear_excel,
    Stream=push_to_excel)

# ---- group: ISOTROPIC MATERIALS / material: S355
material_selection_karamba3d_3 = MaterialSelectionKaramba3D(ElementIdentifier="S355", menu=[dropdown(1), dropdown(4)])

# ---- group: TOTAL / Total of building type 1 / Total of PC2
panel_108 = Panel("F3:F65")  # disabled
panel_109 = Panel("F3:F65")  # disabled
panel_110 = Panel("Walls")  # disabled
panel_111 = Panel("Slabs")  # disabled
read_from_excel_25 = ReadFromExcel(
    WorkbookFilepath=file_path,
    WorksheetName=panel_110,
    Range=panel_108,
    Live=clear_excel,
    Stream=boolean_read_from_excel_for_total)  # disabled
read_from_excel_26 = ReadFromExcel(
    WorkbookFilepath=file_path,
    WorksheetName=panel_111,
    Range=panel_109,
    Live=clear_excel,
    Stream=boolean_read_from_excel_for_total)  # disabled
merge_12 = Merge(Data1=read_from_excel_25, Data2=read_from_excel_26)  # disabled
mass_addition_13 = MassAddition(Input=merge_12)  # -> Result, PartialResults; disabled
panel_112 = Panel("Total")  # disabled
panel_113 = Panel("F2")  # disabled
write_to_excel_classic_79 = WriteToExcelClassic(
    WorkbookFilepath=file_path,
    WorksheetName=panel_112,
    Data=mass_addition_13.Result,
    LocationAddress=panel_113,
    Clear=0,
    Stream=push_to_excel)  # disabled

# ---- group: ORTHOTROPIC MATERIALS / material: HD slab
poissons_tall_3 = Panel("0.3")
material_properties_karamba3d_3 = MaterialPropertiesKaramba3D(
    FamilyOfMaterial="HD slab",
    Name="S235",
    YoungsModulusKNCm2Dir1=21000,
    YoungsModulusKNCm2Dir2=21000,
    InPlaneShearModulus_kN_cm2=8076,
    InPlaneLateralContractionCoefficient=poissons_tall_3,
    TransverseShearModulusKNCm2Dir1=8076,
    TransverseShearModulusKNCm2Dir2=8076,
    SpecificWeight_kN_m3=78.5,
    CoefficientOfThermalExpansion1CDir1=1.2e-05,
    CoefficientOfThermalExpansion1CDir2=1.2e-05,
    TensileStrengthKNCm2Dir1=23.5,
    TensileStrengthKNCm2Dir2=23.5,
    CompressiveStrengthKNCm2Dir1=-23.5,
    CompressiveStrengthKNCm2Dir2=-23.5,
    ShearStrengthKNCm2Dir12=13.6,
    TsaiWuIntCoeff=0,
    StrengthHypothesis="MISES",
    mode="Orthotropic")

# ---- group: ORTHOTROPIC MATERIALS / material: PC wall
poissons_tall_4 = Panel("0.3")
material_properties_karamba3d_4 = MaterialPropertiesKaramba3D(
    FamilyOfMaterial="PC wall",
    Name="S235",
    YoungsModulusKNCm2Dir1=21000,
    YoungsModulusKNCm2Dir2=21000,
    InPlaneShearModulus_kN_cm2=8076,
    InPlaneLateralContractionCoefficient=poissons_tall_4,
    TransverseShearModulusKNCm2Dir1=8076,
    TransverseShearModulusKNCm2Dir2=8076,
    SpecificWeight_kN_m3=78.5,
    CoefficientOfThermalExpansion1CDir1=1.2e-05,
    CoefficientOfThermalExpansion1CDir2=1.2e-05,
    TensileStrengthKNCm2Dir1=23.5,
    TensileStrengthKNCm2Dir2=23.5,
    CompressiveStrengthKNCm2Dir1=-23.5,
    CompressiveStrengthKNCm2Dir2=-23.5,
    ShearStrengthKNCm2Dir12=13.6,
    TsaiWuIntCoeff=0,
    StrengthHypothesis="MISES",
    mode="Orthotropic")

# ---- group: outputs pr. building / primary columns
trim_tree_2 = TrimTree(Tree=csharp_script.primarycolumns, Depth=1)
tree_branch = TreeBranch(Tree=trim_tree_2, Path=buildingnumber, MaintainPaths=True)

# ---- group: outputs pr. building / edge columns
trim_tree_3 = TrimTree(Tree=csharp_script.edgecolumns, Depth=1)
tree_branch_2 = TreeBranch(Tree=trim_tree_3, Path=buildingnumber, MaintainPaths=True)

# ---- group: outputs pr. building / primary beams
trim_tree_4 = TrimTree(Tree=csharp_script.primarybeams, Depth=1)
tree_branch_3 = TreeBranch(Tree=trim_tree_4, Path=buildingnumber, MaintainPaths=True)

# ---- group: outputs pr. building / transverse beams
trim_tree_5 = TrimTree(Tree=csharp_script.transversebeams, Depth=1)
tree_branch_4 = TreeBranch(Tree=trim_tree_5, Path=buildingnumber, MaintainPaths=True)

# ---- group: outputs pr. building / edge beams
trim_tree_6 = TrimTree(Tree=csharp_script.edgebeams, Depth=1)
tree_branch_5 = TreeBranch(Tree=trim_tree_6, Path=buildingnumber, MaintainPaths=True)

# ---- group: outputs pr. building / edge walls
trim_tree_7 = TrimTree(Tree=csharp_script.edgewalls, Depth=1)
tree_branch_6 = TreeBranch(Tree=trim_tree_7, Path=buildingnumber, MaintainPaths=True)

# ---- group: outputs pr. building / primary walls
trim_tree_8 = TrimTree(Tree=csharp_script.primarywalls, Depth=1)
tree_branch_7 = TreeBranch(Tree=trim_tree_8, Path=buildingnumber, MaintainPaths=True)

# ---- group: outputs pr. building / support nodes
tree_branch_8 = TreeBranch(Tree=csharp_script.supportnodes, Path=buildingnumber, MaintainPaths=True)

# ---- group: outputs pr. building / inclusion nodes
tree_branch_9 = TreeBranch(Tree=csharp_script.inclusionnodes, Path=buildingnumber, MaintainPaths=True)

# ---- group: outputs pr. building / floors
tree_branch_10 = TreeBranch(Tree=csharp_script.floors, Path=buildingnumber, MaintainPaths=True)

# ---- group: Write to excel header building type 2
write_to_excel_classic_80 = WriteToExcelClassic(
    WorkbookFilepath=file_path,
    WorksheetName="Slabs",
    Data=panel_75,
    LocationAddress=panel_78,
    Clear=clear_excel,
    Stream=push_to_excel)

write_to_excel_classic_81 = WriteToExcelClassic(
    WorkbookFilepath=file_path,
    WorksheetName="Slabs",
    Data=panel_76,
    LocationAddress=panel_82,
    Clear=clear_excel,
    Stream=push_to_excel)

write_to_excel_classic_82 = WriteToExcelClassic(
    WorkbookFilepath=file_path,
    WorksheetName="Slabs",
    Data=panel_77,
    LocationAddress=panel_79,
    Clear=clear_excel,
    Stream=push_to_excel)

write_to_excel_classic_83 = WriteToExcelClassic(
    WorkbookFilepath=file_path,
    WorksheetName="Slabs",
    Data=panel_80,
    LocationAddress=panel_81,
    Clear=clear_excel,
    Stream=push_to_excel)

# ---- group: Write to excel header building type 4
write_to_excel_classic_84 = WriteToExcelClassic(
    WorkbookFilepath=file_path,
    WorksheetName="Slabs",
    Data=panel_98,
    LocationAddress=panel_102,
    Clear=clear_excel,
    Stream=push_to_excel)

write_to_excel_classic_85 = WriteToExcelClassic(
    WorkbookFilepath=file_path,
    WorksheetName="Slabs",
    Data=panel_100,
    LocationAddress=panel_104,
    Clear=clear_excel,
    Stream=push_to_excel)

write_to_excel_classic_86 = WriteToExcelClassic(
    WorkbookFilepath=file_path,
    WorksheetName="Slabs",
    Data=panel_101,
    LocationAddress=panel_99,
    Clear=clear_excel,
    Stream=push_to_excel)

write_to_excel_classic_87 = WriteToExcelClassic(
    WorkbookFilepath=file_path,
    WorksheetName="Slabs",
    Data=panel_97,
    LocationAddress=panel_103,
    Clear=clear_excel,
    Stream=push_to_excel)

# ----
transversebeamslines_2 = Line(tree_branch_4)
primarycolumnsline_2 = Line(tree_branch)
primarywallsurfaces_2 = Surface(tree_branch_7)
primarybeamslines_2 = Line(tree_branch_3)
edgecolumnsline_2 = Line(tree_branch_2)
edgewallsurfaces_2 = Surface(tree_branch_6)
edgebeamslines_2 = Line(tree_branch_5)
inclusionnodes = Point(tree_branch_9)
supportnodes = Point(tree_branch_8)
floorsurfaces_2 = Surface(tree_branch_10)

# ---- group: TOTAL
panel_114 = Panel("R2")  # disabled
panel_115 = Panel("X2")  # disabled

# ---- group: TOTAL / Total of building type 3 / Total of PC2
panel_116 = Panel("P3:P65")  # disabled
panel_117 = Panel("P3:P65")  # disabled
panel_118 = Panel("Columns")  # disabled
panel_119 = Panel("Beams")  # disabled
panel_120 = Panel("P3:P65")  # disabled
panel_121 = Panel("Slabs")  # disabled
read_from_excel_27 = ReadFromExcel(
    WorkbookFilepath=file_path,
    WorksheetName=panel_119,
    Range=panel_116,
    Live=clear_excel,
    Stream=boolean_read_from_excel_for_total)  # disabled
read_from_excel_28 = ReadFromExcel(
    WorkbookFilepath=file_path,
    WorksheetName=panel_118,
    Range=panel_117,
    Live=clear_excel,
    Stream=boolean_read_from_excel_for_total)  # disabled
read_from_excel_29 = ReadFromExcel(
    WorkbookFilepath=file_path,
    WorksheetName=panel_121,
    Range=panel_120,
    Live=clear_excel,
    Stream=boolean_read_from_excel_for_total)  # disabled
merge_13 = Merge(Data1=read_from_excel_27, Data2=read_from_excel_28)  # disabled
mass_addition_14 = MassAddition(Input=merge_13)  # -> Result, PartialResults; disabled
panel_122 = Panel("Total")  # disabled
panel_123 = Panel("Total")  # disabled
panel_124 = Panel("S2")  # disabled
write_to_excel_classic_88 = WriteToExcelClassic(
    WorkbookFilepath=file_path,
    WorksheetName=panel_122,
    Data=read_from_excel_29,
    LocationAddress=panel_114,
    Clear=0,
    Stream=push_to_excel)  # disabled
write_to_excel_classic_89 = WriteToExcelClassic(
    WorkbookFilepath=file_path,
    WorksheetName=panel_123,
    Data=mass_addition_14.Result,
    LocationAddress=panel_124,
    Clear=0,
    Stream=push_to_excel)  # disabled

# ---- group: TOTAL / Total of building type 4 / Total of PC2
panel_125 = Panel("U3:U65")  # disabled
panel_126 = Panel("U3:U65")  # disabled
panel_127 = Panel("Columns")  # disabled
panel_128 = Panel("U3:U65")  # disabled
panel_129 = Panel("Beams")  # disabled
panel_130 = Panel("Slabs")  # disabled
read_from_excel_30 = ReadFromExcel(
    WorkbookFilepath=file_path,
    WorksheetName=panel_129,
    Range=panel_125,
    Live=clear_excel,
    Stream=boolean_read_from_excel_for_total)  # disabled
read_from_excel_31 = ReadFromExcel(
    WorkbookFilepath=file_path,
    WorksheetName=panel_127,
    Range=panel_126,
    Live=clear_excel,
    Stream=boolean_read_from_excel_for_total)  # disabled
read_from_excel_32 = ReadFromExcel(
    WorkbookFilepath=file_path,
    WorksheetName=panel_130,
    Range=panel_128,
    Live=clear_excel,
    Stream=boolean_read_from_excel_for_total)  # disabled
merge_14 = Merge(Data1=read_from_excel_30, Data2=read_from_excel_31)  # disabled
mass_addition_15 = MassAddition(Input=merge_14)  # -> Result, PartialResults; disabled
panel_131 = Panel("Total")  # disabled
panel_132 = Panel("Total")  # disabled
panel_133 = Panel("Y2")  # disabled
write_to_excel_classic_90 = WriteToExcelClassic(
    WorkbookFilepath=file_path,
    WorksheetName=panel_131,
    Data=read_from_excel_32,
    LocationAddress=panel_115,
    Clear=0,
    Stream=push_to_excel)  # disabled
write_to_excel_classic_91 = WriteToExcelClassic(
    WorkbookFilepath=file_path,
    WorksheetName=panel_132,
    Data=mass_addition_15.Result,
    LocationAddress=panel_133,
    Clear=0,
    Stream=push_to_excel)  # disabled

# ----
write_to_excel_classic_92 = WriteToExcelClassic(
    WorkbookFilepath=file_path,
    WorksheetName="Total",
    Data="BT1 RC",
    LocationAddress="G2",
    Clear=clear_excel,
    Stream=push_to_excel)

write_to_excel_classic_93 = WriteToExcelClassic(
    WorkbookFilepath=file_path,
    WorksheetName="Total",
    Data="BT3 PC2 concrete",
    LocationAddress="O2",
    Clear=clear_excel,
    Stream=push_to_excel)

write_to_excel_classic_94 = WriteToExcelClassic(
    WorkbookFilepath=file_path,
    WorksheetName="Total",
    Data="BT3 PC1",
    LocationAddress="N2",
    Clear=clear_excel,
    Stream=push_to_excel)

write_to_excel_classic_95 = WriteToExcelClassic(
    WorkbookFilepath=file_path,
    WorksheetName="Total",
    Data="BT3 RC",
    LocationAddress="Q2",
    Clear=clear_excel,
    Stream=push_to_excel)

write_to_excel_classic_96 = WriteToExcelClassic(
    WorkbookFilepath=file_path,
    WorksheetName="Total",
    Data="BT1 PC1",
    LocationAddress="D2",
    Clear=clear_excel,
    Stream=push_to_excel)

write_to_excel_classic_97 = WriteToExcelClassic(
    WorkbookFilepath=file_path,
    WorksheetName="Total",
    Data="BT3 PC2 steel",
    LocationAddress="P2",
    Clear=clear_excel,
    Stream=push_to_excel)

write_to_excel_classic_98 = WriteToExcelClassic(
    WorkbookFilepath=file_path,
    WorksheetName="Total",
    Data="BT1 PC2 steel",
    LocationAddress="E2",
    Clear=clear_excel,
    Stream=push_to_excel)

write_to_excel_classic_99 = WriteToExcelClassic(
    WorkbookFilepath=file_path,
    WorksheetName="Total",
    Data="BT1 PC2 concrete",
    LocationAddress="F2",
    Clear=clear_excel,
    Stream=push_to_excel)

write_to_excel_classic_100 = WriteToExcelClassic(
    WorkbookFilepath=file_path,
    WorksheetName="Total",
    Data="BT3 Timber",
    LocationAddress="M2",
    Clear=clear_excel,
    Stream=push_to_excel)

write_to_excel_classic_101 = WriteToExcelClassic(
    WorkbookFilepath=file_path,
    WorksheetName="Total",
    Data="BT1 Timber",
    LocationAddress="C2",
    Clear=clear_excel,
    Stream=push_to_excel)

# ---- group: TOTAL / Total of building type 3 / Total of concrete
panel_134 = Panel("Q3:Q65")  # disabled
panel_135 = Panel("Q3:Q65")  # disabled
panel_136 = Panel("Slabs")  # disabled
panel_137 = Panel("Q3:Q65")  # disabled
panel_138 = Panel("Beams")  # disabled
panel_139 = Panel("Columns")  # disabled
read_from_excel_33 = ReadFromExcel(
    WorkbookFilepath=file_path,
    WorksheetName=panel_136,
    Range=panel_134,
    Live=clear_excel,
    Stream=boolean_read_from_excel_for_total)  # disabled
read_from_excel_34 = ReadFromExcel(
    WorkbookFilepath=file_path,
    WorksheetName=panel_138,
    Range=panel_135,
    Live=clear_excel,
    Stream=boolean_read_from_excel_for_total)  # disabled
read_from_excel_35 = ReadFromExcel(
    WorkbookFilepath=file_path,
    WorksheetName=panel_139,
    Range=panel_137,
    Live=clear_excel,
    Stream=boolean_read_from_excel_for_total)  # disabled
merge_15 = Merge(Data1=read_from_excel_34, Data2=read_from_excel_35)  # disabled
mass_addition_16 = MassAddition(Input=merge_15)  # -> Result, PartialResults; disabled
panel_140 = Panel("Total")  # disabled
panel_141 = Panel("T2")  # disabled
write_to_excel_classic_102 = WriteToExcelClassic(
    WorkbookFilepath=file_path,
    WorksheetName=panel_140,
    Data=mass_addition_16.Result,
    LocationAddress=panel_141,
    Clear=0,
    Stream=push_to_excel)  # disabled

# ---- group: TOTAL / Total of building type 4 / Total of concrete
panel_142 = Panel("V3:V65")  # disabled
panel_143 = Panel("V3:V65")  # disabled
panel_144 = Panel("Slabs")  # disabled
panel_145 = Panel("V3:V65")  # disabled
panel_146 = Panel("Beams")  # disabled
panel_147 = Panel("Columns")  # disabled
read_from_excel_36 = ReadFromExcel(
    WorkbookFilepath=file_path,
    WorksheetName=panel_144,
    Range=panel_142,
    Live=clear_excel,
    Stream=boolean_read_from_excel_for_total)  # disabled
read_from_excel_37 = ReadFromExcel(
    WorkbookFilepath=file_path,
    WorksheetName=panel_146,
    Range=panel_143,
    Live=clear_excel,
    Stream=boolean_read_from_excel_for_total)  # disabled
read_from_excel_38 = ReadFromExcel(
    WorkbookFilepath=file_path,
    WorksheetName=panel_147,
    Range=panel_145,
    Live=clear_excel,
    Stream=boolean_read_from_excel_for_total)  # disabled
merge_16 = Merge(Data1=read_from_excel_37, Data2=read_from_excel_38)  # disabled
mass_addition_17 = MassAddition(Input=merge_16)  # -> Result, PartialResults; disabled
panel_148 = Panel("Total")  # disabled
panel_149 = Panel("Z2")  # disabled
write_to_excel_classic_103 = WriteToExcelClassic(
    WorkbookFilepath=file_path,
    WorksheetName=panel_148,
    Data=mass_addition_17.Result,
    LocationAddress=panel_149,
    Clear=0,
    Stream=push_to_excel)  # disabled

# ---- group: TOTAL / Total of building type 1 / Total of concrete
panel_150 = Panel("G3:G65")  # disabled
panel_151 = Panel("G3:G65")  # disabled
panel_152 = Panel("Slabs")  # disabled
panel_153 = Panel("Walls")  # disabled
read_from_excel_39 = ReadFromExcel(
    WorkbookFilepath=file_path,
    WorksheetName=panel_153,
    Range=panel_150,
    Live=clear_excel,
    Stream=boolean_read_from_excel_for_total)  # disabled
read_from_excel_40 = ReadFromExcel(
    WorkbookFilepath=file_path,
    WorksheetName=panel_152,
    Range=panel_151,
    Live=clear_excel,
    Stream=boolean_read_from_excel_for_total)  # disabled
merge_17 = Merge(Data1=read_from_excel_39, Data2=read_from_excel_40)  # disabled
mass_addition_18 = MassAddition(Input=merge_17)  # -> Result, PartialResults; disabled
panel_154 = Panel("Total")  # disabled
panel_155 = Panel("H2")  # disabled
write_to_excel_classic_104 = WriteToExcelClassic(
    WorkbookFilepath=file_path,
    WorksheetName=panel_154,
    Data=mass_addition_18.Result,
    LocationAddress=panel_155,
    Clear=0,
    Stream=push_to_excel)  # disabled

# ---- group: TOTAL / Total of building type 2 / Total of concrete
panel_156 = Panel("L3:L65")  # disabled
panel_157 = Panel("L3:L65")  # disabled
panel_158 = Panel("L3:L65")  # disabled
panel_159 = Panel("L3:L65")  # disabled
panel_160 = Panel("Columns")  # disabled
panel_161 = Panel("Beams")  # disabled
panel_162 = Panel("Slabs")  # disabled
panel_163 = Panel("Walls")  # disabled
read_from_excel_41 = ReadFromExcel(
    WorkbookFilepath=file_path,
    WorksheetName=panel_160,
    Range=panel_156,
    Live=clear_excel,
    Stream=boolean_read_from_excel_for_total)  # disabled
read_from_excel_42 = ReadFromExcel(
    WorkbookFilepath=file_path,
    WorksheetName=panel_161,
    Range=panel_157,
    Live=clear_excel,
    Stream=boolean_read_from_excel_for_total)  # disabled
read_from_excel_43 = ReadFromExcel(
    WorkbookFilepath=file_path,
    WorksheetName=panel_163,
    Range=panel_158,
    Live=clear_excel,
    Stream=boolean_read_from_excel_for_total)  # disabled
read_from_excel_44 = ReadFromExcel(
    WorkbookFilepath=file_path,
    WorksheetName=panel_162,
    Range=panel_159,
    Live=clear_excel,
    Stream=boolean_read_from_excel_for_total)  # disabled
merge_18 = Merge(Data1=read_from_excel_43, Data2=read_from_excel_44, Data3=read_from_excel_41, Data4=read_from_excel_42)  # disabled
mass_addition_19 = MassAddition(Input=merge_18)  # -> Result, PartialResults; disabled
panel_164 = Panel("Total")  # disabled
panel_165 = Panel("N2")  # disabled
write_to_excel_classic_105 = WriteToExcelClassic(
    WorkbookFilepath=file_path,
    WorksheetName=panel_164,
    Data=mass_addition_19.Result,
    LocationAddress=panel_165,
    Clear=0,
    Stream=push_to_excel)  # disabled

# ---- group: Volum av slabs og walls til Speckle
unit_z_2 = UnitZ(Factor="-0.2")
unit_x = UnitX(Factor="-0.2")
extrude_2 = Extrude(Base=floorsurfaces_2, Direction=unit_z_2)
extrude_3 = Extrude(Base=primarywallsurfaces_2, Direction=unit_x)
brep = Brep(extrude_2)
brep_2 = Brep(extrude_3)
merge_19 = Merge(Data1=brep, Data2=brep_2)

# ---- group: stream
panel_166 = Panel("https://speckle.xyz/streams/75f71c059e/branches/buildingtypes")
send = Send(
    Stream=panel_166,
    Data=[primarycolumnsline_2, edgecolumnsline_2, primarybeamslines_2, transversebeamslines_2, edgebeamslines_2, edgewallsurfaces_2, supportnodes, inclusionnodes, merge_19],
    AutoSend=False,
    BaseId="b4fba9ece6863eae909c3c2be51df37a",
    CurrentComponentState="expired",
    KitName="Objects",
    OutputWrappers="https://app.speckle.systems\t75f71c059e\tdd7bceaf57",
    UseDefaultCache=True,
    selectedKitName="Objects")

# ----
write_to_excel_classic_106 = WriteToExcelClassic(
    WorkbookFilepath=file_path,
    WorksheetName="Total",
    Data="BT2 Timber",
    LocationAddress="H2",
    Clear=clear_excel,
    Stream=push_to_excel)

write_to_excel_classic_107 = WriteToExcelClassic(
    WorkbookFilepath=file_path,
    WorksheetName="Total",
    Data="BT4 PC1",
    LocationAddress="S2",
    Clear=clear_excel,
    Stream=push_to_excel)

write_to_excel_classic_108 = WriteToExcelClassic(
    WorkbookFilepath=file_path,
    WorksheetName="Total",
    Data="BT4 PC2 concrete",
    LocationAddress="T2",
    Clear=clear_excel,
    Stream=push_to_excel)

write_to_excel_classic_109 = WriteToExcelClassic(
    WorkbookFilepath=file_path,
    WorksheetName="Total",
    Data="BT2 RC",
    LocationAddress="L2",
    Clear=clear_excel,
    Stream=push_to_excel)

write_to_excel_classic_110 = WriteToExcelClassic(
    WorkbookFilepath=file_path,
    WorksheetName="Total",
    Data="BT2 PC1",
    LocationAddress="I2",
    Clear=clear_excel,
    Stream=push_to_excel)

write_to_excel_classic_111 = WriteToExcelClassic(
    WorkbookFilepath=file_path,
    WorksheetName="Total",
    Data="BT4 Timber",
    LocationAddress="R2",
    Clear=clear_excel,
    Stream=push_to_excel)

write_to_excel_classic_112 = WriteToExcelClassic(
    WorkbookFilepath=file_path,
    WorksheetName="Total",
    Data="BT4 RC",
    LocationAddress="V2",
    Clear=clear_excel,
    Stream=push_to_excel)

write_to_excel_classic_113 = WriteToExcelClassic(
    WorkbookFilepath=file_path,
    WorksheetName="Total",
    Data="BT2 PC2 concrete",
    LocationAddress="J2",
    Clear=clear_excel,
    Stream=push_to_excel)

write_to_excel_classic_114 = WriteToExcelClassic(
    WorkbookFilepath=file_path,
    WorksheetName="Total",
    Data="BT4 PC2 steel",
    LocationAddress="U2",
    Clear=clear_excel,
    Stream=push_to_excel)

write_to_excel_classic_115 = WriteToExcelClassic(
    WorkbookFilepath=file_path,
    WorksheetName="Total",
    Data="BT2 PC2 steel",
    LocationAddress="K2",
    Clear=clear_excel,
    Stream=push_to_excel)

# ---- group: Line To Column / cross section: steel column [cm]
cross_section_karamba3d = CrossSectionKaramba3D(
    FamilyNameOfCrossSection="DefaultCroSec",
    ElementIdentifier="3",
    Material=material_selection_karamba3d_3,
    Height_cm="10",
    UpperFlangeWidth_cm="10",
    LowerFlangeWidth_cm="10",
    UpperFlangeThickness_cm="1",
    LowerFlangeThickness_cm="1",
    SidewallsThickness_cm="1",
    FilletRadius_cm=0.6,
    mode="Box")  # -> flatten(CrossSection)

# ---- group: wallsShell / cross section: timer wall
cross_section_karamba3d_2 = CrossSectionKaramba3D(
    FamilyNameOfCrossSection="DefaultCroSec",
    ElementIdentifier="1",
    Material=material_properties_karamba3d,
    Height_cm="20",
    mode="Shell - Const")

cross_section_karamba3d_3 = CrossSectionKaramba3D(
    FamilyNameOfCrossSection="DefaultCroSec",
    ElementIdentifier="2",
    Material=material_properties_karamba3d_4,
    Height_cm="20",
    mode="Shell - Const")

# ---- group: Line To Column / cross section: concrete column [cm]
cross_section_karamba3d_4 = CrossSectionKaramba3D(
    FamilyNameOfCrossSection="DefaultCroSec",
    ElementIdentifier="2",
    Material=material_selection_karamba3d_2,
    Height_cm="15",
    UpperFlangeWidth_cm="15",
    LowerFlangeWidth_cm="15",
    mode="Trapezoid")

# ---- group: wallsShell / cross section: timer wall
cross_section_karamba3d_5 = CrossSectionKaramba3D(
    FamilyNameOfCrossSection="DefaultCroSec",
    ElementIdentifier="3",
    Material=material_properties_karamba3d_4,
    Height_cm="20",
    mode="Shell - Const")

# ---- group: Line To Column / cross section: concrete column [cm]
cross_section_karamba3d_6 = CrossSectionKaramba3D(
    FamilyNameOfCrossSection="DefaultCroSec",
    ElementIdentifier="4",
    Material=material_selection_karamba3d_2,
    Height_cm="15",
    UpperFlangeWidth_cm="15",
    LowerFlangeWidth_cm="15",
    mode="Trapezoid")

# ---- group: wallsShell / cross section: timer wall
cross_section_karamba3d_7 = CrossSectionKaramba3D(
    FamilyNameOfCrossSection="DefaultCroSec",
    ElementIdentifier="4",
    Material=material_selection_karamba3d_2,
    Height_cm="20",
    mode="Shell - Const")

# ---- group: Line To Column / cross section: timber column [cm]
cross_section_karamba3d_8 = CrossSectionKaramba3D(
    FamilyNameOfCrossSection="DefaultCroSec",
    ElementIdentifier="1",
    Material=material_selection_karamba3d,
    Height_cm="20",
    UpperFlangeWidth_cm="20",
    LowerFlangeWidth_cm="20",
    mode="Trapezoid")  # -> flatten(CrossSection)

# ---- group: Line To Beam / cross section: timber beam [cm]
cross_section_karamba3d_9 = CrossSectionKaramba3D(
    FamilyNameOfCrossSection="DefaultCroSec",
    ElementIdentifier="1",
    Material=material_selection_karamba3d,
    Height_cm="26",
    UpperFlangeWidth_cm="14",
    LowerFlangeWidth_cm="14",
    mode="Trapezoid")  # -> flatten(CrossSection)

# ---- group: Line To Beam / cross section: concrete beam [cm]
cross_section_karamba3d_10 = CrossSectionKaramba3D(
    FamilyNameOfCrossSection="DefaultCroSec",
    ElementIdentifier="2",
    Material=material_selection_karamba3d_2,
    Height_cm="40",
    UpperFlangeWidth_cm="10",
    LowerFlangeWidth_cm="10",
    mode="Trapezoid")  # -> flatten(CrossSection)

cross_section_karamba3d_11 = CrossSectionKaramba3D(
    FamilyNameOfCrossSection="DefaultCroSec",
    ElementIdentifier="4",
    Material=material_selection_karamba3d_2,
    Height_cm="30",
    UpperFlangeWidth_cm="10",
    LowerFlangeWidth_cm="10",
    mode="Trapezoid")  # -> flatten(CrossSection)

# ---- group: Line To Beam / cross section: steel beam [cm]
cross_section_karamba3d_12 = CrossSectionKaramba3D(
    FamilyNameOfCrossSection="DefaultCroSec",
    ElementIdentifier="3",
    Material=material_selection_karamba3d_3,
    Height_cm="27",
    UpperFlangeWidth_cm="13.5",
    LowerFlangeWidth_cm="13.5",
    UpperFlangeThickness_cm="0.52",
    LowerFlangeThickness_cm="0.52",
    WebThickness_cm="0.66",
    FilletRadius_cm="1.5",
    mode="I")  # -> flatten(CrossSection)

# ---- group: cross section: timber slab
cross_section_karamba3d_13 = CrossSectionKaramba3D(
    FamilyNameOfCrossSection="DefaultCroSec",
    ElementIdentifier="1",
    Material=material_properties_karamba3d_2,
    Height_cm="18",
    mode="Shell - Const")

# ---- group: cross section: HD slab
cross_section_karamba3d_14 = CrossSectionKaramba3D(
    FamilyNameOfCrossSection="DefaultCroSec",
    ElementIdentifier="2",
    Material=material_properties_karamba3d_3,
    Height_cm="20",
    mode="Shell - Const")

cross_section_karamba3d_15 = CrossSectionKaramba3D(
    FamilyNameOfCrossSection="DefaultCroSec",
    ElementIdentifier="3",
    Material=material_properties_karamba3d_3,
    Height_cm="20",
    mode="Shell - Const")

# ---- group: cross section: concrete slab
cross_section_karamba3d_16 = CrossSectionKaramba3D(
    FamilyNameOfCrossSection="DefaultCroSec",
    ElementIdentifier="4",
    Material=material_selection_karamba3d_2,
    Height_cm="18",
    mode="Shell - Const")

# ---- group: column cross section depending on material-value list
addition_2 = Addition(A=materials, B="-1")
list_item = ListItem(
    List=[cross_section_karamba3d_2, cross_section_karamba3d_3, cross_section_karamba3d_5, cross_section_karamba3d_7],
    Index=addition_2,
    Wrap=True)

addition_3 = Addition(A=materials, B="-1")
list_item_2 = ListItem(
    List=[cross_section_karamba3d_13, cross_section_karamba3d_14, cross_section_karamba3d_15, cross_section_karamba3d_16],
    Index=addition_3,
    Wrap=True)

# ---- group: Line To Beam / beam cross section depending on material-value list
addition_4 = Addition(A=materials, B="-1")
list_item_3 = ListItem(
    List=[cross_section_karamba3d_9, cross_section_karamba3d_10, cross_section_karamba3d_12, cross_section_karamba3d_11],
    Index=addition_4,
    Wrap=True)

# ---- group: Line To Column / column cross section depending on material-value list
addition_5 = Addition(A=materials, B="-1")
list_item_4 = ListItem(
    List=[cross_section_karamba3d_8, cross_section_karamba3d_4, cross_section_karamba3d, cross_section_karamba3d_6],
    Index=addition_5,
    Wrap=True)

# ----
read_cross_section_table_from_file_karam = ReadCrossSectionTableFromFileKaramba3D()  # -> CrossSection, Info
inclusionnodes_2 = Point(inclusionnodes)
wallsurfaces = Surface([primarywallsurfaces_2, edgewallsurfaces_2])

# ----
# tSlab tilsvarer dekkespenn på 5m for CLT og HD ettersom materialegenskaper varierer basert på tykkelse. For concrete slab er denne automatisert grunnet at betong er isotropt.
inclusionnodes_3 = Point(inclusionnodes)
floorsurfaces_3 = Surface(floorsurfaces_2)
mesh_breps_karamba3d = MeshBrepsKaramba3D(
    Brep=flatten(floorsurfaces_3),
    InclusionPoints=flatten(inclusionnodes_3),
    MeshResolution="0.2",
    EdgeRefinementFactor=0.67,
    PointReduction=False,
    SmoothingStepSize=0,
    SmoothingIterations=5)  # -> Mesh, Info
mesh_to_shell_karamba3d = MeshToShellKaramba3D(Mesh=mesh_breps_karamba3d.Mesh, Identifier="floors", CrossSection=list_item_2, LimitDistance_m=0.005)  # -> Element, Points, Info

# ---- group: wallsShell
mesh_breps_karamba3d_2 = MeshBrepsKaramba3D(
    Brep=flatten(wallsurfaces),
    InclusionPoints=flatten(inclusionnodes_2),
    MeshResolution=1,
    EdgeRefinementFactor=0.67,
    PointReduction=False,
    SmoothingStepSize=0,
    SmoothingIterations=5)  # -> Mesh, Info
mesh_to_shell_karamba3d_2 = MeshToShellKaramba3D(Mesh=mesh_breps_karamba3d_2.Mesh, Identifier="walls", CrossSection=list_item, LimitDistance_m=0.005)  # -> Element, Points, Info

# ---- group: Line To Beam
transversebeamslines_3 = Line(transversebeamslines_2)
primarybeamslines_3 = Line(primarybeamslines_2)
edgebeamslines_3 = Line(edgebeamslines_2)
line_to_beam_karamba3d = LineToBeamKaramba3D(
    Line=flatten([primarybeamslines_3, transversebeamslines_3, edgebeamslines_3]),
    Identifier="beams",
    CrossSection=list_item_3,
    New=True,
    Remove=True,
    LimitDistance_m=0.005,
    Bending=True,
    SetBucklingLength=True,
    ToPolylineMaxAngle=0.03,
    ToPolylineTolerance=0.01,
    ToPolylineMaxEdgeLength=0.25)  # -> Element, Points, Info

# ---- group: Line To Column
edgecolumnsline_3 = Line(edgecolumnsline_2)
innercolumnsline = Line(primarycolumnsline_2)
line_to_beam_karamba3d_2 = LineToBeamKaramba3D(
    Line=flatten([innercolumnsline, edgecolumnsline_3]),
    Identifier="columns",
    CrossSection=list_item_4,
    New=True,
    Remove=True,
    LimitDistance_m=0.005,
    Bending=True,
    SetBucklingLength=True,
    ToPolylineMaxAngle=0.03,
    ToPolylineTolerance=0.01,
    ToPolylineMaxEdgeLength=0.25)  # -> Element, Points, Info

# ---- group: loads
cull_index = CullIndex(List=floorsurfaces_2, Indices="-1", Wrap=True)
list_item_5 = ListItem(List=floorsurfaces_2, Index="-1", Wrap=True)
loads_karamba3d = LoadsKaramba3D(Vector=Vector(0, 0, -1), LCase="DL1", mode="Gravity")
loads_karamba3d_2 = LoadsKaramba3D(Vector="0,0,-3", Mesh=cull_index, LCase="LL1", mode="MeshLoad -Const.", menu=[buttons(on, off, off), buttons(off, on)])
loads_karamba3d_3 = LoadsKaramba3D(Vector="0,0,-5", Mesh=list_item_5, LCase="LL2", mode="MeshLoad -Const.", menu=[buttons(on, off, off), buttons(off, on)])

# ----
supportpoints = Point(supportnodes)

# ---- group: supports
support_karamba3d = SupportKaramba3D(PosInd=supportpoints, menu=[buttons(on, on, on, on, on, on)])

# ----
mesh_edges = MeshEdges(Mesh=mesh_breps_karamba3d.Mesh)  # -> NakedEdges, InteriorEdges, NonManifoldEdges
beamselement = ElementKaramba3D(line_to_beam_karamba3d.Element)
shellelement = ElementKaramba3D(mesh_to_shell_karamba3d.Element)
dl1 = LoadKaramba3D(loads_karamba3d)
ll1 = LoadKaramba3D(loads_karamba3d_2)
ll2 = LoadKaramba3D(loads_karamba3d_3)
columnselement = ElementKaramba3D(line_to_beam_karamba3d_2.Element)
wallshellelement = ElementKaramba3D(mesh_to_shell_karamba3d_2.Element)
supports = SupportKaramba3D(support_karamba3d)
columnselement_2 = ElementKaramba3D(columnselement)
beamselement_2 = ElementKaramba3D(beamselement)
shellelement_2 = ElementKaramba3D([shellelement, wallshellelement])
supports_2 = SupportKaramba3D(supports)
dl1_2 = LoadKaramba3D(dl1)
ll1_2 = LoadKaramba3D(ll1)
ll2_2 = LoadKaramba3D(ll2)

# ---- group: ANALYSE OG RESULTATER
assemble_model_karamba3d = AssembleModelKaramba3D(
    Elem=flatten([columnselement_2, beamselement_2, shellelement_2]),
    Support=flatten(supports_2),
    Load=flatten([dl1_2, ll1_2, ll2_2]),
    LimitDistance_m=0.005)  # -> Model, Info, Mass_kg, CenterOfGravity, LoadCaseNames
analyze_karamba3d = AnalyzeKaramba3D(Model=assemble_model_karamba3d.Model)  # -> CalculatedModel, MaximumDisplacement_cm, ResultingForceOfGravity_kN, ElasticEnergyChange_kNm
panel_167 = Panel(assemble_model_karamba3d.Mass_kg)
model_view_karamba3d = ModelViewKaramba3D(Model=analyze_karamba3d.CalculatedModel, ResultFactors=1, ResultCase=-1)  # -> Model, DeformedMesh, DeformedAxes, DeformedModel
panel_168 = Panel(model_view_karamba3d.DeformedModel)
shell_view_karamba3d = ShellViewKaramba3D(Model=model_view_karamba3d.Model, IndexOfLayer=0)  # -> Model, MeshesOfRenderedShells, LegendColors, LegendTags
beam_view_karamba3d = BeamViewKaramba3D(Model=model_view_karamba3d.Model)  # -> Model, MeshesOfRenderedBeams, DeformedBeamAxes, LegendColors, LegendTags
legend = Legend(Colour=shell_view_karamba3d.LegendColors, Tags=shell_view_karamba3d.LegendTags, LegendType=1)
legend_2 = Legend(Colour=beam_view_karamba3d.LegendColors, Tags=beam_view_karamba3d.LegendTags, LegendType=1)

# ----
join_curves = JoinCurves(Curves=primarybeamslines_2, Preserve=False)
line_results_on_shells_karamba3d = LineResultsOnShellsKaramba3D(
    AnalyzedModel=shell_view_karamba3d.Model,
    ListOfSourcesOfForceFlowLinesLinesPoints=inclusionnodes,
    SegmentLength_m=0.5,
    DA_deg=5,
    mode="PrincMoment")  # -> AnalyzedModel, Lines1, Lines2
mesh = Mesh(shell_view_karamba3d.MeshesOfRenderedShells)
shell_section_karamba3d = ShellSectionKaramba3D(
    AnalyzedModel=shell_view_karamba3d.Model,
    Polyline=join_curves,
    ProjectionDirection=Vector(0, 0, -1),
    mode="Forces",
    menu=[checkbox(on), checkbox(off), checkbox(off), slider(20), slider(0.25), slider(0.36), checkbox(off), checkbox(off), checkbox(off), checkbox(off), checkbox(on), checkbox(off), checkbox(off), checkbox(off), checkbox(off), slider(1)])  # -> AnalyzedModel, Polylines, FaceIndexes, MeshesOfRenderedResults, CurvesOfRenderedResults, Ntt_kN_m, Nnn_kN_m, Ntn_kN_m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
send_2 = Send(
    Data=mesh,
    AutoSend=False,
    CurrentComponentState="needs_input",
    KitName="Objects",
    UseDefaultCache=True,
    selectedKitName="Objects")

# ---- group: Write to excel for x and y values of rectangle / Write to excel for x values beams
panel_169 = Panel("A3")

# ---- group: Write to excel for x and y values of rectangle / Write to excel for y values beams
panel_170 = Panel("B3")
write_to_excel_classic_116 = WriteToExcelClassic(
    WorkbookFilepath=file_path,
    WorksheetName="Beams",
    Data=graft(cross_reference.ListListA),
    LocationAddress=panel_169,
    Clear=clear_excel,
    Stream=push_to_excel)

# ---- group: Write to excel for x and y values of rectangle / Write to excel for x values beams (continued)
write_to_excel_classic_117 = WriteToExcelClassic(
    WorkbookFilepath=file_path,
    WorksheetName="Beams",
    Data=graft(cross_reference.ListListB),
    LocationAddress=panel_170,
    Clear=clear_excel,
    Stream=push_to_excel)

# ---- group: Write to excel for x and y values of rectangle / Write to excel for y values columns
panel_171 = Panel("B3")

# ---- group: Write to excel for x and y values of rectangle / Write to excel for x values columns
panel_172 = Panel("A3")
write_to_excel_classic_118 = WriteToExcelClassic(
    WorkbookFilepath=file_path,
    WorksheetName="Columns",
    Data=graft(cross_reference.ListListB),
    LocationAddress=panel_171,
    Clear=clear_excel,
    Stream=push_to_excel)

# ---- group: Write to excel for x and y values of rectangle / Write to excel for y values columns (continued)
write_to_excel_classic_119 = WriteToExcelClassic(
    WorkbookFilepath=file_path,
    WorksheetName="Columns",
    Data=graft(cross_reference.ListListA),
    LocationAddress=panel_172,
    Clear=clear_excel,
    Stream=push_to_excel)

# ---- group: Write to excel for x and y values of rectangle / Write to excel for y values walls
panel_173 = Panel("B3")

# ---- group: Write to excel for x and y values of rectangle / Write to excel for x values walls
panel_174 = Panel("A3")
write_to_excel_classic_120 = WriteToExcelClassic(
    WorkbookFilepath=file_path,
    WorksheetName="Walls",
    Data=graft(cross_reference.ListListB),
    LocationAddress=panel_173,
    Clear=clear_excel,
    Stream=push_to_excel)

# ---- group: Write to excel for x and y values of rectangle / Write to excel for y values walls (continued)
write_to_excel_classic_121 = WriteToExcelClassic(
    WorkbookFilepath=file_path,
    WorksheetName="Walls",
    Data=graft(cross_reference.ListListA),
    LocationAddress=panel_174,
    Clear=clear_excel,
    Stream=push_to_excel)

# ---- group: Write to excel for x and y values of rectangle / Write to excel for y values slabs
panel_175 = Panel("B3")

# ---- group: Write to excel for x and y values of rectangle / Write to excel for x values slabs
panel_176 = Panel("A3")
write_to_excel_classic_122 = WriteToExcelClassic(
    WorkbookFilepath=file_path,
    WorksheetName="Slabs",
    Data=graft(cross_reference.ListListB),
    LocationAddress=panel_175,
    Clear=clear_excel,
    Stream=push_to_excel)

# ---- group: Write to excel for x and y values of rectangle / Write to excel for y values slabs (continued)
write_to_excel_classic_123 = WriteToExcelClassic(
    WorkbookFilepath=file_path,
    WorksheetName="Slabs",
    Data=graft(cross_reference.ListListA),
    LocationAddress=panel_176,
    Clear=clear_excel,
    Stream=push_to_excel)

# ---- group: Write to excel for x and y values of rectangle / Write to excel for y values total
panel_177 = Panel("B3")

# ---- group: Write to excel for x and y values of rectangle / Write to excel for x values total
panel_178 = Panel("A3")
write_to_excel_classic_124 = WriteToExcelClassic(
    WorkbookFilepath=file_path,
    WorksheetName="Total",
    Data=graft(cross_reference.ListListB),
    LocationAddress=panel_177,
    Clear=clear_excel,
    Stream=push_to_excel)

# ---- group: Write to excel for x and y values of rectangle / Write to excel for y values total (continued)
write_to_excel_classic_125 = WriteToExcelClassic(
    WorkbookFilepath=file_path,
    WorksheetName="Total",
    Data=graft(cross_reference.ListListA),
    LocationAddress=panel_178,
    Clear=clear_excel,
    Stream=push_to_excel)

# ---- group: TOTAL / Total of building type 2 / Total of PC2
panel_179 = Panel("K3:K65")  # disabled
panel_180 = Panel("K3:K65")  # disabled
panel_181 = Panel("K3:K65")  # disabled
panel_182 = Panel("K3:K65")  # disabled
panel_183 = Panel("Columns")  # disabled
panel_184 = Panel("Beams")  # disabled
panel_185 = Panel("Slabs")  # disabled
panel_186 = Panel("Walls")  # disabled
read_from_excel_45 = ReadFromExcel(
    WorkbookFilepath=file_path,
    WorksheetName=panel_183,
    Range=panel_179,
    Live=clear_excel,
    Stream=boolean_read_from_excel_for_total)  # disabled
read_from_excel_46 = ReadFromExcel(
    WorkbookFilepath=file_path,
    WorksheetName=panel_184,
    Range=panel_180,
    Live=clear_excel,
    Stream=boolean_read_from_excel_for_total)  # disabled
read_from_excel_47 = ReadFromExcel(
    WorkbookFilepath=file_path,
    WorksheetName=panel_186,
    Range=panel_181,
    Live=clear_excel,
    Stream=boolean_read_from_excel_for_total)  # disabled
read_from_excel_48 = ReadFromExcel(
    WorkbookFilepath=file_path,
    WorksheetName=panel_185,
    Range=panel_182,
    Live=clear_excel,
    Stream=boolean_read_from_excel_for_total)  # disabled
merge_20 = Merge(Data1=read_from_excel_45, Data2=read_from_excel_46)  # disabled
merge_21 = Merge(Data1=read_from_excel_47, Data2=read_from_excel_48)  # disabled
mass_addition_20 = MassAddition(Input=merge_21)  # -> Result, PartialResults; disabled
panel_187 = Panel("Total")  # disabled
panel_188 = Panel("M2")  # disabled
panel_189 = Panel("L2")  # disabled
write_to_excel_classic_126 = WriteToExcelClassic(
    WorkbookFilepath=file_path,
    WorksheetName=panel_187,
    Data=mass_addition_20.Result,
    LocationAddress=panel_189,
    Clear=0,
    Stream=push_to_excel)  # disabled

# ---- group: TOTAL / Total of building type 2
mass_addition_21 = MassAddition(Input=merge_20)  # -> Result, PartialResults; disabled

# ---- group: TOTAL / Total of building type 2 / Total of PC2 (continued)
write_to_excel_classic_127 = WriteToExcelClassic(
    WorkbookFilepath=file_path,
    WorksheetName=panel_187,
    Data=mass_addition_21.Result,
    LocationAddress=panel_188,
    Clear=0,
    Stream=push_to_excel)  # disabled
