# Grasshopper definition CS3_Karamba.gh (Grasshopper 1.0.8)
# plug-ins: Karamba3D, RhinoCodePluginGH, CORE.Toolbox.Grasshopper

# ---- group: site area (SA) / construct and adjust (xmin, ymin) for property
number_slider = Slider(50, range=-50..50)
number_slider_2 = Slider(20, range=-20..20)
construct_point = ConstructPoint(XCoordinate=number_slider, YCoordinate=number_slider_2, ZCoordinate=0)

# ---- group: site area (SA)
panel = Panel("80")
panel_2 = Panel("40")
rectangle = Rectangle(Plane=construct_point, XSize=panel, YSize=panel_2, Radius=0)  # -> Rectangle, Length
area = Area(Geometry=rectangle.Rectangle)  # -> Area, Centroid

# ---- group: B3: Adjustable parameters
x_size_property = Panel(panel)
xmin_property = Panel(number_slider)
addition = Addition(A=xmin_property, B=x_size_property)
ymin_property = Panel(number_slider_2)
x_size = Slider(36, range=20..40)
x_size_2 = Panel(x_size)
subtraction = Subtraction(A=addition, B=x_size_2)
y_size = Slider(16, range=5..20)
construct_point_2 = ConstructPoint(XCoordinate=subtraction, YCoordinate=ymin_property, ZCoordinate=0)
rectangle_2 = Rectangle(Plane=construct_point_2, XSize=x_size, YSize=y_size, Radius=0)  # -> Rectangle, Length
area_2 = Area(Geometry=rectangle_2.Rectangle)  # -> Area, Centroid
numberoffloors = Slider(7, range=2..7)
buildingtype = Slider(4, range=1..5)
materialtype = Slider(1, range=1..5)
xspacing = Slider(7, range=5..10)
yspacing = Slider(5, range=5..10)
buildingfootprintcurve = Curve(rectangle_2.Rectangle)
floorheight_m = Panel("3")

# ---- group: B1
# description of materialTypes: materialType 1: CLT for slabs and walls, GL32C for columns and beams
# materialType 2: precast C30/37 for all elements
# materialtype 3: precast C30/37 HCS and walls, steel beams and columns
# materialType 4: on-site-cast C30/37 for all elements
# description of buildingTypes: buildingType 1: slabs + walls in primary direction
# buildingType 2: slabs + inner walls, outer columns and outer primary beams
# buildingtype 3: slabs + columns, primary- and transverse beams
# buildingType 4: slabs + columns, primary beams if slabThickness < 200 mm
yspacing_2 = Slider(5, range=5..10)
xspacing_2 = Slider(6, range=5..10)
numberoffloors_2 = Slider(7, range=2..7)
xsize_b1 = Slider(13, range=5..20)
ysize_b1 = Slider(24, range=20..40)
xmin_ymin_for_b1_point = Point(construct_point)
rectangle_3 = Rectangle(Plane=xmin_ymin_for_b1_point, XSize=xsize_b1, YSize=ysize_b1, Radius=0)  # -> Rectangle, Length
area_3 = Area(Geometry=rectangle_3.Rectangle)  # -> Area, Centroid
buildingfootprintcurve_2 = Curve(rectangle_3.Rectangle)
floorheight_m_2 = Panel("3")

# ----
buildingtype_2 = Slider(4, range=1..4)
materialtype_2 = Slider(1, range=1..4)

# ---- group: evaluates main direction
c_script = CSharpScript(xSpacing=xspacing, ySpacing=yspacing)  # -> out, mainDirection; inputs xSpacing: Double, ySpacing: Double
# ---------- c_script: C# ----------
using System;
using System.Linq;
using System.Collections;
using System.Collections.Generic;
using System.Drawing;

using Rhino;
using Rhino.Geometry;

using Grasshopper;
using Grasshopper.Kernel;
using Grasshopper.Kernel.Data;
using Grasshopper.Kernel.Types;


public class Script_Instance : GH_ScriptInstance
{
    #region Notes
    #endregion

    private void RunScript(
	double xSpacing,
	double ySpacing,
	ref object mainDirection)
    {
        if (xSpacing > ySpacing)
        {
            mainDirection = "x direction";
        }
        else
        {
            mainDirection = "y direction";
        }
    }
}
# ---------- end c_script ----------

c_script_2 = CSharpScript(xSpacing=xspacing_2, ySpacing=yspacing_2)  # -> out, mainDirection; inputs xSpacing: Double, ySpacing: Double; same code as c_script

# ----
maindirectiontext = Text(c_script.mainDirection)
maindirectiontext_2 = Text(c_script_2.mainDirection)
csharp_script = CSharpScript(
    buildingFootPrint=buildingfootprintcurve,
    xSpacing=xspacing,
    ySpacing=yspacing,
    floors=numberoffloors,
    floorHeight=floorheight_m,
    mainDirection=maindirectiontext)  # -> out, xLinesTree, yLinesTree, zLinesTree; inputs buildingFootPrint: Curve, xSpacing: Double, ySpacing: Double, floors: Int32, floorHeight: Double, mainDirection: String
# ---------- csharp_script: C# ----------
// Grasshopper Script Instance
using System;
using System.Collections;
using System.Collections.Generic;
using System.Drawing;
 
using Rhino;
using Rhino.Geometry;
 
using Grasshopper;
using Grasshopper.Kernel;
using Grasshopper.Kernel.Data;
using Grasshopper.Kernel.Types;
using System.Linq;
 
public class Script_Instance : GH_ScriptInstance
{
 
  private void RunScript(
	Curve buildingFootPrint,
	double xSpacing,
	double ySpacing,
	int floors,
	double floorHeight,
	string mainDirection,
	ref object xLinesTree,
	ref object yLinesTree,
	ref object zLinesTree)
 
{
    //GRID
    //x, y intervals
    BoundingBox bb = buildingFootPrint.GetBoundingBox(true);
    Point3d cptmax = bb.Max;
    Point3d cptmin = bb.Min;
    double xmin = cptmin.X;
    double xmax = cptmax.X;
    double ymin = cptmin.Y;
    double ymax = cptmax.Y;
    double xdomain = xmax - xmin;
    double ydomain = ymax - ymin;
    int numberOfStepsX = Convert.ToInt32(Math.Round(xdomain/xSpacing));
    int numberOfStepsY = Convert.ToInt32(Math.Round(ydomain/ySpacing)); 

    // VerticeNodes from buildingFootPrint
    buildingFootPrint.TryGetPolyline(out Polyline polyline);
    List<Point3d> verticeNodes = polyline.ToList();

    //coordinates
    List<double> xValues = new List<double>();
    for (int i = 0; i < numberOfStepsX + 1; i++)
    {
        if (i < numberOfStepsX)
        {
            xValues.Add(xmin + i*xSpacing);
        }
        else
        {
            double secLastValue = xmin + i*xSpacing;
            double lastValue = xmax;
            if (lastValue - secLastValue <= 1)
            {
                xValues.Add(xmax);                
            }
            else
            {
                xValues.Add(xmin + i*xSpacing);
                xValues.Add(xmax);                 
            }
        }
    } 

    List<double> yValues = new List<double>();
    for (int i = 0; i < numberOfStepsY + 1; i++)
    {
        if (i < numberOfStepsY)
        {
            yValues.Add(ymin + i*ySpacing);
        }
        else
        {
            double secLastValue = ymin + i*ySpacing;
            double lastValue = ymax;
            if (lastValue - secLastValue <= 1)
            {
                yValues.Add(ymax);                
            }
            else
            {
                yValues.Add(ymin + i*ySpacing);
                yValues.Add(ymax);                 
            }
        }
    }


    //nodes by spacing
    List<Point3d> spacingNodes = new List<Point3d>();
    foreach (double x in xValues)
    {  
        foreach (double y in yValues)
        {
            Point3d spacingPt = new Point3d(x, y, 0);
            if (buildingFootPrint.Contains(spacingPt) == PointContainment.Coincident || buildingFootPrint.Contains(spacingPt) == PointContainment.Inside)
            {
                spacingNodes.Add(spacingPt);
            }
        }
    }

    //edgeNodes by spacing
    List<Line> xGrid = new List<Line>();
    foreach (double x in xValues)
    {
        Point3d startPointx = new Point3d(x, ymin, 0); 
        Point3d endPointx = new Point3d(x, ymax, 0);
        Line xLine = new Line(startPointx, endPointx);
        xGrid.Add(xLine);
    }

    List<Line> yGrid = new List<Line>();
    foreach (double y in yValues)
    {
        Point3d startPointy = new Point3d(xmin, y, 0); 
        Point3d endPointy = new Point3d(xmax, y, 0);
        Line yLine = new Line(startPointy, endPointy);
        yGrid.Add(yLine);
    }

    List<Point3d> intPts = new List<Point3d>();
    foreach (Line gridLine in xGrid)
    {
        Rhino.Geometry.Intersect.CurveIntersections intersections = Rhino.Geometry.Intersect.Intersection.CurveLine(buildingFootPrint, gridLine, 0.01, 0.01);
        foreach (Rhino.Geometry.Intersect.IntersectionEvent intEvent in intersections)
        {
            if (intEvent.IsPoint)
            {
                Point3d intPt = StandardizePoint(intEvent.PointA);
                intPts.Add(intPt); 
            }
        }   
    }

    foreach (Line gridLine in yGrid)
    {   
        Rhino.Geometry.Intersect.CurveIntersections intersections = Rhino.Geometry.Intersect.Intersection.CurveLine(buildingFootPrint, gridLine, 0.01, 0.01);
        foreach (Rhino.Geometry.Intersect.IntersectionEvent intEvent in intersections)
        {
            if (intEvent.IsPoint)
            {
                Point3d intPt = StandardizePoint(intEvent.PointA);
                intPts.Add(intPt); 
            }
        }
    }

    //all nodes unsorted
    List<Point3d> mergedList = new List<Point3d>();
    mergedList.AddRange(spacingNodes);
    mergedList.AddRange(verticeNodes);
    mergedList.AddRange(intPts);
    List<Point3d> allNodesUnsorted = RemoveDuplicateNodes(mergedList, 0.1);
    allNodesUnsorted = allNodesUnsorted.Select(p => new Point3d(p.X, p.Y, p.Z)).ToList();
   
    //creates datatree with branches {xrow}
    DataTree<Point3d> ptsByX = new DataTree<Point3d>();
    var groupsByX = allNodesUnsorted.GroupBy(p => p.X).OrderBy(g => g.Key);
    int pathIndexX = 0;
    foreach (var group in groupsByX)
    {
        List<Point3d> sortedPoints = group.OrderBy(p => p.Y).ToList();
        GH_Path path = new GH_Path(pathIndexX++);
        ptsByX.AddRange(sortedPoints, path);
    }

    //creates datatree with branches {yrow}
    DataTree<Point3d> ptsByY = new DataTree<Point3d>();
    var groupsByY = allNodesUnsorted.GroupBy(p => p.Y).OrderBy(g => g.Key);
    int pathIndexY = 0;
    foreach (var group in groupsByY)
    {
        List<Point3d> sortedPoints = group.OrderBy(p => p.X).ToList();
        GH_Path path = new GH_Path(pathIndexY++);
        ptsByY.AddRange(sortedPoints, path);
    }

    //list of z-values for each floor
    List<double> zVals = new List<double>();
    for (int i = 0; i <= floors; i++)
    {
        double zVal = i*floorHeight;
        zVals.Add(zVal);
    }

    //creates datatree with branches {floor;row}
    DataTree<Point3d> rowByXTree = new DataTree<Point3d>();
    DataTree<Point3d> rowByYTree = new DataTree<Point3d>();
    int level = 0;
    foreach(double zVal in zVals)
    {
        for (int j = 0; j < ptsByX.BranchCount; j++)
        {
            for (int k = 0 ; k < ptsByX.Branch(j).Count; k++)
            {
                Point3d pt = new Point3d(ptsByX.Branch(j)[k].X, ptsByX.Branch(j)[k].Y, zVal);
                rowByXTree.Add(pt, new GH_Path(level, j));
            }
        }  
        for (int j = 0; j < ptsByY.BranchCount; j++)
        {
            for (int k = 0 ; k < ptsByY.Branch(j).Count; k++)
            {
                Point3d pt = new Point3d(ptsByY.Branch(j)[k].X, ptsByY.Branch(j)[k].Y, zVal);
                rowByYTree.Add(pt, new GH_Path(level, j));
            }
        } 
        level++;
    }

/*    
    //beams in x-direction (polybeams and beam segments)
    DataTree<Polyline> polyBeamsInX = new DataTree<Polyline>();
    DataTree<Line> segmentedBeamsInX =  new DataTree<Line>();
    for (int i = 1; i < rowByYTree.BranchCount; i++)
    {
        GH_Path floorPath = new GH_Path(i);  
        int branchIndexPolyX = 0;
 
        while (rowByYTree.PathExists(new GH_Path(i, branchIndexPolyX)))
        {
            GH_Path path = new GH_Path(i, branchIndexPolyX);
            List<Point3d> pointsInRow = rowByYTree.Branch(path);
 
            if (pointsInRow.Count > 1)
            {
                Polyline plyline = new Polyline(pointsInRow);
                List<Line> linesInside = new List<Line>();
                for (int ps =0; ps < plyline.SegmentCount ; ps++)
                {
                    Line singleLine = plyline.SegmentAt(ps);
                    Point3d testPoint = singleLine.PointAt(0.5);
                    PointContainment pc = buildingFootPrint.Contains(testPoint);
                    if (pc == PointContainment.Inside || pc == PointContainment.Coincident)
                    {  
                        linesInside.Add(singleLine);
                    }
                }
                Polyline[] pl1 = Polyline.CreateByJoiningLines(linesInside, 0.0001, false);
 
                polyBeamsInX.AddRange(pl1, path);
               
                Line[] lineSegmentY = plyline.GetSegments();
                foreach (Line segment in lineSegmentY)
                {
                    if (segment.Length <= xSpacing+1)
                    {
                        if (buildingFootPrint.Contains(segment.PointAt(0.5)) == PointContainment.Inside || buildingFootPrint.Contains(segment.PointAt(0.5)) == PointContainment.Coincident)
                        {
                            segmentedBeamsInX.Add(segment,path);
                        }
                    }
                }          
            }        
            branchIndexPolyX++;  
        }
    }

    //beams in y-direction (polybeams and beam segments)
    DataTree<Polyline> polyBeamsInY = new DataTree<Polyline>();
    DataTree<Line> segmentedBeamsInY =  new DataTree<Line>(); 
    for (int i = 1; i < rowByXTree.BranchCount; i++)
    {
        GH_Path floorPath = new GH_Path(i);  
        int branchIndexPolyY = 0;
 
        while (rowByXTree.PathExists(new GH_Path(i, branchIndexPolyY)))
        {
            GH_Path path = new GH_Path(i, branchIndexPolyY);
            List<Point3d> pointsInRow = rowByXTree.Branch(path);
 
            if (pointsInRow.Count > 1)
            {
                Polyline plyline = new Polyline(pointsInRow);
                List<Line> linesInside = new List<Line>();
                for (int ps =0; ps < plyline.SegmentCount ; ps++)
                {
                    Line singleLine = plyline.SegmentAt(ps);
                    Point3d testPoint = singleLine.PointAt(0.5);
                    PointContainment pc = buildingFootPrint.Contains(testPoint);
                    if (pc == PointContainment.Inside || pc == PointContainment.Coincident)
                    {  
                        linesInside.Add(singleLine);
                    }
                }
                Polyline[] pl1 = Polyline.CreateByJoiningLines(linesInside, 0.0001, false);
 
                polyBeamsInY.AddRange(pl1, path);
 
                Line[] lineSegmentX = plyline.GetSegments();
                foreach (Line segment in lineSegmentX)
                {
                    if (segment.Length <= ySpacing+1)
                    {
                        if (buildingFootPrint.Contains(segment.PointAt(0.5)) == PointContainment.Inside || buildingFootPrint.Contains(segment.PointAt(0.5)) == PointContainment.Coincident)
                        {
                            segmentedBeamsInY.Add(segment,path);
                        }
                    }     
                }
            }
            branchIndexPolyY++;  
        }
    }
    */

    //beams in x-direction (polybeams and beam segments)
    DataTree<Line> segmentedBeamsInX = new DataTree<Line>();
    foreach (GH_Path path in rowByYTree.Paths)
    {
        List<Point3d> pointsInRow = rowByYTree.Branch(path);
        List<Line> lineSegments = new List<Line>();
        for (int i = 0; i < pointsInRow.Count - 1; i++)
        { 
            Point3d currPt = pointsInRow[i];
            Point3d nextPt = pointsInRow[i + 1];
            Line beam = new Line(currPt, nextPt);
            Point3d midPt = beam.PointAt(0.5);

        if ((buildingFootPrint.Contains(midPt) == PointContainment.Coincident || buildingFootPrint.Contains(midPt) == PointContainment.Inside) && beam.Length <= xSpacing + 1)
            {
                lineSegments.Add(beam);
            }
        }
        segmentedBeamsInX.AddRange(lineSegments, path);
    }

    //beams in y-direction (polybeams and beam segments)
    DataTree<Line> segmentedBeamsInY = new DataTree<Line>();
    foreach (GH_Path path in rowByXTree.Paths)
    {
        List<Point3d> pointsInRow = rowByXTree.Branch(path);
        List<Line> lineSegments = new List<Line>();
        for (int i = 0; i < pointsInRow.Count - 1; i++)
        { 
            Point3d currPt = pointsInRow[i];
            Point3d nextPt = pointsInRow[i + 1];
            Line beam = new Line(currPt, nextPt);
            Point3d midPt = beam.PointAt(0.5);

        if ((buildingFootPrint.Contains(midPt) == PointContainment.Coincident || buildingFootPrint.Contains(midPt) == PointContainment.Inside) && beam.Length <= ySpacing + 1)
            {
                lineSegments.Add(beam);
            }
        }
        segmentedBeamsInY.AddRange(lineSegments, path);
    }

    //column segments by floor
    DataTree<Line> segmentedColumnsInZ =  new DataTree<Line>();
    if (mainDirection == "x direction")
    {        
        for (int j = 0; j < rowByXTree.BranchCount; j++)
        {
            GH_Path currentPath = rowByXTree.Paths[j];
            List<Point3d> currentBranchPoints = rowByXTree.Branch(currentPath);
            for (int k = 0; k < currentBranchPoints.Count; k++)
            {
                    GH_Path nextFloorPath = new GH_Path(currentPath.Indices[0] + 1, currentPath.Indices[1]);
                    if (rowByXTree.PathExists(nextFloorPath))
                    {
                        List<Point3d> nextBranchPoints = rowByXTree.Branch(nextFloorPath);
                    
                        if (k < nextBranchPoints.Count)
                        {
                            Line verticalLine = new Line(currentBranchPoints[k], nextBranchPoints[k]);
                            segmentedColumnsInZ.Add(verticalLine, currentPath);
                        }      
                    }
            }
        }
    }

    else if (mainDirection == "y direction")
    {       
        for (int j = 0; j < rowByYTree.BranchCount; j++)
        {
            GH_Path currentPath = rowByYTree.Paths[j];
            List<Point3d> currentBranchPoints = rowByYTree.Branch(currentPath);
            for (int k = 0; k < currentBranchPoints.Count; k++)
            {
                    GH_Path nextFloorPath = new GH_Path(currentPath.Indices[0] + 1, currentPath.Indices[1]);
                    if (rowByYTree.PathExists(nextFloorPath))
                    {
                        List<Point3d> nextBranchPoints = rowByYTree.Branch(nextFloorPath);
                    
                        if (k < nextBranchPoints.Count)
                        {
                            Line verticalLine = new Line(currentBranchPoints[k], nextBranchPoints[k]);
                            segmentedColumnsInZ.Add(verticalLine, currentPath);
                        }      
                    }
            }
        }
    }

    //OUTPUTS
    xLinesTree = segmentedBeamsInX;
    yLinesTree = segmentedBeamsInY;
    zLinesTree = segmentedColumnsInZ;
}
 
//method: removes node duplicates in a list of points
List<Point3d> RemoveDuplicateNodes(List<Point3d> nodeList, double tolerance)
{
    var comparer = new Point3dEqualityComparer(tolerance);
    var uniqueNodes = new HashSet<Point3d>(nodeList, comparer);
    return uniqueNodes.ToList();
}

//IEqualityComparer to compare Point3d with a tolerance
public class Point3dEqualityComparer : IEqualityComparer<Point3d>
{
    private readonly double _tolerance;

    public Point3dEqualityComparer(double tolerance)
    {
        _tolerance = tolerance;
    }

    public bool Equals(Point3d x, Point3d y)
    {
        return x.DistanceToSquared(y) < _tolerance * _tolerance;
    }

    public int GetHashCode(Point3d obj)
    {
        int hashX = Convert.ToInt32(Math.Round(obj.X / _tolerance));
        int hashY = Convert.ToInt32(Math.Round(obj.Y / _tolerance));
        int hashZ = Convert.ToInt32(Math.Round(obj.Z / _tolerance));
        return hashX ^ hashY ^ hashZ;
    }
}

//method: avoids duplicate points beacuse of rounding
public Point3d StandardizePoint(Point3d point)
{
    double x = Math.Round(point.X, 1, MidpointRounding.AwayFromZero);
    double y = Math.Round(point.Y, 1, MidpointRounding.AwayFromZero);
    double z = Math.Round(point.Z, 1, MidpointRounding.AwayFromZero); 

    return new Point3d(x, y, z);
}

//method to customize grid of points to vertices and spacing
List<double> GenerateAdjustedValues(double min, int numberOfSteps, double spacing, List<Point3d> vertices, char axis, double max) 
{
    List<double> values = new List<double>();
    double current = min;

    for (int i = 0; i <= numberOfSteps; i++) 
    {
        double target = min + i * spacing;

        Point3d? closestVertice = vertices
            .Select(v => new { Vertice = v, Distance = Math.Abs((axis == 'X' ? v.X : v.Y) - target) })
            .Where(v => v.Distance <= 1.0)
            .OrderBy(v => v.Distance)
            .FirstOrDefault()?.Vertice;

        if (closestVertice.HasValue) 
        {
            current = (axis == 'X' ? closestVertice.Value.X : closestVertice.Value.Y);
        } 
        else 
        {
            current = target;
        }

        if (values.Count > 0 && Math.Abs(current - values.Last()) < spacing) 
        {
           
            current = values.Last() + spacing;
        }

        if (i == 0 || Math.Abs(current - values.Last()) >= spacing) 
        {
            values.Add(current);
        }
    }

    if (values.Count > 1 && Math.Abs(max - numberOfSteps ) <= 1) 
    {
        values.RemoveAt(values.Count - 2);
    }

    return values;
}
/*
List<double> GenerateAdjustedValues(double min, int numberOfSteps, double spacing, List<Point3d> vertices, char axis) 
{
    List<double> values = new List<double>();
    double current = min;

    for (int i = 0; i <= numberOfSteps; i++) 
    {
        double target = min + i * spacing;

        Point3d? closestVertice = vertices
            .Select(v => new { Vertice = v, Distance = Math.Abs((axis == 'X' ? v.X : v.Y) - target) })
            .Where(v => v.Distance <= 1.0)
            .OrderBy(v => v.Distance)
            .FirstOrDefault()?.Vertice;

        if (closestVertice.HasValue) 
        {
            current = (axis == 'X' ? closestVertice.Value.X : closestVertice.Value.Y);
        } 
        else 
        {
            current = target;
        }

        if (values.Count > 0 && Math.Abs(current - values.Last()) < spacing) 
        {
           
            current = values.Last() + spacing;
        }

        if (i == 0 || Math.Abs(current - values.Last()) >= spacing) 
        {
            values.Add(current);
        }
    }

    if (values.Count > 1 && Math.Abs(values[values.Count - 1] - values[values.Count - 2]) <= 1) 
    {
        values.RemoveAt(values.Count - 2);
    }

    return values;
}
*/


}
# ---------- end csharp_script ----------
csharp_script_2 = CSharpScript(
    buildingFootPrint=buildingfootprintcurve_2,
    xSpacing=xspacing_2,
    ySpacing=yspacing_2,
    floors=numberoffloors_2,
    floorHeight=floorheight_m_2,
    mainDirection=maindirectiontext_2)  # -> out, xLinesTree, yLinesTree, zLinesTree; inputs buildingFootPrint: Curve, xSpacing: Double, ySpacing: Double, floors: Int32, floorHeight: Double, mainDirection: String; same code as csharp_script
ylinetree = Line(csharp_script.yLinesTree)
xlinetree = Line(csharp_script.xLinesTree)
zlinetree = Line(csharp_script.zLinesTree)
zlinetree_2 = Line(csharp_script_2.zLinesTree)
xlinetree_2 = Line(csharp_script_2.xLinesTree)
ylinetree_2 = Line(csharp_script_2.yLinesTree)
ylinetree_3 = Line(ylinetree_2)
ylinetree_4 = Line(ylinetree)
xlinetree_3 = Line(xlinetree_2)
xlinetree_4 = Line(xlinetree)
zlinetree_3 = Line(zlinetree_2)
zlinetree_4 = Line(zlinetree)
buildingfootprint = Curve(buildingfootprintcurve_2)
buildingfootprint_2 = Curve(buildingfootprintcurve)
xlinestree = Line(xlinetree_2)
ylinestree = Line(ylinetree_2)

# ---- group: divideZLinesPrMeter
c_script_3 = CSharpScript(line=graft(zlinetree_3))  # -> out, startPt, endPt; inputs line: tree of Line
# ---------- c_script_3: C# ----------
using System;
using System.Linq;
using System.Collections;
using System.Collections.Generic;
using System.Drawing;

using Rhino;
using Rhino.Geometry;

using Grasshopper;
using Grasshopper.Kernel;
using Grasshopper.Kernel.Data;
using Grasshopper.Kernel.Types;


public class Script_Instance : GH_ScriptInstance
{


    private void RunScript(
	DataTree<Line> line,
	ref object startPt,
	ref object endPt)
{
    DataTree<Point3d> startPoints = new DataTree<Point3d>();
    DataTree<Point3d> endPoints = new DataTree<Point3d>();

    for (int i = 0; i < line.BranchCount; i++)
    {
        GH_Path path = line.Path(i);
        List<Line> lines = line.Branch(i);

        for (int j = 0; j < lines.Count; j++)
        {
            startPoints.Add(lines[j].From, path);
            endPoints.Add(lines[j].To, path);
        }
    }
    startPt = startPoints;
    endPt = endPoints;
}
}
# ---------- end c_script_3 ----------
divide_length = DivideLength(Curve=zlinetree_3, Length="1")  # -> Points, Tangents, Parameters
merge = Merge(Data1=c_script_3.startPt, Data2=divide_length.Points, Data3=c_script_3.endPt)
cull_duplicates = CullDuplicates(Points=merge, Tolerance=0.1, CullMode=3)  # -> Points, Indices, Valence
polyline = PolyLine(Vertices=cull_duplicates.Points, Closed=False)  # -> simplify(Polyline)
zsegmentpoints = Point(simplify(cull_duplicates.Points))
explode = Explode(Curve=polyline, Recursive=True)  # -> simplify(Segments), Vertices
trim_tree = TrimTree(Tree=zsegmentpoints, Depth="2")
trim_tree_2 = TrimTree(Tree=explode.Segments, Depth="2")

# ---- group: divideXLinesPrMeter
c_script_4 = CSharpScript(line=graft(xlinetree_3))  # -> out, startPt, endPt; inputs line: tree of Line; same code as c_script_3
divide_length_2 = DivideLength(Curve=xlinetree_3, Length="1")  # -> Points, Tangents, Parameters
merge_2 = Merge(Data1=c_script_4.startPt, Data2=divide_length_2.Points, Data3=c_script_4.endPt)
cull_duplicates_2 = CullDuplicates(Points=merge_2, Tolerance=0.1, CullMode=3)  # -> Points, Indices, Valence
polyline_2 = PolyLine(Vertices=cull_duplicates_2.Points, Closed=False)  # -> simplify(Polyline)
xsegmentpoints = Point(simplify(cull_duplicates_2.Points))
explode_2 = Explode(Curve=polyline_2, Recursive=True)  # -> simplify(Segments), Vertices

# ----
xlinestree_2 = Line(xlinetree)
ylinestree_2 = Line(ylinetree)

# ---- group: divideZLinesPrMeter
c_script_5 = CSharpScript(line=graft(zlinetree_4))  # -> out, startPt, endPt; inputs line: tree of Line; same code as c_script_3
divide_length_3 = DivideLength(Curve=zlinetree_4, Length="1")  # -> Points, Tangents, Parameters
merge_3 = Merge(Data1=c_script_5.startPt, Data2=divide_length_3.Points, Data3=c_script_5.endPt)
cull_duplicates_3 = CullDuplicates(Points=merge_3, Tolerance=0.1, CullMode=3)  # -> Points, Indices, Valence
polyline_3 = PolyLine(Vertices=cull_duplicates_3.Points, Closed=False)  # -> simplify(Polyline)
zsegmentpoints_2 = Point(simplify(cull_duplicates_3.Points))
explode_3 = Explode(Curve=polyline_3, Recursive=True)  # -> simplify(Segments), Vertices
trim_tree_3 = TrimTree(Tree=zsegmentpoints_2, Depth="2")
trim_tree_4 = TrimTree(Tree=explode_3.Segments, Depth="2")

# ---- group: divideYLinesPrMeter
c_script_6 = CSharpScript(line=graft(ylinetree_4))  # -> out, startPt, endPt; inputs line: tree of Line; same code as c_script_3
divide_length_4 = DivideLength(Curve=ylinetree_4, Length="1")  # -> Points, Tangents, Parameters
merge_4 = Merge(Data1=c_script_6.startPt, Data2=divide_length_4.Points, Data3=c_script_6.endPt)
cull_duplicates_4 = CullDuplicates(Points=merge_4, Tolerance=0.1, CullMode=3)  # -> Points, Indices, Valence
polyline_4 = PolyLine(Vertices=cull_duplicates_4.Points, Closed=False)  # -> simplify(Polyline)
ysegmentpoints = Point(simplify(cull_duplicates_4.Points))
explode_4 = Explode(Curve=polyline_4, Recursive=True)  # -> simplify(Segments), Vertices

# ---- group: divideXLinesPrMeter
c_script_7 = CSharpScript(line=graft(xlinetree_4))  # -> out, startPt, endPt; inputs line: tree of Line; same code as c_script_3
divide_length_5 = DivideLength(Curve=xlinetree_4, Length="1")  # -> Points, Tangents, Parameters
merge_5 = Merge(Data1=c_script_7.startPt, Data2=divide_length_5.Points, Data3=c_script_7.endPt)
cull_duplicates_5 = CullDuplicates(Points=merge_5, Tolerance=0.1, CullMode=3)  # -> Points, Indices, Valence
polyline_5 = PolyLine(Vertices=cull_duplicates_5.Points, Closed=False)  # -> simplify(Polyline)
xsegmentpoints_2 = Point(simplify(cull_duplicates_5.Points))
explode_5 = Explode(Curve=polyline_5, Recursive=True)  # -> simplify(Segments), Vertices
trim_tree_5 = TrimTree(Tree=xsegmentpoints_2, Depth="2")
trim_tree_6 = TrimTree(Tree=explode_5.Segments, Depth="2")

# ---- group: floors
trim_tree_7 = TrimTree(Tree=xlinestree, Depth=1)
trim_tree_8 = TrimTree(Tree=ylinestree, Depth=1)
boundary_surfaces = BoundarySurfaces(Edges=buildingfootprint)
tree_branch = TreeBranch(Tree=trim_tree_7, Path="1", MaintainPaths=True)
tree_branch_2 = TreeBranch(Tree=trim_tree_8, Path="1", MaintainPaths=True)
numberoffloors_3 = Number(numberoffloors_2)
floorheight = Number(floorheight_m_2)
project = Project(Geometry=flatten([tree_branch, tree_branch_2]), Plane=PlaneXY(0, 0, 0))  # -> Geometry, Transform
project_2 = Project(Geometry=boundary_surfaces, Plane=PlaneXY(0, 0, 0))  # -> Geometry, Transform
series = Series(Start=floorheight, Step=floorheight, Count=numberoffloors_3)
surface_split = SurfaceSplit(Surface=project_2.Geometry, Curves=project.Geometry)
unit_z = UnitZ(Factor=series)
move = Move(Geometry=surface_split, Motion=simplify(graft(unit_z)))  # -> simplify(Geometry), Transform

trim_tree_9 = TrimTree(Tree=xlinestree_2, Depth=1)
trim_tree_10 = TrimTree(Tree=ylinestree_2, Depth=1)
boundary_surfaces_2 = BoundarySurfaces(Edges=buildingfootprint_2)
tree_branch_3 = TreeBranch(Tree=trim_tree_9, Path="1", MaintainPaths=True)
tree_branch_4 = TreeBranch(Tree=trim_tree_10, Path="1", MaintainPaths=True)
numberoffloors_4 = Number(numberoffloors)
floorheight_2 = Number(floorheight_m_2)
project_3 = Project(Geometry=flatten([tree_branch_3, tree_branch_4]), Plane=PlaneXY(0, 0, 0))  # -> Geometry, Transform
project_4 = Project(Geometry=boundary_surfaces_2, Plane=PlaneXY(0, 0, 0))  # -> Geometry, Transform
series_2 = Series(Start=floorheight_2, Step=floorheight_2, Count=numberoffloors_4)
surface_split_2 = SurfaceSplit(Surface=project_4.Geometry, Curves=project_3.Geometry)
unit_z_2 = UnitZ(Factor=series_2)
move_2 = Move(Geometry=surface_split_2, Motion=simplify(graft(unit_z_2)))  # -> simplify(Geometry), Transform

# ----
xlinetree_5 = Line(xlinetree_2)
ylinetree_5 = Line(ylinetree_2)
xlinetree_6 = Line(xlinetree)
ylinetree_6 = Line(ylinetree)

# ---- group: xWalls, yWalls
cluster = Cluster_2(tree=xlinetree_5)  # -> geometry, tree_2
cluster_2 = Cluster_2(tree=ylinetree_5)  # -> geometry, tree_2
c_script_8 = CSharpScript(floorLines=cluster.geometry, linesByFloorTree=cluster.tree_2)  # -> out, xwalls; inputs floorLines: list of Line, linesByFloorTree: tree of Line
# ---------- c_script_8: C# ----------
// Grasshopper Script Instance
#region Usings
using System;
using System.Linq;
using System.Collections;
using System.Collections.Generic;
using System.Drawing;

using Rhino;
using Rhino.Geometry;

using Grasshopper;
using Grasshopper.Kernel;
using Grasshopper.Kernel.Data;
using Grasshopper.Kernel.Types;
#endregion

public class Script_Instance : GH_ScriptInstance
{
    #region Notes
    /* 
      Members:
        RhinoDoc RhinoDocument
        GH_Document GrasshopperDocument
        IGH_Component Component
        int Iteration

      Methods (Virtual & overridable):
        Print(string text)
        Print(string format, params object[] args)
        Reflect(object obj)
        Reflect(object obj, string method_name)
    */
    #endregion

    private void RunScript(
	List<Line> floorLines,
	DataTree<Line> linesByFloorTree,
	ref object xwalls)
    {
        DataTree<Brep> walls = new DataTree<Brep>();
        //linesByFloorTree.AddRange(floorLines, new GH_Path(0));
        for (int i = 0; i < linesByFloorTree.BranchCount - 1; i++)
        {
            List<Line> currentFloorLines = linesByFloorTree.Branch(i);
            List<Line> nextFloorLines = linesByFloorTree.Branch(i + 1);
            
            GH_Path floorPath = new GH_Path(i); 

            for (int j = 0; j < currentFloorLines.Count; j++)
            {
                Line upperLine = currentFloorLines[j];
                if (j < nextFloorLines.Count)
                {
                    Line lowerLine = nextFloorLines[j];

                    List<Curve> crvs = new List<Curve>{upperLine.ToNurbsCurve(), lowerLine.ToNurbsCurve()};
                    Brep[] bs = Brep.CreateFromLoft(crvs, Point3d.Unset, Point3d.Unset, LoftType.Normal, false);

                    if (bs != null && bs.Length > 0)
                    {
                        walls.Add(bs[0], floorPath); 
                    }
                }
            }
        }
        xwalls = walls; 
    }
}
# ---------- end c_script_8 ----------
c_script_9 = CSharpScript(floorLines=cluster_2.geometry, linesByFloorTree=cluster_2.tree_2)  # -> out, ywalls; inputs floorLines: list of Line, linesByFloorTree: tree of Line
# ---------- c_script_9: C# ----------
// Grasshopper Script Instance
#region Usings
using System;
using System.Linq;
using System.Collections;
using System.Collections.Generic;
using System.Drawing;

using Rhino;
using Rhino.Geometry;

using Grasshopper;
using Grasshopper.Kernel;
using Grasshopper.Kernel.Data;
using Grasshopper.Kernel.Types;
#endregion

public class Script_Instance : GH_ScriptInstance
{
    #region Notes
    /* 
      Members:
        RhinoDoc RhinoDocument
        GH_Document GrasshopperDocument
        IGH_Component Component
        int Iteration

      Methods (Virtual & overridable):
        Print(string text)
        Print(string format, params object[] args)
        Reflect(object obj)
        Reflect(object obj, string method_name)
    */
    #endregion

    private void RunScript(
	List<Line> floorLines,
	DataTree<Line> linesByFloorTree,
	ref object ywalls)
    {
        DataTree<Brep> walls = new DataTree<Brep>();
        //linesByFloorTree.AddRange(floorLines, new GH_Path(0));
        for (int i = 0; i < linesByFloorTree.BranchCount - 1; i++)
        {
            List<Line> currentFloorLines = linesByFloorTree.Branch(i);
            List<Line> nextFloorLines = linesByFloorTree.Branch(i + 1);
            
            GH_Path floorPath = new GH_Path(i); 

            for (int j = 0; j < currentFloorLines.Count; j++)
            {
                Line upperLine = currentFloorLines[j];
                if (j < nextFloorLines.Count)
                {
                    Line lowerLine = nextFloorLines[j];

                    List<Curve> crvs = new List<Curve>{upperLine.ToNurbsCurve(), lowerLine.ToNurbsCurve()};
                    Brep[] bs = Brep.CreateFromLoft(crvs, Point3d.Unset, Point3d.Unset, LoftType.Normal, false);

                    if (bs != null && bs.Length > 0)
                    {
                        walls.Add(bs[0], floorPath); 
                    }
                }
            }
        }
        ywalls = walls;
    }
}
# ---------- end c_script_9 ----------

cluster_3 = Cluster_2(tree=xlinetree_6)  # -> geometry, tree_2
cluster_4 = Cluster_2(tree=ylinetree_6)  # -> geometry, tree_2
c_script_10 = CSharpScript(floorLines=cluster_3.geometry, linesByFloorTree=cluster_3.tree_2)  # -> out, xwalls; inputs floorLines: list of Line, linesByFloorTree: tree of Line; same code as c_script_8
c_script_11 = CSharpScript(floorLines=cluster_4.geometry, linesByFloorTree=cluster_4.tree_2)  # -> out, ywalls; inputs floorLines: list of Line, linesByFloorTree: tree of Line; same code as c_script_9

# ---- group: zElements
zlinetree_5 = Line(zlinetree_2)
trim_tree_11 = TrimTree(Tree=zlinetree_5, Depth="1")

# ---- group: evaluates slab thickness
c_script_12 = CSharpScript(xSpacing=xspacing_2, ySpacing=yspacing_2, materialType=materialtype_2)  # -> out, slabThickness; inputs xSpacing: Double, ySpacing: Double, materialType: Int32
# ---------- c_script_12: C# ----------
using System;
using System.Linq;
using System.Collections;
using System.Collections.Generic;
using System.Drawing;

using Rhino;
using Rhino.Geometry;

using Grasshopper;
using Grasshopper.Kernel;
using Grasshopper.Kernel.Data;
using Grasshopper.Kernel.Types;

public class Script_Instance : GH_ScriptInstance
{
    private void RunScript(
	double xSpacing,
	double ySpacing,
	int materialType,
	ref object slabThickness)
    {

    double span = Math.Min(xSpacing, ySpacing);

    if (materialType == 4) //CLT
    {
        if (span == 5)
        {
            slabThickness = 0.16;
        }
        else if (span > 5 && span <= 5.5 )
        {
            slabThickness = 0.175;
        }
        else if (span > 5.5 && span <= 6 )
        {
            slabThickness = 0.19;
        }
        else if (span > 6 && span <= 6.5 )
        {
            slabThickness = 0.205;
        }
        else if (span > 6.5 && span <= 7 )
        {
            slabThickness = 0.22;
        }
        else if (span > 7 && span <= 7.5 )
        {
            slabThickness = 0.245;
        }
        else if (span > 7.5 && span <= 8 )
        {
            slabThickness = 0.270;
        }
        else if (span > 8 && span <= 8.5 )
        {
            slabThickness = 0.3;
        }
        else if (span > 8.5 && span <= 9 )
        {
            slabThickness = 0.33;
        }
        else if (span > 9 && span <= 9.5 )
        {
            slabThickness = 0.36;
        }
        else if (span > 9.5 && span <= 10 )
        {
            slabThickness = 0.39;
        }
    }

    else if (materialType == 2 || materialType == 3) //HC
    {
        slabThickness = 0.2;
    }

    else if (materialType == 1) //RC
    {
        if (span == 5)
        {
            slabThickness = 0.18;
        }
        else if (span > 5 && span <= 5.5 )
        {
            slabThickness = 0.195;
        }
        else if (span > 5.5 && span <= 6 )
        {
            slabThickness = 0.2;
        }
        else if (span > 6 && span <= 6.5 )
        {
            slabThickness = 0.225;
        }
        else if (span > 6.5 && span <= 7 )
        {
            slabThickness = 0.25;
        }
        else if (span > 7 && span <= 7.5 )
        {
            slabThickness = 0.26;
        }
        else if (span > 7.5 && span <= 8 )
        {
            slabThickness = 0.27;
        }
        else if (span > 8 && span <= 8.5 )
        {
            slabThickness = 0.3;
        }
        else if (span > 8.5 && span <= 9 )
        {
            slabThickness = 0.33;
        }
        else if (span > 9 && span <= 9.5 )
        {
            slabThickness = 0.36;
        }
        else if (span > 9.5 && span <= 10 )
        {
            slabThickness = 0.39;
        }
    }
    }
}
# ---------- end c_script_12 ----------

# ---- group: divideYLinesPrMeter
c_script_13 = CSharpScript(line=graft(ylinetree_3))  # -> out, startPt, endPt; inputs line: tree of Line; same code as c_script_3
divide_length_6 = DivideLength(Curve=ylinetree_3, Length="1")  # -> Points, Tangents, Parameters
merge_6 = Merge(Data1=c_script_13.startPt, Data2=divide_length_6.Points, Data3=c_script_13.endPt)
cull_duplicates_6 = CullDuplicates(Points=merge_6, Tolerance=0.1, CullMode=3)  # -> Points, Indices, Valence
polyline_6 = PolyLine(Vertices=cull_duplicates_6.Points, Closed=False)  # -> simplify(Polyline)
ysegmentpoints_2 = Point(simplify(cull_duplicates_6.Points))
explode_6 = Explode(Curve=polyline_6, Recursive=True)  # -> simplify(Segments), Vertices
trim_tree_12 = TrimTree(Tree=ysegmentpoints_2, Depth="2")
trim_tree_13 = TrimTree(Tree=explode_6.Segments, Depth="2")
xsegmentbeamlines_floor = Line(trim_tree_13)
xsegmentpoints_floor = Point(trim_tree_12)

# ---- group: zElements
zlinetree_6 = Line(zlinetree)
trim_tree_14 = TrimTree(Tree=zlinetree_6, Depth="1")

# ---- group: evaluates slab thickness
c_script_14 = CSharpScript(xSpacing=xspacing, ySpacing=yspacing, materialType=materialtype)  # -> out, slabThickness; inputs xSpacing: Double, ySpacing: Double, materialType: Int32; same code as c_script_12

# ----
slabthicknessnumber = Number(c_script_12.slabThickness)
zsegmentbeamlines_floor = Line(trim_tree_2)
xsegmentpoints_floor_2 = Point(xsegmentpoints)
zsegmentpoints_floor = Point(trim_tree)
zelementsline = Line(trim_tree_11)
floorsurfaces_floor = Surface(move.Geometry)
xwallsurface = Surface(c_script_8.xwalls)
ywallsurface = Surface(c_script_9.ywalls)
xsegmentbeamlines_floor_2 = Line(explode_2.Segments)
slabthicknessnumber_2 = Number(c_script_14.slabThickness)
ysegmentpoints_floor = Point(ysegmentpoints)
ysegmentbeamlines_floor = Line(explode_4.Segments)
zsegmentpoints_floor_2 = Point(trim_tree_3)
zsegmentbeamlines_floor_2 = Line(trim_tree_4)
xsegmentpoints_floor_3 = Point(trim_tree_5)
zelementsline_2 = Line(trim_tree_14)
floorsurfaces_floor_2 = Surface(move_2.Geometry)
xwallsurface_2 = Surface(c_script_10.xwalls)
ywallsurface_2 = Surface(c_script_11.ywalls)
xsegmentbeamlines_floor_3 = Line(trim_tree_6)
buildingfootprintcurve_3 = Curve(buildingfootprintcurve_2)
xsegmentline = Line(xsegmentbeamlines_floor_2)
buildingtypenumber = Number(buildingtype_2)
ysegmentline = Line(xsegmentbeamlines_floor)
zelementsline_3 = Line(zelementsline)
materialtypenumber = Number(materialtype_2)
buildingfootprintcurve_4 = Curve(buildingfootprintcurve_2)
xsegmentpoints_3 = Point(xsegmentpoints_floor_2)
ysegmentpoints_3 = Point(xsegmentpoints_floor)
zsegmentpoints_3 = Point(zsegmentpoints_floor)
zelementsline_4 = Line(zelementsline)
buildingtypenumber_2 = Number(buildingtype_2)
maindirectiontext_3 = Text(maindirectiontext_2)
materialtypenumber_2 = Number(materialtype_2)
slabthickness_m = Panel(slabthicknessnumber)
maindirectiontext_4 = Text(maindirectiontext_2)
slabthickness_m_2 = Panel(slabthicknessnumber)
floorsurfaces_floor_3 = Surface(floorsurfaces_floor)
buildingfootprintcurve_5 = Curve(buildingfootprintcurve_2)
xwallsurface_3 = Surface(xwallsurface)
ywallsurface_3 = Surface(ywallsurface)
buildingtypenumber_3 = Number(buildingtype_2)
maindirectiontext_5 = Text(maindirectiontext_2)
buildingfootprintcurve_6 = Curve(buildingfootprintcurve)
xsegmentline_2 = Line(xsegmentbeamlines_floor_3)
zelementsline_5 = Line(zelementsline_2)
buildingtypenumber_4 = Number(buildingtype)
ysegmentpoints_4 = Point(ysegmentpoints_floor)
materialtypenumber_3 = Number(materialtype)
slabthickness_m_3 = Panel(slabthicknessnumber_2)
ysegmentline_2 = Line(ysegmentbeamlines_floor)
materialtypenumber_4 = Number(materialtype)
slabthickness_m_4 = Panel(slabthicknessnumber_2)
buildingfootprintcurve_7 = Curve(buildingfootprintcurve)
xsegmentpoints_4 = Point(xsegmentpoints_floor_3)
zsegmentpoints_4 = Point(zsegmentpoints_floor_2)
zelementsline_6 = Line(zelementsline_2)
buildingtypenumber_5 = Number(buildingtype)
maindirectiontext_6 = Text(maindirectiontext)
maindirectiontext_7 = Text(maindirectiontext)
floorsurfaces_floor_4 = Surface(floorsurfaces_floor_2)
buildingfootprintcurve_8 = Curve(buildingfootprintcurve)
xwallsurface_4 = Surface(xwallsurface_2)
ywallsurface_4 = Surface(ywallsurface_2)
buildingtypenumber_6 = Number(buildingtype)
maindirectiontext_8 = Text(maindirectiontext)

# ---- group: supportPts and inclusionPts filter
c_script_15 = CSharpScript(
    buildingFootPrint=buildingfootprintcurve_4,
    xSegmentPts=xsegmentpoints_3,
    ySegmentPts=ysegmentpoints_3,
    zSegmentPts=zsegmentpoints_3,
    zElements=zelementsline_4,
    buildingType=buildingtypenumber_2,
    mainDirection=maindirectiontext_3,
    materialType=materialtypenumber_2,
    slabThickness=slabthickness_m)  # -> out, inclusionPts, supportPts; inputs buildingFootPrint: Curve, xSegmentPts: tree of Point3d, ySegmentPts: tree of Point3d, zSegmentPts: tree of Point3d, zElements: tree of Line, buildingType: Int32, mainDirection: String, materialType: Int32, slabThickness: Double
# ---------- c_script_15: C# ----------
using System;
using System.Linq;
using System.Collections;
using System.Collections.Generic;
using System.Drawing;

using Rhino;
using Rhino.Geometry;

using Grasshopper;
using Grasshopper.Kernel;
using Grasshopper.Kernel.Data;
using Grasshopper.Kernel.Types;

public class Script_Instance : GH_ScriptInstance
{
    private void RunScript(
	Curve buildingFootPrint,
	DataTree<Point3d> xSegmentPts,
	DataTree<Point3d> ySegmentPts,
	DataTree<Point3d> zSegmentPts,
	DataTree<Line> zElements,
	int buildingType,
	string mainDirection,
	int materialType,
	double slabThickness,
	ref object inclusionPts,
	ref object supportPts)
    {
        //buildingType == 1
        if (buildingType == 1)
        {
            List<Point3d> inclPts = new List<Point3d>();
            List<Point3d> supPts = new List<Point3d>();
            if (mainDirection == "x direction")
            {
                for (int i = 0; i < xSegmentPts.BranchCount; i++)
                {
                    foreach (Point3d pt in xSegmentPts.Branch(i))
                    {
                        inclPts.Add(pt);
                    }
                }
                for (int i = 0; i < zSegmentPts.BranchCount; i++)
                {
                    foreach (Point3d pt in zSegmentPts.Branch(i))
                    {
                        inclPts.Add(pt);
                    }
                }
                if (xSegmentPts.BranchCount > 0)
                {
                    List<Point3d> wallSupportPoints = xSegmentPts.Branch(0);
                    foreach (Point3d pt in wallSupportPoints)
                    {
                        supPts.Add(pt);
                    }
                }

            }

            if (mainDirection == "y direction")
            {
                for (int i = 0; i < ySegmentPts.BranchCount; i++)
                {
                    foreach (Point3d pt in ySegmentPts.Branch(i))
                    {
                        inclPts.Add(pt);
                    }
                }
                for (int i = 0; i < zSegmentPts.BranchCount; i++)
                {
                    foreach (Point3d pt in zSegmentPts.Branch(i))
                    {
                        inclPts.Add(pt);
                    }
                }
                if (ySegmentPts.BranchCount > 0)
                {
                    List<Point3d> wallSupportPoints = ySegmentPts.Branch(0);
                    foreach (Point3d pt in wallSupportPoints)
                    {
                        supPts.Add(pt);
                    }
                }
        
            }
            inclusionPts = inclPts;
            supportPts = supPts;
        }
        
        //building type == 2
        if (buildingType == 2)
        {
            DataTree<Point3d> inclPts = new DataTree<Point3d>();
            DataTree<Point3d> supPts = new DataTree<Point3d>();
            if (mainDirection == "x direction")
            {
                //walls inclusion pts
                for (int i = 0; i < xSegmentPts.BranchCount; i++)
                {
                    foreach (Point3d pt in xSegmentPts.Branch(i))
                    {
                        Point3d ptFlat = new Point3d(pt.X, pt.Y, 0);    
                        if (buildingFootPrint.Contains(ptFlat) == PointContainment.Inside)
                        {
                            inclPts.Add(pt);
                        }
                    }
                }
                //columns support and inclusion pts
                for (int i = 0; i < zSegmentPts.BranchCount; i++)
                {
                    GH_Path floorPath = new GH_Path(i);
                    foreach (Point3d pt in zSegmentPts.Branch(i))
                    {
                        if (pt.Z == 0)
                        {
                            supPts.Add(pt);
                        }

                        inclPts.Add(pt);
                    }
                }
                //beams inclusion pts
                for (int i = 1; i < xSegmentPts.BranchCount; i++)
                {
                    foreach (Point3d pt in xSegmentPts.Branch(i))
                    {
                        Point3d ptFlat = new Point3d(pt.X, pt.Y, 0);                        
                        if (buildingFootPrint.Contains(ptFlat) == PointContainment.Coincident)
                        {
                            inclPts.Add(pt);
                        }
                    }
                }
                //wall supports
                if (xSegmentPts.BranchCount > 0)
                {
                    List<Point3d> wallSupportPoints = xSegmentPts.Branch(0);
                    foreach (Point3d pt in wallSupportPoints)
                    {
                        if (buildingFootPrint.Contains(pt) == PointContainment.Inside)
                        {
                            supPts.Add(pt);
                        }
                        
                    }
                }               
            }

            if (mainDirection == "y direction")
            {
                //walls inclusion pts
                for (int i = 0; i < ySegmentPts.BranchCount; i++)
                {
                    foreach (Point3d pt in ySegmentPts.Branch(i))
                    {
                        Point3d ptFlat = new Point3d(pt.X, pt.Y, 0);    
                        if (buildingFootPrint.Contains(ptFlat) == PointContainment.Inside)
                        {
                            inclPts.Add(pt);
                        }
                    }
                }
                //columns support and inclusion pts
                for (int i = 0; i < zSegmentPts.BranchCount; i++)
                {
                    foreach (Point3d pt in zSegmentPts.Branch(i))
                    {
                        if (pt.Z == 0)
                        {
                            supPts.Add(pt);
                        }
                        inclPts.Add(pt);
                    }
                }
                //beams inclusion pts
                for (int i = 1; i < ySegmentPts.BranchCount; i++)
                {
                    foreach (Point3d pt in ySegmentPts.Branch(i))
                    {
                        Point3d ptFlat = new Point3d(pt.X, pt.Y, 0);                        
                        if (buildingFootPrint.Contains(ptFlat) == PointContainment.Coincident)
                        {
                            inclPts.Add(pt);
                        }
                    }
                }
                //wall supports
                if (xSegmentPts.BranchCount > 0)
                {
                    List<Point3d> wallSupportPoints = ySegmentPts.Branch(0);
                    foreach (Point3d pt in wallSupportPoints)
                    {
                        if (buildingFootPrint.Contains(pt) == PointContainment.Inside)
                        {
                            supPts.Add(pt);
                        }     
                    }
                }
            }            
            inclusionPts = inclPts;
            supportPts = supPts;
        }

         //buildingType == 3 
        if (buildingType == 3)
        {
            DataTree<Point3d> inclPts = new DataTree<Point3d>();
            DataTree<Point3d> supPts = new DataTree<Point3d>();
            for (int i = 1; i < xSegmentPts.BranchCount; i++)
            {
                foreach (Point3d pt in xSegmentPts.Branch(i))
                {
                    inclPts.Add(pt);
                }
            }

            for (int i = 1; i < ySegmentPts.BranchCount; i++)
            {
                foreach (Point3d pt in ySegmentPts.Branch(i))
                {
                    inclPts.Add(pt);
                }
            }

            List<Point3d> columnSupportPoints = zSegmentPts.Branch(0);
            foreach (Point3d pt in columnSupportPoints)
            {
                if (pt.Z == 0)
                {
                    supPts.Add(pt);
                }
            }
            inclusionPts = inclPts;
            supportPts = supPts;
        }

        //buildingType == 4
        if (buildingType == 4)
        {
            DataTree<Point3d> inclPts = new DataTree<Point3d>();
            DataTree<Point3d> supPts = new DataTree<Point3d>(); 
            if (mainDirection == "x direction")
            {
                List<Point3d> columnSupportPoints = zSegmentPts.Branch(0);
                foreach (Point3d pt in columnSupportPoints)
                {
                    if (pt.Z == 0)
                    {
                        supPts.Add(pt);
                    }
                }
                
                if (materialType == 1)
                {
                    if (slabThickness < 0.2)
                    {
                        for (int i = 1; i < xSegmentPts.BranchCount; i++)
                        {
                            foreach (Point3d pt in xSegmentPts.Branch(i))
                            {
                                inclPts.Add(pt);
                            }
                        }
                    }
                } 

                else
                {
                    for (int i = 1; i < xSegmentPts.BranchCount; i++)
                    {
                        foreach (Point3d pt in xSegmentPts.Branch(i))
                        {
                            inclPts.Add(pt);
                        }
                    }
                }
                inclusionPts = inclPts;
                supportPts = supPts;
            }

            if (mainDirection == "y direction")
            {
                List<Point3d> columnSupportPoints = zSegmentPts.Branch(0);
                foreach (Point3d pt in columnSupportPoints)
                {
                    if (pt.Z == 0)
                    {
                        supPts.Add(pt);
                    }
                }
                
                if (materialType == 1)
                {
                    if (slabThickness < 0.2)
                    {
                        for (int i = 1; i < ySegmentPts.BranchCount; i++)
                        {
                            foreach (Point3d pt in ySegmentPts.Branch(i))
                            {
                                inclPts.Add(pt);
                            }
                        }
                    }
                } 

                else
                {
                    for (int i = 1; i < xSegmentPts.BranchCount; i++)
                    {
                        foreach (Point3d pt in ySegmentPts.Branch(i))
                        {
                            inclPts.Add(pt);
                        }
                    }
                }
                inclusionPts = inclPts;
                supportPts = supPts;
            }
        }  
    }
}
# ---------- end c_script_15 ----------

# ---- group: filters / walls filter
c_script_16 = CSharpScript(
    buildingFootPrint=buildingfootprintcurve_5,
    xWalls=xwallsurface_3,
    yWalls=ywallsurface_3,
    buildingType=buildingtypenumber_3,
    mainDirection=maindirectiontext_5)  # -> out, walls; inputs buildingFootPrint: Curve, xWalls: tree of Surface, yWalls: tree of Surface, buildingType: Int32
# ---------- c_script_16: C# ----------
// Grasshopper Script Instance
#region Usings
using System;
using System.Linq;
using System.Collections;
using System.Collections.Generic;
using System.Drawing;

using Rhino;
using Rhino.Geometry;

using Grasshopper;
using Grasshopper.Kernel;
using Grasshopper.Kernel.Data;
using Grasshopper.Kernel.Types;
#endregion

public class Script_Instance : GH_ScriptInstance
{
    private void RunScript(
	Curve buildingFootPrint,
	DataTree<Surface> xWalls,
	DataTree<Surface> yWalls,
	int buildingType,
	object mainDirection,
	ref object walls)
    {
        if (mainDirection == "x direction")
        {          
            if (buildingType == 1)
            {
                walls = xWalls;
            }
            else if (buildingType == 2)
            {
                DataTree<Surface> outerWallsExcludedX = new DataTree<Surface>();
                for (int i = 0; i < xWalls.BranchCount; i++)
                {
                    GH_Path floorPath = new GH_Path(i);
                    foreach (Surface srf in xWalls.Branch(i))
                    {
                        Point3d srfCenter = srf.PointAt(0.5, 0.5);
                        Point3d srfCenterFlat = new Point3d(srfCenter.X, srfCenter.Y, 0);                        
                        if (buildingFootPrint.Contains(srfCenterFlat) == PointContainment.Inside)
                        {
                            outerWallsExcludedX.Add(srf);
                        }
                    }
                 }
                 walls = outerWallsExcludedX;
            }
        }
        
        if (mainDirection == "y direction")
        {  
            if (buildingType == 1)
            {
                walls = yWalls;
            }
            else if (buildingType == 2)
            {
                DataTree<Surface> outerWallsExcludedY = new DataTree<Surface>();
                for (int i = 0; i < yWalls.BranchCount; i++)
                {
                    GH_Path floorPath = new GH_Path(i);
                    foreach (Surface srf in yWalls.Branch(i))
                    {
                        Point3d srfCenter = srf.PointAt(0.5, 0.5);
                        Point3d srfCenterFlat = new Point3d(srfCenter.X, srfCenter.Y, 0);                        
                        if (buildingFootPrint.Contains(srfCenterFlat) == PointContainment.Inside)
                        {
                            outerWallsExcludedY.Add(srf);
                        }
                    }
                 }
                 walls = outerWallsExcludedY;
            }
        }
    }
}
# ---------- end c_script_16 ----------

# ---- group: beams and columns filter
c_script_17 = CSharpScript(
    buildingFootPrint=buildingfootprintcurve_3,
    xSegments=xsegmentline,
    ySegments=ysegmentline,
    zElements=zelementsline_3,
    buildingType=buildingtypenumber,
    materialType=materialtypenumber,
    mainDirection=maindirectiontext_4,
    slabThickness=slabthickness_m_2)  # -> out, primaryBeams, transverseBeams, columns; inputs buildingFootPrint: Curve, xSegments: tree of Line, ySegments: tree of Line, zElements: tree of Line, buildingType: Int32, materialType: Int32, mainDirection: String, slabThickness: Double
# ---------- c_script_17: C# ----------
using System;
using System.Linq;
using System.Collections;
using System.Collections.Generic;
using System.Drawing;

using Rhino;
using Rhino.Geometry;

using Grasshopper;
using Grasshopper.Kernel;
using Grasshopper.Kernel.Data;
using Grasshopper.Kernel.Types;

public class Script_Instance : GH_ScriptInstance
{
    private void RunScript(
	Curve buildingFootPrint,
	DataTree<Line> xSegments,
	DataTree<Line> ySegments,
	DataTree<Line> zElements,
	int buildingType,
	int materialType,
	string mainDirection,
	double slabThickness,
	ref object primaryBeams,
	ref object transverseBeams,
	ref object columns)
    {
        //buildingType == 2    
        if (buildingType == 2)
        {
            if (mainDirection == "x direction")
            {
                //primaryBeams filter: excludes inner beams in main direction
                DataTree<Line> primaryBeamsInX = new DataTree<Line>();
                for (int i = 1; i < xSegments.BranchCount; i++)
                {
                    foreach (Line line in xSegments.Branch(i))
                    {
                        Point3d lineCenter = line.PointAt(0.5);
                        Point3d lineCenterFlat = new Point3d(lineCenter.X, lineCenter.Y, 0);                        
                        if (buildingFootPrint.Contains(lineCenterFlat) == PointContainment.Coincident)
                        {
                            primaryBeamsInX.Add(line);
                        }
                    }
                }                
                //column filter: excludes inner columns
                DataTree<Line> innerColumnsExcluded = new DataTree<Line>();
                for (int i = 0; i < zElements.BranchCount; i++)
                {
                    foreach (Line line in zElements.Branch(i))
                    {
                        Point3d lineCenter = line.PointAt(0);
                        Point3d lineCenterFlat = new Point3d(lineCenter.X, lineCenter.Y, 0);                        
                        if (buildingFootPrint.Contains(lineCenterFlat) == PointContainment.Coincident)
                        {
                            innerColumnsExcluded.Add(line);
                        }
                    }
                }

                //OUTPUT
                primaryBeams = primaryBeamsInX;
                columns = zElements;
            }

            else if (mainDirection == "y direction")
            {
                //primaryBeams filter
                DataTree<Line> primaryBeamsInY = new DataTree<Line>();
                for (int i = 0; i < ySegments.BranchCount; i++)
                {
                    GH_Path floorPath = new GH_Path(i);
                    foreach (Line line in ySegments.Branch(i))
                    {
                        Point3d lineCenter = line.PointAt(0.5);
                        if (lineCenter.Z != 0)
                        {
                            Point3d lineCenterFlat = new Point3d(lineCenter.X, lineCenter.Y, 0);                        
                            if (buildingFootPrint.Contains(lineCenterFlat) == PointContainment.Coincident)
                            {
                                primaryBeamsInY.Add(line);
                            }
                        }
                        
                    }
                }
            
                //column filter: excludes inner columns
                DataTree<Line> innerColumnsExcluded = new DataTree<Line>();
                for (int i = 0; i < zElements.BranchCount; i++)
                {
                    foreach (Line line in zElements.Branch(i))
                    {
                        Point3d lineCenter = line.PointAt(0);
                        Point3d lineCenterFlat = new Point3d(lineCenter.X, lineCenter.Y, 0);                        
                        if (buildingFootPrint.Contains(lineCenterFlat) == PointContainment.Coincident)
                        {
                            innerColumnsExcluded.Add(line);
                        }
                    }
                }

                //OUTPUT
                primaryBeams = primaryBeamsInY;
                columns = zElements;
            }
        }
        


        //buildingType == 3
        else if (buildingType == 3)
        {
            if (mainDirection == "x direction")
            {
                //primaryBeams filter
                DataTree<Line> primaryBeamsInX = new DataTree<Line>();
                for (int i = 0; i < xSegments.BranchCount; i++)
                {
                    foreach (Line line in xSegments.Branch(i))
                    {
                        Point3d lineCenter = line.PointAt(0.5);
                        if (lineCenter.Z != 0)
                        {
                            primaryBeamsInX.Add(line);
                        }
                    }
                }
            
                //transverseBeams filter
                DataTree<Line> transverseBeamsInY = new DataTree<Line>();
                for (int i = 1; i < ySegments.BranchCount; i++)
                {
                    foreach (Line line in ySegments.Branch(i))
                    {
                        transverseBeamsInY.Add(line);
                    
                    }
                }

                //OUTPUT
                primaryBeams = primaryBeamsInX;
                transverseBeams = transverseBeamsInY;
                columns = zElements;
            }
            else if (mainDirection == "y direction")
            {
                //primaryBeams filter
                DataTree<Line> primaryBeamsInY = new DataTree<Line>();
                for (int i = 0; i < ySegments.BranchCount; i++)
                {
                    foreach (Line line in ySegments.Branch(i))
                    {
                        Point3d lineCenter = line.PointAt(0.5);
                        if (lineCenter.Z != 0)
                        {
                            primaryBeamsInY.Add(line);
                        }
                    
                    }
                }
            
                //transverseBeams filter
                DataTree<Line> transverseBeamsInX = new DataTree<Line>();
                for (int i = 0; i < xSegments.BranchCount; i++)
                {
                    foreach (Line line in xSegments.Branch(i))
                    {
                        Point3d lineCenter = line.PointAt(0.5);
                        if (lineCenter.Z != 0)
                        {
                            transverseBeamsInX.Add(line);
                        }
                    }
                }

                //OUTPUT
                primaryBeams = primaryBeamsInY;
                transverseBeams = transverseBeamsInX;
                columns = zElements;
            }
        }
        
        //buildingType == 4
        else if (buildingType == 4)
        {
                if (mainDirection == "x direction")
                {
                    //primaryBeams filter
                    DataTree<Line> primaryBeamsInX = new DataTree<Line>();
                    if (materialType == 1 || materialType == 2 || materialType == 3)
                    {
                        for (int i = 0; i < xSegments.BranchCount; i++)
                            {
                                foreach (Line line in xSegments.Branch(i))
                                {
                                    Point3d lineCenter = line.PointAt(0.5);
                                    if (lineCenter.Z != 0)
                                    {
                                        primaryBeamsInX.Add(line);
                                    }
                                }
                            }
                    }

                    else if (materialType == 4)
                    {
                        if (slabThickness < 0.2)
                        {
                            for (int i = 0; i < xSegments.BranchCount; i++)
                            {
                                foreach (Line line in xSegments.Branch(i))
                                {
                                    Point3d lineCenter = line.PointAt(0.5);
                                    if (lineCenter.Z != 0)
                                    {
                                        primaryBeamsInX.Add(line);
                                    }
                                }
                            }
                        } 
                    }


                    //OUTPUT
                    primaryBeams = primaryBeamsInX;
                }

                else if (mainDirection == "y direction")
                {
                    //primaryBeams filter
                    DataTree<Line> primaryBeamsInY = new DataTree<Line>();

                     if (materialType == 1 || materialType == 2 || materialType == 3)
                    {
                        for (int i = 0; i < ySegments.BranchCount; i++)
                            {
                                foreach (Line line in ySegments.Branch(i))
                                {
                                    Point3d lineCenter = line.PointAt(0.5);
                                    if (lineCenter.Z != 0)
                                    {
                                        primaryBeamsInY.Add(line);
                                    }
                                }
                            }
                    }

                    else if (materialType == 4)
                    {
                        if (slabThickness < 0.2)
                        {
                            for (int i = 1; i < ySegments.BranchCount; i++)
                            {
                                foreach (Line line in ySegments.Branch(i))
                                {
                                    Point3d lineCenter = line.PointAt(0.5);
                                    if (lineCenter.Z != 0)
                                    {
                                        primaryBeamsInY.Add(line);
                                    }
                                }
                            }
                        } 
                    }

                    //OUTPUT
                    primaryBeams = primaryBeamsInY;
                }
            
                //OUTPUT
                columns = zElements;
        }    
    }
}
# ---------- end c_script_17 ----------

# ---- group: filters / walls filter
c_script_18 = CSharpScript(
    buildingFootPrint=buildingfootprintcurve_8,
    xWalls=xwallsurface_4,
    yWalls=ywallsurface_4,
    buildingType=buildingtypenumber_6,
    mainDirection=maindirectiontext_8)  # -> out, walls; inputs buildingFootPrint: Curve, xWalls: tree of Surface, yWalls: tree of Surface, buildingType: Int32; same code as c_script_16

# ---- group: supportPts and inclusionPts filter
c_script_19 = CSharpScript(
    buildingFootPrint=buildingfootprintcurve_7,
    xSegmentPts=xsegmentpoints_4,
    ySegmentPts=ysegmentpoints_4,
    zSegmentPts=zsegmentpoints_4,
    zElements=zelementsline_6,
    buildingType=buildingtypenumber_5,
    mainDirection=maindirectiontext_6,
    materialType=materialtypenumber_3,
    slabThickness=slabthickness_m_3)  # -> out, inclusionPts, supportPts; inputs buildingFootPrint: Curve, xSegmentPts: tree of Point3d, ySegmentPts: tree of Point3d, zSegmentPts: tree of Point3d, zElements: tree of Line, buildingType: Int32, mainDirection: String, materialType: Int32, slabThickness: Double; same code as c_script_15

# ---- group: beams and columns filter
c_script_20 = CSharpScript(
    buildingFootPrint=buildingfootprintcurve_6,
    xSegments=xsegmentline_2,
    ySegments=ysegmentline_2,
    zElements=zelementsline_5,
    buildingType=buildingtypenumber_4,
    materialType=materialtypenumber_4,
    mainDirection=maindirectiontext_7,
    slabThickness=slabthickness_m_4)  # -> out, primaryBeams, transverseBeams, columns; inputs buildingFootPrint: Curve, xSegments: tree of Line, ySegments: tree of Line, zElements: tree of Line, buildingType: Int32, materialType: Int32, mainDirection: String, slabThickness: Double
# ---------- c_script_20: C# ----------
using System;
using System.Linq;
using System.Collections;
using System.Collections.Generic;
using System.Drawing;

using Rhino;
using Rhino.Geometry;

using Grasshopper;
using Grasshopper.Kernel;
using Grasshopper.Kernel.Data;
using Grasshopper.Kernel.Types;

public class Script_Instance : GH_ScriptInstance
{
    private void RunScript(
	Curve buildingFootPrint,
	DataTree<Line> xSegments,
	DataTree<Line> ySegments,
	DataTree<Line> zElements,
	int buildingType,
	int materialType,
	string mainDirection,
	double slabThickness,
	ref object primaryBeams,
	ref object transverseBeams,
	ref object columns)
    {
        //buildingType == 2    
        if (buildingType == 2)
        {
            if (mainDirection == "x direction")
            {
                //primaryBeams filter: excludes inner beams in main direction
                DataTree<Line> primaryBeamsInX = new DataTree<Line>();
                for (int i = 1; i < xSegments.BranchCount; i++)
                {
                    foreach (Line line in xSegments.Branch(i))
                    {
                        Point3d lineCenter = line.PointAt(0.5);
                        Point3d lineCenterFlat = new Point3d(lineCenter.X, lineCenter.Y, 0);                        
                        if (buildingFootPrint.Contains(lineCenterFlat) == PointContainment.Coincident)
                        {
                            primaryBeamsInX.Add(line);
                        }
                    }
                }                
                //column filter: excludes inner columns
                DataTree<Line> innerColumnsExcluded = new DataTree<Line>();
                for (int i = 0; i < zElements.BranchCount; i++)
                {
                    foreach (Line line in zElements.Branch(i))
                    {
                        Point3d lineCenter = line.PointAt(0);
                        Point3d lineCenterFlat = new Point3d(lineCenter.X, lineCenter.Y, 0);                        
                        if (buildingFootPrint.Contains(lineCenterFlat) == PointContainment.Coincident)
                        {
                            innerColumnsExcluded.Add(line);
                        }
                    }
                }

                //OUTPUT
                primaryBeams = primaryBeamsInX;
                columns = zElements;
            }

            else if (mainDirection == "y direction")
            {
                //primaryBeams filter
                DataTree<Line> primaryBeamsInY = new DataTree<Line>();
                for (int i = 0; i < ySegments.BranchCount; i++)
                {
                    GH_Path floorPath = new GH_Path(i);
                    foreach (Line line in ySegments.Branch(i))
                    {
                        Point3d lineCenter = line.PointAt(0.5);
                        if (lineCenter.Z != 0)
                        {
                            Point3d lineCenterFlat = new Point3d(lineCenter.X, lineCenter.Y, 0);                        
                            if (buildingFootPrint.Contains(lineCenterFlat) == PointContainment.Coincident)
                            {
                                primaryBeamsInY.Add(line);
                            }
                        }
                        
                    }
                }
            
                //column filter: excludes inner columns
                DataTree<Line> innerColumnsExcluded = new DataTree<Line>();
                for (int i = 0; i < zElements.BranchCount; i++)
                {
                    foreach (Line line in zElements.Branch(i))
                    {
                        Point3d lineCenter = line.PointAt(0);
                        Point3d lineCenterFlat = new Point3d(lineCenter.X, lineCenter.Y, 0);                        
                        if (buildingFootPrint.Contains(lineCenterFlat) == PointContainment.Coincident)
                        {
                            innerColumnsExcluded.Add(line);
                        }
                    }
                }

                //OUTPUT
                primaryBeams = primaryBeamsInY;
                columns = zElements;
            }
        }
        


        //buildingType == 3
        else if (buildingType == 3)
        {
            if (mainDirection == "x direction")
            {
                //primaryBeams filter
                DataTree<Line> primaryBeamsInX = new DataTree<Line>();
                for (int i = 1; i < xSegments.BranchCount; i++)
                {
                    foreach (Line line in xSegments.Branch(i))
                    {
                        primaryBeamsInX.Add(line);
                    }
                }
            
                //transverseBeams filter
                DataTree<Line> transverseBeamsInY = new DataTree<Line>();
                for (int i = 0; i < ySegments.BranchCount; i++)
                {
                    foreach (Line line in ySegments.Branch(i))
                    {
                        Point3d lineCenter = line.PointAt(0.5);
                        if (lineCenter.Z != 0)
                        {
                            transverseBeamsInY.Add(line);
                        }
                    
                    }
                }

                //OUTPUT
                primaryBeams = primaryBeamsInX;
                transverseBeams = transverseBeamsInY;
                columns = zElements;
            }
            else if (mainDirection == "y direction")
            {
                //primaryBeams filter
                DataTree<Line> primaryBeamsInY = new DataTree<Line>();
                for (int i = 0; i < ySegments.BranchCount; i++)
                {
                    foreach (Line line in ySegments.Branch(i))
                    {
                        Point3d lineCenter = line.PointAt(0.5);
                        if (lineCenter.Z != 0)
                        {
                            primaryBeamsInY.Add(line);
                        }
                    
                    }
                }
            
                //transverseBeams filter
                DataTree<Line> transverseBeamsInX = new DataTree<Line>();
                for (int i = 1; i < xSegments.BranchCount; i++)
                {
                    GH_Path floorPath = new GH_Path(i);
                    foreach (Line line in xSegments.Branch(i))
                    {
                        transverseBeamsInX.Add(line);
                    }
                }

                //OUTPUT
                primaryBeams = primaryBeamsInY;
                transverseBeams = transverseBeamsInX;
                columns = zElements;
            }
        }
        
        //buildingType == 4
        else if (buildingType == 4)
        {
                if (mainDirection == "x direction")
                {
                    //primaryBeams filter
                    DataTree<Line> primaryBeamsInX = new DataTree<Line>();
                    if (materialType == 1 || materialType == 2 || materialType == 3)
                    {
                        for (int i = 1; i < xSegments.BranchCount; i++)
                            {
                                foreach (Line line in xSegments.Branch(i))
                                {
                                    primaryBeamsInX.Add(line);
                                }
                            }
                    }

                    else if (materialType == 4)
                    {
                        if (slabThickness < 0.2)
                        {
                            for (int i = 1; i < xSegments.BranchCount; i++)
                            {
                                foreach (Line line in xSegments.Branch(i))
                                {
                                    primaryBeamsInX.Add(line);
                                }
                            }
                        } 
                    }


                    //OUTPUT
                    primaryBeams = primaryBeamsInX;
                }

                else if (mainDirection == "y direction")
                {
                    //primaryBeams filter
                    DataTree<Line> primaryBeamsInY = new DataTree<Line>();

                     if (materialType == 1 || materialType == 2 || materialType == 3)
                    {
                        for (int i = 0; i < ySegments.BranchCount; i++)
                            {
                                foreach (Line line in ySegments.Branch(i))
                                {
                                    Point3d lineCenter = line.PointAt(0.5);
                                    if (lineCenter.Z != 0)
                                    {
                                        primaryBeamsInY.Add(line);
                                    }
                                }
                            }
                    }

                    else if (materialType == 4)
                    {
                        if (slabThickness < 0.2)
                        {
                            for (int i = 1; i < ySegments.BranchCount; i++)
                            {
                                foreach (Line line in ySegments.Branch(i))
                                {
                                    Point3d lineCenter = line.PointAt(0.5);
                                    if (lineCenter.Z != 0)
                                    {
                                        primaryBeamsInY.Add(line);
                                    }
                                }
                            }
                        } 
                    }

                    //OUTPUT
                    primaryBeams = primaryBeamsInY;
                }
            
                //OUTPUT
                columns = zElements;
        }    
    }
}
# ---------- end c_script_20 ----------

# ---- group: filters / filter: removes columns if overlap with wall
deconstruct_brep = DeconstructBrep(Brep=c_script_16.walls)  # -> Faces, Edges, Vertices
list_item = ListItem(List=deconstruct_brep.Edges, Index="2", Wrap=True)
list_item_2 = ListItem(List=deconstruct_brep.Edges, Index="4", Wrap=True)
collision_one_many = CollisionOneMany(Collider=flatten(c_script_17.columns), Obstacles=flatten([list_item, list_item_2]))  # -> Collision, Index
dispatch = Dispatch(List=c_script_17.columns, DispatchPattern=collision_one_many.Collision)  # -> ListA, flatten(ListB)

deconstruct_brep_2 = DeconstructBrep(Brep=c_script_18.walls)  # -> Faces, Edges, Vertices
list_item_3 = ListItem(List=deconstruct_brep_2.Edges, Index="2", Wrap=True)
list_item_4 = ListItem(List=deconstruct_brep_2.Edges, Index="4", Wrap=True)
collision_one_many_2 = CollisionOneMany(Collider=flatten(c_script_20.columns), Obstacles=flatten([list_item_3, list_item_4]))  # -> Collision, Index
dispatch_2 = Dispatch(List=c_script_20.columns, DispatchPattern=collision_one_many_2.Collision)  # -> ListA, flatten(ListB)

# ----
cull_duplicates_7 = CullDuplicates(Points=c_script_15.inclusionPts, Tolerance=0.1, CullMode=3)  # -> Points, Indices, Valence
cull_duplicates_8 = CullDuplicates(Points=c_script_15.supportPts, Tolerance=0.1, CullMode=3)  # -> Points, Indices, Valence
cull_duplicates_9 = CullDuplicates(Points=c_script_19.inclusionPts, Tolerance=0.1, CullMode=3)  # -> Points, Indices, Valence
cull_duplicates_10 = CullDuplicates(Points=c_script_19.supportPts, Tolerance=0.1, CullMode=3)  # -> Points, Indices, Valence
primarycurvepermeter = Curve(flatten(c_script_17.primaryBeams))
transversecurvepermeter = Curve(flatten(c_script_17.transverseBeams))
inclusionpoints = Point(flatten(cull_duplicates_7.Points))
supportpoints = Point(flatten(cull_duplicates_8.Points))
floorsurfaces = Surface(flatten(floorsurfaces_floor_3))
wallsurfaces = Surface(flatten(c_script_16.walls))
columnlineperelement = Line(flatten(dispatch.ListB))
primarycurvepermeter_2 = Curve(flatten(c_script_20.primaryBeams))
transversecurvepermeter_2 = Curve(flatten(c_script_20.transverseBeams))
wallsurfaces_2 = Surface(flatten(c_script_18.walls))
columnlineperelement_2 = Line(flatten(dispatch_2.ListB))
inclusionpoints_2 = Point(flatten(cull_duplicates_9.Points))
supportpoints_2 = Point(flatten(cull_duplicates_10.Points))
floorsurfaces_2 = Surface(flatten(floorsurfaces_floor_4))

# ---- group: element volumes per building [m3] / slabVolume
area_4 = Area(Geometry=floorsurfaces)  # -> flatten(Area), Centroid
mass_addition = MassAddition(Input=area_4.Area)  # -> Result, PartialResults
c_script_21 = CSharpScript(slabThickness=slabthicknessnumber, materialType=materialtype_2)  # -> out, effectiveSlabThickness; inputs slabThickness: Double, materialType: Int32
# ---------- c_script_21: C# ----------
using System;
using System.Linq;
using System.Collections;
using System.Collections.Generic;
using System.Drawing;

using Rhino;
using Rhino.Geometry;

using Grasshopper;
using Grasshopper.Kernel;
using Grasshopper.Kernel.Data;
using Grasshopper.Kernel.Types;

public class Script_Instance : GH_ScriptInstance
{

    private void RunScript(
	double slabThickness,
	int materialType,
	ref object effectiveSlabThickness)
    {
        if (materialType == 1 || materialType == 4)
        {
            effectiveSlabThickness = slabThickness;
        }
        else 
        {
           effectiveSlabThickness = slabThickness * 0.55; 
        }
    }
}
# ---------- end c_script_21 ----------
totalslabarea_m2 = Number(mass_addition.Result)
multiplication = Multiplication(A=totalslabarea_m2, B=c_script_21.effectiveSlabThickness)

# ---- group: element volumes per building [m3] / beamsVolume
length = Length(Curve=[primarycurvepermeter, transversecurvepermeter])  # -> flatten(Length)
mass_addition_2 = MassAddition(Input=length)  # -> Result, PartialResults
c_script_22 = CSharpScript(massAdditionResult=mass_addition_2.Result)  # -> out, totalBeamLength
# ---------- c_script_22: C# ----------
using System;
using System.Linq;
using System.Collections;
using System.Collections.Generic;
using System.Drawing;

using Rhino;
using Rhino.Geometry;

using Grasshopper;
using Grasshopper.Kernel;
using Grasshopper.Kernel.Data;
using Grasshopper.Kernel.Types;

public class Script_Instance : GH_ScriptInstance
{
    #region Notes
    /* 
      Members:
        RhinoDoc RhinoDocument
        GH_Document GrasshopperDocument
        IGH_Component Component
        int Iteration

      Methods (Virtual & overridable):
        Print(string text)
        Print(string format, params object[] args)
        Reflect(object obj)
        Reflect(object obj, string method_name)
    */
    #endregion

    private void RunScript(object massAdditionResult, ref object totalBeamLength)
    {
        if (massAdditionResult == null)
        {
            totalBeamLength = 0;
        }
        else
        {
            totalBeamLength = massAdditionResult;
        }

    }
}
# ---------- end c_script_22 ----------
c_script_23 = CSharpScript(materials=materialtype_2, xSpacing=xspacing_2, ySpacing=yspacing_2)  # -> beamarea; inputs materials: Int32, xSpacing: Double, ySpacing: Double
# ---------- c_script_23: C# ----------
// Grasshopper Script Instance
#region Usings
using System;
using System.Linq;
using System.Collections;
using System.Collections.Generic;
using System.Drawing;

using Rhino;
using Rhino.Geometry;

using Grasshopper;
using Grasshopper.Kernel;
using Grasshopper.Kernel.Data;
using Grasshopper.Kernel.Types;
#endregion

public class Script_Instance : GH_ScriptInstance
{

    private void RunScript(
	int materials,
	double xSpacing,
	double ySpacing,
	ref object beamarea)
    {
        List<double> beamArea = new List<double>();
        double span = Math.Max(xSpacing, ySpacing);
        if (materials == 4) //GL
        {
            if (span == 5)
            {
                beamArea.Add(0.0378);
            }
            else if (span > 5 && span <= 5.5 )
            {
                beamArea.Add(0.0441);
            }
            else if (span > 5.5 && span <= 6 )
            {
                beamArea.Add(0.0504);
            }
            else if (span > 6 && span <= 6.5 )
            {
                beamArea.Add(0.0567);
            }
            else if (span > 6.5 && span <= 7 )
            {
                beamArea.Add(0.063);
            }
            else if (span > 7 && span <= 7.5 )
            {
                beamArea.Add(0.0696);
            }
            else if (span > 7.5 && span <= 8 )
            {
                beamArea.Add(0.0756);
            }
            else if (span > 8 && span <= 8.5 )
            {
                beamArea.Add(0.0819);
            }
            else if (span > 8.5 && span <= 9 )
            {
                beamArea.Add(0.0882);
            }
            else if (span > 9 && span <= 9.5 )
            {
                beamArea.Add(0.0945);
            }
            else if (span > 9.5 && span <= 10 )
            {
                beamArea.Add(0.1008);
            }
        }

        else if (materials == 3) //PC
        {
            if (span == 5)
            {
                beamArea.Add(0.072);
            }
            else if (span > 5 && span <= 5.5 )
            {
                beamArea.Add(0.08);
            }
            else if (span > 5.5 && span <= 6 )
            {
                beamArea.Add(0.086);
            }
            else if (span > 6 && span <= 6.5 )
            {
                beamArea.Add(0.094);
            }
            else if (span > 6.5 && span <= 7 )
            {
                beamArea.Add(0.1);
            }
            else if (span > 7 && span <= 7.5 )
            {
                beamArea.Add(0.106);
            }
            else if (span > 7.5 && span <= 8 )
            {
                beamArea.Add(0.11);
            }
            else if (span > 8 && span <= 8.5 )
            {
                beamArea.Add(0.114);
            }
            else if (span > 8.5 && span <= 9 )
            {
                beamArea.Add(0.12);
            }
            else if (span > 9 && span <= 9.5 )
            {
                beamArea.Add(0.128);
            }
            else if (span > 9.5 && span <= 10 )
            {
                beamArea.Add(0.136);
            }
        }

        else if (materials == 2) //PCS
        {
            if (span == 5)
            {
                beamArea.Add(0.0391);
            }
            else if (span > 5 && span <= 5.5 )
            {
                beamArea.Add(0.0459);
            }
            else if (span > 5.5 && span <= 6 )
            {
                beamArea.Add(0.0538);
            }
            else if (span > 6 && span <= 7 )
            {
                beamArea.Add(0.0626);
            }
            else if (span > 7 && span <= 7.5 )
            {
                beamArea.Add(0.0727);
            }
            else if (span > 7.5 && span <= 9 )
            {
                beamArea.Add(0.0845);
            }
            else if (span > 9 && span <= 10)
            {
                beamArea.Add(0.0988);
            }
        }

        else if (materials == 1) //RC
        {
            if (span == 5)
            {
                beamArea.Add(0.044);
            }
            else if (span > 5 && span <= 5.5 )
            {
                beamArea.Add(0.046);
            }
            else if (span > 5.5 && span <= 6 )
            {
                beamArea.Add(0.048);
            }
            else if (span > 6 && span <= 6.5 )
            {
                beamArea.Add(0.05);
            }
            else if (span > 6.5 && span <= 7 )
            {
                beamArea.Add(0.052);
            }
            else if (span > 7 && span <= 7.5 )
            {
                beamArea.Add(0.054);
            }
            else if (span > 7.5 && span <= 8 )
            {
                beamArea.Add(0.056);
            }
            else if (span > 8 && span <= 8.5 )
            {
                beamArea.Add(0.058);
            }
            else if (span > 8.5 && span <= 9 )
            {
                beamArea.Add(0.06);
            }
            else if (span > 9 && span <= 9.5 )
            {
                beamArea.Add(0.062);
            }
            else if (span > 9.5 && span <= 10 )
            {
                beamArea.Add(0.064);
            }
        }
        beamarea = beamArea;
    }  
}
# ---------- end c_script_23 ----------
multiplication_2 = Multiplication(A=c_script_22.totalBeamLength, B=c_script_23)

# ---- group: element volumes per building [m3] / slabVolume
area_5 = Area(Geometry=floorsurfaces_2)  # -> flatten(Area), Centroid
mass_addition_3 = MassAddition(Input=area_5.Area)  # -> Result, PartialResults
c_script_24 = CSharpScript(slabThickness=slabthicknessnumber_2, materialType=materialtype)  # -> out, effectiveSlabThickness; inputs slabThickness: Double, materialType: Int32; same code as c_script_21
totalslabarea_m2_2 = Number(mass_addition_3.Result)
multiplication_3 = Multiplication(A=totalslabarea_m2_2, B=c_script_24.effectiveSlabThickness)

# ---- group: element volumes per building [m3] / beamsVolume
length_2 = Length(Curve=[primarycurvepermeter_2, transversecurvepermeter_2])  # -> flatten(Length)
mass_addition_4 = MassAddition(Input=length_2)  # -> Result, PartialResults
c_script_25 = CSharpScript(massAdditionResult=mass_addition_4.Result)  # -> out, totalBeamLength; same code as c_script_22
c_script_26 = CSharpScript(materials=materialtype, xSpacing=xspacing, ySpacing=yspacing)  # -> beamarea; inputs materials: Int32, xSpacing: Double, ySpacing: Double; same code as c_script_23
multiplication_4 = Multiplication(A=c_script_25.totalBeamLength, B=c_script_26)

# ---- group: element volumes per building [m3] / columnsVolume
length_3 = Length(Curve=columnlineperelement)  # -> flatten(Length)
c_script_27 = CSharpScript(materialType=materialtype_2)  # -> out, crossSectionArea; inputs materialType: Int32
# ---------- c_script_27: C# ----------
// Grasshopper Script Instance
#region Usings
using System;
using System.Linq;
using System.Collections;
using System.Collections.Generic;
using System.Drawing;

using Rhino;
using Rhino.Geometry;

using Grasshopper;
using Grasshopper.Kernel;
using Grasshopper.Kernel.Data;
using Grasshopper.Kernel.Types;
#endregion

public class Script_Instance : GH_ScriptInstance
{
    #region Notes
    /* 
      Members:
        RhinoDoc RhinoDocument
        GH_Document GrasshopperDocument
        IGH_Component Component
        int Iteration

      Methods (Virtual & overridable):
        Print(string text)
        Print(string format, params object[] args)
        Reflect(object obj)
        Reflect(object obj, string method_name)
    */
    #endregion

    private void RunScript(int materialType, ref object crossSectionArea)
    {
        if (materialType == 2)
        {
            crossSectionArea = 0.00435;
        }
        else 
        {
            crossSectionArea = 0.04;
        }
    }
}
# ---------- end c_script_27 ----------
mass_addition_5 = MassAddition(Input=length_3)  # -> Result, PartialResults
c_script_28 = CSharpScript(massAdditionResult=mass_addition_5.Result)  # -> out, totalColumnLength
# ---------- c_script_28: C# ----------
using System;
using System.Linq;
using System.Collections;
using System.Collections.Generic;
using System.Drawing;

using Rhino;
using Rhino.Geometry;

using Grasshopper;
using Grasshopper.Kernel;
using Grasshopper.Kernel.Data;
using Grasshopper.Kernel.Types;

public class Script_Instance : GH_ScriptInstance
{
    private void RunScript(object massAdditionResult, ref object totalColumnLength)
    {
        if (massAdditionResult == null)
        {
            totalColumnLength = 0;
        }
        else
        {
            totalColumnLength = massAdditionResult;
        }

    }
}
# ---------- end c_script_28 ----------
multiplication_5 = Multiplication(A=c_script_28.totalColumnLength, B=c_script_27.crossSectionArea)

length_4 = Length(Curve=columnlineperelement_2)  # -> flatten(Length)
c_script_29 = CSharpScript(materialType=materialtype)  # -> out, crossSectionArea; inputs materialType: Int32; same code as c_script_27
mass_addition_6 = MassAddition(Input=length_4)  # -> Result, PartialResults
c_script_30 = CSharpScript(massAdditionResult=mass_addition_6.Result)  # -> out, totalColumnLength; same code as c_script_28
multiplication_6 = Multiplication(A=c_script_30.totalColumnLength, B=c_script_29.crossSectionArea)

# ---- group: building 1: current parameter values
xsize_b1_2 = Panel(xsize_b1)
ysize_b1_2 = Panel(ysize_b1)
xspacing_b1 = Panel(xspacing_2)
yspacing_b1 = Panel(yspacing_2)
n_floors_b1 = Panel(numberoffloors_2)
bt_b1 = Panel(buildingtype_2)
mt_b1 = Panel(materialtype_2)

# ---- group: fitness value parameters (estimated & adjustable)
gfa_tolerance_deviation = Panel("3400")
# 22mill is chosen after test optimization, where a suggestion gave a BFA of 3604 m2, GFA of 18000 m2 and a cost of 24mill and a CO2 emission of 1,5mill kg
co2_tolerance = Panel("268000")
# 400k is chosen after the same test optimization, where a suggestion gave a BFA of 3724 m2, GFA of 19680 m2, a CO2 emission of 328k and a cost of 55mill.
cost_tolerance = Panel("14740000")
bfa_tolerance_deviation = Panel("720")

# ---- group: Optimization
galapagos = Galapagos(
    fitness=fitnessvaluenumber,
    gene=[ysize_b1, xsize_b1, x_size_3, y_size_2, y_size, x_size, xspacing_2, yspacing_2, xspacing_4, yspacing_4, numberoffloors_5, xspacing, yspacing, numberoffloors, numberoffloors_2, buildingtype_2, materialtype_2, buildingtype_3, materialtype_3, buildingtype, materialtype])

# ---- group: building 3: current parameter values
xsize_b3 = Panel(x_size)
ysize_b3 = Panel(y_size)
xspacing_b3 = Panel(xspacing)
yspacing_b3 = Panel(yspacing)
n_floors_b3 = Panel(numberoffloors)
bt_b3 = Panel(buildingtype)
mt_b3 = Panel(materialtype)

# ---- group: Preparing for Karamba for B1
material_selection_karamba3d = MaterialSelectionKaramba3D(menu=[dropdown(5), dropdown(6)])
material_selection_karamba3d_2 = MaterialSelectionKaramba3D(menu=[dropdown(5), dropdown(6)])
material_selection_karamba3d_3 = MaterialSelectionKaramba3D(menu=[dropdown(5), dropdown(6)])
cross_section_karamba3d = CrossSectionKaramba3D(
    FamilyNameOfCrossSection="DefaultCroSec",
    Material=material_selection_karamba3d_3,
    Height_cm="36",
    UpperFlangeWidth_cm="14",
    LowerFlangeWidth_cm="14",
    mode="Trapezoid")
cross_section_karamba3d_2 = CrossSectionKaramba3D(
    FamilyNameOfCrossSection="DefaultCroSec",
    Material=material_selection_karamba3d_2,
    Height_cm="20",
    UpperFlangeWidth_cm="20",
    LowerFlangeWidth_cm="20",
    mode="Trapezoid")
cross_section_karamba3d_3 = CrossSectionKaramba3D(FamilyNameOfCrossSection="DefaultCroSec", Material=material_selection_karamba3d, Height_cm="16", mode="Shell - Const")
inclusionnodes = Point(inclusionpoints)
floorsurfaces_3 = Surface(floorsurfaces)
mesh_breps_karamba3d = MeshBrepsKaramba3D(
    Brep=flatten(floorsurfaces_3),
    InclusionPoints=flatten(inclusionnodes),
    MeshResolution="2",
    EdgeRefinementFactor=0.67,
    PointReduction=False,
    SmoothingStepSize=0,
    SmoothingIterations=5)  # -> Mesh, Info
line_to_beam_karamba3d = LineToBeamKaramba3D(
    Line=[transversecurvepermeter, primarycurvepermeter],
    CrossSection=cross_section_karamba3d,
    New=True,
    Remove=True,
    LimitDistance_m=0.005,
    Bending=True,
    SetBucklingLength=True,
    ToPolylineMaxAngle=0.03,
    ToPolylineTolerance=0.01,
    ToPolylineMaxEdgeLength=0.25)  # -> Element, Points, Info
line_to_beam_karamba3d_2 = LineToBeamKaramba3D(
    Line=columnlineperelement,
    CrossSection=cross_section_karamba3d_2,
    New=True,
    Remove=True,
    LimitDistance_m=0.005,
    Bending=True,
    SetBucklingLength=True,
    ToPolylineMaxAngle=0.03,
    ToPolylineTolerance=0.01,
    ToPolylineMaxEdgeLength=0.25)  # -> Element, Points, Info
support_karamba3d = SupportKaramba3D(PosInd=supportpoints, menu=[buttons(on, on, on, on, on, on)])
mesh_to_shell_karamba3d = MeshToShellKaramba3D(Mesh=mesh_breps_karamba3d.Mesh, CrossSection=cross_section_karamba3d_3, LimitDistance_m=0.005)  # -> Element, Points, Info
loads_karamba3d = LoadsKaramba3D(
    Vector="0,0,-3",
    Mesh=mesh_breps_karamba3d.Mesh,
    LCase="0",
    mode="MeshLoad -Const.",
    menu=[buttons(off, on, off), buttons(on, on)])
loads_karamba3d_2 = LoadsKaramba3D(Vector=Vector(0, 0, -1), LCase="0", mode="Gravity")

# ---- group: Preparing for Karamba for B3
material_selection_karamba3d_4 = MaterialSelectionKaramba3D(menu=[dropdown(5), dropdown(6)])
material_selection_karamba3d_5 = MaterialSelectionKaramba3D(menu=[dropdown(5), dropdown(6)])
material_selection_karamba3d_6 = MaterialSelectionKaramba3D(menu=[dropdown(5), dropdown(6)])
cross_section_karamba3d_4 = CrossSectionKaramba3D(
    FamilyNameOfCrossSection="DefaultCroSec",
    Material=material_selection_karamba3d_6,
    Height_cm="36",
    UpperFlangeWidth_cm="14",
    LowerFlangeWidth_cm="14",
    mode="Trapezoid")
cross_section_karamba3d_5 = CrossSectionKaramba3D(
    FamilyNameOfCrossSection="DefaultCroSec",
    Material=material_selection_karamba3d_5,
    Height_cm="20",
    UpperFlangeWidth_cm="20",
    LowerFlangeWidth_cm="20",
    mode="Trapezoid")
cross_section_karamba3d_6 = CrossSectionKaramba3D(FamilyNameOfCrossSection="DefaultCroSec", Material=material_selection_karamba3d_4, Height_cm="16", mode="Shell - Const")
inclusionnodes_2 = Point(inclusionpoints_2)
floorsurfaces_4 = Surface(floorsurfaces_2)
mesh_breps_karamba3d_2 = MeshBrepsKaramba3D(
    Brep=flatten(floorsurfaces_4),
    InclusionPoints=flatten(inclusionnodes_2),
    MeshResolution="2",
    EdgeRefinementFactor=0.67,
    PointReduction=False,
    SmoothingStepSize=0,
    SmoothingIterations=5)  # -> Mesh, Info
line_to_beam_karamba3d_3 = LineToBeamKaramba3D(
    Line=primarycurvepermeter_2,
    CrossSection=cross_section_karamba3d_4,
    New=True,
    Remove=True,
    LimitDistance_m=0.005,
    Bending=True,
    SetBucklingLength=True,
    ToPolylineMaxAngle=0.03,
    ToPolylineTolerance=0.01,
    ToPolylineMaxEdgeLength=0.25)  # -> Element, Points, Info
line_to_beam_karamba3d_4 = LineToBeamKaramba3D(
    Line=columnlineperelement_2,
    CrossSection=cross_section_karamba3d_5,
    New=True,
    Remove=True,
    LimitDistance_m=0.005,
    Bending=True,
    SetBucklingLength=True,
    ToPolylineMaxAngle=0.03,
    ToPolylineTolerance=0.01,
    ToPolylineMaxEdgeLength=0.25)  # -> Element, Points, Info
support_karamba3d_2 = SupportKaramba3D(PosInd=supportpoints_2, menu=[buttons(on, on, on, on, on, on)])
mesh_to_shell_karamba3d_2 = MeshToShellKaramba3D(Mesh=mesh_breps_karamba3d_2.Mesh, CrossSection=cross_section_karamba3d_6, LimitDistance_m=0.005)  # -> Element, Points, Info
loads_karamba3d_3 = LoadsKaramba3D(
    Vector="0,0,-3",
    Mesh=mesh_breps_karamba3d_2.Mesh,
    LCase="0",
    mode="MeshLoad -Const.",
    menu=[buttons(off, on, off), buttons(on, on)])
loads_karamba3d_4 = LoadsKaramba3D(Vector=Vector(0, 0, -1), LCase="0", mode="Gravity")

# ----
surface = Surface(rectangle.Rectangle)
custom_preview = CustomPreview(Geometry=surface, Material=ColourSwatch(SwatchColor=RGBA(124, 219, 0, 41)))

# ---- group: building 3: destroy recorded data
data_recorder = DataRecorder(xspacing_b3, DataLimit=-10, RecordData=True)
data_recorder_2 = DataRecorder(yspacing_b3, DataLimit=-10, RecordData=True)
data_recorder_3 = DataRecorder(mt_b3, DataLimit=-10, RecordData=True)
data_recorder_4 = DataRecorder(xsize_b3, DataLimit=-10, RecordData=True)
data_recorder_5 = DataRecorder(ysize_b3, DataLimit=-10, RecordData=True)
data_recorder_6 = DataRecorder(n_floors_b3, DataLimit=-10, RecordData=True)
data_recorder_7 = DataRecorder(bt_b3, DataLimit=-10, RecordData=True)
xsize = Panel(data_recorder_4)
ysize = Panel(data_recorder_5)
xspacing_3 = Panel(data_recorder)
bt = Panel(data_recorder_7)
mt = Panel(data_recorder_3)
yspacing_3 = Panel(data_recorder_2)
n_floors = Panel(data_recorder_6)

# ----
columnselement = ElementKaramba3D(line_to_beam_karamba3d_4.Element)
beamselement = ElementKaramba3D(line_to_beam_karamba3d_3.Element)
columnselement_2 = ElementKaramba3D(line_to_beam_karamba3d_2.Element)
shellelement = ElementKaramba3D(mesh_to_shell_karamba3d_2.Element)
beamselement_2 = ElementKaramba3D(line_to_beam_karamba3d.Element)
shellelement_2 = ElementKaramba3D(mesh_to_shell_karamba3d.Element)
supports = SupportKaramba3D(support_karamba3d_2)
ll1 = LoadKaramba3D(loads_karamba3d_3)
dl1 = LoadKaramba3D(loads_karamba3d_4)
supports_2 = SupportKaramba3D(support_karamba3d)
dl1_2 = LoadKaramba3D(loads_karamba3d_2)
ll1_2 = LoadKaramba3D(loads_karamba3d)

# ---- group: ANALYSE OG RESULTATER
assemble_model_karamba3d = AssembleModelKaramba3D(
    Elem=flatten([columnselement, beamselement, shellelement]),
    Support=flatten(supports),
    Load=flatten([dl1, ll1]),
    LimitDistance_m=0.005)  # -> Model, Info, Mass_kg, CenterOfGravity, LoadCaseNames
analyze_karamba3d = AnalyzeKaramba3D(Model=assemble_model_karamba3d.Model)  # -> CalculatedModel, MaximumDisplacement_cm, ResultingForceOfGravity_kN, ElasticEnergyChange_kNm
panel_3 = Panel(assemble_model_karamba3d.Mass_kg)
model_view_karamba3d = ModelViewKaramba3D(Model=analyze_karamba3d.CalculatedModel, ResultFactors=1, ResultCase=-1)  # -> Model, DeformedMesh, DeformedAxes, DeformedModel
panel_4 = Panel(model_view_karamba3d.DeformedModel)
shell_view_karamba3d = ShellViewKaramba3D(Model=model_view_karamba3d.Model, IndexOfLayer=0)  # -> Model, MeshesOfRenderedShells, LegendColors, LegendTags
beam_view_karamba3d = BeamViewKaramba3D(Model=model_view_karamba3d.Model)  # -> Model, MeshesOfRenderedBeams, DeformedBeamAxes, LegendColors, LegendTags
legend = Legend(Colour=shell_view_karamba3d.LegendColors, Tags=shell_view_karamba3d.LegendTags, LegendType=1)
legend_2 = Legend(Colour=beam_view_karamba3d.LegendColors, Tags=beam_view_karamba3d.LegendTags, LegendType=1)

assemble_model_karamba3d_2 = AssembleModelKaramba3D(
    Elem=flatten([columnselement_2, beamselement_2, shellelement_2]),
    Support=flatten(supports_2),
    Load=flatten([dl1_2, ll1_2]),
    LimitDistance_m=0.005)  # -> Model, Info, Mass_kg, CenterOfGravity, LoadCaseNames
analyze_karamba3d_2 = AnalyzeKaramba3D(Model=assemble_model_karamba3d_2.Model)  # -> CalculatedModel, MaximumDisplacement_cm, ResultingForceOfGravity_kN, ElasticEnergyChange_kNm
panel_5 = Panel(assemble_model_karamba3d_2.Mass_kg)
model_view_karamba3d_2 = ModelViewKaramba3D(Model=analyze_karamba3d_2.CalculatedModel, ResultFactors=1, ResultCase=-1)  # -> Model, DeformedMesh, DeformedAxes, DeformedModel
panel_6 = Panel(model_view_karamba3d_2.DeformedModel)
shell_view_karamba3d_2 = ShellViewKaramba3D(Model=model_view_karamba3d_2.Model, IndexOfLayer=0)  # -> Model, MeshesOfRenderedShells, LegendColors, LegendTags
beam_view_karamba3d_2 = BeamViewKaramba3D(Model=model_view_karamba3d_2.Model)  # -> Model, MeshesOfRenderedBeams, DeformedBeamAxes, LegendColors, LegendTags
legend_3 = Legend(Colour=shell_view_karamba3d_2.LegendColors, Tags=shell_view_karamba3d_2.LegendTags, LegendType=1)
legend_4 = Legend(Colour=beam_view_karamba3d_2.LegendColors, Tags=beam_view_karamba3d_2.LegendTags, LegendType=1)

# ---- group: B2: Adjustable parameters
xmin_property_2 = Panel(number_slider)
x_size_property_2 = Panel(panel)
ymin_property_2 = Panel(number_slider_2)
y_size_property = Panel(panel_2)
addition_2 = Addition(A=xmin_property_2, B=x_size_property_2)
addition_3 = Addition(A=ymin_property_2, B=y_size_property)
x_size_3 = Slider(25, range=20..40)
x_size_4 = Panel(x_size_3)
subtraction_2 = Subtraction(A=addition_2, B=x_size_4)
y_size_2 = Slider(16, range=5..20)
y_size_3 = Panel(y_size_2)
subtraction_3 = Subtraction(A=addition_3, B=y_size_3)
xspacing_4 = Slider(6, range=5..10)
yspacing_4 = Slider(5, range=5..10)
numberoffloors_5 = Slider(7, range=2..7)
materialtype_3 = Slider(1, range=1..5)
buildingtype_3 = Slider(4, range=1..5)
floorheight_m_3 = Panel("3")

# ----
subtraction_4 = Subtraction(A=subtraction_2, B=Slider(20, range=0..20))

# ---- group: B2: Adjustable parameters (continued)
construct_point_3 = ConstructPoint(XCoordinate=subtraction_4, YCoordinate=subtraction_3, ZCoordinate=0)
rectangle_4 = Rectangle(Plane=construct_point_3, XSize=x_size_3, YSize=y_size_2, Radius=0)  # -> Rectangle, Length
area_6 = Area(Geometry=rectangle_4.Rectangle)  # -> Area, Centroid
buildingfootprintcurve_9 = Curve(rectangle_4.Rectangle)

# ---- group: evaluates main direction
c_script_31 = CSharpScript(xSpacing=xspacing_4, ySpacing=yspacing_4)  # -> out, mainDirection; inputs xSpacing: Double, ySpacing: Double; same code as c_script

# ----
maindirectiontext_9 = Text(c_script_31.mainDirection)
csharp_script_3 = CSharpScript(
    buildingFootPrint=buildingfootprintcurve_9,
    xSpacing=xspacing_4,
    ySpacing=yspacing_4,
    floors=numberoffloors_5,
    floorHeight=floorheight_m_3,
    mainDirection=maindirectiontext_9)  # -> out, xLinesTree, yLinesTree, zLinesTree; inputs buildingFootPrint: Curve, xSpacing: Double, ySpacing: Double, floors: Int32, floorHeight: Double, mainDirection: String; same code as csharp_script
xlinetree_7 = Line(csharp_script_3.xLinesTree)
ylinetree_7 = Line(csharp_script_3.yLinesTree)
zlinetree_7 = Line(csharp_script_3.zLinesTree)
ylinetree_8 = Line(ylinetree_7)
xlinetree_8 = Line(xlinetree_7)
zlinetree_8 = Line(zlinetree_7)
buildingfootprint_3 = Curve(buildingfootprintcurve_9)
xlinestree_3 = Line(xlinetree_7)
ylinestree_3 = Line(ylinetree_7)

# ---- group: divideZLinesPrMeter
c_script_32 = CSharpScript(line=graft(zlinetree_8))  # -> out, startPt, endPt; inputs line: tree of Line; same code as c_script_3
divide_length_7 = DivideLength(Curve=zlinetree_8, Length="1")  # -> Points, Tangents, Parameters
merge_7 = Merge(Data1=c_script_32.startPt, Data2=divide_length_7.Points, Data3=c_script_32.endPt)
cull_duplicates_11 = CullDuplicates(Points=merge_7, Tolerance=0.1, CullMode=3)  # -> Points, Indices, Valence
polyline_7 = PolyLine(Vertices=cull_duplicates_11.Points, Closed=False)  # -> simplify(Polyline)
zsegmentpoints_5 = Point(simplify(cull_duplicates_11.Points))
explode_7 = Explode(Curve=polyline_7, Recursive=True)  # -> simplify(Segments), Vertices
trim_tree_15 = TrimTree(Tree=zsegmentpoints_5, Depth="2")
trim_tree_16 = TrimTree(Tree=explode_7.Segments, Depth="2")

# ---- group: divideYLinesPrMeter
c_script_33 = CSharpScript(line=graft(ylinetree_8))  # -> out, startPt, endPt; inputs line: tree of Line; same code as c_script_3
divide_length_8 = DivideLength(Curve=ylinetree_8, Length="1")  # -> Points, Tangents, Parameters
merge_8 = Merge(Data1=c_script_33.startPt, Data2=divide_length_8.Points, Data3=c_script_33.endPt)
cull_duplicates_12 = CullDuplicates(Points=merge_8, Tolerance=0.1, CullMode=3)  # -> Points, Indices, Valence
polyline_8 = PolyLine(Vertices=cull_duplicates_12.Points, Closed=False)  # -> simplify(Polyline)
ysegmentpoints_5 = Point(simplify(cull_duplicates_12.Points))
explode_8 = Explode(Curve=polyline_8, Recursive=True)  # -> simplify(Segments), Vertices

# ---- group: divideXLinesPrMeter
c_script_34 = CSharpScript(line=graft(xlinetree_8))  # -> out, startPt, endPt; inputs line: tree of Line; same code as c_script_3
divide_length_9 = DivideLength(Curve=xlinetree_8, Length="1")  # -> Points, Tangents, Parameters
merge_9 = Merge(Data1=c_script_34.startPt, Data2=divide_length_9.Points, Data3=c_script_34.endPt)
cull_duplicates_13 = CullDuplicates(Points=merge_9, Tolerance=0.1, CullMode=3)  # -> Points, Indices, Valence
polyline_9 = PolyLine(Vertices=cull_duplicates_13.Points, Closed=False)  # -> simplify(Polyline)
xsegmentpoints_5 = Point(simplify(cull_duplicates_13.Points))
explode_9 = Explode(Curve=polyline_9, Recursive=True)  # -> simplify(Segments), Vertices
trim_tree_17 = TrimTree(Tree=xsegmentpoints_5, Depth="2")
trim_tree_18 = TrimTree(Tree=explode_9.Segments, Depth="2")

# ---- group: floors
trim_tree_19 = TrimTree(Tree=xlinestree_3, Depth=1)
trim_tree_20 = TrimTree(Tree=ylinestree_3, Depth=1)
boundary_surfaces_3 = BoundarySurfaces(Edges=buildingfootprint_3)
tree_branch_5 = TreeBranch(Tree=trim_tree_19, Path="1", MaintainPaths=True)
tree_branch_6 = TreeBranch(Tree=trim_tree_20, Path="1", MaintainPaths=True)
numberoffloors_6 = Number(numberoffloors_5)
floorheight_3 = Number(floorheight_m_2)
project_5 = Project(Geometry=flatten([tree_branch_5, tree_branch_6]), Plane=PlaneXY(0, 0, 0))  # -> Geometry, Transform
project_6 = Project(Geometry=boundary_surfaces_3, Plane=PlaneXY(0, 0, 0))  # -> Geometry, Transform
series_3 = Series(Start=floorheight_3, Step=floorheight_3, Count=numberoffloors_6)
surface_split_3 = SurfaceSplit(Surface=project_6.Geometry, Curves=project_5.Geometry)
unit_z_3 = UnitZ(Factor=series_3)
move_3 = Move(Geometry=surface_split_3, Motion=simplify(graft(unit_z_3)))  # -> simplify(Geometry), Transform

# ----
xlinetree_9 = Line(xlinetree_7)
ylinetree_9 = Line(ylinetree_7)

# ---- group: xWalls, yWalls
cluster_5 = Cluster_2(tree=xlinetree_9)  # -> geometry, tree_2
cluster_6 = Cluster_2(tree=ylinetree_9)  # -> geometry, tree_2
c_script_35 = CSharpScript(floorLines=cluster_5.geometry, linesByFloorTree=cluster_5.tree_2)  # -> out, xwalls; inputs floorLines: list of Line, linesByFloorTree: tree of Line; same code as c_script_8
c_script_36 = CSharpScript(floorLines=cluster_6.geometry, linesByFloorTree=cluster_6.tree_2)  # -> out, ywalls; inputs floorLines: list of Line, linesByFloorTree: tree of Line; same code as c_script_9

# ---- group: zElements
zlinetree_9 = Line(zlinetree_7)
trim_tree_21 = TrimTree(Tree=zlinetree_9, Depth="1")

# ---- group: evaluates slab thickness
c_script_37 = CSharpScript(xSpacing=xspacing_4, ySpacing=yspacing_4, materialType=materialtype_3)  # -> out, slabThickness; inputs xSpacing: Double, ySpacing: Double, materialType: Int32; same code as c_script_12

# ----
slabthicknessnumber_3 = Number(c_script_37.slabThickness)
ysegmentpoints_floor_2 = Point(ysegmentpoints_5)
zsegmentbeamlines_floor_3 = Line(trim_tree_16)
xsegmentpoints_floor_4 = Point(trim_tree_17)
ysegmentbeamlines_floor_2 = Line(explode_8.Segments)
zsegmentpoints_floor_3 = Point(trim_tree_15)
zelementsline_7 = Line(trim_tree_21)
floorsurfaces_floor_5 = Surface(move_3.Geometry)
xwallsurface_5 = Surface(c_script_35.xwalls)
ywallsurface_5 = Surface(c_script_36.ywalls)
xsegmentbeamlines_floor_4 = Line(trim_tree_18)
buildingfootprintcurve_10 = Curve(buildingfootprintcurve_9)
xsegmentline_3 = Line(xsegmentbeamlines_floor_4)
buildingtypenumber_7 = Number(buildingtype_3)
ysegmentline_3 = Line(ysegmentbeamlines_floor_2)
zelementsline_8 = Line(zelementsline_7)
materialtypenumber_5 = Number(materialtype_3)
buildingfootprintcurve_11 = Curve(buildingfootprintcurve_9)
xsegmentpoints_6 = Point(xsegmentpoints_floor_4)
ysegmentpoints_6 = Point(ysegmentpoints_floor_2)
zsegmentpoints_6 = Point(zsegmentpoints_floor_3)
zelementsline_9 = Line(zelementsline_7)
buildingtypenumber_8 = Number(buildingtype_3)
maindirectiontext_10 = Text(maindirectiontext_9)
materialtypenumber_6 = Number(materialtype_3)
slabthickness_m_5 = Panel(slabthicknessnumber_3)
maindirectiontext_11 = Text(maindirectiontext_9)
slabthickness_m_6 = Panel(slabthicknessnumber_3)
floorsurfaces_floor_6 = Surface(floorsurfaces_floor_5)
buildingfootprintcurve_12 = Curve(buildingfootprintcurve_9)
xwallsurface_6 = Surface(xwallsurface_5)
ywallsurface_6 = Surface(ywallsurface_5)
buildingtypenumber_9 = Number(buildingtype_3)
maindirectiontext_12 = Text(maindirectiontext_9)

# ---- group: filters / walls filter
c_script_38 = CSharpScript(
    buildingFootPrint=buildingfootprintcurve_12,
    xWalls=xwallsurface_6,
    yWalls=ywallsurface_6,
    buildingType=buildingtypenumber_9,
    mainDirection=maindirectiontext_12)  # -> out, walls; inputs buildingFootPrint: Curve, xWalls: tree of Surface, yWalls: tree of Surface, buildingType: Int32; same code as c_script_16

# ---- group: supportPts and inclusionPts filter
c_script_39 = CSharpScript(
    buildingFootPrint=buildingfootprintcurve_11,
    xSegmentPts=xsegmentpoints_6,
    ySegmentPts=ysegmentpoints_6,
    zSegmentPts=zsegmentpoints_6,
    zElements=zelementsline_9,
    buildingType=buildingtypenumber_8,
    mainDirection=maindirectiontext_10,
    materialType=materialtypenumber_6,
    slabThickness=slabthickness_m_5)  # -> out, inclusionPts, supportPts; inputs buildingFootPrint: Curve, xSegmentPts: tree of Point3d, ySegmentPts: tree of Point3d, zSegmentPts: tree of Point3d, zElements: tree of Line, buildingType: Int32, mainDirection: String, materialType: Int32, slabThickness: Double; same code as c_script_15

# ---- group: beams and columns filter
c_script_40 = CSharpScript(
    buildingFootPrint=buildingfootprintcurve_10,
    xSegments=xsegmentline_3,
    ySegments=ysegmentline_3,
    zElements=zelementsline_8,
    buildingType=buildingtypenumber_7,
    materialType=materialtypenumber_5,
    mainDirection=maindirectiontext_11,
    slabThickness=slabthickness_m_6)  # -> out, primaryBeams, transverseBeams, columns; inputs buildingFootPrint: Curve, xSegments: tree of Line, ySegments: tree of Line, zElements: tree of Line, buildingType: Int32, materialType: Int32, mainDirection: String, slabThickness: Double; same code as c_script_20

# ---- group: filters / filter: removes columns if overlap with wall
deconstruct_brep_3 = DeconstructBrep(Brep=c_script_38.walls)  # -> Faces, Edges, Vertices
list_item_5 = ListItem(List=deconstruct_brep_3.Edges, Index="2", Wrap=True)
list_item_6 = ListItem(List=deconstruct_brep_3.Edges, Index="4", Wrap=True)
collision_one_many_3 = CollisionOneMany(Collider=flatten(c_script_40.columns), Obstacles=flatten([list_item_5, list_item_6]))  # -> Collision, Index
dispatch_3 = Dispatch(List=c_script_40.columns, DispatchPattern=collision_one_many_3.Collision)  # -> ListA, flatten(ListB)

# ----
cull_duplicates_14 = CullDuplicates(Points=c_script_39.inclusionPts, Tolerance=0.1, CullMode=3)  # -> Points, Indices, Valence
cull_duplicates_15 = CullDuplicates(Points=c_script_39.supportPts, Tolerance=0.1, CullMode=3)  # -> Points, Indices, Valence
primarycurvepermeter_3 = Curve(flatten(c_script_40.primaryBeams))
transversecurvepermeter_3 = Curve(flatten(c_script_40.transverseBeams))
inclusionpoints_3 = Point(flatten(cull_duplicates_14.Points))
supportpoints_3 = Point(flatten(cull_duplicates_15.Points))
floorsurfaces_5 = Surface(flatten(floorsurfaces_floor_6))
wallsurfaces_3 = Surface(flatten(c_script_38.walls))
columnlineperelement_3 = Line(flatten(dispatch_3.ListB))

# ---- group: element volumes per building [m3] / slabVolume
area_7 = Area(Geometry=floorsurfaces_5)  # -> flatten(Area), Centroid
mass_addition_7 = MassAddition(Input=area_7.Area)  # -> Result, PartialResults
c_script_41 = CSharpScript(slabThickness=slabthicknessnumber_3, materialType=materialtype_3)  # -> out, effectiveSlabThickness; inputs slabThickness: Double, materialType: Int32; same code as c_script_21
totalslabarea_m2_3 = Number(mass_addition_7.Result)
multiplication_7 = Multiplication(A=totalslabarea_m2_3, B=c_script_41.effectiveSlabThickness)

# ---- group: element volumes per building [m3] / beamsVolume
length_5 = Length(Curve=[primarycurvepermeter_3, transversecurvepermeter_3])  # -> flatten(Length)
mass_addition_8 = MassAddition(Input=length_5)  # -> Result, PartialResults
c_script_42 = CSharpScript(massAdditionResult=mass_addition_8.Result)  # -> out, totalBeamLength; same code as c_script_22
c_script_43 = CSharpScript(materials=materialtype_3, xSpacing=xspacing_4, ySpacing=yspacing_4)  # -> beamarea; inputs materials: Int32, xSpacing: Double, ySpacing: Double; same code as c_script_23
multiplication_8 = Multiplication(A=c_script_42.totalBeamLength, B=c_script_43)

# ---- group: element volumes per building [m3] / columnsVolume
length_6 = Length(Curve=columnlineperelement_3)  # -> flatten(Length)
c_script_44 = CSharpScript(materialType=materialtype_3)  # -> out, crossSectionArea; inputs materialType: Int32; same code as c_script_27
mass_addition_9 = MassAddition(Input=length_6)  # -> Result, PartialResults
c_script_45 = CSharpScript(massAdditionResult=mass_addition_9.Result)  # -> out, totalColumnLength; same code as c_script_28
multiplication_9 = Multiplication(A=c_script_45.totalColumnLength, B=c_script_44.crossSectionArea)

# ---- group: Add BFA b1, b2, b3
# idealBFA = 1920 = 60% av SA. Velger toleranse på 720 og en idealBFA på 1200 ettersom det ikke er et krav at tot.BFA er mindre enn 60%, men et krav at den ikke kan være over.
addition_4 = Addition(BFAB1=area_3.Area, BFAB2=area_6.Area, BFAB3=area_2.Area)

# ---- group: normalize BFA/SA
bfa_b1_b2_b3_m2 = Panel(addition_4)
panel_7 = Panel(bfa_tolerance_deviation)
c_script_46 = CSharpScript(currentBFA=bfa_b1_b2_b3_m2, idealBFA="1200", tolerance=panel_7)  # -> normalizedBFA; inputs currentBFA: Double, idealBFA: Double, tolerance: Int32
# ---------- c_script_46: C# ----------
using System;
using System.Linq;
using System.Collections;
using System.Collections.Generic;
using System.Drawing;

using Rhino;
using Rhino.Geometry;

using Grasshopper;
using Grasshopper.Kernel;
using Grasshopper.Kernel.Data;
using Grasshopper.Kernel.Types;

public class Script_Instance : GH_ScriptInstance
{
    private void RunScript(
	double currentBFA,
	double idealBFA,
	int tolerance,
	ref object normalizedBFA)
    {
        normalizedBFA = ((currentBFA - idealBFA)/(tolerance))*((currentBFA - idealBFA)/(tolerance)); //number represent acceptable limit for deviation
    }
}
# ---------- end c_script_46 ----------

# ---- group: building 2: current parameter values
xsize_b2 = Panel(x_size_3)
ysize_b2 = Panel(y_size_2)
xspacing_b2 = Panel(xspacing_4)
yspacing_b2 = Panel(yspacing_4)
n_floors_b2 = Panel(numberoffloors_5)
bt_b2 = Panel(buildingtype_3)
mt_b2 = Panel(materialtype_3)

# ---- group: VISUALIZATION / building 2
panel_8 = Panel("0.2")
unit_x = UnitX(Factor="-20")
pipe = Pipe(Curve=columnlineperelement_3, Radius="0.2", Caps=0)
unit_z_4 = UnitZ(Factor=panel_8)
extrude = Extrude(Base=[floorsurfaces_5, wallsurfaces_3], Direction=unit_z_4)
brep = Brep(extrude)
move_4 = Move(Geometry=[pipe, brep], Motion=unit_x)  # -> Geometry, Transform
custom_preview_2 = CustomPreview(Geometry=move_4.Geometry, Material=ColourSwatch(SwatchColor=RGBA(118, 151, 222, 210)))

# ---- group: VISUALIZATION / building 1
unit_y = UnitY(Factor="7")
unit_z_5 = UnitZ(Factor=panel_8)
pipe_2 = Pipe(Curve=columnlineperelement, Radius="0.2", Caps=0)
move_5 = Move(Motion=unit_y)  # -> Geometry, Transform
extrude_2 = Extrude(Base=[floorsurfaces, wallsurfaces], Direction=unit_z_5)
brep_2 = Brep(extrude_2)
# 400k*1.44 = 576k
# 22mill*1.44=31.68mill
# Setter disse verdiene ettersom det jobbes mot et areal på 28,8k kvm istedenfor 20k som tidligere.
# 28,8kvm ettersom dette er en grunnflate på 60% av tomta på 6000 kvm, ganget med 8 etg., dvs. maksverdien som vi faktisk kan oppnå på denne tomta. Dette tilsvarer en økning i verdiene på 1,44%.
custom_preview_3 = CustomPreview(Geometry=[pipe_2, brep_2], Material=ColourSwatch(SwatchColor=RGBA(32, 192, 232, 129)))

# ---- group: VISUALIZATION / building 3
unit_z_6 = UnitZ(Factor=panel_8)
pipe_3 = Pipe(Curve=columnlineperelement_2, Radius="0.2", Caps=0)
extrude_3 = Extrude(Base=[floorsurfaces_2, wallsurfaces_2], Direction=unit_z_6)
brep_3 = Brep(extrude_3)
custom_preview_4 = CustomPreview(Geometry=[pipe_3, brep_3], Material=ColourSwatch(SwatchColor=RGBA(204, 48, 0, 46)))

# ---- group: Preparing for Karamba for B2
material_selection_karamba3d_7 = MaterialSelectionKaramba3D(menu=[dropdown(5), dropdown(6)])
material_selection_karamba3d_8 = MaterialSelectionKaramba3D(menu=[dropdown(5), dropdown(6)])
material_selection_karamba3d_9 = MaterialSelectionKaramba3D(menu=[dropdown(5), dropdown(6)])
cross_section_karamba3d_7 = CrossSectionKaramba3D(
    FamilyNameOfCrossSection="DefaultCroSec",
    Material=material_selection_karamba3d_9,
    Height_cm="36",
    UpperFlangeWidth_cm="14",
    LowerFlangeWidth_cm="14",
    mode="Trapezoid")
cross_section_karamba3d_8 = CrossSectionKaramba3D(
    FamilyNameOfCrossSection="DefaultCroSec",
    Material=material_selection_karamba3d_8,
    Height_cm="20",
    UpperFlangeWidth_cm="20",
    LowerFlangeWidth_cm="20",
    mode="Trapezoid")
cross_section_karamba3d_9 = CrossSectionKaramba3D(FamilyNameOfCrossSection="DefaultCroSec", Material=material_selection_karamba3d_7, Height_cm="16", mode="Shell - Const")
inclusionnodes_3 = Point(inclusionpoints_3)
floorsurfaces_6 = Surface(floorsurfaces_5)
mesh_breps_karamba3d_3 = MeshBrepsKaramba3D(
    Brep=flatten(floorsurfaces_6),
    InclusionPoints=flatten(inclusionnodes_3),
    MeshResolution="2",
    EdgeRefinementFactor=0.67,
    PointReduction=False,
    SmoothingStepSize=0,
    SmoothingIterations=5)  # -> Mesh, Info
line_to_beam_karamba3d_5 = LineToBeamKaramba3D(
    Line=primarycurvepermeter_3,
    CrossSection=cross_section_karamba3d_7,
    New=True,
    Remove=True,
    LimitDistance_m=0.005,
    Bending=True,
    SetBucklingLength=True,
    ToPolylineMaxAngle=0.03,
    ToPolylineTolerance=0.01,
    ToPolylineMaxEdgeLength=0.25)  # -> Element, Points, Info
line_to_beam_karamba3d_6 = LineToBeamKaramba3D(
    Line=columnlineperelement_3,
    CrossSection=cross_section_karamba3d_8,
    New=True,
    Remove=True,
    LimitDistance_m=0.005,
    Bending=True,
    SetBucklingLength=True,
    ToPolylineMaxAngle=0.03,
    ToPolylineTolerance=0.01,
    ToPolylineMaxEdgeLength=0.25)  # -> Element, Points, Info
support_karamba3d_3 = SupportKaramba3D(PosInd=supportpoints_3, menu=[buttons(on, on, on, on, on, on)])
mesh_to_shell_karamba3d_3 = MeshToShellKaramba3D(Mesh=mesh_breps_karamba3d_3.Mesh, CrossSection=cross_section_karamba3d_9, LimitDistance_m=0.005)  # -> Element, Points, Info
loads_karamba3d_5 = LoadsKaramba3D(
    Vector="0,0,-3",
    Mesh=mesh_breps_karamba3d_3.Mesh,
    LCase="0",
    mode="MeshLoad -Const.",
    menu=[buttons(off, on, off), buttons(on, on)])
loads_karamba3d_6 = LoadsKaramba3D(Vector=Vector(0, 0, -1), LCase="0", mode="Gravity")

# ---- group: building 2: destroy recorded data
data_recorder_8 = DataRecorder(xsize_b2, DataLimit=-10, RecordData=True)
data_recorder_9 = DataRecorder(ysize_b2, DataLimit=-10, RecordData=True)
data_recorder_10 = DataRecorder(xspacing_b2, DataLimit=-10, RecordData=True)
data_recorder_11 = DataRecorder(yspacing_b2, DataLimit=-10, RecordData=True)
data_recorder_12 = DataRecorder(n_floors_b2, DataLimit=-10, RecordData=True)
data_recorder_13 = DataRecorder(bt_b2, DataLimit=-10, RecordData=True)
data_recorder_14 = DataRecorder(mt_b2, DataLimit=-10, RecordData=True)
xsize_2 = Panel(data_recorder_8)
ysize_2 = Panel(data_recorder_9)
yspacing_5 = Panel(data_recorder_11)
mt_2 = Panel(data_recorder_14)
xspacing_5 = Panel(data_recorder_10)
n_floors_2 = Panel(data_recorder_12)
bt_2 = Panel(data_recorder_13)

# ----
columnselement_3 = ElementKaramba3D(line_to_beam_karamba3d_6.Element)
beamselement_3 = ElementKaramba3D(line_to_beam_karamba3d_5.Element)
shellelement_3 = ElementKaramba3D(mesh_to_shell_karamba3d_3.Element)
supports_3 = SupportKaramba3D(support_karamba3d_3)
dl1_3 = LoadKaramba3D(loads_karamba3d_6)
ll1_3 = LoadKaramba3D(loads_karamba3d_5)

# ---- group: ANALYSE OG RESULTATER
assemble_model_karamba3d_3 = AssembleModelKaramba3D(
    Elem=flatten([columnselement_3, beamselement_3, shellelement_3]),
    Support=flatten(supports_3),
    Load=flatten([dl1_3, ll1_3]),
    LimitDistance_m=0.005)  # -> Model, Info, Mass_kg, CenterOfGravity, LoadCaseNames
analyze_karamba3d_3 = AnalyzeKaramba3D(Model=assemble_model_karamba3d_3.Model)  # -> CalculatedModel, MaximumDisplacement_cm, ResultingForceOfGravity_kN, ElasticEnergyChange_kNm
panel_9 = Panel(assemble_model_karamba3d_3.Mass_kg)
model_view_karamba3d_3 = ModelViewKaramba3D(Model=analyze_karamba3d_3.CalculatedModel, ResultFactors=1, ResultCase=-1)  # -> Model, DeformedMesh, DeformedAxes, DeformedModel
panel_10 = Panel(model_view_karamba3d_3.DeformedModel)
shell_view_karamba3d_3 = ShellViewKaramba3D(Model=model_view_karamba3d_3.Model, IndexOfLayer=0)  # -> Model, MeshesOfRenderedShells, LegendColors, LegendTags
beam_view_karamba3d_3 = BeamViewKaramba3D(Model=model_view_karamba3d_3.Model)  # -> Model, MeshesOfRenderedBeams, DeformedBeamAxes, LegendColors, LegendTags
legend_5 = Legend(Colour=shell_view_karamba3d_3.LegendColors, Tags=shell_view_karamba3d_3.LegendTags, LegendType=1)
legend_6 = Legend(Colour=beam_view_karamba3d_3.LegendColors, Tags=beam_view_karamba3d_3.LegendTags, LegendType=1)

# ---- group: element volumes per building [m3] / wallsVolume
area_8 = Area(Geometry=wallsurfaces)  # -> flatten(Area), Centroid
mass_addition_10 = MassAddition(Input=area_8.Area)  # -> Result, PartialResults

# ----
c_script_47 = CSharpScript(massAdditionResult=mass_addition_10.Result)  # -> out, totalWallsArea
# ---------- c_script_47: C# ----------
using System;
using System.Linq;
using System.Collections;
using System.Collections.Generic;
using System.Drawing;

using Rhino;
using Rhino.Geometry;

using Grasshopper;
using Grasshopper.Kernel;
using Grasshopper.Kernel.Data;
using Grasshopper.Kernel.Types;

public class Script_Instance : GH_ScriptInstance
{

    private void RunScript(object massAdditionResult, ref object totalWallsArea)
    {
        if (massAdditionResult == null)
        {
            totalWallsArea = 0;
        }
        else
        {
            totalWallsArea = massAdditionResult;
        }

    }
}
# ---------- end c_script_47 ----------

# ---- group: element volumes per building [m3] / wallsVolume (continued)
multiplication_10 = Multiplication(A=c_script_47.totalWallsArea, B="0.2")

# ----
c_script_48 = CSharpScript(
    buildingType=buildingtype_3,
    materialType=materialtype_2,
    floorsVolume=flatten(multiplication),
    wallsVolume=flatten(multiplication_10),
    beamsVolume=flatten(multiplication_2),
    columnsVolume=flatten(multiplication_5))  # -> CO2emission; inputs buildingType: Int32, materialType: Int32, floorsVolume: Double, wallsVolume: Double, beamsVolume: Double, columnsVolume: Double
# ---------- c_script_48: C# ----------
using System;
using System.Linq;
using System.Collections;
using System.Collections.Generic;
using System.Drawing;

using Rhino;
using Rhino.Geometry;

using Grasshopper;
using Grasshopper.Kernel;
using Grasshopper.Kernel.Data;
using Grasshopper.Kernel.Types;

public class Script_Instance : GH_ScriptInstance
{
    private void RunScript(
	int buildingType,
	int materialType,
	double floorsVolume,
	double wallsVolume,
	double beamsVolume,
	double columnsVolume,
	ref object CO2emission)
    {
        //CO2 emission table values:
        //B500NC  3535.13
        //Betong plasstøpt - B30 - Lavkarbon B	230
        //Betong prefab - B30, C30/37	305.68
        //Stål - S355 VF - 60% resirkulert	16300.35
        //Tre - Limtre - GL32c	72

        double co2emission = 0;
        if (buildingType == 1)
        {
            if (materialType == 1)
            {
                co2emission = co2emission + floorsVolume * 72 + wallsVolume * 72;
            }

            else if (materialType == 2)
            {
                co2emission = co2emission + floorsVolume * 305.7 + wallsVolume * 305.7 + 0.0015 * floorsVolume * 3535.13 +  0.0015 * wallsVolume * 3535.13;
            }

            else if (materialType == 3)
            {
                co2emission = co2emission + floorsVolume * 305.7 + wallsVolume * 305.7 + 0.0015 * floorsVolume * 3535.13 +  0.0015 * wallsVolume * 3535.13;
            }

            else if (materialType == 4)
            {
                co2emission = co2emission + floorsVolume * 230  + wallsVolume * 230 + 0.0015 * floorsVolume * 3535.13 +  0.0015 * wallsVolume * 3535.13;
            }   
        }

        else if (buildingType == 2)
        {
            if (materialType == 1)
            {
                co2emission = co2emission + floorsVolume * 72 + wallsVolume * 72 + columnsVolume * 72 + beamsVolume * 72;
            }

            else if (materialType == 2)
            {
                co2emission = co2emission + floorsVolume * 305.7 + wallsVolume * 305.7 + columnsVolume * 305.7 + beamsVolume * 305.7 + 0.0015 * floorsVolume * 3535.13 +  0.0015 * wallsVolume * 3535.13 + 0.008 * columnsVolume * 3535.13 + 0.008 * beamsVolume * 3535.13;
            }

            else if (materialType == 3)
            {
                co2emission = co2emission + floorsVolume * 305.7 + wallsVolume * 305.7 + columnsVolume * 16300 + beamsVolume * 16300 + 0.0015 * floorsVolume * 3535.13 +  0.0015 * wallsVolume * 3535.13 + 0.008 * columnsVolume * 3535.13 + 0.008 * beamsVolume * 3535.13;
            }

            else if (materialType == 4)
            {
                co2emission = co2emission + floorsVolume * 230  + wallsVolume * 230 + columnsVolume * 230 + beamsVolume * 230 + 0.0015 * floorsVolume * 3535.13 +  0.0015 * wallsVolume * 3535.13 + 0.008 * columnsVolume * 3535.13 + 0.008 * beamsVolume * 3535.13;
            }
        }

        else if (buildingType == 3)
        {
            if (materialType == 1)
            {
                co2emission = co2emission + floorsVolume * 72 + columnsVolume * 72 + beamsVolume * 72;
            }

            else if (materialType == 2)
            {
                co2emission = co2emission + floorsVolume * 305.7 + columnsVolume * 305.7 + beamsVolume * 305.7 + 0.0015 * floorsVolume * 3535.13 + 0.008 * columnsVolume * 3535.13 + 0.008 * beamsVolume * 3535.13;
            }

            else if (materialType == 3)
            {
                co2emission = co2emission + floorsVolume * 305.7 + columnsVolume * 16300 + beamsVolume * 16300 + 0.0015 * floorsVolume * 3535.13 + 0.008 * columnsVolume * 3535.13 + 0.008 * beamsVolume * 3535.13;
            }

            else if (materialType == 4)
            {
                co2emission = co2emission + floorsVolume * 230  + columnsVolume * 230 + beamsVolume * 230 + 0.0015 * floorsVolume * 3535.13 + 0.008 * columnsVolume * 3535.13 + 0.008 * beamsVolume * 3535.13;
            }   
        }

        else if (buildingType == 4)
        {
            if (materialType == 1)
            {
                co2emission = co2emission + floorsVolume * 72 + columnsVolume * 72 + beamsVolume * 72;
            }

            else if (materialType == 2)
            {
                co2emission = co2emission + floorsVolume * 305.7 + columnsVolume * 305.7 + beamsVolume * 305.7 + 0.0015 * floorsVolume * 3535.13 + 0.008 * columnsVolume * 3535.13 + 0.008 * beamsVolume * 3535.13;
            }

            else if (materialType == 3)
            {
                co2emission = co2emission + floorsVolume * 305.7 + columnsVolume * 16300 + beamsVolume * 16300 + 0.0015 * floorsVolume * 3535.13 + 0.008 * columnsVolume * 3535.13 + 0.008 * beamsVolume * 3535.13;
            }

            else if (materialType == 4)
            {
                co2emission = co2emission + floorsVolume * 230  + columnsVolume * 230 + beamsVolume * 230 + 0.0015 * floorsVolume * 3535.13 + 0.008 * columnsVolume * 3535.13 + 0.008 * beamsVolume * 3535.13;
            }   
        }

        else if (buildingType == 5)
        {
            co2emission = co2emission + 99999999;
        }

        CO2emission = co2emission;
    }
}
# ---------- end c_script_48 ----------
c_script_49 = CSharpScript(
    buildingType=buildingtype_2,
    materialType=materialtype_2,
    slabThickness=slabthicknessnumber,
    floorsArea=flatten(totalslabarea_m2),
    wallsArea=flatten(c_script_47.totalWallsArea),
    beamsVolume=flatten(multiplication_2),
    beamsLength=flatten(c_script_22.totalBeamLength),
    columnsVolume=flatten(multiplication_5),
    columnLength=flatten(c_script_28.totalColumnLength))  # -> cost; inputs buildingType: Int32, materialType: Int32, slabThickness: Double, floorsArea: Double, wallsArea: Double, beamsVolume: Double, beamsLength: Double, columnsVolume: Double, columnLength: Double
# ---------- c_script_49: C# ----------
// Grasshopper Script Instance
#region Usings
using System;
using System.Linq;
using System.Collections;
using System.Collections.Generic;
using System.Drawing;

using Rhino;
using Rhino.Geometry;

using Grasshopper;
using Grasshopper.Kernel;
using Grasshopper.Kernel.Data;
using Grasshopper.Kernel.Types;
#endregion

public class Script_Instance : GH_ScriptInstance
{
    private void RunScript(
	int buildingType,
	int materialType,
	double slabThickness,
	double floorsArea,
	double wallsArea,
	double beamsVolume,
	double beamsLength,
	double columnsVolume,
	double columnLength,
	ref object cost)
    {
    
        double cubicmeterCost = 0;
        double wallThickness = 0.2; //standard 200 mm thickness of walls. 
        double percentageOfSizeWall = 0;
        double percentageOfSizeFloor = 0;
        double percentageOfPriceWall = 0;
        double percentageOfPriceFloor = 0;


        if (buildingType == 1)
        {
            if (materialType == 1)
            {
                double timberWallsPrice = 2176;
                percentageOfSizeWall = wallThickness/0.24; //thickness of wall given by prisboka is 240mm. 
                percentageOfPriceWall = percentageOfSizeWall * timberWallsPrice;

                double timberFloorPrice = new double();
                if (slabThickness == 0.16)
                {
                    timberFloorPrice = 1680;
                }
                else if (slabThickness == 0.175)
                {
                    timberFloorPrice = 1826.4;
                }
                else if (slabThickness == 0.19)
                {
                    timberFloorPrice = 1972.8;
                }
                else if (slabThickness == 0.205)
                {
                    timberFloorPrice = 2119.2;
                }
                else if (slabThickness == 0.22)
                {
                    timberFloorPrice = 1698.5;
                }
                else if (slabThickness == 0.245)
                {
                    timberFloorPrice = 2509.6;
                }
                else if (slabThickness == 0.27)
                {
                    timberFloorPrice = 2753.6;
                }
                else if (slabThickness == 0.3)
                {
                    timberFloorPrice = 3046.4;
                }
                else if (slabThickness == 0.33)
                {
                    timberFloorPrice = 3339.2;
                }
                else if (slabThickness == 0.36)
                {
                    timberFloorPrice = 3632;
                }
                else if (slabThickness == 0.39)
                {
                    timberFloorPrice = 3924.8;
                }
     
                cubicmeterCost = cubicmeterCost + floorsArea * timberFloorPrice + wallsArea * percentageOfPriceWall;
            }

            else if (materialType == 2 || materialType == 3)
            {
                cubicmeterCost = cubicmeterCost + floorsArea * 903 + wallsArea * 1887;
            }
            
            else if (materialType == 4)
            {
                double concreteFloorPrice = new double();       
                if (slabThickness == 0.18)
                {
                    concreteFloorPrice = 1415;
                }
                else if (slabThickness == 0.195)
                {
                    concreteFloorPrice = 1475.75;
                }
                else if (slabThickness == 0.2)
                {
                    concreteFloorPrice = 1496;
                }
                else if (slabThickness == 0.225)
                {
                    concreteFloorPrice = 1597.25;
                }
                else if (slabThickness == 0.25)
                {
                    concreteFloorPrice = 1698.5;
                }
                else if (slabThickness == 0.26)
                {
                    concreteFloorPrice = 1739;
                }
                else if (slabThickness == 0.27)
                {
                    concreteFloorPrice = 1779.5;
                }
                else if (slabThickness == 0.285)
                {
                    concreteFloorPrice = 1840.25;
                }
                else if (slabThickness == 0.3)
                {
                    concreteFloorPrice = 1901;
                }
                else if (slabThickness == 0.315)
                {
                    concreteFloorPrice = 1961.75;
                }
                else if (slabThickness == 0.33)
                {
                    concreteFloorPrice = 2022.5;
                }
                cubicmeterCost = cubicmeterCost + floorsArea * concreteFloorPrice + wallsArea * 1916;
            }              
        }

        else if (buildingType == 2)
        {
            if (materialType == 1)
            {
                double timberBeamPrice = 820;
                double timberColumnPrice = 398;

                double timberWallsPrice = 2176;
                percentageOfSizeWall = wallThickness/0.24; //thickness of wall given by prisboka is 240mm. 
                percentageOfPriceWall = percentageOfSizeWall * timberWallsPrice;
                
                double timberFloorPrice = new double();
                if (slabThickness == 0.16)
                {
                    timberFloorPrice = 1680;
                }
                else if (slabThickness == 0.175)
                {
                    timberFloorPrice = 1826.4;
                }
                else if (slabThickness == 0.19)
                {
                    timberFloorPrice = 1972.8;
                }
                else if (slabThickness == 0.205)
                {
                    timberFloorPrice = 2119.2;
                }
                else if (slabThickness == 0.22)
                {
                    timberFloorPrice = 1698.5;
                }
                else if (slabThickness == 0.245)
                {
                    timberFloorPrice = 2509.6;
                }
                else if (slabThickness == 0.27)
                {
                    timberFloorPrice = 2753.6;
                }
                else if (slabThickness == 0.3)
                {
                    timberFloorPrice = 3046.4;
                }
                else if (slabThickness == 0.33)
                {
                    timberFloorPrice = 3339.2;
                }
                else if (slabThickness == 0.36)
                {
                    timberFloorPrice = 3632;
                }
                else if (slabThickness == 0.39)
                {
                    timberFloorPrice = 3924.8;
                }    
                cubicmeterCost = cubicmeterCost + floorsArea * timberFloorPrice + wallsArea * percentageOfPriceWall + timberBeamPrice * beamsLength + timberColumnPrice * columnLength;
            }

            else if (materialType == 2)
            {         
                cubicmeterCost = cubicmeterCost + floorsArea * 903 + wallsArea * 1887 + beamsLength * 2059 + columnLength * 3033;
            }

            else if (materialType == 3)
            {
                double steelBeamPrice = 37.88; //given i NOK/kg.
                double steelColumnPrice = 43.07; //given in NOK/kg.

                double steelDensity = 7.8; //kg/m3.
                
                cubicmeterCost = cubicmeterCost + floorsArea * 903 + wallsArea * 1887 + beamsVolume * steelDensity*steelBeamPrice + columnsVolume * steelDensity * steelColumnPrice;
            }

            else if (materialType == 4)
            {    
                double concreteFloorPrice = new double();  
                if (slabThickness == 0.18)
                {
                    concreteFloorPrice = 1415;
                }
                else if (slabThickness == 0.195)
                {
                    concreteFloorPrice = 1475.75;
                }
                else if (slabThickness == 0.2)
                {
                    concreteFloorPrice = 1496;
                }
                else if (slabThickness == 0.225)
                {
                    concreteFloorPrice = 1597.25;
                }
                else if (slabThickness == 0.25)
                {
                    concreteFloorPrice = 1698.5;
                }
                else if (slabThickness == 0.26)
                {
                    concreteFloorPrice = 1739;
                }
                else if (slabThickness == 0.27)
                {
                    concreteFloorPrice = 1779.5;
                }
                else if (slabThickness == 0.285)
                {
                    concreteFloorPrice = 1840.25;
                }
                else if (slabThickness == 0.3)
                {
                    concreteFloorPrice = 1901;
                }
                else if (slabThickness == 0.315)
                {
                    concreteFloorPrice = 1961.75;
                }
                else if (slabThickness == 0.33)
                {
                    concreteFloorPrice = 2022.5;
                }

                double concreteBeamHeight = slabThickness + 0.1;
                double percentageOfSizeBeam = concreteBeamHeight/0.5; //Prisboka gives a beamheight of 500mm.
                double percentageOfPriceBeam = percentageOfSizeBeam * 1904;

                cubicmeterCost = cubicmeterCost + floorsArea * concreteFloorPrice + wallsArea * 1916 + percentageOfPriceBeam * beamsLength + columnsVolume * 2056;
            }

        }

        else if (buildingType == 3)
        {
            if (materialType == 1)
            {
                double timberFloorPrice = new double();
                if (slabThickness == 0.16)
                {
                    timberFloorPrice = 1680;
                }
                else if (slabThickness == 0.175)
                {
                    timberFloorPrice = 1826.4;
                }
                else if (slabThickness == 0.19)
                {
                    timberFloorPrice = 1972.8;
                }
                else if (slabThickness == 0.205)
                {
                    timberFloorPrice = 2119.2;
                }
                else if (slabThickness == 0.22)
                {
                    timberFloorPrice = 1698.5;
                }
                else if (slabThickness == 0.245)
                {
                    timberFloorPrice = 2509.6;
                }
                else if (slabThickness == 0.27)
                {
                    timberFloorPrice = 2753.6;
                }
                else if (slabThickness == 0.3)
                {
                    timberFloorPrice = 3046.4;
                }
                else if (slabThickness == 0.33)
                {
                    timberFloorPrice = 3339.2;
                }
                else if (slabThickness == 0.36)
                {
                    timberFloorPrice = 3632;
                }
                else if (slabThickness == 0.39)
                {
                    timberFloorPrice = 3924.8;
                }

                double timberBeamPrice = 820;
                double timberColumnPrice = 398;

                cubicmeterCost = cubicmeterCost + floorsArea * timberFloorPrice + timberBeamPrice * beamsLength + timberColumnPrice * columnLength;
            }

            else if (materialType == 2)
            {         
                cubicmeterCost = cubicmeterCost + floorsArea * 903 + beamsLength * 2059 + columnLength * 3033;
            }

            else if (materialType == 3)
            {
                double steelBeamPrice = 37.88; //given i NOK/kg.
                double steelColumnPrice = 43.07; //given in NOK/kg.

                double steelDensity = 7.8; //kg/m3.
                
                cubicmeterCost = cubicmeterCost + floorsArea * 903 + beamsVolume * steelDensity * steelBeamPrice + columnsVolume * steelDensity * steelColumnPrice;
            }

            else if (materialType == 4)
            {
                double concreteFloorPrice = new double();
                if (slabThickness == 0.18)
                {
                    concreteFloorPrice = 1415;
                }
                else if (slabThickness == 0.195)
                {
                    concreteFloorPrice = 1475.75;
                }
                else if (slabThickness == 0.2)
                {
                    concreteFloorPrice = 1496;
                }
                else if (slabThickness == 0.225)
                {
                    concreteFloorPrice = 1597.25;
                }
                else if (slabThickness == 0.25)
                {
                    concreteFloorPrice = 1698.5;
                }
                else if (slabThickness == 0.26)
                {
                    concreteFloorPrice = 1739;
                }
                else if (slabThickness == 0.27)
                {
                    concreteFloorPrice = 1779.5;
                }
                else if (slabThickness == 0.285)
                {
                    concreteFloorPrice = 1840.25;
                }
                else if (slabThickness == 0.3)
                {
                    concreteFloorPrice = 1901;
                }
                else if (slabThickness == 0.315)
                {
                    concreteFloorPrice = 1961.75;
                }
                else if (slabThickness == 0.33)
                {
                    concreteFloorPrice = 2022.5;
                }

                double concreteBeamHeight = slabThickness + 0.1;
                double percentageOfSizeBeam = concreteBeamHeight/0.5; //Prisboka gives a beamheight of 500mm.
                double percentageOfPriceBeam = percentageOfSizeBeam * 1904;

                cubicmeterCost = cubicmeterCost + floorsArea * concreteFloorPrice + percentageOfPriceBeam * beamsLength + columnsVolume * 2056;
            }
 
        }

        else if (buildingType == 4)
        {
            if (materialType == 1)
            {
                double timberFloorPrice = new double();
                if (slabThickness == 0.16)
                {
                    timberFloorPrice = 1680;
                }
                else if (slabThickness == 0.175)
                {
                    timberFloorPrice = 1826.4;
                }
                else if (slabThickness == 0.19)
                {
                    timberFloorPrice = 1972.8;
                }
                else if (slabThickness == 0.205)
                {
                    timberFloorPrice = 2119.2;
                }
                else if (slabThickness == 0.22)
                {
                    timberFloorPrice = 1698.5;
                }
                else if (slabThickness == 0.245)
                {
                    timberFloorPrice = 2509.6;
                }
                else if (slabThickness == 0.27)
                {
                    timberFloorPrice = 2753.6;
                }
                else if (slabThickness == 0.3)
                {
                    timberFloorPrice = 3046.4;
                }
                else if (slabThickness == 0.33)
                {
                    timberFloorPrice = 3339.2;
                }
                else if (slabThickness == 0.36)
                {
                    timberFloorPrice = 3632;
                }
                else if (slabThickness == 0.39)
                {
                    timberFloorPrice = 3924.8;
                }

                double timberBeamPrice = 820;
                double timberColumnPrice = 398;

                cubicmeterCost = cubicmeterCost + floorsArea * timberFloorPrice + timberBeamPrice * beamsLength + timberColumnPrice * columnLength;
            }

            else if (materialType == 2)
            {
                
                cubicmeterCost = cubicmeterCost + floorsArea * 903 + beamsLength * 2059 + columnLength * 3033;
            }

            else if (materialType == 3)
            {
                double steelBeamPrice = 37.88; //given i NOK/kg.
                double steelColumnPrice = 43.07; //given in NOK/kg.

                double steelDensity = 7.8; //kg/m3.
                
                cubicmeterCost = cubicmeterCost + floorsArea * 903 + beamsVolume * steelDensity * steelBeamPrice + columnsVolume * steelDensity * steelColumnPrice;
            }

            else if (materialType == 4)
            {     
                double concreteFloorPrice = new double();
                if (slabThickness == 0.18)
                {
                    concreteFloorPrice = 1415;
                }
                else if (slabThickness == 0.195)
                {
                    concreteFloorPrice = 1475.75;
                }
                else if (slabThickness == 0.2)
                {
                    concreteFloorPrice = 1496;
                }
                else if (slabThickness == 0.225)
                {
                    concreteFloorPrice = 1597.25;
                }
                else if (slabThickness == 0.25)
                {
                    concreteFloorPrice = 1698.5;
                }
                else if (slabThickness == 0.26)
                {
                    concreteFloorPrice = 1739;
                }
                else if (slabThickness == 0.27)
                {
                    concreteFloorPrice = 1779.5;
                }
                else if (slabThickness == 0.285)
                {
                    concreteFloorPrice = 1840.25;
                }
                else if (slabThickness == 0.3)
                {
                    concreteFloorPrice = 1901;
                }
                else if (slabThickness == 0.315)
                {
                    concreteFloorPrice = 1961.75;
                }
                else if (slabThickness == 0.33)
                {
                    concreteFloorPrice = 2022.5;
                }

                double concreteBeamHeight = slabThickness + 0.1;
                double percentageOfSizeBeam = concreteBeamHeight/0.5; //Prisboka gives a beamheight of 500mm.
                double percentageOfPriceBeam = percentageOfSizeBeam * 1904;

                cubicmeterCost = cubicmeterCost + floorsArea * concreteFloorPrice + percentageOfPriceBeam * beamsLength + columnsVolume * 2056;

            }

        }
        cost = cubicmeterCost;
    }
}
# ---------- end c_script_49 ----------
cost_nok = Panel(c_script_49)
co2_eq_kg = Panel(c_script_48)
current_gfa_b2_m2 = Panel(totalslabarea_m2)

# ---- group: element volumes per building [m3] / wallsVolume
area_9 = Area(Geometry=wallsurfaces_3)  # -> flatten(Area), Centroid
mass_addition_11 = MassAddition(Input=area_9.Area)  # -> Result, PartialResults

# ----
c_script_50 = CSharpScript(massAdditionResult=mass_addition_11.Result)  # -> out, totalWallsArea; same code as c_script_47

# ---- group: element volumes per building [m3] / wallsVolume (continued)
multiplication_11 = Multiplication(A=c_script_50.totalWallsArea, B="0.2")

# ----
c_script_51 = CSharpScript(
    buildingType=buildingtype_3,
    materialType=materialtype_3,
    floorsVolume=flatten(multiplication_7),
    wallsVolume=flatten(multiplication_11),
    beamsVolume=flatten(multiplication_8),
    columnsVolume=flatten(multiplication_9))  # -> CO2emission; inputs buildingType: Int32, materialType: Int32, floorsVolume: Double, wallsVolume: Double, beamsVolume: Double, columnsVolume: Double
# ---------- c_script_51: C# ----------
using System;
using System.Linq;
using System.Collections;
using System.Collections.Generic;
using System.Drawing;

using Rhino;
using Rhino.Geometry;

using Grasshopper;
using Grasshopper.Kernel;
using Grasshopper.Kernel.Data;
using Grasshopper.Kernel.Types;

public class Script_Instance : GH_ScriptInstance
{
    private void RunScript(
	int buildingType,
	int materialType,
	double floorsVolume,
	double wallsVolume,
	double beamsVolume,
	double columnsVolume,
	ref object CO2emission)
    {
        //CO2 emission table values:
        //B500NC  3535.13
        //Betong plasstøpt - B30 - Lavkarbon B	230
        //Betong prefab - B30, C30/37	305.68
        //Stål - S355 VF - 60% resirkulert	16300.35
        //Tre - Limtre - GL32c	72

        double co2emission = 0;
        if (buildingType == 1)
        {
            if (materialType == 1)
            {
                co2emission = co2emission + floorsVolume * 72 + wallsVolume * 72;
            }

            else if (materialType == 2)
            {
                co2emission = co2emission + floorsVolume * 305.7 + wallsVolume * 305.7 + 0.0015 * floorsVolume * 3535.13 +  0.0015 * wallsVolume * 3535.13;
            }

            else if (materialType == 3)
            {
                co2emission = co2emission + floorsVolume * 305.7 + wallsVolume * 305.7 + 0.0015 * floorsVolume * 3535.13 +  0.0015 * wallsVolume * 3535.13;
            }

            else if (materialType == 4)
            {
                co2emission = co2emission + floorsVolume * 230  + wallsVolume * 230 + 0.0015 * floorsVolume * 3535.13 +  0.0015 * wallsVolume * 3535.13;
            }   
        }

        else if (buildingType == 2)
        {
            if (materialType == 1)
            {
                co2emission = co2emission + floorsVolume * 72 + wallsVolume * 72 + columnsVolume * 72 + beamsVolume * 72;
            }

            else if (materialType == 2)
            {
                co2emission = co2emission + floorsVolume * 305.7 + wallsVolume * 305.7 + columnsVolume * 305.7 + beamsVolume * 305.7 + 0.0015 * floorsVolume * 3535.13 +  0.0015 * wallsVolume * 3535.13 + 0.008 * columnsVolume * 3535.13 + 0.008 * beamsVolume * 3535.13;
            }

            else if (materialType == 3)
            {
                co2emission = co2emission + floorsVolume * 305.7 + wallsVolume * 305.7 + columnsVolume * 16300 + beamsVolume * 16300 + 0.0015 * floorsVolume * 3535.13 +  0.0015 * wallsVolume * 3535.13 + 0.008 * columnsVolume * 3535.13 + 0.008 * beamsVolume * 3535.13;
            }

            else if (materialType == 4)
            {
                co2emission = co2emission + floorsVolume * 230  + wallsVolume * 230 + columnsVolume * 230 + beamsVolume * 230 + 0.0015 * floorsVolume * 3535.13 +  0.0015 * wallsVolume * 3535.13 + 0.008 * columnsVolume * 3535.13 + 0.008 * beamsVolume * 3535.13;
            }
        }

        else if (buildingType == 3)
        {
            if (materialType == 1)
            {
                co2emission = co2emission + floorsVolume * 72 + columnsVolume * 72 + beamsVolume * 72;
            }

            else if (materialType == 2)
            {
                co2emission = co2emission + floorsVolume * 305.7 + columnsVolume * 305.7 + beamsVolume * 305.7 + 0.0015 * floorsVolume * 3535.13 + 0.008 * columnsVolume * 3535.13 + 0.008 * beamsVolume * 3535.13;
            }

            else if (materialType == 3)
            {
                co2emission = co2emission + floorsVolume * 305.7 + columnsVolume * 16300 + beamsVolume * 16300 + 0.0015 * floorsVolume * 3535.13 + 0.008 * columnsVolume * 3535.13 + 0.008 * beamsVolume * 3535.13;
            }

            else if (materialType == 4)
            {
                co2emission = co2emission + floorsVolume * 230  + columnsVolume * 230 + beamsVolume * 230 + 0.0015 * floorsVolume * 3535.13 + 0.008 * columnsVolume * 3535.13 + 0.008 * beamsVolume * 3535.13;
            }   
        }

        else if (buildingType == 4)
        {
            if (materialType == 1)
            {
                co2emission = co2emission + floorsVolume * 72 + columnsVolume * 72 + beamsVolume * 72;
            }

            else if (materialType == 2)
            {
                co2emission = co2emission + floorsVolume * 305.7 + columnsVolume * 305.7 + beamsVolume * 305.7 + 0.0015 * floorsVolume * 3535.13 + 0.008 * columnsVolume * 3535.13 + 0.008 * beamsVolume * 3535.13;
            }

            else if (materialType == 3)
            {
                co2emission = co2emission + floorsVolume * 305.7 + columnsVolume * 16300 + beamsVolume * 16300 + 0.0015 * floorsVolume * 3535.13 + 0.008 * columnsVolume * 3535.13 + 0.008 * beamsVolume * 3535.13;
            }

            else if (materialType == 4)
            {
                co2emission = co2emission + floorsVolume * 230  + columnsVolume * 230 + beamsVolume * 230 + 0.0015 * floorsVolume * 3535.13 + 0.008 * columnsVolume * 3535.13 + 0.008 * beamsVolume * 3535.13;
            }   
        }

         else if (buildingType == 5)
        {
            co2emission = co2emission + 99999999;
        }

        CO2emission = co2emission;
    }
}
# ---------- end c_script_51 ----------
c_script_52 = CSharpScript(
    buildingType=buildingtype_3,
    materialType=materialtype_3,
    slabThickness=slabthicknessnumber_3,
    floorsArea=flatten(totalslabarea_m2_3),
    wallsArea=flatten(c_script_50.totalWallsArea),
    beamsVolume=flatten(multiplication_8),
    beamsLength=flatten(c_script_42.totalBeamLength),
    columnsVolume=flatten(multiplication_9),
    columnLength=flatten(c_script_45.totalColumnLength))  # -> cost; inputs buildingType: Int32, materialType: Int32, slabThickness: Double, floorsArea: Double, wallsArea: Double, beamsVolume: Double, beamsLength: Double, columnsVolume: Double, columnLength: Double; same code as c_script_49
cost_nok_2 = Panel(c_script_52)
co2_eq_kg_2 = Panel(c_script_51)
current_gfa_b2_m2_2 = Panel(totalslabarea_m2_3)

# ---- group: element volumes per building [m3] / wallsVolume
area_10 = Area(Geometry=wallsurfaces_2)  # -> flatten(Area), Centroid
mass_addition_12 = MassAddition(Input=area_10.Area)  # -> Result, PartialResults

# ----
c_script_53 = CSharpScript(massAdditionResult=mass_addition_12.Result)  # -> out, totalWallsArea; same code as c_script_47

# ---- group: element volumes per building [m3] / wallsVolume (continued)
multiplication_12 = Multiplication(A=c_script_53.totalWallsArea, B="0.2")

# ----
c_script_54 = CSharpScript(
    buildingType=buildingtype,
    materialType=materialtype,
    floorsVolume=flatten(multiplication_3),
    wallsVolume=flatten(multiplication_12),
    beamsVolume=flatten(multiplication_4),
    columnsVolume=flatten(multiplication_6))  # -> CO2emission; inputs buildingType: Int32, materialType: Int32, floorsVolume: Double, wallsVolume: Double, beamsVolume: Double, columnsVolume: Double
# ---------- c_script_54: C# ----------
using System;
using System.Linq;
using System.Collections;
using System.Collections.Generic;
using System.Drawing;

using Rhino;
using Rhino.Geometry;

using Grasshopper;
using Grasshopper.Kernel;
using Grasshopper.Kernel.Data;
using Grasshopper.Kernel.Types;

public class Script_Instance : GH_ScriptInstance
{
    private void RunScript(
	int buildingType,
	int materialType,
	double floorsVolume,
	double wallsVolume,
	double beamsVolume,
	double columnsVolume,
	ref object CO2emission)
    {
        //CO2 emission table values:
        //B500NC  3535.13
        //Betong plasstøpt - B30 - Lavkarbon B	230
        //Betong prefab - B30, C30/37	305.68
        //Stål - S355 VF - 60% resirkulert	16300.35
        //Tre - Limtre - GL32c	72

        double co2emission = 0;
        if (buildingType == 1)
        {
            if (materialType == 1)
            {
                co2emission = co2emission + floorsVolume * 72 + wallsVolume * 72;
            }

            else if (materialType == 2)
            {
                co2emission = co2emission + floorsVolume * 305.7 + wallsVolume * 305.7 + 0.0015 * floorsVolume * 3535.13 +  0.0015 * wallsVolume * 3535.13;
            }

            else if (materialType == 3)
            {
                co2emission = co2emission + floorsVolume * 305.7 + wallsVolume * 305.7 + 0.0015 * floorsVolume * 3535.13 +  0.0015 * wallsVolume * 3535.13;
            }

            else if (materialType == 4)
            {
                co2emission = co2emission + floorsVolume * 230  + wallsVolume * 230 + 0.0015 * floorsVolume * 3535.13 +  0.0015 * wallsVolume * 3535.13;
            }   
        }

        else if (buildingType == 2)
        {
            if (materialType == 1)
            {
                co2emission = co2emission + floorsVolume * 72 + wallsVolume * 72 + columnsVolume * 72 + beamsVolume * 72;
            }

            else if (materialType == 2)
            {
                co2emission = co2emission + floorsVolume * 305.7 + wallsVolume * 305.7 + columnsVolume * 305.7 + beamsVolume * 305.7 + 0.0015 * floorsVolume * 3535.13 +  0.0015 * wallsVolume * 3535.13 + 0.008 * columnsVolume * 3535.13 + 0.008 * beamsVolume * 3535.13;
            }

            else if (materialType == 3)
            {
                co2emission = co2emission + floorsVolume * 305.7 + wallsVolume * 305.7 + columnsVolume * 16300 + beamsVolume * 16300 + 0.0015 * floorsVolume * 3535.13 +  0.0015 * wallsVolume * 3535.13 + 0.008 * columnsVolume * 3535.13 + 0.008 * beamsVolume * 3535.13;
            }

            else if (materialType == 4)
            {
                co2emission = co2emission + floorsVolume * 230  + wallsVolume * 230 + columnsVolume * 230 + beamsVolume * 230 + 0.0015 * floorsVolume * 3535.13 +  0.0015 * wallsVolume * 3535.13 + 0.008 * columnsVolume * 3535.13 + 0.008 * beamsVolume * 3535.13;
            }
        }

        else if (buildingType == 3)
        {
            if (materialType == 1)
            {
                co2emission = co2emission + floorsVolume * 72 + columnsVolume * 72 + beamsVolume * 72;
            }

            else if (materialType == 2)
            {
                co2emission = co2emission + floorsVolume * 305.7 + columnsVolume * 305.7 + beamsVolume * 305.7 + 0.0015 * floorsVolume * 3535.13 + 0.008 * columnsVolume * 3535.13 + 0.008 * beamsVolume * 3535.13;
            }

            else if (materialType == 3)
            {
                co2emission = co2emission + floorsVolume * 305.7 + columnsVolume * 16300 + beamsVolume * 16300 + 0.0015 * floorsVolume * 3535.13 + 0.008 * columnsVolume * 3535.13 + 0.008 * beamsVolume * 3535.13;
            }

            else if (materialType == 4)
            {
                co2emission = co2emission + floorsVolume * 230  + columnsVolume * 230 + beamsVolume * 230 + 0.0015 * floorsVolume * 3535.13 + 0.008 * columnsVolume * 3535.13 + 0.008 * beamsVolume * 3535.13;
            }   
        }

        else if (buildingType == 4)
        {
            if (materialType == 1)
            {
                co2emission = co2emission + floorsVolume * 72 + columnsVolume * 72 + beamsVolume * 72;
            }

            else if (materialType == 2)
            {
                co2emission = co2emission + floorsVolume * 305.7 + columnsVolume * 305.7 + beamsVolume * 305.7 + 0.0015 * floorsVolume * 3535.13 + 0.008 * columnsVolume * 3535.13 + 0.008 * beamsVolume * 3535.13;
            }

            else if (materialType == 3)
            {
                co2emission = co2emission + floorsVolume * 305.7 + columnsVolume * 16300 + beamsVolume * 16300 + 0.0015 * floorsVolume * 3535.13 + 0.008 * columnsVolume * 3535.13 + 0.008 * beamsVolume * 3535.13;
            }

            else if (materialType == 4)
            {
                co2emission = co2emission + floorsVolume * 230  + columnsVolume * 230 + beamsVolume * 230 + 0.0015 * floorsVolume * 3535.13 + 0.008 * columnsVolume * 3535.13 + 0.008 * beamsVolume * 3535.13;
            }   
        }

        else if (buildingType == 5)
        {
            co2emission = co2emission + 9999999;
        }

        CO2emission = co2emission;
    }
}
# ---------- end c_script_54 ----------
c_script_55 = CSharpScript(
    buildingType=buildingtype,
    materialType=materialtype,
    slabThickness=slabthicknessnumber_2,
    floorsArea=flatten(totalslabarea_m2_2),
    wallsArea=flatten(c_script_53.totalWallsArea),
    beamsVolume=flatten(multiplication_4),
    beamsLength=flatten(c_script_25.totalBeamLength),
    columnsVolume=flatten(multiplication_6),
    columnLength=flatten(c_script_30.totalColumnLength))  # -> cost; inputs buildingType: Int32, materialType: Int32, slabThickness: Double, floorsArea: Double, wallsArea: Double, beamsVolume: Double, beamsLength: Double, columnsVolume: Double, columnLength: Double; same code as c_script_49
cost_nok_3 = Panel(c_script_55)
co2_eq_kg_3 = Panel(c_script_54)
current_gfa_b2_m2_3 = Panel(totalslabarea_m2_2)

# ---- group: Add CO2 emission b1, b2, b3
# idealGFA=(SA*0,6)*7=13400, altså maks tomteutnyttelse (60%), over maks antall etasjer. Velger en toleranse på 3400 for å ikke la denne veie for tungt men sikre at det genereres et vidt antall alternativer.
addition_5 = Addition(CO2eqB1=co2_eq_kg, CO2eqB2=co2_eq_kg_2, CO2eqB3=co2_eq_kg_3)

# ---- group: Add GFA b1, b2, b3
addition_6 = Addition(GFAB1=current_gfa_b2_m2, GFAB2=current_gfa_b2_m2_2, GFAB3=current_gfa_b2_m2_3)

# ---- group: Add cost b1, b2, b3
addition_7 = Addition(CostB1=cost_nok, CostB2=cost_nok_2, CostB3=cost_nok_3)

# ---- group: normalize GFA
gfa_b1_b2_b3_m2 = Panel(addition_6)
panel_11 = Panel(gfa_tolerance_deviation)
c_script_56 = CSharpScript(currentGFA=gfa_b1_b2_b3_m2, idealGFA="10000", tolerance=panel_11)  # -> normalizedGFA; inputs currentGFA: Double, idealGFA: Double, tolerance: Int32
# ---------- c_script_56: C# ----------
using System;
using System.Linq;
using System.Collections;
using System.Collections.Generic;
using System.Drawing;

using Rhino;
using Rhino.Geometry;

using Grasshopper;
using Grasshopper.Kernel;
using Grasshopper.Kernel.Data;
using Grasshopper.Kernel.Types;

public class Script_Instance : GH_ScriptInstance
{
    private void RunScript(
	double currentGFA,
	double idealGFA,
	int tolerance,
	ref object normalizedGFA)
    {
        normalizedGFA = ((currentGFA - idealGFA)/(tolerance))*((currentGFA - idealGFA)/(tolerance)); //number represent acceptable limit for deviation
    }
}
# ---------- end c_script_56 ----------

# ---- group: normalize CO2 emission
panel_12 = Panel(co2_tolerance)
c_script_57 = CSharpScript(currentValue=addition_5, co2tolerance=panel_12)  # -> normalizedEmission; inputs currentValue: Double, co2tolerance: Int32
# ---------- c_script_57: C# ----------
using System;
using System.Linq;
using System.Collections;
using System.Collections.Generic;
using System.Drawing;

using Rhino;
using Rhino.Geometry;

using Grasshopper;
using Grasshopper.Kernel;
using Grasshopper.Kernel.Data;
using Grasshopper.Kernel.Types;

public class Script_Instance : GH_ScriptInstance
{
    private void RunScript(
	double currentValue,
	int co2tolerance,
	ref object normalizedEmission)
    {
        normalizedEmission = currentValue/co2tolerance;
    }
}
# ---------- end c_script_57 ----------

# ---- group: normalize cost
panel_13 = Panel(cost_tolerance)
c_script_58 = CSharpScript(currentValue=addition_7, NOKtolerance=panel_13)  # -> normalizedEmission; inputs currentValue: Double, NOKtolerance: Int32
# ---------- c_script_58: C# ----------
using System;
using System.Linq;
using System.Collections;
using System.Collections.Generic;
using System.Drawing;

using Rhino;
using Rhino.Geometry;

using Grasshopper;
using Grasshopper.Kernel;
using Grasshopper.Kernel.Data;
using Grasshopper.Kernel.Types;

public class Script_Instance : GH_ScriptInstance
{
    private void RunScript(
	double currentValue,
	int NOKtolerance,
	ref object normalizedEmission)
    {
        normalizedEmission = currentValue/NOKtolerance;
    }
}
# ---------- end c_script_58 ----------

# ----
c_script_59 = CSharpScript(fV1=c_script_46, fV2=c_script_56, fV3=c_script_57, fV4=c_script_58)  # -> finalFitnessValue; inputs fV1: Double, fV2: Double, fV3: Double, fV4: Double
# ---------- c_script_59: C# ----------
using System;
using System.Linq;
using System.Collections;
using System.Collections.Generic;
using System.Drawing;

using Rhino;
using Rhino.Geometry;

using Grasshopper;
using Grasshopper.Kernel;
using Grasshopper.Kernel.Data;
using Grasshopper.Kernel.Types;

public class Script_Instance : GH_ScriptInstance
{
    private void RunScript(
	double fV1,
	double fV2,
	double fV3,
	double fV4,
	ref object finalFitnessValue)
    {
        finalFitnessValue = fV1 + fV2 + fV3 + fV4; //weights can be changed based on priorities for finalFitnessValue
    }
}
# ---------- end c_script_59 ----------
fitnessvaluenumber = Number(c_script_59)

# ---- group: current fitness values (fV)
# CO2tol = 576k * 0,4652 = 268k
# COSTtol = 31,68mill * 0,4652 = 14,74 mill
fv1_bfa_not_normalized = Panel(addition_4)
fv2_gfa_not_normalized = Panel(addition_6)
fv3_co2_not_normalized = Panel(addition_5)
fv4_cost_not_normalized = Panel(addition_7)
total_fv_normalized = Panel(fitnessvaluenumber)

# ---- group: number of Galapagos iterations
data_recorder_15 = DataRecorder(fitnessvaluenumber, DataLimit=-10, RecordData=True)
list_length = ListLength(List=data_recorder_15)
n_iterations = Panel(list_length)

# ---- group: building 1: destroy recorded data
data_recorder_16 = DataRecorder(bt_b1, DataLimit=-10, RecordData=True)
data_recorder_17 = DataRecorder(xsize_b1_2, DataLimit=-10, RecordData=True)
data_recorder_18 = DataRecorder(ysize_b1_2, DataLimit=-10, RecordData=True)
data_recorder_19 = DataRecorder(xspacing_b1, DataLimit=-10, RecordData=True)
data_recorder_20 = DataRecorder(yspacing_b1, DataLimit=-10, RecordData=True)
data_recorder_21 = DataRecorder(n_floors_b1, DataLimit=-10, RecordData=True)
data_recorder_22 = DataRecorder(mt_b1, DataLimit=-10, RecordData=True)
xsize_3 = Panel(data_recorder_17)
ysize_3 = Panel(data_recorder_18)
yspacing_6 = Panel(data_recorder_20)
bt_3 = Panel(data_recorder_16)
xspacing_6 = Panel(data_recorder_19)
mt_3 = Panel(data_recorder_22)

# ----
cull_index = CullIndex(List=data_recorder_21, Indices="0", Wrap=True)  # -> flatten(List)

# ---- group: building 1: destroy recorded data (continued)
n_floors_3 = Panel(cull_index)

# ---- group: fitness values: destroy all recorded data
data_recorder_23 = DataRecorder(fv3_co2_not_normalized, DataLimit=-10, RecordData=True)
data_recorder_24 = DataRecorder(bfa_b1_b2_b3_m2, DataLimit=-10, RecordData=True)
data_recorder_25 = DataRecorder(fv2_gfa_not_normalized, DataLimit=-10, RecordData=True)
data_recorder_26 = DataRecorder(fv4_cost_not_normalized, DataLimit=-10, RecordData=True)
data_recorder_27 = DataRecorder(total_fv_normalized, DataLimit=-10, RecordData=True)
round = Round(Number=data_recorder_26)  # -> Nearest, Floor, Ceiling
round_2 = Round(Number=data_recorder_25)  # -> Nearest, Floor, Ceiling
round_3 = Round(Number=data_recorder_23)  # -> Nearest, Floor, Ceiling
cluster_7 = Cluster(A=data_recorder_27)
fv_total = Panel(cluster_7)
fv1_bfa = Panel(data_recorder_24)
fv3_co2_emission = Panel(round_3.Nearest)
fv2_gfa = Panel(round_2.Nearest)

# ----
cull_index_2 = CullIndex(List=round.Nearest, Indices="0", Wrap=True)  # -> flatten(List)
cull_index_3 = CullIndex(List=data_recorder_27, Indices="0", Wrap=True)  # -> flatten(List)

# ---- group: fitness values: destroy all recorded data (continued)
fv4_cost = Panel(cull_index_2)

# ---- group: write to Excel
stream = BooleanToggle(False)
file_path = FilePath("C:\Users\andre\OneDrive - NTNU\RhinoGrasshopper\CS3\0529_CS3_part3_ny.xlsx")
write_to_excel_classic = WriteToExcelClassic(WorkbookFilepath=file_path, Data=graft("mT b1"), LocationAddress="G1", Clear=0, Stream=stream)
write_to_excel_classic_2 = WriteToExcelClassic(WorkbookFilepath=file_path, Data=graft(mt_3), LocationAddress="G2", Clear=0, Stream=stream)
write_to_excel_classic_3 = WriteToExcelClassic(WorkbookFilepath=file_path, Data=graft("X b1"), LocationAddress="A1", Clear=0, Stream=stream)
write_to_excel_classic_4 = WriteToExcelClassic(WorkbookFilepath=file_path, Data=graft(xsize_3), LocationAddress="A2", Clear=0, Stream=stream)
write_to_excel_classic_5 = WriteToExcelClassic(WorkbookFilepath=file_path, Data=graft("Y b1"), LocationAddress="B1", Clear=0, Stream=stream)
write_to_excel_classic_6 = WriteToExcelClassic(WorkbookFilepath=file_path, Data=graft(ysize_3), LocationAddress="B2", Clear=0, Stream=stream)
write_to_excel_classic_7 = WriteToExcelClassic(WorkbookFilepath=file_path, Data=graft("x_b1"), LocationAddress="C1", Clear=0, Stream=stream)
write_to_excel_classic_8 = WriteToExcelClassic(WorkbookFilepath=file_path, Data=graft(xspacing_6), LocationAddress="C2", Clear=0, Stream=stream)
write_to_excel_classic_9 = WriteToExcelClassic(WorkbookFilepath=file_path, Data=graft("y_b1"), LocationAddress="D1", Clear=0, Stream=stream)
write_to_excel_classic_10 = WriteToExcelClassic(WorkbookFilepath=file_path, Data=graft(yspacing_6), LocationAddress="D2", Clear=0, Stream=stream)
write_to_excel_classic_11 = WriteToExcelClassic(WorkbookFilepath=file_path, Data=graft("floors b1"), LocationAddress="E1", Clear=0, Stream=stream)
write_to_excel_classic_12 = WriteToExcelClassic(WorkbookFilepath=file_path, Data=graft(n_floors_3), LocationAddress="E2", Clear=0, Stream=stream)
write_to_excel_classic_13 = WriteToExcelClassic(WorkbookFilepath=file_path, Data=graft("bT b1"), LocationAddress="F1", Clear=0, Stream=stream)
write_to_excel_classic_14 = WriteToExcelClassic(WorkbookFilepath=file_path, Data=graft(bt_3), LocationAddress="F2", Clear=0, Stream=stream)
write_to_excel_classic_15 = WriteToExcelClassic(WorkbookFilepath=file_path, Data=graft("mT b2"), LocationAddress="N1", Clear=0, Stream=stream)
write_to_excel_classic_16 = WriteToExcelClassic(WorkbookFilepath=file_path, Data=graft(mt_2), LocationAddress="N2", Clear=0, Stream=stream)
write_to_excel_classic_17 = WriteToExcelClassic(WorkbookFilepath=file_path, Data=graft("X b2"), LocationAddress="H1", Clear=0, Stream=stream)
write_to_excel_classic_18 = WriteToExcelClassic(WorkbookFilepath=file_path, Data=graft(xsize_2), LocationAddress="H2", Clear=0, Stream=stream)
write_to_excel_classic_19 = WriteToExcelClassic(WorkbookFilepath=file_path, Data=graft("Y b2"), LocationAddress="I1", Clear=0, Stream=stream)
write_to_excel_classic_20 = WriteToExcelClassic(WorkbookFilepath=file_path, Data=graft(ysize_2), LocationAddress="I2", Clear=0, Stream=stream)
write_to_excel_classic_21 = WriteToExcelClassic(WorkbookFilepath=file_path, Data=graft("x_b2"), LocationAddress="J1", Clear=0, Stream=stream)
write_to_excel_classic_22 = WriteToExcelClassic(WorkbookFilepath=file_path, Data=graft(xspacing_5), LocationAddress="J2", Clear=0, Stream=stream)
write_to_excel_classic_23 = WriteToExcelClassic(WorkbookFilepath=file_path, Data=graft("y_b2"), LocationAddress="K1", Clear=0, Stream=stream)
write_to_excel_classic_24 = WriteToExcelClassic(WorkbookFilepath=file_path, Data=graft(yspacing_5), LocationAddress="K2", Clear=0, Stream=stream)
write_to_excel_classic_25 = WriteToExcelClassic(WorkbookFilepath=file_path, Data=graft("floors b2"), LocationAddress="L1", Clear=0, Stream=stream)
write_to_excel_classic_26 = WriteToExcelClassic(WorkbookFilepath=file_path, Data=graft(n_floors_2), LocationAddress="L2", Clear=0, Stream=stream)
write_to_excel_classic_27 = WriteToExcelClassic(WorkbookFilepath=file_path, Data=graft("bT b2"), LocationAddress="M1", Clear=0, Stream=stream)
write_to_excel_classic_28 = WriteToExcelClassic(WorkbookFilepath=file_path, Data=graft(bt_2), LocationAddress="M2", Clear=0, Stream=stream)
write_to_excel_classic_29 = WriteToExcelClassic(WorkbookFilepath=file_path, Data=graft("mT b3"), LocationAddress="U1", Clear=0, Stream=stream)
write_to_excel_classic_30 = WriteToExcelClassic(WorkbookFilepath=file_path, Data=graft(mt), LocationAddress="U2", Clear=0, Stream=stream)
write_to_excel_classic_31 = WriteToExcelClassic(WorkbookFilepath=file_path, Data=graft("X b3"), LocationAddress="O1", Clear=0, Stream=stream)
write_to_excel_classic_32 = WriteToExcelClassic(WorkbookFilepath=file_path, Data=graft(xsize), LocationAddress="O2", Clear=0, Stream=stream)
write_to_excel_classic_33 = WriteToExcelClassic(WorkbookFilepath=file_path, Data=graft("Y b3"), LocationAddress="P1", Clear=0, Stream=stream)
write_to_excel_classic_34 = WriteToExcelClassic(WorkbookFilepath=file_path, Data=graft(ysize), LocationAddress="P2", Clear=0, Stream=stream)
write_to_excel_classic_35 = WriteToExcelClassic(WorkbookFilepath=file_path, Data=graft("x_b3"), LocationAddress="Q1", Clear=0, Stream=stream)
write_to_excel_classic_36 = WriteToExcelClassic(WorkbookFilepath=file_path, Data=graft(xspacing_3), LocationAddress="Q2", Clear=0, Stream=stream)
write_to_excel_classic_37 = WriteToExcelClassic(WorkbookFilepath=file_path, Data=graft("y_b3"), LocationAddress="R1", Clear=0, Stream=stream)
write_to_excel_classic_38 = WriteToExcelClassic(WorkbookFilepath=file_path, Data=graft(yspacing_3), LocationAddress="R2", Clear=0, Stream=stream)
write_to_excel_classic_39 = WriteToExcelClassic(WorkbookFilepath=file_path, Data=graft("floors b3"), LocationAddress="S1", Clear=0, Stream=stream)
write_to_excel_classic_40 = WriteToExcelClassic(WorkbookFilepath=file_path, Data=graft(n_floors), LocationAddress="S2", Clear=0, Stream=stream)
write_to_excel_classic_41 = WriteToExcelClassic(WorkbookFilepath=file_path, Data=graft("bT b3"), LocationAddress="T1", Clear=0, Stream=stream)
write_to_excel_classic_42 = WriteToExcelClassic(WorkbookFilepath=file_path, Data=graft(bt), LocationAddress="T2", Clear=0, Stream=stream)
write_to_excel_classic_43 = WriteToExcelClassic(WorkbookFilepath=file_path, Data=graft("tot. GFA"), LocationAddress="W1", Clear=0, Stream=stream)
write_to_excel_classic_44 = WriteToExcelClassic(WorkbookFilepath=file_path, Data=graft(fv2_gfa), LocationAddress="W2", Clear=0, Stream=stream)
write_to_excel_classic_45 = WriteToExcelClassic(WorkbookFilepath=file_path, Data=graft("tot. CO2eq."), LocationAddress="X1", Clear=0, Stream=stream)
write_to_excel_classic_46 = WriteToExcelClassic(WorkbookFilepath=file_path, Data=graft(fv3_co2_emission), LocationAddress="X2", Clear=0, Stream=stream)
write_to_excel_classic_47 = WriteToExcelClassic(WorkbookFilepath=file_path, Data=graft("tot. cost"), LocationAddress="Y1", Clear=0, Stream=stream)
write_to_excel_classic_48 = WriteToExcelClassic(WorkbookFilepath=file_path, Data=graft(fv4_cost), LocationAddress="Y2", Clear=0, Stream=stream)
write_to_excel_classic_49 = WriteToExcelClassic(WorkbookFilepath=file_path, Data=graft("tot. BFA"), LocationAddress="V1", Clear=0, Stream=stream)
write_to_excel_classic_50 = WriteToExcelClassic(WorkbookFilepath=file_path, Data=graft(fv1_bfa), LocationAddress="V2", Clear=0, Stream=stream)

# ----
write_to_excel_classic_51 = WriteToExcelClassic(WorkbookFilepath=file_path, Data=graft("fV"), LocationAddress="Z1", Clear=0, Stream=stream)
write_to_excel_classic_52 = WriteToExcelClassic(WorkbookFilepath=file_path, Data=graft(fv_total), LocationAddress="Z2", Clear=0, Stream=stream)

# ==== cluster Cluster
A = ClusterInput()
multiplication = Multiplication(A=A, B=100)
round = Round(Number=multiplication)  # -> Nearest, Floor, Ceiling
nearest = ClusterOutput(round.Nearest)

# ==== cluster Cluster_2
tree = ClusterInput()
trim_tree = TrimTree(Tree=tree, Depth=1)
tree_branch = TreeBranch(Tree=trim_tree, Path="1", MaintainPaths=True)
tree_2 = ClusterOutput(trim_tree)
project = Project(Geometry=tree_branch, Plane=PlaneXY(0, 0, 0))  # -> Geometry, Transform
geometry = ClusterOutput(project.Geometry)
