# Grasshopper definition CS3_part2.gh (Grasshopper 1.0.8)
# plug-ins: RhinoCodePluginGH, CORE.Toolbox.Grasshopper

# ---- group: Adjustable parameters
# description of materialTypes: materialType 1: CLT for slabs and walls, GL32C for columns and beams
# materialType 2: precast C30/37 for all elements
# materialtype 3: precast C30/37 HCS and walls, steel beams and columns
# materialType 4: on-site-cast C30/37 for all elements
# description of buildingTypes: buildingType 1: slabs + walls in primary direction
# buildingType 2: slabs + inner walls, outer columns and outer primary beams
# buildingtype 3: slabs + columns, primary- and transverse beams
# buildingType 4: slabs + columns, primary beams if slabThickness < 200 mm
x_size = Slider(38, range=20..40)
y_size = Slider(19, range=5..20)
rectangle = Rectangle(Plane="0,0", XSize=x_size, YSize=y_size, Radius=0)  # -> Rectangle, Length
numberoffloors = Slider(5, range=2..7)
xspacing = Slider(8, range=5..10)
yspacing = Slider(7, range=5..10)
materialtype = Slider(1, range=1..4)
buildingtype = Slider(3, range=1..4)
buildingfootprintcurve = Curve(rectangle.Rectangle)
floorheight_m = Panel("3")

# ---- group: evaluates main direction
c_script = CSharpScript(xSpacing=xspacing, ySpacing=yspacing)  # -> out, mainDirection; inputs xSpacing: Double, ySpacing: Double
# ---------- c_script: C# ----------
using System;
using System.Linq;
using System.Collections;
using System.Collections.Generic;
using System.Drawing;

using Rhino;
using Rhino.Geometry;

using Grasshopper;
using Grasshopper.Kernel;
using Grasshopper.Kernel.Data;
using Grasshopper.Kernel.Types;


public class Script_Instance : GH_ScriptInstance
{
    #region Notes
    #endregion

    private void RunScript(
	double xSpacing,
	double ySpacing,
	ref object mainDirection)
    {
        if (xSpacing > ySpacing)
        {
            mainDirection = "x direction";
        }
        else
        {
            mainDirection = "y direction";
        }
    }
}
# ---------- end c_script ----------

# ----
maindirectiontext = Text(c_script.mainDirection)
csharp_script = CSharpScript(
    buildingFootPrint=buildingfootprintcurve,
    xSpacing=xspacing,
    ySpacing=yspacing,
    floors=numberoffloors,
    floorHeight=floorheight_m,
    mainDirection=maindirectiontext)  # -> out, xLinesTree, yLinesTree, zLinesTree; inputs buildingFootPrint: Curve, xSpacing: Double, ySpacing: Double, floors: Int32, floorHeight: Double, mainDirection: String
# ---------- csharp_script: C# ----------
// Grasshopper Script Instance
using System;
using System.Collections;
using System.Collections.Generic;
using System.Drawing;
 
using Rhino;
using Rhino.Geometry;
 
using Grasshopper;
using Grasshopper.Kernel;
using Grasshopper.Kernel.Data;
using Grasshopper.Kernel.Types;
using System.Linq;
 
public class Script_Instance : GH_ScriptInstance
{
 
  private void RunScript(
	Curve buildingFootPrint,
	double xSpacing,
	double ySpacing,
	int floors,
	double floorHeight,
	string mainDirection,
	ref object xLinesTree,
	ref object yLinesTree,
	ref object zLinesTree)
 
{
    //GRID
    //x, y intervals
    BoundingBox bb = buildingFootPrint.GetBoundingBox(true);
    Point3d cptmax = bb.Max;
    Point3d cptmin = bb.Min;
    double xmin = cptmin.X;
    double xmax = cptmax.X;
    double ymin = cptmin.Y;
    double ymax = cptmax.Y;
    double xdomain = xmax - xmin;
    double ydomain = ymax - ymin;
    int numberOfStepsX = Convert.ToInt32(Math.Round(xdomain/xSpacing));
    int numberOfStepsY = Convert.ToInt32(Math.Round(ydomain/ySpacing)); 

    // VerticeNodes from buildingFootPrint
    buildingFootPrint.TryGetPolyline(out Polyline polyline);
    List<Point3d> verticeNodes = polyline.ToList();

    //coordinates
    List<double> xValues = new List<double>();
    for (int i = 0; i < numberOfStepsX + 1; i++)
    {
        if (i < numberOfStepsX)
        {
            xValues.Add(xmin + i*xSpacing);
        }
        else
        {
            double secLastValue = xmin + i*xSpacing;
            double lastValue = xmax;
            if (lastValue - secLastValue <= 1)
            {
                xValues.Add(xmax);                
            }
            else
            {
                xValues.Add(xmin + i*xSpacing);
                xValues.Add(xmax);                 
            }
        }
    } 

    List<double> yValues = new List<double>();
    for (int i = 0; i < numberOfStepsY + 1; i++)
    {
        if (i < numberOfStepsY)
        {
            yValues.Add(ymin + i*ySpacing);
        }
        else
        {
            double secLastValue = ymin + i*ySpacing;
            double lastValue = ymax;
            if (lastValue - secLastValue <= 1)
            {
                yValues.Add(ymax);                
            }
            else
            {
                yValues.Add(ymin + i*ySpacing);
                yValues.Add(ymax);                 
            }
        }
    }


    //nodes by spacing
    List<Point3d> spacingNodes = new List<Point3d>();
    foreach (double x in xValues)
    {  
        foreach (double y in yValues)
        {
            Point3d spacingPt = new Point3d(x, y, 0);
            if (buildingFootPrint.Contains(spacingPt) == PointContainment.Coincident || buildingFootPrint.Contains(spacingPt) == PointContainment.Inside)
            {
                spacingNodes.Add(spacingPt);
            }
        }
    }

    //edgeNodes by spacing
    List<Line> xGrid = new List<Line>();
    foreach (double x in xValues)
    {
        Point3d startPointx = new Point3d(x, ymin, 0); 
        Point3d endPointx = new Point3d(x, ymax, 0);
        Line xLine = new Line(startPointx, endPointx);
        xGrid.Add(xLine);
    }

    List<Line> yGrid = new List<Line>();
    foreach (double y in yValues)
    {
        Point3d startPointy = new Point3d(xmin, y, 0); 
        Point3d endPointy = new Point3d(xmax, y, 0);
        Line yLine = new Line(startPointy, endPointy);
        yGrid.Add(yLine);
    }

    List<Point3d> intPts = new List<Point3d>();
    foreach (Line gridLine in xGrid)
    {
        Rhino.Geometry.Intersect.CurveIntersections intersections = Rhino.Geometry.Intersect.Intersection.CurveLine(buildingFootPrint, gridLine, 0.01, 0.01);
        foreach (Rhino.Geometry.Intersect.IntersectionEvent intEvent in intersections)
        {
            if (intEvent.IsPoint)
            {
                Point3d intPt = StandardizePoint(intEvent.PointA);
                intPts.Add(intPt); 
            }
        }   
    }

    foreach (Line gridLine in yGrid)
    {   
        Rhino.Geometry.Intersect.CurveIntersections intersections = Rhino.Geometry.Intersect.Intersection.CurveLine(buildingFootPrint, gridLine, 0.01, 0.01);
        foreach (Rhino.Geometry.Intersect.IntersectionEvent intEvent in intersections)
        {
            if (intEvent.IsPoint)
            {
                Point3d intPt = StandardizePoint(intEvent.PointA);
                intPts.Add(intPt); 
            }
        }
    }

    //all nodes unsorted
    List<Point3d> mergedList = new List<Point3d>();
    mergedList.AddRange(spacingNodes);
    mergedList.AddRange(verticeNodes);
    mergedList.AddRange(intPts);
    List<Point3d> allNodesUnsorted = RemoveDuplicateNodes(mergedList, 0.1);
    allNodesUnsorted = allNodesUnsorted.Select(p => new Point3d(p.X, p.Y, p.Z)).ToList();
   
    //creates datatree with branches {xrow}
    DataTree<Point3d> ptsByX = new DataTree<Point3d>();
    var groupsByX = allNodesUnsorted.GroupBy(p => p.X).OrderBy(g => g.Key);
    int pathIndexX = 0;
    foreach (var group in groupsByX)
    {
        List<Point3d> sortedPoints = group.OrderBy(p => p.Y).ToList();
        GH_Path path = new GH_Path(pathIndexX++);
        ptsByX.AddRange(sortedPoints, path);
    }

    //creates datatree with branches {yrow}
    DataTree<Point3d> ptsByY = new DataTree<Point3d>();
    var groupsByY = allNodesUnsorted.GroupBy(p => p.Y).OrderBy(g => g.Key);
    int pathIndexY = 0;
    foreach (var group in groupsByY)
    {
        List<Point3d> sortedPoints = group.OrderBy(p => p.X).ToList();
        GH_Path path = new GH_Path(pathIndexY++);
        ptsByY.AddRange(sortedPoints, path);
    }

    //list of z-values for each floor
    List<double> zVals = new List<double>();
    for (int i = 0; i <= floors; i++)
    {
        double zVal = i*floorHeight;
        zVals.Add(zVal);
    }

    //creates datatree with branches {floor;row}
    DataTree<Point3d> rowByXTree = new DataTree<Point3d>();
    DataTree<Point3d> rowByYTree = new DataTree<Point3d>();
    int level = 0;
    foreach(double zVal in zVals)
    {
        for (int j = 0; j < ptsByX.BranchCount; j++)
        {
            for (int k = 0 ; k < ptsByX.Branch(j).Count; k++)
            {
                Point3d pt = new Point3d(ptsByX.Branch(j)[k].X, ptsByX.Branch(j)[k].Y, zVal);
                rowByXTree.Add(pt, new GH_Path(level, j));
            }
        }  
        for (int j = 0; j < ptsByY.BranchCount; j++)
        {
            for (int k = 0 ; k < ptsByY.Branch(j).Count; k++)
            {
                Point3d pt = new Point3d(ptsByY.Branch(j)[k].X, ptsByY.Branch(j)[k].Y, zVal);
                rowByYTree.Add(pt, new GH_Path(level, j));
            }
        } 
        level++;
    }

/*    
    //beams in x-direction (polybeams and beam segments)
    DataTree<Polyline> polyBeamsInX = new DataTree<Polyline>();
    DataTree<Line> segmentedBeamsInX =  new DataTree<Line>();
    for (int i = 1; i < rowByYTree.BranchCount; i++)
    {
        GH_Path floorPath = new GH_Path(i);  
        int branchIndexPolyX = 0;
 
        while (rowByYTree.PathExists(new GH_Path(i, branchIndexPolyX)))
        {
            GH_Path path = new GH_Path(i, branchIndexPolyX);
            List<Point3d> pointsInRow = rowByYTree.Branch(path);
 
            if (pointsInRow.Count > 1)
            {
                Polyline plyline = new Polyline(pointsInRow);
                List<Line> linesInside = new List<Line>();
                for (int ps =0; ps < plyline.SegmentCount ; ps++)
                {
                    Line singleLine = plyline.SegmentAt(ps);
                    Point3d testPoint = singleLine.PointAt(0.5);
                    PointContainment pc = buildingFootPrint.Contains(testPoint);
                    if (pc == PointContainment.Inside || pc == PointContainment.Coincident)
                    {  
                        linesInside.Add(singleLine);
                    }
                }
                Polyline[] pl1 = Polyline.CreateByJoiningLines(linesInside, 0.0001, false);
 
                polyBeamsInX.AddRange(pl1, path);
               
                Line[] lineSegmentY = plyline.GetSegments();
                foreach (Line segment in lineSegmentY)
                {
                    if (segment.Length <= xSpacing+1)
                    {
                        if (buildingFootPrint.Contains(segment.PointAt(0.5)) == PointContainment.Inside || buildingFootPrint.Contains(segment.PointAt(0.5)) == PointContainment.Coincident)
                        {
                            segmentedBeamsInX.Add(segment,path);
                        }
                    }
                }          
            }        
            branchIndexPolyX++;  
        }
    }

    //beams in y-direction (polybeams and beam segments)
    DataTree<Polyline> polyBeamsInY = new DataTree<Polyline>();
    DataTree<Line> segmentedBeamsInY =  new DataTree<Line>(); 
    for (int i = 1; i < rowByXTree.BranchCount; i++)
    {
        GH_Path floorPath = new GH_Path(i);  
        int branchIndexPolyY = 0;
 
        while (rowByXTree.PathExists(new GH_Path(i, branchIndexPolyY)))
        {
            GH_Path path = new GH_Path(i, branchIndexPolyY);
            List<Point3d> pointsInRow = rowByXTree.Branch(path);
 
            if (pointsInRow.Count > 1)
            {
                Polyline plyline = new Polyline(pointsInRow);
                List<Line> linesInside = new List<Line>();
                for (int ps =0; ps < plyline.SegmentCount ; ps++)
                {
                    Line singleLine = plyline.SegmentAt(ps);
                    Point3d testPoint = singleLine.PointAt(0.5);
                    PointContainment pc = buildingFootPrint.Contains(testPoint);
                    if (pc == PointContainment.Inside || pc == PointContainment.Coincident)
                    {  
                        linesInside.Add(singleLine);
                    }
                }
                Polyline[] pl1 = Polyline.CreateByJoiningLines(linesInside, 0.0001, false);
 
                polyBeamsInY.AddRange(pl1, path);
 
                Line[] lineSegmentX = plyline.GetSegments();
                foreach (Line segment in lineSegmentX)
                {
                    if (segment.Length <= ySpacing+1)
                    {
                        if (buildingFootPrint.Contains(segment.PointAt(0.5)) == PointContainment.Inside || buildingFootPrint.Contains(segment.PointAt(0.5)) == PointContainment.Coincident)
                        {
                            segmentedBeamsInY.Add(segment,path);
                        }
                    }     
                }
            }
            branchIndexPolyY++;  
        }
    }
    */

    //beams in x-direction (polybeams and beam segments)
    DataTree<Line> segmentedBeamsInX = new DataTree<Line>();
    foreach (GH_Path path in rowByYTree.Paths)
    {
        List<Point3d> pointsInRow = rowByYTree.Branch(path);
        List<Line> lineSegments = new List<Line>();
        for (int i = 0; i < pointsInRow.Count - 1; i++)
        { 
            Point3d currPt = pointsInRow[i];
            Point3d nextPt = pointsInRow[i + 1];
            Line beam = new Line(currPt, nextPt);
            Point3d midPt = beam.PointAt(0.5);

        if ((buildingFootPrint.Contains(midPt) == PointContainment.Coincident || buildingFootPrint.Contains(midPt) == PointContainment.Inside) && beam.Length <= xSpacing + 1)
            {
                lineSegments.Add(beam);
            }
        }
        segmentedBeamsInX.AddRange(lineSegments, path);
    }

    //beams in y-direction (polybeams and beam segments)
    DataTree<Line> segmentedBeamsInY = new DataTree<Line>();
    foreach (GH_Path path in rowByXTree.Paths)
    {
        List<Point3d> pointsInRow = rowByXTree.Branch(path);
        List<Line> lineSegments = new List<Line>();
        for (int i = 0; i < pointsInRow.Count - 1; i++)
        { 
            Point3d currPt = pointsInRow[i];
            Point3d nextPt = pointsInRow[i + 1];
            Line beam = new Line(currPt, nextPt);
            Point3d midPt = beam.PointAt(0.5);

        if ((buildingFootPrint.Contains(midPt) == PointContainment.Coincident || buildingFootPrint.Contains(midPt) == PointContainment.Inside) && beam.Length <= ySpacing + 1)
            {
                lineSegments.Add(beam);
            }
        }
        segmentedBeamsInY.AddRange(lineSegments, path);
    }

    //column segments by floor
    DataTree<Line> segmentedColumnsInZ =  new DataTree<Line>();
    if (mainDirection == "x direction")
    {        
        for (int j = 0; j < rowByXTree.BranchCount; j++)
        {
            GH_Path currentPath = rowByXTree.Paths[j];
            List<Point3d> currentBranchPoints = rowByXTree.Branch(currentPath);
            for (int k = 0; k < currentBranchPoints.Count; k++)
            {
                    GH_Path nextFloorPath = new GH_Path(currentPath.Indices[0] + 1, currentPath.Indices[1]);
                    if (rowByXTree.PathExists(nextFloorPath))
                    {
                        List<Point3d> nextBranchPoints = rowByXTree.Branch(nextFloorPath);
                    
                        if (k < nextBranchPoints.Count)
                        {
                            Line verticalLine = new Line(currentBranchPoints[k], nextBranchPoints[k]);
                            segmentedColumnsInZ.Add(verticalLine, currentPath);
                        }      
                    }
            }
        }
    }

    else if (mainDirection == "y direction")
    {       
        for (int j = 0; j < rowByYTree.BranchCount; j++)
        {
            GH_Path currentPath = rowByYTree.Paths[j];
            List<Point3d> currentBranchPoints = rowByYTree.Branch(currentPath);
            for (int k = 0; k < currentBranchPoints.Count; k++)
            {
                    GH_Path nextFloorPath = new GH_Path(currentPath.Indices[0] + 1, currentPath.Indices[1]);
                    if (rowByYTree.PathExists(nextFloorPath))
                    {
                        List<Point3d> nextBranchPoints = rowByYTree.Branch(nextFloorPath);
                    
                        if (k < nextBranchPoints.Count)
                        {
                            Line verticalLine = new Line(currentBranchPoints[k], nextBranchPoints[k]);
                            segmentedColumnsInZ.Add(verticalLine, currentPath);
                        }      
                    }
            }
        }
    }

    //OUTPUTS
    xLinesTree = segmentedBeamsInX;
    yLinesTree = segmentedBeamsInY;
    zLinesTree = segmentedColumnsInZ;
}
 
//method: removes node duplicates in a list of points
List<Point3d> RemoveDuplicateNodes(List<Point3d> nodeList, double tolerance)
{
    var comparer = new Point3dEqualityComparer(tolerance);
    var uniqueNodes = new HashSet<Point3d>(nodeList, comparer);
    return uniqueNodes.ToList();
}

//IEqualityComparer to compare Point3d with a tolerance
public class Point3dEqualityComparer : IEqualityComparer<Point3d>
{
    private readonly double _tolerance;

    public Point3dEqualityComparer(double tolerance)
    {
        _tolerance = tolerance;
    }

    public bool Equals(Point3d x, Point3d y)
    {
        return x.DistanceToSquared(y) < _tolerance * _tolerance;
    }

    public int GetHashCode(Point3d obj)
    {
        int hashX = Convert.ToInt32(Math.Round(obj.X / _tolerance));
        int hashY = Convert.ToInt32(Math.Round(obj.Y / _tolerance));
        int hashZ = Convert.ToInt32(Math.Round(obj.Z / _tolerance));
        return hashX ^ hashY ^ hashZ;
    }
}

//method: avoids duplicate points beacuse of rounding
public Point3d StandardizePoint(Point3d point)
{
    double x = Math.Round(point.X, 1, MidpointRounding.AwayFromZero);
    double y = Math.Round(point.Y, 1, MidpointRounding.AwayFromZero);
    double z = Math.Round(point.Z, 1, MidpointRounding.AwayFromZero); 

    return new Point3d(x, y, z);
}

//method to customize grid of points to vertices and spacing
List<double> GenerateAdjustedValues(double min, int numberOfSteps, double spacing, List<Point3d> vertices, char axis, double max) 
{
    List<double> values = new List<double>();
    double current = min;

    for (int i = 0; i <= numberOfSteps; i++) 
    {
        double target = min + i * spacing;

        Point3d? closestVertice = vertices
            .Select(v => new { Vertice = v, Distance = Math.Abs((axis == 'X' ? v.X : v.Y) - target) })
            .Where(v => v.Distance <= 1.0)
            .OrderBy(v => v.Distance)
            .FirstOrDefault()?.Vertice;

        if (closestVertice.HasValue) 
        {
            current = (axis == 'X' ? closestVertice.Value.X : closestVertice.Value.Y);
        } 
        else 
        {
            current = target;
        }

        if (values.Count > 0 && Math.Abs(current - values.Last()) < spacing) 
        {
           
            current = values.Last() + spacing;
        }

        if (i == 0 || Math.Abs(current - values.Last()) >= spacing) 
        {
            values.Add(current);
        }
    }

    if (values.Count > 1 && Math.Abs(max - numberOfSteps ) <= 1) 
    {
        values.RemoveAt(values.Count - 2);
    }

    return values;
}
/*
List<double> GenerateAdjustedValues(double min, int numberOfSteps, double spacing, List<Point3d> vertices, char axis) 
{
    List<double> values = new List<double>();
    double current = min;

    for (int i = 0; i <= numberOfSteps; i++) 
    {
        double target = min + i * spacing;

        Point3d? closestVertice = vertices
            .Select(v => new { Vertice = v, Distance = Math.Abs((axis == 'X' ? v.X : v.Y) - target) })
            .Where(v => v.Distance <= 1.0)
            .OrderBy(v => v.Distance)
            .FirstOrDefault()?.Vertice;

        if (closestVertice.HasValue) 
        {
            current = (axis == 'X' ? closestVertice.Value.X : closestVertice.Value.Y);
        } 
        else 
        {
            current = target;
        }

        if (values.Count > 0 && Math.Abs(current - values.Last()) < spacing) 
        {
           
            current = values.Last() + spacing;
        }

        if (i == 0 || Math.Abs(current - values.Last()) >= spacing) 
        {
            values.Add(current);
        }
    }

    if (values.Count > 1 && Math.Abs(values[values.Count - 1] - values[values.Count - 2]) <= 1) 
    {
        values.RemoveAt(values.Count - 2);
    }

    return values;
}
*/


}
# ---------- end csharp_script ----------
ylinetree = Line(csharp_script.yLinesTree)
zlinetree = Line(csharp_script.zLinesTree)
xlinetree = Line(csharp_script.xLinesTree)
ylinetree_2 = Line(ylinetree)
xlinetree_2 = Line(xlinetree)
zlinetree_2 = Line(zlinetree)
buildingfootprint = Curve(buildingfootprintcurve)
xlinestree = Line(csharp_script.xLinesTree)
ylinestree = Line(csharp_script.yLinesTree)

# ---- group: divideZLinesPrMeter
c_script_2 = CSharpScript(line=graft(zlinetree_2))  # -> out, startPt, endPt; inputs line: tree of Line
# ---------- c_script_2: C# ----------
using System;
using System.Linq;
using System.Collections;
using System.Collections.Generic;
using System.Drawing;

using Rhino;
using Rhino.Geometry;

using Grasshopper;
using Grasshopper.Kernel;
using Grasshopper.Kernel.Data;
using Grasshopper.Kernel.Types;


public class Script_Instance : GH_ScriptInstance
{


    private void RunScript(
	DataTree<Line> line,
	ref object startPt,
	ref object endPt)
{
    DataTree<Point3d> startPoints = new DataTree<Point3d>();
    DataTree<Point3d> endPoints = new DataTree<Point3d>();

    for (int i = 0; i < line.BranchCount; i++)
    {
        GH_Path path = line.Path(i);
        List<Line> lines = line.Branch(i);

        for (int j = 0; j < lines.Count; j++)
        {
            startPoints.Add(lines[j].From, path);
            endPoints.Add(lines[j].To, path);
        }
    }
    startPt = startPoints;
    endPt = endPoints;
}
}
# ---------- end c_script_2 ----------
divide_length = DivideLength(Curve=zlinetree_2, Length="1")  # -> Points, Tangents, Parameters
merge = Merge(Data1=c_script_2.startPt, Data2=divide_length.Points, Data3=c_script_2.endPt)
cull_duplicates = CullDuplicates(Points=merge, Tolerance=0.1, CullMode=3)  # -> Points, Indices, Valence
polyline = PolyLine(Vertices=cull_duplicates.Points, Closed=False)  # -> simplify(Polyline)
zsegmentpoints = Point(simplify(cull_duplicates.Points))
explode = Explode(Curve=polyline, Recursive=True)  # -> simplify(Segments), Vertices
trim_tree = TrimTree(Tree=zsegmentpoints, Depth="2")
trim_tree_2 = TrimTree(Tree=explode.Segments, Depth="2")

# ---- group: divideYLinesPrMeter
c_script_3 = CSharpScript(line=graft(ylinetree_2))  # -> out, startPt, endPt; inputs line: tree of Line; same code as c_script_2
divide_length_2 = DivideLength(Curve=ylinetree_2, Length="1")  # -> Points, Tangents, Parameters
merge_2 = Merge(Data1=c_script_3.startPt, Data2=divide_length_2.Points, Data3=c_script_3.endPt)
cull_duplicates_2 = CullDuplicates(Points=merge_2, Tolerance=0.1, CullMode=3)  # -> Points, Indices, Valence
polyline_2 = PolyLine(Vertices=cull_duplicates_2.Points, Closed=False)  # -> simplify(Polyline)
ysegmentpoints = Point(simplify(cull_duplicates_2.Points))
explode_2 = Explode(Curve=polyline_2, Recursive=True)  # -> simplify(Segments), Vertices

# ---- group: divideXLinesPrMeter
c_script_4 = CSharpScript(line=graft(xlinetree_2))  # -> out, startPt, endPt; inputs line: tree of Line; same code as c_script_2
divide_length_3 = DivideLength(Curve=xlinetree_2, Length="1")  # -> Points, Tangents, Parameters
merge_3 = Merge(Data1=c_script_4.startPt, Data2=divide_length_3.Points, Data3=c_script_4.endPt)
cull_duplicates_3 = CullDuplicates(Points=merge_3, Tolerance=0.1, CullMode=3)  # -> Points, Indices, Valence
polyline_3 = PolyLine(Vertices=cull_duplicates_3.Points, Closed=False)  # -> simplify(Polyline)
xsegmentpoints = Point(simplify(cull_duplicates_3.Points))
explode_3 = Explode(Curve=polyline_3, Recursive=True)  # -> simplify(Segments), Vertices
trim_tree_3 = TrimTree(Tree=xsegmentpoints, Depth="2")
trim_tree_4 = TrimTree(Tree=explode_3.Segments, Depth="2")

# ---- group: floors
trim_tree_5 = TrimTree(Tree=xlinestree, Depth=1)
trim_tree_6 = TrimTree(Tree=ylinestree, Depth=1)
boundary_surfaces = BoundarySurfaces(Edges=buildingfootprint)
tree_branch = TreeBranch(Tree=trim_tree_5, Path="1", MaintainPaths=True)
tree_branch_2 = TreeBranch(Tree=trim_tree_6, Path="1", MaintainPaths=True)
numberoffloors_2 = Number(numberoffloors)
floorheight = Number(floorheight_m)
project = Project(Geometry=flatten([tree_branch, tree_branch_2]), Plane=PlaneXY(0, 0, 0))  # -> Geometry, Transform
project_2 = Project(Geometry=boundary_surfaces, Plane=PlaneXY(0, 0, 0))  # -> Geometry, Transform
series = Series(Start=floorheight, Step=floorheight, Count=numberoffloors_2)
surface_split = SurfaceSplit(Surface=project_2.Geometry, Curves=project.Geometry)
unit_z = UnitZ(Factor=series)
move = Move(Geometry=surface_split, Motion=simplify(graft(unit_z)))  # -> simplify(Geometry), Transform

# ----
xlinetree_3 = Line(csharp_script.xLinesTree)
ylinetree_3 = Line(csharp_script.yLinesTree)

# ---- group: xWalls, yWalls
cluster = Cluster(tree=xlinetree_3)  # -> geometry, tree_2
cluster_2 = Cluster(tree=ylinetree_3)  # -> geometry, tree_2
c_script_5 = CSharpScript(floorLines=cluster.geometry, linesByFloorTree=cluster.tree_2)  # -> out, xwalls; inputs floorLines: list of Line, linesByFloorTree: tree of Line
# ---------- c_script_5: C# ----------
// Grasshopper Script Instance
#region Usings
using System;
using System.Linq;
using System.Collections;
using System.Collections.Generic;
using System.Drawing;

using Rhino;
using Rhino.Geometry;

using Grasshopper;
using Grasshopper.Kernel;
using Grasshopper.Kernel.Data;
using Grasshopper.Kernel.Types;
#endregion

public class Script_Instance : GH_ScriptInstance
{
    #region Notes
    /* 
      Members:
        RhinoDoc RhinoDocument
        GH_Document GrasshopperDocument
        IGH_Component Component
        int Iteration

      Methods (Virtual & overridable):
        Print(string text)
        Print(string format, params object[] args)
        Reflect(object obj)
        Reflect(object obj, string method_name)
    */
    #endregion

    private void RunScript(
	List<Line> floorLines,
	DataTree<Line> linesByFloorTree,
	ref object xwalls)
    {
        DataTree<Brep> walls = new DataTree<Brep>();
        //linesByFloorTree.AddRange(floorLines, new GH_Path(0));
        for (int i = 0; i < linesByFloorTree.BranchCount - 1; i++)
        {
            List<Line> currentFloorLines = linesByFloorTree.Branch(i);
            List<Line> nextFloorLines = linesByFloorTree.Branch(i + 1);
            
            GH_Path floorPath = new GH_Path(i); 

            for (int j = 0; j < currentFloorLines.Count; j++)
            {
                Line upperLine = currentFloorLines[j];
                if (j < nextFloorLines.Count)
                {
                    Line lowerLine = nextFloorLines[j];

                    List<Curve> crvs = new List<Curve>{upperLine.ToNurbsCurve(), lowerLine.ToNurbsCurve()};
                    Brep[] bs = Brep.CreateFromLoft(crvs, Point3d.Unset, Point3d.Unset, LoftType.Normal, false);

                    if (bs != null && bs.Length > 0)
                    {
                        walls.Add(bs[0], floorPath); 
                    }
                }
            }
        }
        xwalls = walls; 
    }
}
# ---------- end c_script_5 ----------
c_script_6 = CSharpScript(floorLines=cluster_2.geometry, linesByFloorTree=cluster_2.tree_2)  # -> out, ywalls; inputs floorLines: list of Line, linesByFloorTree: tree of Line
# ---------- c_script_6: C# ----------
// Grasshopper Script Instance
#region Usings
using System;
using System.Linq;
using System.Collections;
using System.Collections.Generic;
using System.Drawing;

using Rhino;
using Rhino.Geometry;

using Grasshopper;
using Grasshopper.Kernel;
using Grasshopper.Kernel.Data;
using Grasshopper.Kernel.Types;
#endregion

public class Script_Instance : GH_ScriptInstance
{
    #region Notes
    /* 
      Members:
        RhinoDoc RhinoDocument
        GH_Document GrasshopperDocument
        IGH_Component Component
        int Iteration

      Methods (Virtual & overridable):
        Print(string text)
        Print(string format, params object[] args)
        Reflect(object obj)
        Reflect(object obj, string method_name)
    */
    #endregion

    private void RunScript(
	List<Line> floorLines,
	DataTree<Line> linesByFloorTree,
	ref object ywalls)
    {
        DataTree<Brep> walls = new DataTree<Brep>();
        //linesByFloorTree.AddRange(floorLines, new GH_Path(0));
        for (int i = 0; i < linesByFloorTree.BranchCount - 1; i++)
        {
            List<Line> currentFloorLines = linesByFloorTree.Branch(i);
            List<Line> nextFloorLines = linesByFloorTree.Branch(i + 1);
            
            GH_Path floorPath = new GH_Path(i); 

            for (int j = 0; j < currentFloorLines.Count; j++)
            {
                Line upperLine = currentFloorLines[j];
                if (j < nextFloorLines.Count)
                {
                    Line lowerLine = nextFloorLines[j];

                    List<Curve> crvs = new List<Curve>{upperLine.ToNurbsCurve(), lowerLine.ToNurbsCurve()};
                    Brep[] bs = Brep.CreateFromLoft(crvs, Point3d.Unset, Point3d.Unset, LoftType.Normal, false);

                    if (bs != null && bs.Length > 0)
                    {
                        walls.Add(bs[0], floorPath); 
                    }
                }
            }
        }
        ywalls = walls;
    }
}
# ---------- end c_script_6 ----------

# ---- group: zElements
zlinetree_3 = Line(zlinetree)
trim_tree_7 = TrimTree(Tree=zlinetree_3, Depth="1")

# ---- group: evaluates slab thickness
c_script_7 = CSharpScript(xSpacing=yspacing, ySpacing=yspacing, materialType=materialtype)  # -> out, slabThickness; inputs xSpacing: Double, ySpacing: Double, materialType: Int32
# ---------- c_script_7: C# ----------
using System;
using System.Linq;
using System.Collections;
using System.Collections.Generic;
using System.Drawing;

using Rhino;
using Rhino.Geometry;

using Grasshopper;
using Grasshopper.Kernel;
using Grasshopper.Kernel.Data;
using Grasshopper.Kernel.Types;

public class Script_Instance : GH_ScriptInstance
{
    private void RunScript(
	double xSpacing,
	double ySpacing,
	int materialType,
	ref object slabThickness)
    {

    double span = Math.Min(xSpacing, ySpacing);

    if (materialType == 1) //CLT
    {
        if (span == 5)
        {
            slabThickness = 0.16;
        }
        else if (span > 5 && span <= 5.5 )
        {
            slabThickness = 0.175;
        }
        else if (span > 5.5 && span <= 6 )
        {
            slabThickness = 0.19;
        }
        else if (span > 6 && span <= 6.5 )
        {
            slabThickness = 0.205;
        }
        else if (span > 6.5 && span <= 7 )
        {
            slabThickness = 0.22;
        }
        else if (span > 7 && span <= 7.5 )
        {
            slabThickness = 0.245;
        }
        else if (span > 7.5 && span <= 8 )
        {
            slabThickness = 0.270;
        }
        else if (span > 8 && span <= 8.5 )
        {
            slabThickness = 0.3;
        }
        else if (span > 8.5 && span <= 9 )
        {
            slabThickness = 0.33;
        }
        else if (span > 9 && span <= 9.5 )
        {
            slabThickness = 0.36;
        }
        else if (span > 9.5 && span <= 10 )
        {
            slabThickness = 0.39;
        }
    }

    else if (materialType == 2 || materialType == 3) //HC
    {
        slabThickness = 0.2;
    }

    else if (materialType == 4) //RC
    {
        if (span == 5)
        {
            slabThickness = 0.18;
        }
        else if (span > 5 && span <= 5.5 )
        {
            slabThickness = 0.195;
        }
        else if (span > 5.5 && span <= 6 )
        {
            slabThickness = 0.2;
        }
        else if (span > 6 && span <= 6.5 )
        {
            slabThickness = 0.225;
        }
        else if (span > 6.5 && span <= 7 )
        {
            slabThickness = 0.25;
        }
        else if (span > 7 && span <= 7.5 )
        {
            slabThickness = 0.26;
        }
        else if (span > 7.5 && span <= 8 )
        {
            slabThickness = 0.27;
        }
        else if (span > 8 && span <= 8.5 )
        {
            slabThickness = 0.3;
        }
        else if (span > 8.5 && span <= 9 )
        {
            slabThickness = 0.33;
        }
        else if (span > 9 && span <= 9.5 )
        {
            slabThickness = 0.36;
        }
        else if (span > 9.5 && span <= 10 )
        {
            slabThickness = 0.39;
        }
    }
    }
}
# ---------- end c_script_7 ----------

# ----
slabthicknessnumber = Number(c_script_7.slabThickness)
xsegmentpoints_floor = Point(trim_tree_3)
ysegmentpoints_floor = Point(ysegmentpoints)
ysegmentbeamlines_floor = Line(explode_2.Segments)
zsegmentpoints_floor = Point(trim_tree)
zsegmentbeamlines_floor = Line(trim_tree_2)
zelementsline = Line(trim_tree_7)
floorsurfaces_floor = Surface(move.Geometry)
xwallsurface = Surface(c_script_5.xwalls)
ywallsurface = Surface(c_script_6.ywalls)
xsegmentbeamlines_floor = Line(trim_tree_4)
buildingfootprintcurve_2 = Curve(buildingfootprintcurve)
xsegmentline = Line(xsegmentbeamlines_floor)
ysegmentline = Line(ysegmentbeamlines_floor)
zelementsline_2 = Line(zelementsline)
buildingtypenumber = Number(buildingtype)
materialtypenumber = Number(materialtype)
xsegmentpoints_2 = Point(xsegmentpoints_floor)
ysegmentpoints_2 = Point(ysegmentpoints_floor)
zsegmentpoints_2 = Point(zsegmentpoints_floor)
buildingtypenumber_2 = Number(buildingtype)
maindirectiontext_2 = Text(c_script.mainDirection)
materialtypenumber_2 = Number(materialtype)
slabthickness_m = Panel(slabthicknessnumber)
maindirectiontext_3 = Text(c_script.mainDirection)
slabthickness_m_2 = Panel(slabthicknessnumber)
buildingfootprintcurve_3 = Curve(buildingfootprintcurve)
xwallsurface_2 = Surface(xwallsurface)
ywallsurface_2 = Surface(ywallsurface)
maindirectiontext_4 = Text(c_script.mainDirection)
buildingfootprintcurve_4 = Curve(buildingfootprintcurve)
zelementsline_3 = Line(zelementsline)
floorsurfaces_floor_2 = Surface(floorsurfaces_floor)
buildingtypenumber_3 = Number(buildingtype)

# ---- group: filters / walls filter
c_script_8 = CSharpScript(
    buildingFootPrint=buildingfootprintcurve_3,
    xWalls=xwallsurface_2,
    yWalls=ywallsurface_2,
    buildingType=buildingtypenumber_3,
    mainDirection=maindirectiontext_4)  # -> out, walls; inputs buildingFootPrint: Curve, xWalls: tree of Surface, yWalls: tree of Surface, buildingType: Int32
# ---------- c_script_8: C# ----------
// Grasshopper Script Instance
#region Usings
using System;
using System.Linq;
using System.Collections;
using System.Collections.Generic;
using System.Drawing;

using Rhino;
using Rhino.Geometry;

using Grasshopper;
using Grasshopper.Kernel;
using Grasshopper.Kernel.Data;
using Grasshopper.Kernel.Types;
#endregion

public class Script_Instance : GH_ScriptInstance
{
    private void RunScript(
	Curve buildingFootPrint,
	DataTree<Surface> xWalls,
	DataTree<Surface> yWalls,
	int buildingType,
	object mainDirection,
	ref object walls)
    {
        if (mainDirection == "x direction")
        {          
            if (buildingType == 1)
            {
                walls = xWalls;
            }
            else if (buildingType == 2)
            {
                DataTree<Surface> outerWallsExcludedX = new DataTree<Surface>();
                for (int i = 0; i < xWalls.BranchCount; i++)
                {
                    GH_Path floorPath = new GH_Path(i);
                    foreach (Surface srf in xWalls.Branch(i))
                    {
                        Point3d srfCenter = srf.PointAt(0.5, 0.5);
                        Point3d srfCenterFlat = new Point3d(srfCenter.X, srfCenter.Y, 0);                        
                        if (buildingFootPrint.Contains(srfCenterFlat) == PointContainment.Inside)
                        {
                            outerWallsExcludedX.Add(srf);
                        }
                    }
                 }
                 walls = outerWallsExcludedX;
            }
        }
        
        if (mainDirection == "y direction")
        {  
            if (buildingType == 1)
            {
                walls = yWalls;
            }
            else if (buildingType == 2)
            {
                DataTree<Surface> outerWallsExcludedY = new DataTree<Surface>();
                for (int i = 0; i < yWalls.BranchCount; i++)
                {
                    GH_Path floorPath = new GH_Path(i);
                    foreach (Surface srf in yWalls.Branch(i))
                    {
                        Point3d srfCenter = srf.PointAt(0.5, 0.5);
                        Point3d srfCenterFlat = new Point3d(srfCenter.X, srfCenter.Y, 0);                        
                        if (buildingFootPrint.Contains(srfCenterFlat) == PointContainment.Inside)
                        {
                            outerWallsExcludedY.Add(srf);
                        }
                    }
                 }
                 walls = outerWallsExcludedY;
            }
        }
    }
}
# ---------- end c_script_8 ----------

# ---- group: supportPts and inclusionPts filter
c_script_9 = CSharpScript(
    buildingFootPrint=buildingfootprintcurve_4,
    xSegmentPts=xsegmentpoints_2,
    ySegmentPts=ysegmentpoints_2,
    zSegmentPts=zsegmentpoints_2,
    zElements=zelementsline_3,
    buildingType=buildingtypenumber_2,
    mainDirection=maindirectiontext_2,
    materialType=materialtypenumber_2,
    slabThickness=slabthickness_m)  # -> out, inclusionPts, supportPts; inputs buildingFootPrint: Curve, xSegmentPts: tree of Point3d, ySegmentPts: tree of Point3d, zSegmentPts: tree of Point3d, zElements: tree of Line, buildingType: Int32, mainDirection: String, materialType: Int32, slabThickness: Double
# ---------- c_script_9: C# ----------
using System;
using System.Linq;
using System.Collections;
using System.Collections.Generic;
using System.Drawing;

using Rhino;
using Rhino.Geometry;

using Grasshopper;
using Grasshopper.Kernel;
using Grasshopper.Kernel.Data;
using Grasshopper.Kernel.Types;

public class Script_Instance : GH_ScriptInstance
{
    private void RunScript(
	Curve buildingFootPrint,
	DataTree<Point3d> xSegmentPts,
	DataTree<Point3d> ySegmentPts,
	DataTree<Point3d> zSegmentPts,
	DataTree<Line> zElements,
	int buildingType,
	string mainDirection,
	int materialType,
	double slabThickness,
	ref object inclusionPts,
	ref object supportPts)
    {
        //buildingType == 1
        if (buildingType == 1)
        {
            List<Point3d> inclPts = new List<Point3d>();
            List<Point3d> supPts = new List<Point3d>();
            if (mainDirection == "x direction")
            {
                for (int i = 0; i < xSegmentPts.BranchCount; i++)
                {
                    foreach (Point3d pt in xSegmentPts.Branch(i))
                    {
                        inclPts.Add(pt);
                    }
                }
                for (int i = 0; i < zSegmentPts.BranchCount; i++)
                {
                    foreach (Point3d pt in zSegmentPts.Branch(i))
                    {
                        inclPts.Add(pt);
                    }
                }
                if (xSegmentPts.BranchCount > 0)
                {
                    List<Point3d> wallSupportPoints = xSegmentPts.Branch(0);
                    foreach (Point3d pt in wallSupportPoints)
                    {
                        supPts.Add(pt);
                    }
                }

            }

            if (mainDirection == "y direction")
            {
                for (int i = 0; i < ySegmentPts.BranchCount; i++)
                {
                    foreach (Point3d pt in ySegmentPts.Branch(i))
                    {
                        inclPts.Add(pt);
                    }
                }
                for (int i = 0; i < zSegmentPts.BranchCount; i++)
                {
                    foreach (Point3d pt in zSegmentPts.Branch(i))
                    {
                        inclPts.Add(pt);
                    }
                }
                if (ySegmentPts.BranchCount > 0)
                {
                    List<Point3d> wallSupportPoints = ySegmentPts.Branch(0);
                    foreach (Point3d pt in wallSupportPoints)
                    {
                        supPts.Add(pt);
                    }
                }
        
            }
            inclusionPts = inclPts;
            supportPts = supPts;
        }
        
        //building type == 2
        if (buildingType == 2)
        {
            DataTree<Point3d> inclPts = new DataTree<Point3d>();
            DataTree<Point3d> supPts = new DataTree<Point3d>();
            if (mainDirection == "x direction")
            {
                //walls inclusion pts
                for (int i = 0; i < xSegmentPts.BranchCount; i++)
                {
                    foreach (Point3d pt in xSegmentPts.Branch(i))
                    {
                        Point3d ptFlat = new Point3d(pt.X, pt.Y, 0);    
                        if (buildingFootPrint.Contains(ptFlat) == PointContainment.Inside)
                        {
                            inclPts.Add(pt);
                        }
                    }
                }
                //columns support and inclusion pts
                for (int i = 0; i < zSegmentPts.BranchCount; i++)
                {
                    GH_Path floorPath = new GH_Path(i);
                    foreach (Point3d pt in zSegmentPts.Branch(i))
                    {
                        if (pt.Z == 0)
                        {
                            supPts.Add(pt);
                        }

                        inclPts.Add(pt);
                    }
                }
                //beams inclusion pts
                for (int i = 1; i < xSegmentPts.BranchCount; i++)
                {
                    foreach (Point3d pt in xSegmentPts.Branch(i))
                    {
                        Point3d ptFlat = new Point3d(pt.X, pt.Y, 0);                        
                        if (buildingFootPrint.Contains(ptFlat) == PointContainment.Coincident)
                        {
                            inclPts.Add(pt);
                        }
                    }
                }
                //wall supports
                if (xSegmentPts.BranchCount > 0)
                {
                    List<Point3d> wallSupportPoints = xSegmentPts.Branch(0);
                    foreach (Point3d pt in wallSupportPoints)
                    {
                        if (buildingFootPrint.Contains(pt) == PointContainment.Inside)
                        {
                            supPts.Add(pt);
                        }
                        
                    }
                }               
            }

            if (mainDirection == "y direction")
            {
                //walls inclusion pts
                for (int i = 0; i < ySegmentPts.BranchCount; i++)
                {
                    foreach (Point3d pt in ySegmentPts.Branch(i))
                    {
                        Point3d ptFlat = new Point3d(pt.X, pt.Y, 0);    
                        if (buildingFootPrint.Contains(ptFlat) == PointContainment.Inside)
                        {
                            inclPts.Add(pt);
                        }
                    }
                }
                //columns support and inclusion pts
                for (int i = 0; i < zSegmentPts.BranchCount; i++)
                {
                    foreach (Point3d pt in zSegmentPts.Branch(i))
                    {
                        if (pt.Z == 0)
                        {
                            supPts.Add(pt);
                        }
                        inclPts.Add(pt);
                    }
                }
                //beams inclusion pts
                for (int i = 1; i < ySegmentPts.BranchCount; i++)
                {
                    foreach (Point3d pt in ySegmentPts.Branch(i))
                    {
                        Point3d ptFlat = new Point3d(pt.X, pt.Y, 0);                        
                        if (buildingFootPrint.Contains(ptFlat) == PointContainment.Coincident)
                        {
                            inclPts.Add(pt);
                        }
                    }
                }
                //wall supports
                if (xSegmentPts.BranchCount > 0)
                {
                    List<Point3d> wallSupportPoints = ySegmentPts.Branch(0);
                    foreach (Point3d pt in wallSupportPoints)
                    {
                        if (buildingFootPrint.Contains(pt) == PointContainment.Inside)
                        {
                            supPts.Add(pt);
                        }     
                    }
                }
            }            
            inclusionPts = inclPts;
            supportPts = supPts;
        }

         //buildingType == 3 
        if (buildingType == 3)
        {
            DataTree<Point3d> inclPts = new DataTree<Point3d>();
            DataTree<Point3d> supPts = new DataTree<Point3d>();
            for (int i = 1; i < xSegmentPts.BranchCount; i++)
            {
                foreach (Point3d pt in xSegmentPts.Branch(i))
                {
                    inclPts.Add(pt);
                }
            }

            for (int i = 1; i < ySegmentPts.BranchCount; i++)
            {
                foreach (Point3d pt in ySegmentPts.Branch(i))
                {
                    inclPts.Add(pt);
                }
            }

            List<Point3d> columnSupportPoints = zSegmentPts.Branch(0);
            foreach (Point3d pt in columnSupportPoints)
            {
                if (pt.Z == 0)
                {
                    supPts.Add(pt);
                }
            }
            inclusionPts = inclPts;
            supportPts = supPts;
        }

        //buildingType == 4
        if (buildingType == 4)
        {
            DataTree<Point3d> inclPts = new DataTree<Point3d>();
            DataTree<Point3d> supPts = new DataTree<Point3d>(); 
            if (mainDirection == "x direction")
            {
                List<Point3d> columnSupportPoints = zSegmentPts.Branch(0);
                foreach (Point3d pt in columnSupportPoints)
                {
                    if (pt.Z == 0)
                    {
                        supPts.Add(pt);
                    }
                }
                
                if (materialType == 4)
                {
                    if (slabThickness < 0.2)
                    {
                        for (int i = 1; i < xSegmentPts.BranchCount; i++)
                        {
                            foreach (Point3d pt in xSegmentPts.Branch(i))
                            {
                                inclPts.Add(pt);
                            }
                        }
                    }
                } 

                else
                {
                    for (int i = 1; i < xSegmentPts.BranchCount; i++)
                    {
                        foreach (Point3d pt in xSegmentPts.Branch(i))
                        {
                            inclPts.Add(pt);
                        }
                    }
                }
                inclusionPts = inclPts;
                supportPts = supPts;
            }

            if (mainDirection == "y direction")
            {
                List<Point3d> columnSupportPoints = zSegmentPts.Branch(0);
                foreach (Point3d pt in columnSupportPoints)
                {
                    if (pt.Z == 0)
                    {
                        supPts.Add(pt);
                    }
                }
                
                if (materialType == 4)
                {
                    if (slabThickness < 0.2)
                    {
                        for (int i = 1; i < ySegmentPts.BranchCount; i++)
                        {
                            foreach (Point3d pt in ySegmentPts.Branch(i))
                            {
                                inclPts.Add(pt);
                            }
                        }
                    }
                } 

                else
                {
                    for (int i = 1; i < xSegmentPts.BranchCount; i++)
                    {
                        foreach (Point3d pt in ySegmentPts.Branch(i))
                        {
                            inclPts.Add(pt);
                        }
                    }
                }
                inclusionPts = inclPts;
                supportPts = supPts;
            }
        }  
    }
}
# ---------- end c_script_9 ----------

# ---- group: beams and columns filter
c_script_10 = CSharpScript(
    buildingFootPrint=buildingfootprintcurve_2,
    xSegments=xsegmentline,
    ySegments=ysegmentline,
    zElements=zelementsline_2,
    buildingType=buildingtypenumber,
    materialType=materialtypenumber,
    mainDirection=maindirectiontext_3,
    slabThickness=slabthickness_m_2)  # -> out, primaryBeams, transverseBeams, columns; inputs buildingFootPrint: Curve, xSegments: tree of Line, ySegments: tree of Line, zElements: tree of Line, buildingType: Int32, materialType: Int32, mainDirection: String, slabThickness: Double
# ---------- c_script_10: C# ----------
using System;
using System.Linq;
using System.Collections;
using System.Collections.Generic;
using System.Drawing;

using Rhino;
using Rhino.Geometry;

using Grasshopper;
using Grasshopper.Kernel;
using Grasshopper.Kernel.Data;
using Grasshopper.Kernel.Types;

public class Script_Instance : GH_ScriptInstance
{
    private void RunScript(
	Curve buildingFootPrint,
	DataTree<Line> xSegments,
	DataTree<Line> ySegments,
	DataTree<Line> zElements,
	int buildingType,
	int materialType,
	string mainDirection,
	double slabThickness,
	ref object primaryBeams,
	ref object transverseBeams,
	ref object columns)
    {
        //buildingType == 2    
        if (buildingType == 2)
        {
            if (mainDirection == "x direction")
            {
                //primaryBeams filter: excludes inner beams in main direction
                DataTree<Line> primaryBeamsInX = new DataTree<Line>();
                for (int i = 1; i < xSegments.BranchCount; i++)
                {
                    foreach (Line line in xSegments.Branch(i))
                    {
                        Point3d lineCenter = line.PointAt(0.5);
                        Point3d lineCenterFlat = new Point3d(lineCenter.X, lineCenter.Y, 0);                        
                        if (buildingFootPrint.Contains(lineCenterFlat) == PointContainment.Coincident)
                        {
                            primaryBeamsInX.Add(line);
                        }
                    }
                }                
                //column filter: excludes inner columns
                DataTree<Line> innerColumnsExcluded = new DataTree<Line>();
                for (int i = 0; i < zElements.BranchCount; i++)
                {
                    foreach (Line line in zElements.Branch(i))
                    {
                        Point3d lineCenter = line.PointAt(0);
                        Point3d lineCenterFlat = new Point3d(lineCenter.X, lineCenter.Y, 0);                        
                        if (buildingFootPrint.Contains(lineCenterFlat) == PointContainment.Coincident)
                        {
                            innerColumnsExcluded.Add(line);
                        }
                    }
                }

                //OUTPUT
                primaryBeams = primaryBeamsInX;
                columns = zElements;
            }

            else if (mainDirection == "y direction")
            {
                //primaryBeams filter
                DataTree<Line> primaryBeamsInY = new DataTree<Line>();
                for (int i = 0; i < ySegments.BranchCount; i++)
                {
                    GH_Path floorPath = new GH_Path(i);
                    foreach (Line line in ySegments.Branch(i))
                    {
                        Point3d lineCenter = line.PointAt(0.5);
                        if (lineCenter.Z != 0)
                        {
                            Point3d lineCenterFlat = new Point3d(lineCenter.X, lineCenter.Y, 0);                        
                            if (buildingFootPrint.Contains(lineCenterFlat) == PointContainment.Coincident)
                            {
                                primaryBeamsInY.Add(line);
                            }
                        }
                        
                    }
                }
            
                //column filter: excludes inner columns
                DataTree<Line> innerColumnsExcluded = new DataTree<Line>();
                for (int i = 0; i < zElements.BranchCount; i++)
                {
                    foreach (Line line in zElements.Branch(i))
                    {
                        Point3d lineCenter = line.PointAt(0);
                        Point3d lineCenterFlat = new Point3d(lineCenter.X, lineCenter.Y, 0);                        
                        if (buildingFootPrint.Contains(lineCenterFlat) == PointContainment.Coincident)
                        {
                            innerColumnsExcluded.Add(line);
                        }
                    }
                }

                //OUTPUT
                primaryBeams = primaryBeamsInY;
                columns = zElements;
            }
        }
        


        //buildingType == 3
        else if (buildingType == 3)
        {
            if (mainDirection == "x direction")
            {
                //primaryBeams filter
                DataTree<Line> primaryBeamsInX = new DataTree<Line>();
                for (int i = 1; i < xSegments.BranchCount; i++)
                {
                    foreach (Line line in xSegments.Branch(i))
                    {
                        primaryBeamsInX.Add(line);
                    }
                }
            
                //transverseBeams filter
                DataTree<Line> transverseBeamsInY = new DataTree<Line>();
                for (int i = 0; i < ySegments.BranchCount; i++)
                {
                    foreach (Line line in ySegments.Branch(i))
                    {
                        Point3d lineCenter = line.PointAt(0.5);
                        if (lineCenter.Z != 0)
                        {
                            transverseBeamsInY.Add(line);
                        }
                    
                    }
                }

                //OUTPUT
                primaryBeams = primaryBeamsInX;
                transverseBeams = transverseBeamsInY;
                columns = zElements;
            }
            else if (mainDirection == "y direction")
            {
                //primaryBeams filter
                DataTree<Line> primaryBeamsInY = new DataTree<Line>();
                for (int i = 0; i < ySegments.BranchCount; i++)
                {
                    foreach (Line line in ySegments.Branch(i))
                    {
                        Point3d lineCenter = line.PointAt(0.5);
                        if (lineCenter.Z != 0)
                        {
                            primaryBeamsInY.Add(line);
                        }
                    
                    }
                }
            
                //transverseBeams filter
                DataTree<Line> transverseBeamsInX = new DataTree<Line>();
                for (int i = 1; i < xSegments.BranchCount; i++)
                {
                    GH_Path floorPath = new GH_Path(i);
                    foreach (Line line in xSegments.Branch(i))
                    {
                        transverseBeamsInX.Add(line);
                    }
                }

                //OUTPUT
                primaryBeams = primaryBeamsInY;
                transverseBeams = transverseBeamsInX;
                columns = zElements;
            }
        }
        
        //buildingType == 4
        else if (buildingType == 4)
        {
                if (mainDirection == "x direction")
                {
                    //primaryBeams filter
                    DataTree<Line> primaryBeamsInX = new DataTree<Line>();
                    if (materialType == 1 || materialType == 2 || materialType == 3)
                    {
                        for (int i = 1; i < xSegments.BranchCount; i++)
                            {
                                foreach (Line line in xSegments.Branch(i))
                                {
                                    primaryBeamsInX.Add(line);
                                }
                            }
                    }

                    else if (materialType == 4)
                    {
                        if (slabThickness < 0.2)
                        {
                            for (int i = 1; i < xSegments.BranchCount; i++)
                            {
                                foreach (Line line in xSegments.Branch(i))
                                {
                                    primaryBeamsInX.Add(line);
                                }
                            }
                        } 
                    }


                    //OUTPUT
                    primaryBeams = primaryBeamsInX;
                }

                else if (mainDirection == "y direction")
                {
                    //primaryBeams filter
                    DataTree<Line> primaryBeamsInY = new DataTree<Line>();

                     if (materialType == 1 || materialType == 2 || materialType == 3)
                    {
                        for (int i = 0; i < ySegments.BranchCount; i++)
                            {
                                foreach (Line line in ySegments.Branch(i))
                                {
                                    Point3d lineCenter = line.PointAt(0.5);
                                    if (lineCenter.Z != 0)
                                    {
                                        primaryBeamsInY.Add(line);
                                    }
                                }
                            }
                    }

                    else if (materialType == 4)
                    {
                        if (slabThickness < 0.2)
                        {
                            for (int i = 1; i < ySegments.BranchCount; i++)
                            {
                                foreach (Line line in ySegments.Branch(i))
                                {
                                    Point3d lineCenter = line.PointAt(0.5);
                                    if (lineCenter.Z != 0)
                                    {
                                        primaryBeamsInY.Add(line);
                                    }
                                }
                            }
                        } 
                    }

                    //OUTPUT
                    primaryBeams = primaryBeamsInY;
                }
            
                //OUTPUT
                columns = zElements;
        }    
    }
}
# ---------- end c_script_10 ----------
# ---- group: filters / filter: removes columns if overlap with wall
deconstruct_brep = DeconstructBrep(Brep=c_script_8.walls)  # -> Faces, Edges, Vertices
list_item = ListItem(List=deconstruct_brep.Edges, Index="2", Wrap=True)
list_item_2 = ListItem(List=deconstruct_brep.Edges, Index="4", Wrap=True)
collision_one_many = CollisionOneMany(Collider=flatten(c_script_10.columns), Obstacles=flatten([list_item, list_item_2]))  # -> Collision, Index
dispatch = Dispatch(List=c_script_10.columns, DispatchPattern=collision_one_many.Collision)  # -> ListA, flatten(ListB)

# ----
cull_duplicates_4 = CullDuplicates(Points=c_script_9.inclusionPts, Tolerance=0.1, CullMode=3)  # -> Points, Indices, Valence
cull_duplicates_5 = CullDuplicates(Points=c_script_9.supportPts, Tolerance=0.1, CullMode=3)  # -> Points, Indices, Valence
primarycurvepermeter = Curve(flatten(c_script_10.primaryBeams))
inclusionpoints = Point(flatten(cull_duplicates_4.Points))
transversecurvepermeter = Curve(flatten(c_script_10.transverseBeams))
wallsurfaces = Surface(flatten(c_script_8.walls))
columnlineperelement = Line(flatten(dispatch.ListB))
supportpoints = Point(flatten(cull_duplicates_5.Points))
floorsurfaces = Surface(flatten(floorsurfaces_floor_2))

# ---- group: element volumes per building [m3] / slabVolume
area = Area(Geometry=floorsurfaces)  # -> flatten(Area), Centroid
mass_addition = MassAddition(Input=area.Area)  # -> Result, PartialResults
c_script_11 = CSharpScript(slabThickness=slabthicknessnumber, buildingType=buildingtype)  # -> out, effectiveSlabThickness; inputs slabThickness: Double, buildingType: Int32
# ---------- c_script_11: C# ----------
using System;
using System.Linq;
using System.Collections;
using System.Collections.Generic;
using System.Drawing;

using Rhino;
using Rhino.Geometry;

using Grasshopper;
using Grasshopper.Kernel;
using Grasshopper.Kernel.Data;
using Grasshopper.Kernel.Types;

public class Script_Instance : GH_ScriptInstance
{

    private void RunScript(
	double slabThickness,
	int buildingType,
	ref object effectiveSlabThickness)
    {
        if (buildingType == 1 || buildingType == 4)
        {
            effectiveSlabThickness = slabThickness;
        }
        else 
        {
           effectiveSlabThickness = slabThickness * 0.55; 
        }
    }
}
# ---------- end c_script_11 ----------
totalslabarea_m2 = Number(mass_addition.Result)
multiplication = Multiplication(A=totalslabarea_m2, B=c_script_11.effectiveSlabThickness)

# ---- group: element volumes per building [m3] / beamsVolume
length = Length(Curve=[primarycurvepermeter, transversecurvepermeter])  # -> flatten(Length)
mass_addition_2 = MassAddition(Input=length)  # -> Result, PartialResults
c_script_12 = CSharpScript(massAdditionResult=mass_addition_2.Result)  # -> out, totalBeamLength
# ---------- c_script_12: C# ----------
using System;
using System.Linq;
using System.Collections;
using System.Collections.Generic;
using System.Drawing;

using Rhino;
using Rhino.Geometry;

using Grasshopper;
using Grasshopper.Kernel;
using Grasshopper.Kernel.Data;
using Grasshopper.Kernel.Types;

public class Script_Instance : GH_ScriptInstance
{
    #region Notes
    /* 
      Members:
        RhinoDoc RhinoDocument
        GH_Document GrasshopperDocument
        IGH_Component Component
        int Iteration

      Methods (Virtual & overridable):
        Print(string text)
        Print(string format, params object[] args)
        Reflect(object obj)
        Reflect(object obj, string method_name)
    */
    #endregion

    private void RunScript(object massAdditionResult, ref object totalBeamLength)
    {
        if (massAdditionResult == null)
        {
            totalBeamLength = 0;
        }
        else
        {
            totalBeamLength = massAdditionResult;
        }

    }
}
# ---------- end c_script_12 ----------
c_script_13 = CSharpScript(materials=materialtype, xSpacing=xspacing, ySpacing=yspacing)  # -> beamarea; inputs materials: Int32, xSpacing: Double, ySpacing: Double
# ---------- c_script_13: C# ----------
// Grasshopper Script Instance
#region Usings
using System;
using System.Linq;
using System.Collections;
using System.Collections.Generic;
using System.Drawing;

using Rhino;
using Rhino.Geometry;

using Grasshopper;
using Grasshopper.Kernel;
using Grasshopper.Kernel.Data;
using Grasshopper.Kernel.Types;
#endregion

public class Script_Instance : GH_ScriptInstance
{

    private void RunScript(
	int materials,
	double xSpacing,
	double ySpacing,
	ref object beamarea)
    {
        List<double> beamArea = new List<double>();
        double span = Math.Max(xSpacing, ySpacing);
        if (materials == 1) //GL
        {
            if (span == 5)
            {
                beamArea.Add(0.0378);
            }
            else if (span > 5 && span <= 5.5 )
            {
                beamArea.Add(0.0441);
            }
            else if (span > 5.5 && span <= 6 )
            {
                beamArea.Add(0.0504);
            }
            else if (span > 6 && span <= 6.5 )
            {
                beamArea.Add(0.0567);
            }
            else if (span > 6.5 && span <= 7 )
            {
                beamArea.Add(0.063);
            }
            else if (span > 7 && span <= 7.5 )
            {
                beamArea.Add(0.0696);
            }
            else if (span > 7.5 && span <= 8 )
            {
                beamArea.Add(0.0756);
            }
            else if (span > 8 && span <= 8.5 )
            {
                beamArea.Add(0.0819);
            }
            else if (span > 8.5 && span <= 9 )
            {
                beamArea.Add(0.0882);
            }
            else if (span > 9 && span <= 9.5 )
            {
                beamArea.Add(0.0945);
            }
            else if (span > 9.5 && span <= 10 )
            {
                beamArea.Add(0.1008);
            }
        }

        else if (materials == 2) //PC
        {
            if (span == 5)
            {
                beamArea.Add(0.072);
            }
            else if (span > 5 && span <= 5.5 )
            {
                beamArea.Add(0.08);
            }
            else if (span > 5.5 && span <= 6 )
            {
                beamArea.Add(0.086);
            }
            else if (span > 6 && span <= 6.5 )
            {
                beamArea.Add(0.094);
            }
            else if (span > 6.5 && span <= 7 )
            {
                beamArea.Add(0.1);
            }
            else if (span > 7 && span <= 7.5 )
            {
                beamArea.Add(0.106);
            }
            else if (span > 7.5 && span <= 8 )
            {
                beamArea.Add(0.11);
            }
            else if (span > 8 && span <= 8.5 )
            {
                beamArea.Add(0.114);
            }
            else if (span > 8.5 && span <= 9 )
            {
                beamArea.Add(0.12);
            }
            else if (span > 9 && span <= 9.5 )
            {
                beamArea.Add(0.128);
            }
            else if (span > 9.5 && span <= 10 )
            {
                beamArea.Add(0.136);
            }
        }

        else if (materials == 3) //PCS
        {
            if (span == 5)
            {
                beamArea.Add(0.0391);
            }
            else if (span > 5 && span <= 5.5 )
            {
                beamArea.Add(0.0459);
            }
            else if (span > 5.5 && span <= 6 )
            {
                beamArea.Add(0.0538);
            }
            else if (span > 6 && span <= 7 )
            {
                beamArea.Add(0.0626);
            }
            else if (span > 7 && span <= 7.5 )
            {
                beamArea.Add(0.0727);
            }
            else if (span > 7.5 && span <= 9 )
            {
                beamArea.Add(0.0845);
            }
            else if (span > 9 && span <= 10)
            {
                beamArea.Add(0.0988);
            }
        }

        else if (materials == 4) //RC
        {
            if (span == 5)
            {
                beamArea.Add(0.044);
            }
            else if (span > 5 && span <= 5.5 )
            {
                beamArea.Add(0.046);
            }
            else if (span > 5.5 && span <= 6 )
            {
                beamArea.Add(0.048);
            }
            else if (span > 6 && span <= 6.5 )
            {
                beamArea.Add(0.05);
            }
            else if (span > 6.5 && span <= 7 )
            {
                beamArea.Add(0.052);
            }
            else if (span > 7 && span <= 7.5 )
            {
                beamArea.Add(0.054);
            }
            else if (span > 7.5 && span <= 8 )
            {
                beamArea.Add(0.056);
            }
            else if (span > 8 && span <= 8.5 )
            {
                beamArea.Add(0.058);
            }
            else if (span > 8.5 && span <= 9 )
            {
                beamArea.Add(0.06);
            }
            else if (span > 9 && span <= 9.5 )
            {
                beamArea.Add(0.062);
            }
            else if (span > 9.5 && span <= 10 )
            {
                beamArea.Add(0.064);
            }
        }
        beamarea = beamArea;
    }  
}
# ---------- end c_script_13 ----------
multiplication_2 = Multiplication(A=c_script_12.totalBeamLength, B=c_script_13)

# ---- group: element volumes per building [m3] / columnsVolume
length_2 = Length(Curve=columnlineperelement)  # -> flatten(Length)
c_script_14 = CSharpScript(materialType=materialtype)  # -> out, crossSectionArea; inputs materialType: Int32
# ---------- c_script_14: C# ----------
// Grasshopper Script Instance
#region Usings
using System;
using System.Linq;
using System.Collections;
using System.Collections.Generic;
using System.Drawing;

using Rhino;
using Rhino.Geometry;

using Grasshopper;
using Grasshopper.Kernel;
using Grasshopper.Kernel.Data;
using Grasshopper.Kernel.Types;
#endregion

public class Script_Instance : GH_ScriptInstance
{
    #region Notes
    /* 
      Members:
        RhinoDoc RhinoDocument
        GH_Document GrasshopperDocument
        IGH_Component Component
        int Iteration

      Methods (Virtual & overridable):
        Print(string text)
        Print(string format, params object[] args)
        Reflect(object obj)
        Reflect(object obj, string method_name)
    */
    #endregion

    private void RunScript(int materialType, ref object crossSectionArea)
    {
        if (materialType == 3)
        {
            crossSectionArea = 0.00435;
        }
        else 
        {
            crossSectionArea = 0.04;
        }
    }
}
# ---------- end c_script_14 ----------
mass_addition_3 = MassAddition(Input=length_2)  # -> Result, PartialResults
c_script_15 = CSharpScript(massAdditionResult=mass_addition_3.Result)  # -> out, totalColumnLength
# ---------- c_script_15: C# ----------
using System;
using System.Linq;
using System.Collections;
using System.Collections.Generic;
using System.Drawing;

using Rhino;
using Rhino.Geometry;

using Grasshopper;
using Grasshopper.Kernel;
using Grasshopper.Kernel.Data;
using Grasshopper.Kernel.Types;

public class Script_Instance : GH_ScriptInstance
{
    private void RunScript(object massAdditionResult, ref object totalColumnLength)
    {
        if (massAdditionResult == null)
        {
            totalColumnLength = 0;
        }
        else
        {
            totalColumnLength = massAdditionResult;
        }

    }
}
# ---------- end c_script_15 ----------
multiplication_3 = Multiplication(A=c_script_15.totalColumnLength, B=c_script_14.crossSectionArea)

# ---- group: Optimization
galapagos = Galapagos(fitness=fitnessvaluenumber, gene=[y_size, x_size, xspacing, yspacing, buildingtype, materialtype, numberoffloors])

# ---- group: current parameter values
xsize = Panel(x_size)
ysize = Panel(y_size)
xspacing_2 = Panel(xspacing)
yspacing_2 = Panel(yspacing)
n_floors = Panel(numberoffloors)
bt = Panel(buildingtype)
mt = Panel(materialtype)

# ---- group: fitness value parameters (estimated & adjustable)
# the smallest cost for a building with GFA of 1800 m2 was 1084500 NOK in the test round
# the smallest CO2emission for a building with GFA of 1800 m2 was 7603 in the test round
fv1_gfa_tolerance = Panel("1000")
fv2_co2_tolerance = Panel("30000")
fv3_cost_tolerance = Panel("1084500")

# ----
data_recorder = DataRecorder(n_floors, DataLimit=-10, RecordData=True)
cull_index = CullIndex(List=data_recorder, Indices="0", Wrap=True)  # -> flatten(List)

# ---- group: building 1: destroy recorded data
data_recorder_2 = DataRecorder(xsize, DataLimit=-10, RecordData=True)
data_recorder_3 = DataRecorder(ysize, DataLimit=-10, RecordData=True)
data_recorder_4 = DataRecorder(xspacing_2, DataLimit=-10, RecordData=True)
data_recorder_5 = DataRecorder(yspacing_2, DataLimit=-10, RecordData=True)
data_recorder_6 = DataRecorder(bt, DataLimit=-10, RecordData=True)
data_recorder_7 = DataRecorder(mt, DataLimit=-10, RecordData=True)
xsize_2 = Panel(data_recorder_2)
ysize_2 = Panel(data_recorder_3)
xspacing_3 = Panel(data_recorder_4)
yspacing_3 = Panel(data_recorder_5)
n_floors_2 = Panel(cull_index)
bt_2 = Panel(data_recorder_6)
mt_2 = Panel(data_recorder_7)

# ---- group: element volumes per building [m3] / wallsVolume
area_2 = Area(Geometry=wallsurfaces)  # -> flatten(Area), Centroid
mass_addition_4 = MassAddition(Input=area_2.Area)  # -> Result, PartialResults

# ----
c_script_16 = CSharpScript(massAdditionResult=mass_addition_4.Result)  # -> out, totalWallsArea
# ---------- c_script_16: C# ----------
using System;
using System.Linq;
using System.Collections;
using System.Collections.Generic;
using System.Drawing;

using Rhino;
using Rhino.Geometry;

using Grasshopper;
using Grasshopper.Kernel;
using Grasshopper.Kernel.Data;
using Grasshopper.Kernel.Types;

public class Script_Instance : GH_ScriptInstance
{

    private void RunScript(object massAdditionResult, ref object totalWallsArea)
    {
        if (massAdditionResult == null)
        {
            totalWallsArea = 0;
        }
        else
        {
            totalWallsArea = massAdditionResult;
        }

    }
}
# ---------- end c_script_16 ----------

# ---- group: element volumes per building [m3] / wallsVolume (continued)
multiplication_4 = Multiplication(A=c_script_16.totalWallsArea, B="0.2")

# ----
c_script_17 = CSharpScript(
    buildingType=buildingtype,
    materialType=materialtype,
    floorsVolume=flatten(multiplication),
    wallsVolume=flatten(multiplication_4),
    beamsVolume=flatten(multiplication_2),
    columnsVolume=flatten(multiplication_3))  # -> out, CO2emission; inputs buildingType: Int32, materialType: Int32, floorsVolume: Double, wallsVolume: Double, beamsVolume: Double, columnsVolume: Double
# ---------- c_script_17: C# ----------
using System;
using System.Linq;
using System.Collections;
using System.Collections.Generic;
using System.Drawing;

using Rhino;
using Rhino.Geometry;

using Grasshopper;
using Grasshopper.Kernel;
using Grasshopper.Kernel.Data;
using Grasshopper.Kernel.Types;

public class Script_Instance : GH_ScriptInstance
{
    private void RunScript(
	int buildingType,
	int materialType,
	double floorsVolume,
	double wallsVolume,
	double beamsVolume,
	double columnsVolume,
	ref object CO2emission)
    {
        //CO2 emission table values:
        //B500NC  3535.13
        //Betong plasstøpt - B30 - Lavkarbon B	230
        //Betong prefab - B30, C30/37	305.68
        //Stål - S355 VF - 60% resirkulert	16300.35
        //Tre - Limtre - GL32c	72

        double co2emission = 0;
        if (buildingType == 1)
        {
            if (materialType == 1)
            {
                co2emission = co2emission + floorsVolume * 72 + wallsVolume * 72;
            }

            else if (materialType == 2)
            {
                co2emission = co2emission + floorsVolume * 305.7 + wallsVolume * 305.7 + 0.0015 * floorsVolume * 3535.13 +  0.0015 * wallsVolume * 3535.13;
            }

            else if (materialType == 3)
            {
                co2emission = co2emission + floorsVolume * 305.7 + wallsVolume * 305.7 + 0.0015 * floorsVolume * 3535.13 +  0.0015 * wallsVolume * 3535.13;
            }

            else if (materialType == 4)
            {
                co2emission = co2emission + floorsVolume * 230  + wallsVolume * 230 + 0.0015 * floorsVolume * 3535.13 +  0.0015 * wallsVolume * 3535.13;
            }   
        }

        else if (buildingType == 2)
        {
            if (materialType == 1)
            {
                co2emission = co2emission + floorsVolume * 72 + wallsVolume * 72 + columnsVolume * 72 + beamsVolume * 72;
            }

            else if (materialType == 2)
            {
                co2emission = co2emission + floorsVolume * 305.7 + wallsVolume * 305.7 + columnsVolume * 305.7 + beamsVolume * 305.7 + 0.0015 * floorsVolume * 3535.13 +  0.0015 * wallsVolume * 3535.13 + 0.008 * columnsVolume * 3535.13 + 0.008 * beamsVolume * 3535.13;
            }

            else if (materialType == 3)
            {
                co2emission = co2emission + floorsVolume * 305.7 + wallsVolume * 305.7 + columnsVolume * 16300 + beamsVolume * 16300 + 0.0015 * floorsVolume * 3535.13 +  0.0015 * wallsVolume * 3535.13 + 0.008 * columnsVolume * 3535.13 + 0.008 * beamsVolume * 3535.13;
            }

            else if (materialType == 4)
            {
                co2emission = co2emission + floorsVolume * 230  + wallsVolume * 230 + columnsVolume * 230 + beamsVolume * 230 + 0.0015 * floorsVolume * 3535.13 +  0.0015 * wallsVolume * 3535.13 + 0.008 * columnsVolume * 3535.13 + 0.008 * beamsVolume * 3535.13;
            }
        }

        else if (buildingType == 3)
        {
            if (materialType == 1)
            {
                co2emission = co2emission + floorsVolume * 72 + columnsVolume * 72 + beamsVolume * 72;
            }

            else if (materialType == 2)
            {
                co2emission = co2emission + floorsVolume * 305.7 + columnsVolume * 305.7 + beamsVolume * 305.7 + 0.0015 * floorsVolume * 3535.13 + 0.008 * columnsVolume * 3535.13 + 0.008 * beamsVolume * 3535.13;
            }

            else if (materialType == 3)
            {
                co2emission = co2emission + floorsVolume * 305.7 + columnsVolume * 16300 + beamsVolume * 16300 + 0.0015 * floorsVolume * 3535.13 + 0.008 * columnsVolume * 3535.13 + 0.008 * beamsVolume * 3535.13;
            }

            else if (materialType == 4)
            {
                co2emission = co2emission + floorsVolume * 230  + columnsVolume * 230 + beamsVolume * 230 + 0.0015 * floorsVolume * 3535.13 + 0.008 * columnsVolume * 3535.13 + 0.008 * beamsVolume * 3535.13;
            }   
        }

        else if (buildingType == 4)
        {
            if (materialType == 1)
            {
                co2emission = co2emission + floorsVolume * 72 + columnsVolume * 72 + beamsVolume * 72;
            }

            else if (materialType == 2)
            {
                co2emission = co2emission + floorsVolume * 305.7 + columnsVolume * 305.7 + beamsVolume * 305.7 + 0.0015 * floorsVolume * 3535.13 + 0.008 * columnsVolume * 3535.13 + 0.008 * beamsVolume * 3535.13;
            }

            else if (materialType == 3)
            {
                co2emission = co2emission + floorsVolume * 305.7 + columnsVolume * 16300 + beamsVolume * 16300 + 0.0015 * floorsVolume * 3535.13 + 0.008 * columnsVolume * 3535.13 + 0.008 * beamsVolume * 3535.13;
            }

            else if (materialType == 4)
            {
                co2emission = co2emission + floorsVolume * 230  + columnsVolume * 230 + beamsVolume * 230 + 0.0015 * floorsVolume * 3535.13 + 0.008 * columnsVolume * 3535.13 + 0.008 * beamsVolume * 3535.13;
            }   
        }

        CO2emission = co2emission;
    }
}
# ---------- end c_script_17 ----------
c_script_18 = CSharpScript(
    buildingType=buildingtype,
    materialType=materialtype,
    slabThickness=slabthicknessnumber,
    floorsArea=flatten(totalslabarea_m2),
    wallsArea=flatten(c_script_16.totalWallsArea),
    beamsVolume=flatten(multiplication_2),
    beamsLength=flatten(c_script_12.totalBeamLength),
    columnsVolume=flatten(multiplication_3),
    columnLength=flatten(c_script_15.totalColumnLength))  # -> cost; inputs buildingType: Int32, materialType: Int32, slabThickness: Double, floorsArea: Double, wallsArea: Double, beamsVolume: Double, beamsLength: Double, beamsHeight: Double, columnsVolume: Double, columnLength: Double
# ---------- c_script_18: C# ----------
// Grasshopper Script Instance
#region Usings
using System;
using System.Linq;
using System.Collections;
using System.Collections.Generic;
using System.Drawing;

using Rhino;
using Rhino.Geometry;

using Grasshopper;
using Grasshopper.Kernel;
using Grasshopper.Kernel.Data;
using Grasshopper.Kernel.Types;
#endregion

public class Script_Instance : GH_ScriptInstance
{
    private void RunScript(
	int buildingType,
	int materialType,
	double slabThickness,
	double floorsArea,
	double wallsArea,
	double beamsVolume,
	double beamsLength,
	double beamsHeight,
	double columnsVolume,
	double columnLength,
	ref object cost)
    {
    
        double cubicmeterCost = 0;
        double wallThickness = 0.2; //standard 200 mm thickness of walls. 
        double percentageOfSizeWall = 0;
        double percentageOfSizeFloor = 0;
        double percentageOfPriceWall = 0;
        double percentageOfPriceFloor = 0;


        if (buildingType == 1)
        {
            if (materialType == 1)
            {
                double timberWallsPrice = 2176;
                percentageOfSizeWall = wallThickness/0.24; //thickness of wall given by prisboka is 240mm. 
                percentageOfPriceWall = percentageOfSizeWall * timberWallsPrice;

                double timberFloorPrice = new double();
                if (slabThickness == 0.16)
                {
                    timberFloorPrice = 1680;
                }
                else if (slabThickness == 0.175)
                {
                    timberFloorPrice = 1826.4;
                }
                else if (slabThickness == 0.19)
                {
                    timberFloorPrice = 1972.8;
                }
                else if (slabThickness == 0.205)
                {
                    timberFloorPrice = 2119.2;
                }
                else if (slabThickness == 0.22)
                {
                    timberFloorPrice = 1698.5;
                }
                else if (slabThickness == 0.245)
                {
                    timberFloorPrice = 2509.6;
                }
                else if (slabThickness == 0.27)
                {
                    timberFloorPrice = 2753.6;
                }
                else if (slabThickness == 0.3)
                {
                    timberFloorPrice = 3046.4;
                }
                else if (slabThickness == 0.33)
                {
                    timberFloorPrice = 3339.2;
                }
                else if (slabThickness == 0.36)
                {
                    timberFloorPrice = 3632;
                }
                else if (slabThickness == 0.39)
                {
                    timberFloorPrice = 3924.8;
                }
     
                cubicmeterCost = cubicmeterCost + floorsArea * timberFloorPrice + wallsArea * percentageOfPriceWall;
            }

            else if (materialType == 2 || materialType == 3)
            {
                cubicmeterCost = cubicmeterCost + floorsArea * 903 + wallsArea * 1887;
            }
            
            else if (materialType == 4)
            {
                double concreteFloorPrice = new double();       
                if (slabThickness == 0.18)
                {
                    concreteFloorPrice = 1415;
                }
                else if (slabThickness == 0.195)
                {
                    concreteFloorPrice = 1475.75;
                }
                else if (slabThickness == 0.2)
                {
                    concreteFloorPrice = 1496;
                }
                else if (slabThickness == 0.225)
                {
                    concreteFloorPrice = 1597.25;
                }
                else if (slabThickness == 0.25)
                {
                    concreteFloorPrice = 1698.5;
                }
                else if (slabThickness == 0.26)
                {
                    concreteFloorPrice = 1739;
                }
                else if (slabThickness == 0.27)
                {
                    concreteFloorPrice = 1779.5;
                }
                else if (slabThickness == 0.285)
                {
                    concreteFloorPrice = 1840.25;
                }
                else if (slabThickness == 0.3)
                {
                    concreteFloorPrice = 1901;
                }
                else if (slabThickness == 0.315)
                {
                    concreteFloorPrice = 1961.75;
                }
                else if (slabThickness == 0.33)
                {
                    concreteFloorPrice = 2022.5;
                }
                cubicmeterCost = cubicmeterCost + floorsArea * concreteFloorPrice + wallsArea * 1916;
            }              
        }

        else if (buildingType == 2)
        {
            if (materialType == 1)
            {
                double timberBeamPrice = 820;
                double timberColumnPrice = 398;

                double timberWallsPrice = 2176;
                percentageOfSizeWall = wallThickness/0.24; //thickness of wall given by prisboka is 240mm. 
                percentageOfPriceWall = percentageOfSizeWall * timberWallsPrice;
                
                double timberFloorPrice = new double();
                if (slabThickness == 0.16)
                {
                    timberFloorPrice = 1680;
                }
                else if (slabThickness == 0.175)
                {
                    timberFloorPrice = 1826.4;
                }
                else if (slabThickness == 0.19)
                {
                    timberFloorPrice = 1972.8;
                }
                else if (slabThickness == 0.205)
                {
                    timberFloorPrice = 2119.2;
                }
                else if (slabThickness == 0.22)
                {
                    timberFloorPrice = 1698.5;
                }
                else if (slabThickness == 0.245)
                {
                    timberFloorPrice = 2509.6;
                }
                else if (slabThickness == 0.27)
                {
                    timberFloorPrice = 2753.6;
                }
                else if (slabThickness == 0.3)
                {
                    timberFloorPrice = 3046.4;
                }
                else if (slabThickness == 0.33)
                {
                    timberFloorPrice = 3339.2;
                }
                else if (slabThickness == 0.36)
                {
                    timberFloorPrice = 3632;
                }
                else if (slabThickness == 0.39)
                {
                    timberFloorPrice = 3924.8;
                }    
                cubicmeterCost = cubicmeterCost + floorsArea * timberFloorPrice + wallsArea * percentageOfPriceWall + timberBeamPrice * beamsLength + timberColumnPrice * columnLength;
            }

            else if (materialType == 2)
            {         
                cubicmeterCost = cubicmeterCost + floorsArea * 903 + wallsArea * 1887 + beamsLength * 2059 + columnLength * 3033;
            }

            else if (materialType == 3)
            {
                double steelBeamPrice = 37.88; //given i NOK/kg.
                double steelColumnPrice = 43.07; //given in NOK/kg.

                double steelDensity = 7.8; //kg/m3.
                
                cubicmeterCost = cubicmeterCost + floorsArea * 903 + wallsArea * 1887 + beamsVolume * steelDensity*steelBeamPrice + columnsVolume * steelDensity * steelColumnPrice;
            }

            else if (materialType == 4)
            {    
                double concreteFloorPrice = new double();  
                if (slabThickness == 0.18)
                {
                    concreteFloorPrice = 1415;
                }
                else if (slabThickness == 0.195)
                {
                    concreteFloorPrice = 1475.75;
                }
                else if (slabThickness == 0.2)
                {
                    concreteFloorPrice = 1496;
                }
                else if (slabThickness == 0.225)
                {
                    concreteFloorPrice = 1597.25;
                }
                else if (slabThickness == 0.25)
                {
                    concreteFloorPrice = 1698.5;
                }
                else if (slabThickness == 0.26)
                {
                    concreteFloorPrice = 1739;
                }
                else if (slabThickness == 0.27)
                {
                    concreteFloorPrice = 1779.5;
                }
                else if (slabThickness == 0.285)
                {
                    concreteFloorPrice = 1840.25;
                }
                else if (slabThickness == 0.3)
                {
                    concreteFloorPrice = 1901;
                }
                else if (slabThickness == 0.315)
                {
                    concreteFloorPrice = 1961.75;
                }
                else if (slabThickness == 0.33)
                {
                    concreteFloorPrice = 2022.5;
                }

                double concreteBeamHeight = slabThickness + 0.1;
                double percentageOfSizeBeam = concreteBeamHeight/0.5; //Prisboka gives a beamheight of 500mm.
                double percentageOfPriceBeam = percentageOfSizeBeam * 1904;

                cubicmeterCost = cubicmeterCost + floorsArea * concreteFloorPrice + wallsArea * 1916 + percentageOfPriceBeam * beamsLength + columnsVolume * 2056;
            }

        }

        else if (buildingType == 3)
        {
            if (materialType == 1)
            {
                double timberFloorPrice = new double();
                if (slabThickness == 0.16)
                {
                    timberFloorPrice = 1680;
                }
                else if (slabThickness == 0.175)
                {
                    timberFloorPrice = 1826.4;
                }
                else if (slabThickness == 0.19)
                {
                    timberFloorPrice = 1972.8;
                }
                else if (slabThickness == 0.205)
                {
                    timberFloorPrice = 2119.2;
                }
                else if (slabThickness == 0.22)
                {
                    timberFloorPrice = 1698.5;
                }
                else if (slabThickness == 0.245)
                {
                    timberFloorPrice = 2509.6;
                }
                else if (slabThickness == 0.27)
                {
                    timberFloorPrice = 2753.6;
                }
                else if (slabThickness == 0.3)
                {
                    timberFloorPrice = 3046.4;
                }
                else if (slabThickness == 0.33)
                {
                    timberFloorPrice = 3339.2;
                }
                else if (slabThickness == 0.36)
                {
                    timberFloorPrice = 3632;
                }
                else if (slabThickness == 0.39)
                {
                    timberFloorPrice = 3924.8;
                }

                double timberBeamPrice = 820;
                double timberColumnPrice = 398;

                cubicmeterCost = cubicmeterCost + floorsArea * timberFloorPrice + timberBeamPrice * beamsLength + timberColumnPrice * columnLength;
            }

            else if (materialType == 2)
            {         
                cubicmeterCost = cubicmeterCost + floorsArea * 903 + beamsLength * 2059 + columnLength * 3033;
            }

            else if (materialType == 3)
            {
                double steelBeamPrice = 37.88; //given i NOK/kg.
                double steelColumnPrice = 43.07; //given in NOK/kg.

                double steelDensity = 7.8; //kg/m3.
                
                cubicmeterCost = cubicmeterCost + floorsArea * 903 + beamsVolume * steelDensity * steelBeamPrice + columnsVolume * steelDensity * steelColumnPrice;
            }

            else if (materialType == 4)
            {
                double concreteFloorPrice = new double();
                if (slabThickness == 0.18)
                {
                    concreteFloorPrice = 1415;
                }
                else if (slabThickness == 0.195)
                {
                    concreteFloorPrice = 1475.75;
                }
                else if (slabThickness == 0.2)
                {
                    concreteFloorPrice = 1496;
                }
                else if (slabThickness == 0.225)
                {
                    concreteFloorPrice = 1597.25;
                }
                else if (slabThickness == 0.25)
                {
                    concreteFloorPrice = 1698.5;
                }
                else if (slabThickness == 0.26)
                {
                    concreteFloorPrice = 1739;
                }
                else if (slabThickness == 0.27)
                {
                    concreteFloorPrice = 1779.5;
                }
                else if (slabThickness == 0.285)
                {
                    concreteFloorPrice = 1840.25;
                }
                else if (slabThickness == 0.3)
                {
                    concreteFloorPrice = 1901;
                }
                else if (slabThickness == 0.315)
                {
                    concreteFloorPrice = 1961.75;
                }
                else if (slabThickness == 0.33)
                {
                    concreteFloorPrice = 2022.5;
                }

                double concreteBeamHeight = slabThickness + 0.1;
                double percentageOfSizeBeam = concreteBeamHeight/0.5; //Prisboka gives a beamheight of 500mm.
                double percentageOfPriceBeam = percentageOfSizeBeam * 1904;

                cubicmeterCost = cubicmeterCost + floorsArea * concreteFloorPrice + percentageOfPriceBeam * beamsLength + columnsVolume * 2056;
            }
 
        }

        else if (buildingType == 4)
        {
            if (materialType == 1)
            {
                double timberFloorPrice = new double();
                if (slabThickness == 0.16)
                {
                    timberFloorPrice = 1680;
                }
                else if (slabThickness == 0.175)
                {
                    timberFloorPrice = 1826.4;
                }
                else if (slabThickness == 0.19)
                {
                    timberFloorPrice = 1972.8;
                }
                else if (slabThickness == 0.205)
                {
                    timberFloorPrice = 2119.2;
                }
                else if (slabThickness == 0.22)
                {
                    timberFloorPrice = 1698.5;
                }
                else if (slabThickness == 0.245)
                {
                    timberFloorPrice = 2509.6;
                }
                else if (slabThickness == 0.27)
                {
                    timberFloorPrice = 2753.6;
                }
                else if (slabThickness == 0.3)
                {
                    timberFloorPrice = 3046.4;
                }
                else if (slabThickness == 0.33)
                {
                    timberFloorPrice = 3339.2;
                }
                else if (slabThickness == 0.36)
                {
                    timberFloorPrice = 3632;
                }
                else if (slabThickness == 0.39)
                {
                    timberFloorPrice = 3924.8;
                }

                double timberBeamPrice = 820;
                double timberColumnPrice = 398;

                cubicmeterCost = cubicmeterCost + floorsArea * timberFloorPrice + timberBeamPrice * beamsLength + timberColumnPrice * columnLength;
            }

            else if (materialType == 2)
            {
                
                cubicmeterCost = cubicmeterCost + floorsArea * 903 + beamsLength * 2059 + columnLength * 3033;
            }

            else if (materialType == 3)
            {
                double steelBeamPrice = 37.88; //given i NOK/kg.
                double steelColumnPrice = 43.07; //given in NOK/kg.

                double steelDensity = 7.8; //kg/m3.
                
                cubicmeterCost = cubicmeterCost + floorsArea * 903 + beamsVolume * steelDensity * steelBeamPrice + columnsVolume * steelDensity * steelColumnPrice;
            }

            else if (materialType == 4)
            {     
                double concreteFloorPrice = new double();
                if (slabThickness == 0.18)
                {
                    concreteFloorPrice = 1415;
                }
                else if (slabThickness == 0.195)
                {
                    concreteFloorPrice = 1475.75;
                }
                else if (slabThickness == 0.2)
                {
                    concreteFloorPrice = 1496;
                }
                else if (slabThickness == 0.225)
                {
                    concreteFloorPrice = 1597.25;
                }
                else if (slabThickness == 0.25)
                {
                    concreteFloorPrice = 1698.5;
                }
                else if (slabThickness == 0.26)
                {
                    concreteFloorPrice = 1739;
                }
                else if (slabThickness == 0.27)
                {
                    concreteFloorPrice = 1779.5;
                }
                else if (slabThickness == 0.285)
                {
                    concreteFloorPrice = 1840.25;
                }
                else if (slabThickness == 0.3)
                {
                    concreteFloorPrice = 1901;
                }
                else if (slabThickness == 0.315)
                {
                    concreteFloorPrice = 1961.75;
                }
                else if (slabThickness == 0.33)
                {
                    concreteFloorPrice = 2022.5;
                }

                double concreteBeamHeight = slabThickness + 0.1;
                double percentageOfSizeBeam = concreteBeamHeight/0.5; //Prisboka gives a beamheight of 500mm.
                double percentageOfPriceBeam = percentageOfSizeBeam * 1904;

                cubicmeterCost = cubicmeterCost + floorsArea * concreteFloorPrice + percentageOfPriceBeam * beamsLength + columnsVolume * 2056;

            }

        }
        cost = cubicmeterCost;
    }
}
# ---------- end c_script_18 ----------
totalslabarea_m2_2 = Panel(totalslabarea_m2)
cost_nok = Panel(c_script_18)
co2_eq_kg = Panel(c_script_17.CO2emission)
panel = Panel(fv3_cost_tolerance)
panel_2 = Panel(fv2_co2_tolerance)

# ---- group: normalize GFA
current_gfa_m2 = Panel(totalslabarea_m2_2)
panel_3 = Panel(fv1_gfa_tolerance)
c_script_19 = CSharpScript(currentGFA=current_gfa_m2, idealGFA="4600", tolerance=panel_3)  # -> out, normalizedGFA; inputs currentGFA: Double, idealGFA: Double, tolerance: Int32
# ---------- c_script_19: C# ----------
using System;
using System.Linq;
using System.Collections;
using System.Collections.Generic;
using System.Drawing;

using Rhino;
using Rhino.Geometry;

using Grasshopper;
using Grasshopper.Kernel;
using Grasshopper.Kernel.Data;
using Grasshopper.Kernel.Types;

public class Script_Instance : GH_ScriptInstance
{
    private void RunScript(
	double currentGFA,
	double idealGFA,
	int tolerance,
	ref object normalizedGFA)
    {
        normalizedGFA = ((currentGFA - idealGFA)/(tolerance))*((currentGFA - idealGFA)/(tolerance)); //number represent acceptable limit for deviation
    }
}
# ---------- end c_script_19 ----------

# ---- group: normalize cost
c_script_20 = CSharpScript(currentValue=cost_nok, NOKtolerance=panel)  # -> out, normalizedCost; inputs currentValue: Double, NOKtolerance: Int32
# ---------- c_script_20: C# ----------
using System;
using System.Linq;
using System.Collections;
using System.Collections.Generic;
using System.Drawing;

using Rhino;
using Rhino.Geometry;

using Grasshopper;
using Grasshopper.Kernel;
using Grasshopper.Kernel.Data;
using Grasshopper.Kernel.Types;

public class Script_Instance : GH_ScriptInstance
{
    private void RunScript(
	double currentValue,
	int NOKtolerance,
	ref object normalizedCost)
    {
        normalizedCost = currentValue/NOKtolerance;
    }
}
# ---------- end c_script_20 ----------

# ---- group: normalize CO2 emission
c_script_21 = CSharpScript(currentValue=co2_eq_kg, co2tolerance=panel_2)  # -> out, normalizedEmission; inputs currentValue: Double, co2tolerance: Int32
# ---------- c_script_21: C# ----------
using System;
using System.Linq;
using System.Collections;
using System.Collections.Generic;
using System.Drawing;

using Rhino;
using Rhino.Geometry;

using Grasshopper;
using Grasshopper.Kernel;
using Grasshopper.Kernel.Data;
using Grasshopper.Kernel.Types;

public class Script_Instance : GH_ScriptInstance
{
    private void RunScript(
	double currentValue,
	int co2tolerance,
	ref object normalizedEmission)
    {
        normalizedEmission = currentValue/co2tolerance;
    }
}
# ---------- end c_script_21 ----------

# ----
c_script_22 = CSharpScript(fV1=c_script_19.normalizedGFA, fV2=c_script_21.normalizedEmission, fV3=c_script_20.normalizedCost)  # -> out, finalFitnessValue; inputs fV1: Double, fV2: Double, fV3: Double
# ---------- c_script_22: C# ----------
using System;
using System.Linq;
using System.Collections;
using System.Collections.Generic;
using System.Drawing;

using Rhino;
using Rhino.Geometry;

using Grasshopper;
using Grasshopper.Kernel;
using Grasshopper.Kernel.Data;
using Grasshopper.Kernel.Types;

public class Script_Instance : GH_ScriptInstance
{
    private void RunScript(
	double fV1,
	double fV2,
	double fV3,
	ref object finalFitnessValue)
    {
        finalFitnessValue = 2*fV1 + fV2 + 2*fV3; //weights can be changed based on priorities for finalFitnessValue
    }
}
# ---------- end c_script_22 ----------
fitnessvaluenumber = Number(c_script_22.finalFitnessValue)

# ---- group: current fitness values (fV)
fv1_gfa_not_normalized = Panel(current_gfa_m2)
fv2_co2_not_normalized = Panel(c_script_17.CO2emission)
fv3_cost_not_normalized = Panel(c_script_18)
total_fv_normalized = Panel(fitnessvaluenumber)

# ---- group: number of Galapagos iterations
data_recorder_8 = DataRecorder(fitnessvaluenumber, DataLimit=-10, RecordData=True)
list_length = ListLength(List=data_recorder_8)
n_iterations = Panel(list_length)

# ---- group: fitness values: destroy all recorded data
cluster_3 = Cluster_2(A=total_fv_normalized)
round = Round(Number=fv2_co2_not_normalized)  # -> Nearest, Floor, Ceiling
round_2 = Round(Number=fv3_cost_not_normalized)  # -> Nearest, Floor, Ceiling
data_recorder_9 = DataRecorder(fv1_gfa_not_normalized, DataLimit=-10, RecordData=True)
data_recorder_10 = DataRecorder(round.Nearest, DataLimit=-10, RecordData=True)
data_recorder_11 = DataRecorder(round_2.Nearest, DataLimit=-10, RecordData=True)
data_recorder_12 = DataRecorder(cluster_3, DataLimit=-10, RecordData=True)
fv_total = Panel(data_recorder_12)
fv2_co2_emission = Panel(data_recorder_10)
fv1_gfa = Panel(data_recorder_9)

# ----
cull_index_2 = CullIndex(List=data_recorder_11, Indices="0", Wrap=True)  # -> flatten(List)

# ---- group: fitness values: destroy all recorded data (continued)
fv3_cost = Panel(cull_index_2)

# ---- group: write to Excel
stream = BooleanToggle(False)
file_path = FilePath("C:\Users\Andrea Lauvstad\OneDrive - NTNU\RhinoGrasshopper\CS3\0522_CS3_part2.xlsx")
write_to_excel_classic = WriteToExcelClassic(WorkbookFilepath=file_path, Data=graft("X"), LocationAddress="A1", Clear=0, Stream=stream)
write_to_excel_classic_2 = WriteToExcelClassic(WorkbookFilepath=file_path, Data=graft(xsize_2), LocationAddress="A2", Clear=0, Stream=stream)
write_to_excel_classic_3 = WriteToExcelClassic(WorkbookFilepath=file_path, Data=graft("Y"), LocationAddress="B1", Clear=0, Stream=stream)
write_to_excel_classic_4 = WriteToExcelClassic(WorkbookFilepath=file_path, Data=graft(ysize_2), LocationAddress="B2", Clear=0, Stream=stream)
write_to_excel_classic_5 = WriteToExcelClassic(WorkbookFilepath=file_path, Data=graft("x"), LocationAddress="C1", Clear=0, Stream=stream)
write_to_excel_classic_6 = WriteToExcelClassic(WorkbookFilepath=file_path, Data=graft(xspacing_3), LocationAddress="C2", Clear=0, Stream=stream)
write_to_excel_classic_7 = WriteToExcelClassic(WorkbookFilepath=file_path, Data=graft("y"), LocationAddress="D1", Clear=0, Stream=stream)
write_to_excel_classic_8 = WriteToExcelClassic(WorkbookFilepath=file_path, Data=graft(yspacing_3), LocationAddress="D2", Clear=0, Stream=stream)
write_to_excel_classic_9 = WriteToExcelClassic(WorkbookFilepath=file_path, Data=graft("floors"), LocationAddress="E1", Clear=0, Stream=stream)
write_to_excel_classic_10 = WriteToExcelClassic(WorkbookFilepath=file_path, Data=graft(n_floors_2), LocationAddress="E2", Clear=0, Stream=stream)
write_to_excel_classic_11 = WriteToExcelClassic(WorkbookFilepath=file_path, Data=graft("bT"), LocationAddress="F1", Clear=0, Stream=stream)
write_to_excel_classic_12 = WriteToExcelClassic(WorkbookFilepath=file_path, Data=graft(bt_2), LocationAddress="F2", Clear=0, Stream=stream)
write_to_excel_classic_13 = WriteToExcelClassic(WorkbookFilepath=file_path, Data=graft("mT"), LocationAddress="G1", Clear=0, Stream=stream)
write_to_excel_classic_14 = WriteToExcelClassic(WorkbookFilepath=file_path, Data=graft(mt_2), LocationAddress="G2", Clear=0, Stream=stream)
write_to_excel_classic_15 = WriteToExcelClassic(WorkbookFilepath=file_path, Data=graft("GFA [m2]"), LocationAddress="H1", Clear=0, Stream=stream)
write_to_excel_classic_16 = WriteToExcelClassic(WorkbookFilepath=file_path, Data=graft(fv1_gfa), LocationAddress="H2", Clear=0, Stream=stream)
write_to_excel_classic_17 = WriteToExcelClassic(WorkbookFilepath=file_path, Data=graft("CO2eq. [kg]"), LocationAddress="I1", Clear=0, Stream=stream)
write_to_excel_classic_18 = WriteToExcelClassic(WorkbookFilepath=file_path, Data=graft(fv2_co2_emission), LocationAddress="I2", Clear=0, Stream=stream)
write_to_excel_classic_19 = WriteToExcelClassic(WorkbookFilepath=file_path, Data=graft("Cost [NOK]"), LocationAddress="J1", Clear=0, Stream=stream)
write_to_excel_classic_20 = WriteToExcelClassic(WorkbookFilepath=file_path, Data=graft(fv3_cost), LocationAddress="J2", Clear=0, Stream=stream)
write_to_excel_classic_21 = WriteToExcelClassic(WorkbookFilepath=file_path, Data=graft("fV"), LocationAddress="K1", Clear=0, Stream=stream)
write_to_excel_classic_22 = WriteToExcelClassic(WorkbookFilepath=file_path, Data=graft(fv_total), LocationAddress="K2", Clear=0, Stream=stream)

# ==== cluster Cluster
tree = ClusterInput()
trim_tree = TrimTree(Tree=tree, Depth=1)
tree_branch = TreeBranch(Tree=trim_tree, Path="1", MaintainPaths=True)
tree_2 = ClusterOutput(trim_tree)
project = Project(Geometry=tree_branch, Plane=PlaneXY(0, 0, 0))  # -> Geometry, Transform
geometry = ClusterOutput(project.Geometry)

# ==== cluster Cluster_2
A = ClusterInput()
multiplication = Multiplication(A=A, B=100)
round = Round(Number=multiplication)  # -> Nearest, Floor, Ceiling
nearest = ClusterOutput(round.Nearest)
